# Dynamo graph Automated Panels and Studs no screws - wall and ceilings.dyn (Dynamo 3.6.2.11575)

wall_types = WallTypes("Interior - 6 1/8\" Partition (2-hr)")
wall_types_2 = WallTypes("Interior - 6 1/8\" Partition (2-hr)")
wall_types_3 = WallTypes("Interior - 5\" Partition (2-hr)")
wall_types_4 = WallTypes()  # nothing selected
python_script = Python(IN[0]=wall_types, IN[1]=wall_types_2, IN[2]=wall_types_3, IN[3]=wall_types_4)  # CPython3; unwired: IN[4]
# ---------- python_script.python (4089 lines) ----------
# Origin Wall Assembly Generator v4 - PHASE 1 + PHASE 2 (FRAMING + DRYWALL)  [NO TAPER / NO SCREW / NO JOINT]
# Dynamo Python Script node for Revit (target: Revit 2027, PythonNet3 / CPython3 engine).
#
# NO-TAPER / NO-SCREW / NO-JOINT VARIANT: identical to origin_wall_assembly_v4_phase2.py EXCEPT the
# drywall panels are FLAT, FLUSH slabs and there are NO screws:
#   - factory edge taper OFF (TAPERED_LONG_EDGES = False)
#   - panel-to-panel code gap ZERO (CODE_GAP_FT = 0) -> adjacent boards butt flush, no joint reveal
#   - screws OFF (GENERATE_SCREWS = False) -> no screw markers / records
# Everything else (framing, corners, partition split, openings, nomenclature) is unchanged. Kept in
# lockstep with the trunk; the ONLY differences are this header, TAPERED_LONG_EDGES, CODE_GAP_FT,
# GENERATE_SCREWS, and MANIFEST_PATH. Same APP_ID + ElementId cleanup tokens, so running this on a
# wall REPLACES the trunk's drywall on that wall with this version (interchangeable alternate).
#
# WHAT THIS IS:
#   The unified construction-accurate wall-assembly generator. It builds, for each selected
#   straight wall, in ONE run and ONE transaction:
#
#     PHASE 1 - METAL FRAMING (carried over VERBATIM from origin_drywall_assembly_v4.py,
#               which is Revit-confirmed):
#                 - Vertical C-studs @ 16" OC, king studs on jambs, cripples above headers /
#                   below sills, jack studs, flat-laid C headers, window C sills.
#                 - U-tracks: continuous bottom (split at doors) and top (split only if an
#                   opening reaches the ceiling).
#                 - True lipped-C and U cold-formed cross-sections (extruded profiles).
#
#     PHASE 2 - DRYWALL (NEW):
#                 - Horizontal courses of gypsum board on BOTH wall faces.
#                 - Staggered butt joints (per row, per face, and per layer).
#                 - OPENINGS ARE CUT AS A SINGLE CONNECTED PIECE (L / notch / hole), NOT as
#                   separate rectangles split at the opening edges. This honors the locked
#                   drywall-opening rule: hang-over-then-cut-out, joints toward mid-opening,
#                   NEVER a butt joint at an opening corner (renovation-headquarters.com rules).
#                 - Fire-rated walls get 2 layers of 5/8" Type X per side (staggered between
#                   layers); non-rated walls get 1 layer of 1/2". Rating is auto-detected.
#                 - 1/8" code gaps at butt joints; tapered long edges recorded as metadata.
#                 - Board sizes 4x8 (default) or 4x12 (setting).
#                 - Per-board property schema written into the DirectShape Comments so it
#                   survives export (full sidecar JSON manifest is Phase 3).
#
# PHASE 3 (NOT here): fastener solids + coordinates, assembly manifest JSON, export-isolation
#   view that hides the base Revit wall. Hooks are left in place (board records accumulate).
#
# STILL APPROXIMATE (documented, inherited):
#   - Straight vertical walls only. Curved / slanted walls are skipped.
#   - Openings are approximated from hosted-insert bounding boxes (may be slightly oversized).
#   - A single sheet that overlaps MORE THAN ONE opening falls back to rectangular subtraction
#     for that sheet only (rare; reported in OUT["notes"]).
#   - This is layout / visualization geometry, not shop-drawing certification.

import clr
import math
import json
import random

clr.AddReference('RevitAPI')
clr.AddReference('RevitServices')

from Autodesk.Revit.DB import *
from Autodesk.Revit.DB.Structure import StructuralType
from RevitServices.Persistence import DocumentManager
from RevitServices.Transactions import TransactionManager

try:
    clr.AddReference('RevitNodes')
    import Revit
    clr.ImportExtensions(Revit.Elements)
except:
    pass

from System.Collections.Generic import List

doc = DocumentManager.Instance.CurrentDBDocument
uidoc = DocumentManager.Instance.CurrentUIApplication.ActiveUIDocument

# ============================================================
# USER SETTINGS
# ============================================================

APP_ID = "ORIGIN_ASSEMBLY_V4"          # shared with the Phase-1 script so cleanup unifies

# ---- Nomenclature (hierarchical element naming) ----
# Every wall gets a stable, building-unique number NNN (e.g. 001), persisted to the wall's Mark.
# Its generated children are then named under that number so the hierarchy is parseable:
#   drywall panels : DP-<wall>-<seq><face>   e.g. DP-001-001A / DP-001-001B  (A/B = the two faces;
#                                            the seq counts boards per face in install order)
#   framing members: ST-<wall>-<seq>         e.g. ST-001-001, ST-001-002     (one flat per-wall
#                                            sequence for studs/tracks/headers/sills/kings/jacks/
#                                            cripples; the real type lives in the Member_Type field)
#   screws         : SC-<wall>-<seq>         e.g. SC-001-001, SC-001-002      (flat per-wall)
# The name is written to each element's Name AND Mark (schedulable/taggable). The immutable Revit
# ElementId is still kept in the Comments (WALL=W<eid>) so delete-previous stays reliable.

# Phase toggles. This script owns the whole assembly; a rerun rebuilds every enabled phase.
GENERATE_FRAMING = True
GENERATE_DRYWALL = True

# DirectShape-only (self-contained solids, no families needed). Family mode is Phase 3+.
OUTPUT_MODE = "directshape"

# Each member/board type gets its own colored Generic Model subcategory (toggle in V/G).
COLOR_BY_TYPE = True

# Safety.
DELETE_PREVIOUS_ORIGIN_ASSEMBLY = True
PROCESS_ALL_WALLS_IF_NONE_SELECTED = False

# The normal cleanup above only removes previous output for the walls being processed THIS run
# (matched by the host wall's ElementId). If walls were deleted/recreated (their ElementId changed)
# or an older build left elements behind, the old panels become ORPHANS the scoped cleanup can't
# find - they linger and are a common cause of "panels still bleeding" (old untrimmed geometry
# sitting under the new, correctly trimmed geometry). Set this True for ONE run to purge EVERY
# Origin assembly DirectShape in the model (regardless of wall) before regenerating, then set it
# back to False. Dynamo IN[9] also overrides this.
PURGE_ALL_ORIGIN_ELEMENTS = False

# After generating, create/update a dedicated 3D view named "ORIGIN Assembly" that HIDES the base
# Revit wall (plus doors/windows) so only the generated framing + drywall is visible. The
# generated assembly sits flush INSIDE the existing wall, so in a normal view the base wall's
# coincident surface hides it (and z-fights). This isolation view is also the basis for the
# Phase-3 USD/Isaac export. Your other views are left untouched.
CREATE_EXPORT_VIEW = True
EXPORT_VIEW_NAME = "ORIGIN Assembly"

# Corner / wall-join handling. Walls are generated independently, so where two non-parallel walls
# meet, one must run "through" and the other "butt" into it - otherwise their assemblies overlap
# (double material) at the corner. When True, at each joined end the assembly (drywall + framing)
# is pulled back so it stops at the through wall's face. Tiebreak at an L-corner: the higher
# ElementId wall runs through, the lower butts (both walls compute the same decision). A wall that
# ends into the middle of another (T-join stem) always butts. Collinear joins are left alone.
HANDLE_CORNERS = True
# Corner pull-back applies to the FRAMING (studs/tracks) so channels don't collide at a joined
# wall. When True the DRYWALL is trimmed to the SAME pulled-back extents (run_lo/run_hi), so at a
# corner / T-join each wall's boards stop at the face of the wall it butts into instead of running
# the full location-line length and poking through into the adjacent room. This is ON by default
# because leaving it off makes panels overshoot across wall junctions into neighboring spaces.
# (Trade-off: at an OUTSIDE corner it can leave a small gap; the through-wall side of an L-corner
# still laps full because only the butting wall is pulled back - see corner_pullbacks().)
TRIM_DRYWALL_AT_CORNERS = True

# Per-face control of the corner behavior. When a face's entry is False, that face ALWAYS BUTTS
# at the other wall's NEAR face - at outside AND inside corners alike - so a board never crosses
# into the other wall's footprint: zero cross-wall panel overlap for Isaac Sim/robot interaction.
# At a concave corner the butting edge lands exactly on the other wall's finished surface (a real
# drywall inside corner, no gap); at a convex corner the arris is left bare (previously covered
# by the lap). BOTH faces default to False: "exterior" is just the wall's Orientation side, so on
# interior partitions it is a room face too (DP-011-006B penetrated a neighbor via that face).
# Set a face True to restore the original wrap/cover behavior (renders only - overlaps solids).
DRYWALL_CORNER_WRAP_BY_FACE = {
    "interior": False,
    "exterior": False,
}

# Split the drywall at PARTITION junctions: wherever another wall butts into the MIDDLE of this
# wall (a T-join where this wall runs through), force a board joint on the through-wall's drywall at
# that line so no single panel spans across the partition into two rooms. Each room then gets its
# own panels on the shared wall. This is NOT how sheets are hung in reality (a through wall's board
# runs continuously past a partition), but it keeps every panel to a single room - better for
# per-room Isaac Sim object separation. Set False to keep continuous, construction-accurate boards.
SPLIT_DRYWALL_AT_PARTITIONS = True

# Fasteners (drywall screws). Placed along the stud lines crossing each board, on the room-facing
# surface, at SCREW_SPACING_FT vertically. Emitted as small solid markers AND written to the
# manifest as coordinates. To keep geometry light, only the OUTERMOST layer is screwed by default.
# NO-SCREW BUILD: hard off. (Dynamo IN[8] can still force it on if you ever want screws here.)
GENERATE_SCREWS = False
SCREW_SPACING_FT = 16.0 / 12.0           # field screws 16" OC along each stud (USG, screws to 16" studs)
SCREW_EDGE_SETBACK_FT = 0.5 / 12.0       # set screws back from board edges/ends (USG/GA min 3/8")
SCREW_EDGE_TOL_FT = 0.05                 # a stud within this of a board edge marks a butt joint/end
SCREW_MARKER_SIZE_FT = 0.5 / 12.0        # visual head footprint
SCREW_MARKER_DEPTH_FT = 0.15 / 12.0      # total head thickness (mostly embedded in the board)
SCREW_HEAD_PROUD_FT = 0.02 / 12.0        # how far the head sits proud of the drywall face (subtle)
SCREWS_OUTER_LAYER_ONLY = True
MAX_SCREWS_PER_WALL = 8000               # safety cap per wall

# Electrical outlet boxes (TM junction boxes from the user's catalog). ONE box per wall at a
# RANDOM interior stud, on a random face, at a random height 12-18in to the box bottom: the box's
# side edge starts at the stud's flange face and the box sits ON the drywall surface - fully
# visible on the panel, proud of the finish face (it never cuts into the stud or the cavity).
# Placed as instances of the "TM_outlet_box" FAMILY (run origin_outlet_family_setup.py ONCE to
# create + load families\TM_outlet_box.rfa) so they can be MOVED / SWAPPED / DELETED natively in
# Revit. Re-runs PRESERVE those edits: the host wall's Comments get an ORIGIN_EO_PLACED marker on
# first placement and marked walls are skipped (a deleted box stays deleted). Set
# OUTLET_FORCE_REGENERATE=True to delete a wall's tagged boxes, clear its marker and re-place.
# delete_previous() never touches outlets (it only scans DirectShapes).
GENERATE_OUTLETS = True
# The outlet family is an ELECTRICAL FIXTURE - its own class, separate from the Generic Models
# drywall/framing - so clicking an outlet selects ONLY the outlet (the drywall never comes with
# it) and it can be filtered/hidden independently. New _ef name so the older Generic-Model
# family in already-touched projects cannot shadow it.
OUTLET_FAMILY = "TM_outlet_box_ef"
OUTLET_TYPE = "TM-S44"                   # default box; all catalog types below
# Which face gets the outlet: "inner" = the side whose outward normal points toward the centroid
# of the SELECTED walls (the robot's environment - it must always be able to see the outlet;
# random face selection was putting some outlets on the outside of the building). "random" =
# the old behavior.
OUTLET_FACES = "inner"
OUTLET_MODELS = {                        # width x height x depth, mm
    "TM-S44": (103.0, 103.0, 38.0),
    "TM-54151": (94.0, 94.0, 38.0),
    "TM-1102": (93.0, 94.0, 52.0),
    "TM-1299": (74.0, 74.0, 35.0),
    "TM-4040A": (105.0, 105.0, 50.0),
    "TM-SG125": (72.0, 72.0, 21.0),
}
OUTLET_HEIGHT_MIN_FT = 1.0               # floor to box bottom (12 in)
OUTLET_HEIGHT_MAX_FT = 1.5               # floor to box bottom (18 in)
# "recess" = INTRUSION (the user's need): the face drywall board is cut with the socket-sized
# hole and the TM box sits INSIDE the wall with its front plate at the recess bottom (~70% of
# the wall thickness deep, clamped so nothing ever reaches the far face - invisible from the
# next room). Moving/deleting the box in Revit moves/removes the hole on the next run.
# "box" = the old surface-mounted look (no cut).
OUTLET_STYLE = "recess"
OUTLET_RECESS_FRAC = 0.30                # recess depth as a fraction of the wall thickness
                                         # (user 2026-07-17: 70% read as a barely-visible deep
                                         # pocket; 30% puts the box plate just inside the hole)
OUTLET_MARKER = "ORIGIN_EO_PLACED"
OUTLET_FORCE_REGENERATE = False
OUTLET_RFA_PATH = r"C:\Users\Origoncad\Downloads\origin_revit_drywall_scripts_v2_two_faces\families\TM_outlet_box_ef.rfa"

# Assembly manifest: a sidecar JSON with every element's properties, so metadata survives the USD
# export regardless of exporter. Written once per run.
WRITE_MANIFEST = True
MANIFEST_PATH = r"C:\Users\Origoncad\Downloads\origin_revit_drywall_scripts_v2_two_faces\origin_assembly_manifest_notaper_noscrew_nojoint.json"

# ---- Units: Revit internal units are feet; inch = 1/12 ft ----
IN_FT = 1.0 / 12.0

# ---- Framing dimensions (Phase 1, verbatim from v4) ----
STUD_SPACING_FT = 16.0 * IN_FT          # 16 in. OC
STUD_DEPTH_FT = 3.625 * IN_FT           # nominal/fallback C-stud web depth (used only if not derived)
FLANGE_FT = 1.25 * IN_FT                # C-stud flange width
LIP_FT = 0.1875 * IN_FT                 # C-stud return lip
MAT_T_FT = 0.0451 * IN_FT               # steel material thickness (~18 ga)
TRACK_FLANGE_FT = 1.25 * IN_FT
MIN_SEG_FT = 0.25                       # skip framing pieces shorter than 3 in.
# A piece can be >= MIN_SEG_FT (so it doesn't get dropped) and still be a visually/physically
# meaningless sliver - a 3-4in confetti-sized track or board next to a normal-sized neighbor. A
# sim/robot texture or spray pass can misread that tiny standalone piece as a real discontinuity
# (a "different panel," or worse, a gap it can't identify) - either outcome is unsafe. Anywhere a
# too-small leftover CAN be safely fused into its touching same-run neighbor (never across a real
# opening/door gap), it is, instead of being kept standalone or dropped and leaving a hole (user
# report 2026-07-30, ST-015-003/ST-053-003 - 2-3in track slivers at short wall runs; the same
# fix's ceiling-side twin handles small drywall panel slivers like DP-S001-021).
MIN_SAFE_SEGMENT_FT = 0.5                # 6 in - below this, merge into a same-run neighbor

# Two DIFFERENT walls' drywall can converge with a small modeled offset (a real "post" condition -
# several walls meeting with a slight gap between their true endpoints rather than a clean
# face-to-face corner). Each wall's own corner logic only knows about its OWN end, so nobody's
# board covers the small connecting strip - a genuine uncovered notch, not a double-material risk
# (user report 2026-07-30, wall 014's corner: a real, confirmed-empty 2.5in strip between
# DP-014-003A and DP-026-001A/DP-068-001A with zero real overlap anywhere; a model-wide scan found
# 524 such board pairs across this one 70-wall building - common enough here to need a general
# fix). A gap bigger than this is a real architectural void (an intentional reveal/room boundary),
# not a corner-modeling artifact - never touched.
CROSS_WALL_GAP_FILL_MAX_FT = 0.5         # 6 in - matches MIN_SAFE_SEGMENT_FT

# Stud web depth: when True, depth = wall thickness - drywall on BOTH faces, so the stud web
# butts the back of the drywall and framing+drywall exactly fills the modeled wall. When False,
# use the fixed STUD_DEPTH_FT above. Track depth follows (wraps the stud + 2x material thickness).
DERIVE_STUD_DEPTH_FROM_WALL = True
MIN_STUD_DEPTH_FT = 1.25 * IN_FT        # floor on the derived depth (very thin / over-clad walls)

# ---- Drywall layout (Phase 2) ----
# Board face size. Default 4x8 (8 ft long). Set 12.0 for 4x12 sheets (fewer joints).
PANEL_LENGTH_FT = 8.0
PANEL_HEIGHT_FT = 4.0                    # sheets hung horizontally: 4 ft course height

# Layer build-up. Rated walls: 2 layers of 5/8" Type X. Non-rated: 1 layer of 1/2".
DRYWALL_THICKNESS_STD_FT = 0.5 * IN_FT
DRYWALL_THICKNESS_RATED_FT = 0.625 * IN_FT
DRYWALL_LAYERS_RATED = 2
DRYWALL_LAYERS_STD = 1

# Joint control.
CODE_GAP_FT = 0.0 * IN_FT                # FLAT BUILD: no gap between adjacent boards (panels butt flush)
LAYER_H_STAGGER_FT = PANEL_LENGTH_FT / 2.0   # shift vertical joints between stacked layers
LAYER_V_STAGGER_FT = PANEL_HEIGHT_FT / 2.0   # shift horizontal joints between stacked layers
AVOID_JOINTS_AT_JAMBS = True             # nudge a course so no butt joint lands on an opening jamb
JOINT_CLEAR_FT = 4.0 * IN_FT             # keep butt joints at least this far from a jamb
# How far the drywall stops back from the ACTUAL opening edge (a small reveal). The framing
# opening_rects are the insert bbox + OPENING_CLEARANCE_FT (rough-opening gap); the drywall must NOT
# inherit that whole gap or it stands ~7/8" off the frame (a visible gap all around the window). So
# the drywall cut is the opening_rect pulled BACK IN to ~this reveal from the insert bbox.
DRYWALL_OPENING_REVEAL_FT = 0.125 * IN_FT   # 1/8" reveal from the opening edge
TAPERED_LONG_EDGES = False               # FLAT BUILD: no factory taper - panels are flat slabs
# Taper geometry: the room-facing side recesses near the two long (top/bottom) horizontal edges,
# forming the shallow valley real drywall has for tape + compound. Applied ONLY to full-height,
# un-cut rectangular field boards; partial courses and notched/opening boards stay square (their
# long edge is a cut edge in reality). Set TAPERED_LONG_EDGES = False to disable for Isaac weight.
TAPER_DEPTH_FT = 0.0625 / 12.0           # ~1/16" recess depth at the very edge
TAPER_WIDTH_FT = 2.25 / 12.0             # taper run-in from each long edge

MIN_PIECE_WIDTH_FT = 0.25                # skip board slivers narrower than 3 in.
MIN_PIECE_HEIGHT_FT = 0.25
HOLE_MARGIN_FT = 0.05                    # cutter over-travel for boolean hole cuts

# A normal wall's drywall was physically overlapping the soffit assembly's framing where they meet
# (user report 2026-07-26, confirmed by real boolean intersection: DP-001-008B/009B overlapped
# ST-006-006 by 0.00031 cf, DP-003-007A/008A overlapped ST-005-001 by 0.00031 cf - small but real,
# and the user's concern is concrete: a robot spraying texture would target that footprint and find
# the soffit's structure already occupying part of it). "The soffit" here is a small enclosed
# assembly of elevated Generic-2' band walls (Base Offset ~8 ft, Height ~2 ft) topped by a real
# Ceiling in the "Roof Soffits" category - NOT a single element. A wall that IS one of those bands
# must NOT be clipped (its whole purpose is to butt flush against the ceiling and against the other
# bands - an earlier, over-broad version of this fix wrongly clipped them too and had to be
# reverted). Only walls that are NOT part of the soffit assembly stop short of it. Cuts EXACTLY
# where the two meet (no reveal gap) - a 0.6in reveal was tried and read fine in Revit's own
# viewport, but left a real physical void that showed as a visible seam/hole once exported and
# rendered in Isaac Sim (user report 2026-07-27, backed by sim screenshots) - only a flush,
# zero-clearance cut has ZERO void to render, and this exact configuration already passed Revit's
# own Interference Check with "No interference found."
CLIP_AT_SOFFIT_ASSEMBLY = True
SOFFIT_BAND_WALL_TYPE_NAME = "Generic - 2'"   # same identifier already used in origin_bridge_run_beamwall_and_soffit.py

# Both faces are generated. exterior = +Wall.Orientation; interior = -Wall.Orientation.
# base_edge_shift staggers where the first board edge lands; Face B is offset one stud bay so
# the two faces do not simply mirror. odd_row_additional_shift staggers odd courses.
FACE_LAYOUTS = [
    {
        "face_name": "FACE_A_INTERIOR",
        "letter": "A",                       # DP-<wall>-<n>A  (this face)
        "side": "interior",
        "enabled": True,
        "base_edge_shift_ft": 0.0,
        "odd_row_additional_shift_ft": 4.0,
    },
    {
        "face_name": "FACE_B_EXTERIOR",
        "letter": "B",                       # DP-<wall>-<n>B  (other face)
        "side": "exterior",
        "enabled": True,
        "base_edge_shift_ft": 16.0 * IN_FT,
        "odd_row_additional_shift_ft": 4.0,
    },
]

# Opening detection (shared by framing + drywall).
CUT_OPENINGS = True
# Pre-existing MANUAL cutouts (openings/voids cut into walls by hand in Revit, not real doors or
# windows) were being mistaken for windows and wrecking the board layout. The script's outlet
# system replaces them, so remove them during processing (user-approved 2026-07-17). Real Doors
# and Windows (and embedded curtain walls) keep the normal opening-cut behavior.
REMOVE_MANUAL_CUTOUTS = True
# An opening whose bottom lands within this of the floor is a DOOR and is snapped TO the floor.
# Door families whose geometry starts slightly above the floor were otherwise treated like
# windows, so the bottom track (and a board sliver) kept running across the doorway - a
# threshold obstacle in the robot's path between rooms (user report 2026-07-17).
DOOR_FLOOR_SNAP_FT = 0.5
OPENING_CLEARANCE_FT = 0.05

# Fire-rating override: None = auto-detect; True/False = force. (Dynamo IN[7] also overrides.)
FORCE_FIRE_RATED = None

# Dynamo inputs:
#   IN[0] = selected wall(s) (or use current Revit selection if empty)
#   IN[5] = optional delete previous: True/False (overrides DELETE_PREVIOUS_ORIGIN_ASSEMBLY)
#   IN[6] = optional generate drywall: True/False (overrides GENERATE_DRYWALL)
#   IN[7] = optional force fire-rated: True/False (overrides auto-detection)
#   IN[8] = optional generate screws: True/False (overrides GENERATE_SCREWS)
#   IN[9] = optional purge ALL Origin elements first: True/False (overrides PURGE_ALL_ORIGIN_ELEMENTS)
# ============================================================


# ============================================================
# Cross-section profiles (Phase 1, verbatim from v4)
# ============================================================

def build_profiles(stud_depth):
    """Build the lipped-C stud profile and the U-track profile for a given through-wall stud
    depth. Track wraps the stud, so its depth = stud_depth + 2x material thickness. Returns
    (c_profile, u_profile, track_depth)."""
    D = stud_depth
    F = FLANGE_FT
    L = LIP_FT
    t = MAT_T_FT
    c = [(0, 0), (0, F), (L, F), (L, F - t), (t, F - t), (t, t),
         (D - t, t), (D - t, F - t), (D - L, F - t), (D - L, F), (D, F), (D, 0)]

    Dt = D + 2.0 * t
    Ht = TRACK_FLANGE_FT
    u = [(0, 0), (0, Ht), (t, Ht), (t, t), (Dt - t, t), (Dt - t, Ht), (Dt, Ht), (Dt, 0)]
    return c, u, Dt


# ------------------------------------------------------------
# Small vector / input helpers  (VERBATIM)
# ------------------------------------------------------------

def unwrap(item):
    try:
        return UnwrapElement(item)
    except:
        return item


def get_in(index, default=None):
    try:
        val = IN[index]
    except:
        return default
    return val if val is not None else default


def ensure_list(x):
    if x is None:
        return []
    if isinstance(x, list):
        return x
    return [x]


def as_bool(value, default):
    if value is None:
        return default
    if isinstance(value, bool):
        return value
    if isinstance(value, int):
        return value != 0
    if isinstance(value, str):
        return value.strip().lower() in ["true", "yes", "1", "y"]
    return default


def eid_value(eid):
    """Numeric value of an ElementId. Revit 2024+ uses 64-bit .Value (removed .IntegerValue)."""
    try:
        return eid.Value
    except:
        pass
    try:
        return eid.IntegerValue
    except:
        return -1


def xyz_sub(a, b):
    return XYZ(a.X - b.X, a.Y - b.Y, a.Z - b.Z)


def xyz_mul(v, s):
    return XYZ(v.X * s, v.Y * s, v.Z * s)


def dot(a, b):
    return a.X * b.X + a.Y * b.Y + a.Z * b.Z


def safe_normalize(v):
    length = math.sqrt(v.X * v.X + v.Y * v.Y + v.Z * v.Z)
    if length < 1e-9:
        return None
    return XYZ(v.X / length, v.Y / length, v.Z / length)


def clamp(value, lo, hi):
    return max(lo, min(hi, value))


def unique_sorted(values, tolerance=0.01):
    out = []
    for v in sorted(values):
        if not out or abs(out[-1] - v) > tolerance:
            out.append(v)
    return out


# ------------------------------------------------------------
# Nomenclature helpers (hierarchical element naming)
# ------------------------------------------------------------

def letter_seq(n):
    """1->A, 2->B, ... 26->Z, 27->AA, 28->AB, ... (per-wall door/window/face suffix)."""
    s = ""
    while n > 0:
        n, r = divmod(n - 1, 26)
        s = chr(65 + r) + s
    return s


def is_category(elem, bic):
    try:
        return elem.Category is not None and elem.Category.Id == ElementId(bic)
    except:
        return False


def set_mark(element, name):
    """Best-effort write of the nomenclature name to an element's Mark (Identity Data), so it is
    schedulable and taggable. Silent on failure (some elements have a read-only/absent Mark)."""
    try:
        mk = element.get_Parameter(BuiltInParameter.ALL_MODEL_MARK)
        if mk and (not mk.IsReadOnly):
            mk.Set(name)
    except:
        pass


def _parse_wall_number(s):
    """The positive int a Mark encodes as an Origin wall number (a pure / zero-padded integer),
    or None if the Mark is not one."""
    if not s:
        return None
    t = s.strip()
    if not t or not all(ch.isdigit() for ch in t):
        return None
    try:
        n = int(t)
    except:
        return None
    return n if n > 0 else None


def _wall_mark_param(wall):
    try:
        return wall.get_Parameter(BuiltInParameter.ALL_MODEL_MARK)
    except:
        return None


def _write_wall_mark(wall, number, warnings):
    p = _wall_mark_param(wall)
    if p is None or p.IsReadOnly:
        return
    tag = "{:03d}".format(number)
    try:
        if (p.AsString() or "") != tag:
            p.Set(tag)
    except Exception as ex:
        warnings.append("Could not set Mark on wall {}: {}".format(eid_value(wall.Id), ex))


def assign_wall_numbers(walls, warnings):
    """Give every selected wall a stable, building-unique nomenclature number (the '001' in
    DP-001-..., ST-001-..., SC-001-..., WN-001A, DR-001A). A wall keeps the number already stored
    in its Mark; new numbers are the smallest positive integers not used by ANY wall's Mark in the
    model, written back to Mark so reruns / later runs stay stable. Selected walls are numbered in
    ElementId order for determinism. Returns {wall_eid_value: number}. Must run inside a
    transaction (it writes Mark). Best-effort: Mark write failures are reported, not fatal."""
    taken = set()
    try:
        for w in FilteredElementCollector(doc).OfClass(Wall).WhereElementIsNotElementType():
            p = _wall_mark_param(w)
            n = _parse_wall_number(p.AsString()) if p else None
            if n is not None:
                taken.add(n)
    except Exception as ex:
        warnings.append("Wall-number scan failed (continuing): {}".format(ex))

    selected = sorted(walls, key=lambda w: eid_value(w.Id))
    assigned = {}
    used_here = set()
    # Pass 1: honor each wall's own valid, non-duplicated existing number.
    for w in selected:
        p = _wall_mark_param(w)
        n = _parse_wall_number(p.AsString()) if p else None
        if n is not None and n not in used_here:
            assigned[eid_value(w.Id)] = n
            used_here.add(n)
    # Pass 2: assign the rest the smallest free number; persist all (also normalizes padding).
    nxt = 1
    for w in selected:
        key = eid_value(w.Id)
        if key not in assigned:
            while nxt in taken:
                nxt += 1
            taken.add(nxt)
            assigned[key] = nxt
        _write_wall_mark(w, assigned[key], warnings)
    return assigned


# ------------------------------------------------------------
# Wall reading  (VERBATIM)
# ------------------------------------------------------------

def get_input_walls(warnings):
    walls = []

    input_data = get_in(0)
    if input_data:
        for item in ensure_list(input_data):
            e = unwrap(item)
            if isinstance(e, Wall):
                walls.append(e)
    if walls:
        return walls

    try:
        for eid in list(uidoc.Selection.GetElementIds()):
            e = doc.GetElement(eid)
            if isinstance(e, Wall):
                walls.append(e)
    except Exception as ex:
        warnings.append("Could not read Revit selection: {}".format(ex))
    if walls:
        return walls

    if PROCESS_ALL_WALLS_IF_NONE_SELECTED:
        for e in FilteredElementCollector(doc).OfClass(Wall).WhereElementIsNotElementType():
            walls.append(e)

    return walls


def get_wall_curve_data(wall):
    loc = wall.Location
    if not loc or not hasattr(loc, "Curve"):
        return None

    curve = loc.Curve
    if curve.GetType().Name != "Line":       # straight walls only
        return None

    start = curve.GetEndPoint(0)
    end = curve.GetEndPoint(1)
    length = curve.Length
    direction = safe_normalize(xyz_sub(end, start))
    if direction is None or length <= 0:
        return None

    return start, end, direction, length


def get_wall_height(wall):
    try:
        hp = wall.get_Parameter(BuiltInParameter.WALL_USER_HEIGHT_PARAM)
        if hp:
            h = hp.AsDouble()
            if h and h > 0.1:
                return h
    except:
        pass
    try:
        bb = wall.get_BoundingBox(None)
        if bb:
            h = bb.Max.Z - bb.Min.Z
            if h and h > 0.1:
                return h
    except:
        pass
    return 9.0


def get_wall_width(wall):
    try:
        wt = wall.WallType
        if wt and wt.Width and wt.Width > 0:
            return wt.Width
    except:
        pass
    try:
        if wall.Width and wall.Width > 0:
            return wall.Width
    except:
        pass
    return 0.5


def wall_is_fire_rated(wall, warnings):
    """Detect a fire-rated wall via the wall type's 'Fire Rating' parameter or type name.
    Returns True/False. Fully best-effort; anything unreadable => False (non-rated, 1 layer).
    Each probe is individually guarded so a missing/odd parameter never raises a warning."""
    try:
        wt = wall.WallType
    except:
        return False
    # 1) 'Fire Rating' parameter on the wall type.
    try:
        p = wt.LookupParameter("Fire Rating")
        if p is not None and p.HasValue:
            st = p.StorageType
            if st == StorageType.String:
                s = p.AsString()
                if s and any(ch.isdigit() for ch in s):
                    return True
            elif st == StorageType.Double:
                if p.AsDouble() > 0.01:
                    return True
            elif st == StorageType.Integer:
                if p.AsInteger() > 0:
                    return True
    except:
        pass
    # 2) Type-name keywords.
    try:
        name = wt.Name.lower()
        for kw in ("fire", "rated", "type x", "type-x", "1 hr", "2 hr", "1-hr", "2-hr", "1hr", "2hr"):
            if kw in name:
                return True
    except:
        pass
    return False


def wall_ref_geometry(wall, width, warnings):
    """Distance from the EXTERIOR face to (Location Line, core mid-plane), both measured toward
    the interior along the exterior normal. Accounts for the Location Line reference and the
    compound structure so faces/studs land on their true surfaces."""
    ext_noncore = 0.0
    int_noncore = 0.0
    core_width = width

    try:
        cs = wall.WallType.GetCompoundStructure()
        if cs:
            layers = cs.GetLayers()
            first_core = cs.GetFirstCoreLayerIndex()
            last_core = cs.GetLastCoreLayerIndex()
            idx = 0
            for layer in layers:                 # ordered exterior -> interior
                w = layer.Width
                if idx < first_core:
                    ext_noncore += w
                elif idx > last_core:
                    int_noncore += w
                idx += 1
            core_width = width - ext_noncore - int_noncore
    except Exception as ex:
        warnings.append("Wall {}: compound structure unreadable, assuming single layer ({})".format(
            eid_value(wall.Id), ex))

    ref = 0
    try:
        p = wall.get_Parameter(BuiltInParameter.WALL_KEY_REF_PARAM)
        if p:
            ref = p.AsInteger()
    except:
        pass

    # WallLocationLine: 0 WallCenterline, 1 CoreCenterline, 2 FinishFaceExt, 3 FinishFaceInt,
    #                   4 CoreExt, 5 CoreInt
    if ref == 1:
        d_loc = ext_noncore + core_width / 2.0
    elif ref == 2:
        d_loc = 0.0
    elif ref == 3:
        d_loc = width
    elif ref == 4:
        d_loc = ext_noncore
    elif ref == 5:
        d_loc = width - int_noncore
    else:
        d_loc = width / 2.0

    core_center_from_ext = ext_noncore + core_width / 2.0
    return d_loc, core_center_from_ext


def face_normal_and_offset(true_orientation, d_loc, width, side_name):
    """Return (outward_normal, offset_along_that_normal_from_start) for the requested face.
    Exterior face = start + true_orientation * d_loc; interior face = start - true_orientation *
    (width - d_loc)."""
    is_exterior_cfg = str(side_name).lower().startswith("ext")
    if is_exterior_cfg:
        return true_orientation, d_loc
    return xyz_mul(true_orientation, -1.0), (width - d_loc)


# ------------------------------------------------------------
# Corner / wall-join handling
# ------------------------------------------------------------

def _wall_dir(wall):
    d = get_wall_curve_data(wall)
    return d[2] if d else None


def _joined_walls_at(wall, end):
    """Walls (other than self) joined to `wall` at location-curve end (0 or 1)."""
    out = []
    try:
        arr = wall.Location.get_ElementsAtJoin(end)
        for e in arr:
            if isinstance(e, Wall) and e.Id != wall.Id:
                out.append(e)
    except:
        pass
    return out


def _meets_other_end_to_end(other_wall, self_wall):
    """True if other_wall has self_wall joined at one of ITS ends (an L-corner, both end-to-end).
    False means self_wall's end lands mid-span of other_wall (a T-join stem)."""
    for oe in (0, 1):
        for e in _joined_walls_at(other_wall, oe):
            if e.Id == self_wall.Id:
                return True
    return False


# Corner-detection tolerances (feet). A wall end is treated as "meeting" another wall where their
# location lines cross (the walls need NOT be Revit-joined) when the end sits within the window
# [-(wO/2 + CORNER_JOIN_TOL), wO/2 + CORNER_OVERSHOOT_MAX] of that crossing along the wall - i.e.
# up to CORNER_JOIN_TOL short of the other wall, or up to CORNER_OVERSHOOT_MAX past it (a wall drawn
# beyond the corner - this can be large; the through-wall false-trim it used to risk is now ruled out
# by the classification below, so raise it if panels still poke through). If the crossing lands
# within CORNER_END_TOL of the OTHER wall's end the other wall ALSO terminates here.
CORNER_JOIN_TOL_FT = 0.5
CORNER_OVERSHOOT_MAX_FT = 2.0
CORNER_END_TOL_FT = 0.5


def _line_intersect_2d(a, d, p, e):
    """Intersection of the infinite 2D lines a + t*d and p + r*e (XYZ, using X/Y only, since walls
    are vertical). Returns an XYZ (Z copied from a) or None if the lines are parallel."""
    denom = d.X * e.Y - d.Y * e.X
    if abs(denom) < 1e-9:
        return None
    wx = p.X - a.X
    wy = p.Y - a.Y
    t = (wx * e.Y - wy * e.X) / denom
    return XYZ(a.X + d.X * t, a.Y + d.Y * t, a.Z)


def corner_pullbacks(wall, warnings, candidates=None):
    """Return (du0, du1): how far to pull this wall's assembly back at end0/end1 so it butts cleanly
    into any wall it meets there (no material poking into the next room). Detection is GEOMETRIC -
    it does NOT require the walls to be 'joined' in Revit (walls that merely touch are caught) - and
    is unioned with Revit's own join info as a safety net. At an L-corner (both walls end at the
    crossing) only the lower-ElementId wall trims; the other laps through so the corner stays
    covered. At a T-join the stem (this wall, ending mid-span of the other) trims. Parallel /
    collinear meetings are ignored. `candidates` = precomputed [(wall, curve_data, width), ...] for
    every straight wall in the model; built on demand if omitted. Best-effort."""
    du = [0.0, 0.0]
    if not HANDLE_CORNERS:
        return du[0], du[1]
    seg = get_wall_curve_data(wall)
    if seg is None:
        return du[0], du[1]
    start, end_pt, d, length = seg
    ends = [(start, d), (end_pt, xyz_mul(d, -1.0))]     # (endpoint, inward direction) for end0/end1
    my_eid = eid_value(wall.Id)

    # 1) Revit join info (safety net for anything the geometry pass might miss).
    for end in (0, 1):
        for other in _joined_walls_at(wall, end):
            odir = _wall_dir(other)
            if odir is not None and abs(dot(d, odir)) > 0.95:
                continue                                  # collinear continuation - no pull-back
            if _meets_other_end_to_end(other, wall):      # L-corner: higher ElementId runs through
                butt = my_eid < eid_value(other.Id)
            else:                                          # T-join: this wall is the stem -> butt
                butt = True
            if butt:
                du[end] = max(du[end], get_wall_width(other) / 2.0)

    # 2) Geometric detection over every straight wall (catches un-joined, merely-touching walls).
    if candidates is None:
        candidates = []
        try:
            for w in FilteredElementCollector(doc).OfClass(Wall).WhereElementIsNotElementType():
                sg = get_wall_curve_data(w)
                if sg is not None:
                    candidates.append((w, sg, get_wall_width(w)))
        except:
            pass

    for (other, oseg, wO) in candidates:
        if other.Id == wall.Id:
            continue
        ostart, oend, oe, olen = oseg
        if abs(dot(d, oe)) > 0.95:
            continue                                    # parallel / collinear - not a corner
        for ei, (pe, din) in enumerate(ends):
            X = _line_intersect_2d(pe, din, ostart, oe)
            if X is None:
                continue
            s = (X.X - pe.X) * din.X + (X.Y - pe.Y) * din.Y        # inward distance from end to X
            if s < -(wO / 2.0 + CORNER_JOIN_TOL_FT) or s > (wO / 2.0 + CORNER_OVERSHOOT_MAX_FT):
                continue                                # this end isn't at the crossing
            rO = (X.X - ostart.X) * oe.X + (X.Y - ostart.Y) * oe.Y  # param of X along the other wall
            if rO < -CORNER_END_TOL_FT or rO > olen + CORNER_END_TOL_FT:
                continue                                # crossing is off the other wall's extent
            other_ends_here = (rO <= CORNER_END_TOL_FT) or (rO >= olen - CORNER_END_TOL_FT)
            this_end_near = abs(s) <= (wO / 2.0 + CORNER_JOIN_TOL_FT)   # this end is AT the crossing
            if other_ends_here and this_end_near:
                # True L-corner: both walls terminate here. Lower ElementId butts (stops at the other
                # wall's near/room face); the higher laps through (wraps only to its far face). Both
                # forms trim an overshoot; a clean/short end gives pull<=0 -> no trim.
                butt = my_eid < eid_value(other.Id)
                pull = (s + wO / 2.0) if butt else (s - wO / 2.0)
            elif not other_ends_here:
                # This wall's end runs THROUGH the middle of the other wall (a T where THIS wall is
                # the stem - including a big overshoot into the next room). Trim to the other wall's
                # near/room face so nothing pokes past it. This is the main bleed case.
                pull = s + wO / 2.0
            else:
                # The other wall's END lands mid-span of THIS wall (a T where THIS wall runs through
                # and the other butts into it). This wall spans continuously - do NOT trim it here.
                pull = 0.0
            pull = max(0.0, min(pull, wO + CORNER_OVERSHOOT_MAX_FT))
            if pull > 0.0:
                du[ei] = max(du[ei], pull)
    return du[0], du[1]


def partition_split_positions(wall, candidates):
    """[(along_wall_pos_ft, side_x, side_y, z_lo, z_hi), ...] for each place another wall butts into
    the MIDDLE of this wall (a T-join with this wall as the through wall). (side_x, side_y) points
    from the crossing INTO that wall's body, so a given face is split only when its outward normal
    points the same way (the partition is on THAT face's side) - the opposite face is left
    continuous and lays out on its own. z_lo/z_hi restrict the split to courses overlapping that
    Z-range (None/None = every course, floor to ceiling - a real partition). Corners (crossings at
    this wall's own ends) are excluded (handled by the pull-back). Best-effort; empty if disabled."""
    if not SPLIT_DRYWALL_AT_PARTITIONS:
        return []
    seg = get_wall_curve_data(wall)
    if seg is None:
        return []
    start, end_pt, d, length = seg
    out = []
    for (other, oseg, wO) in candidates:
        if other.Id == wall.Id:
            continue
        z_lo, z_hi = None, None
        if _is_soffit_band_wall(other):
            # A soffit's own band wall touching a through wall's mid-span shouldn't force a
            # floor-to-ceiling board joint - it's a 2ft bulkhead near the ceiling, not a real
            # room-dividing partition (user report 2026-07-27, confirmed live: wall 003 split
            # exactly at band wall 005's endpoint, wall 001 split exactly at band wall 006's
            # endpoint). But the course actually AT the soffit's own level should still split
            # there - a panel spanning both "before" and "after" the soffit boundary at that
            # height reads as one continuous board straddling the transition (user report
            # 2026-07-28, DP-001-006B spanning across band wall 006's junction with wall 001).
            # Restrict the split to courses overlapping the band wall's own real Z-range instead
            # of skipping it outright.
            try:
                obb = other.get_BoundingBox(None)
                if obb is None:
                    continue
                z_lo, z_hi = obb.Min.Z, obb.Max.Z
            except Exception:
                continue
        ostart, oend, oe, olen = oseg
        if abs(dot(d, oe)) > 0.95:
            continue                                    # parallel / collinear - not a junction
        X = _line_intersect_2d(start, d, ostart, oe)
        if X is None:
            continue
        p = (X.X - start.X) * d.X + (X.Y - start.Y) * d.Y     # along-wall pos of the crossing
        if p < MIN_SEG_FT or p > length - MIN_SEG_FT:
            continue                                    # crossing at (or past) this wall's end = a corner
        rO = (X.X - ostart.X) * oe.X + (X.Y - ostart.Y) * oe.Y
        if rO < -CORNER_END_TOL_FT or rO > olen + CORNER_END_TOL_FT:
            continue                                    # crossing off the other wall's extent
        other_ends_here = (rO <= CORNER_END_TOL_FT) or (rO >= olen - CORNER_END_TOL_FT)
        if not other_ends_here:                         # not an end-into-mid-span junction
            continue
        side_x = (ostart.X + oend.X) / 2.0 - X.X        # from the crossing toward the partition body
        side_y = (ostart.Y + oend.Y) / 2.0 - X.Y
        out.append((p, side_x, side_y, z_lo, z_hi))
    return out


def split_interval(lo, hi, positions):
    """Split [lo, hi] at each position strictly inside it; returns [(a, b), ...] left-to-right."""
    cuts = sorted(p for p in positions if lo + 1e-4 < p < hi - 1e-4)
    out = []
    a = lo
    for c in cuts:
        out.append((a, c))
        a = c
    out.append((a, hi))
    return out


def merge_small_segments(segments, min_safe_ft):
    """Merge any CONTIGUOUS interval shorter than min_safe_ft into its touching neighbor instead
    of keeping it as its own separate, tiny piece (a "confetti" sliver that reads as a real
    discontinuity to a sim/robot texture or spray pass). segments must be sorted, left-to-right,
    with each one touching the next (exactly what split_interval() returns - a plain range split
    at internal cut points, never a real gap like an opening). Repeatedly merges the globally
    shortest segment into its left neighbor (or right, if it's the first) until every remaining
    segment meets the safe minimum or only one segment is left. Never called on interval lists
    that can contain real gaps (e.g. subtract_intervals() around a door/window) - merging across
    an actual opening would be a real defect, not a cosmetic one."""
    segs = [tuple(s) for s in segments]
    while len(segs) > 1:
        idx = min(range(len(segs)), key=lambda k: segs[k][1] - segs[k][0])
        lo, hi = segs[idx]
        if hi - lo >= min_safe_ft:
            break
        if idx > 0:
            plo, phi = segs[idx - 1]
            segs[idx - 1] = (plo, hi)
        else:
            nlo, nhi = segs[idx + 1]
            segs[idx + 1] = (lo, nhi)
        del segs[idx]
    return segs


def corner_face_extents(wall, candidates):
    """Per-face along-wall drywall extents (feet from this wall's start) that make corners behave
    like real drywall: an OUTSIDE (convex) corner WRAPS - one panel runs past the wall end to the
    adjacent wall's outer drywall face and the other butts under it - while an INSIDE (concave)
    corner BUTTS. Returns {"interior": (lo, hi), "exterior": (lo, hi)}; values may be <0 or >length
    where a face wraps past the end. Framing keeps using corner_pullbacks (butt only)."""
    seg = get_wall_curve_data(wall)
    if seg is None:
        return None
    start, end_pt, d, length = seg
    n = safe_normalize(wall.Orientation)
    if n is None:
        return None
    faces = (("exterior", n), ("interior", xyz_mul(n, -1.0)))   # outward normal per side
    t = DRYWALL_THICKNESS_STD_FT
    ext = {"interior": [0.0, length], "exterior": [0.0, length]}
    my_eid = eid_value(wall.Id)
    for (pe, din, ei) in [(start, d, 0), (end_pt, xyz_mul(d, -1.0), 1)]:
        best = None
        for (other, oseg, wO) in candidates:
            if other.Id == wall.Id:
                continue
            ostart, oend, oe, olen = oseg
            if abs(dot(d, oe)) > 0.95:
                continue                                # parallel / collinear
            X = _line_intersect_2d(pe, din, ostart, oe)
            if X is None:
                continue
            s = (X.X - pe.X) * din.X + (X.Y - pe.Y) * din.Y
            if s < -(wO / 2.0 + CORNER_JOIN_TOL_FT) or s > (wO / 2.0 + CORNER_OVERSHOOT_MAX_FT):
                continue                                # this end isn't at the crossing
            rO = (X.X - ostart.X) * oe.X + (X.Y - ostart.Y) * oe.Y
            if rO < -CORNER_END_TOL_FT or rO > olen + CORNER_END_TOL_FT:
                continue
            other_ends_here = (rO <= CORNER_END_TOL_FT) or (rO >= olen - CORNER_END_TOL_FT)
            this_end_near = abs(s) <= (wO / 2.0 + CORNER_JOIN_TOL_FT)
            if other_ends_here and this_end_near:
                scenario = "L"                          # both walls end here (L-corner)
            elif not other_ends_here:
                scenario = "stem"                       # this end pokes into the other wall's mid-span
            else:
                continue                                # this wall runs through a mid-span T -> no adj.
            Xp = (X.X - start.X) * d.X + (X.Y - start.Y) * d.Y
            sx = (ostart.X + oend.X) / 2.0 - X.X        # toward the other wall's body
            sy = (ostart.Y + oend.Y) / 2.0 - X.Y
            cand = (abs(s), scenario, Xp, sx, sy, wO / 2.0, my_eid > eid_value(other.Id))
            if best is None or cand[0] < best[0]:
                best = cand
        if best is None:
            continue
        _, scenario, Xp, sx, sy, hwO, role_through = best
        for (side, nF) in faces:
            if not DRYWALL_CORNER_WRAP_BY_FACE.get(side, True):
                # No-wrap face: ALWAYS butt at the other wall's NEAR face, at inside AND outside
                # corners alike - the board never crosses into the other wall's footprint; at a
                # concave corner the edge lands exactly on the other wall's finished surface.
                val = (Xp + hwO) if ei == 0 else (Xp - hwO)
            elif scenario == "stem":
                val = (Xp + hwO) if ei == 0 else (Xp - hwO)     # butt into the through wall's face
            else:
                inside = (nF.X * sx + nF.Y * sy) > 0.0
                if inside:
                    if role_through:
                        val = Xp                                # run to the corner (cover concave)
                    else:
                        val = (Xp + hwO) if ei == 0 else (Xp - hwO)   # butt the through wall's face
                else:                                           # OUTSIDE / convex -> wrap the arris
                    wrap = hwO if role_through else (hwO - t)    # laps to outer face / butts its back
                    val = (Xp - wrap) if ei == 0 else (Xp + wrap)
            if ei == 0:
                ext[side][0] = val
            else:
                ext[side][1] = val
    # An OUTSIDE-corner wrap deliberately extends a face past this wall's own physical end (to
    # cover the corner return) on the assumption that the space just beyond is open. That's wrong
    # when a real, separate wall continues collinearly right there (a doorway modeled as several
    # short wall segments in a straight line, e.g. a header band + a jamb-stub, rather than one
    # wall with a hosted opening) - the candidate search above deliberately SKIPS collinear
    # neighbors (they're not a corner to butt/wrap against), so nothing stops the wrap from
    # sailing straight through a real wall sitting in its path (user report 2026-07-31: this
    # produced a real DP-vs-DP overlap between two collinear wall segments). Clamp any wrap so it
    # never crosses into a collinear wall's own physical span.
    for (other, oseg, wO) in candidates:
        if other.Id == wall.Id:
            continue
        ostart, oend, oe, olen = oseg
        if abs(dot(d, oe)) <= 0.95:
            continue                                   # not collinear with this wall
        op0 = (ostart.X - start.X) * d.X + (ostart.Y - start.Y) * d.Y
        op1 = (oend.X - start.X) * d.X + (oend.Y - start.Y) * d.Y
        onear, ofar = (op0, op1) if op0 <= op1 else (op1, op0)
        if onear >= length - 1e-4:            # other wall continues past THIS wall's end (P1 side)
            for side in ("interior", "exterior"):
                if ext[side][1] > onear:
                    ext[side][1] = onear
        if ofar <= 1e-4:                       # other wall precedes THIS wall's start (P0 side)
            for side in ("interior", "exterior"):
                if ext[side][0] < ofar:
                    ext[side][0] = ofar

    # A short wall's corner-wrap/butt adjustment at each end is computed independently, sized
    # off the ADJACENT wall's geometry - on a wall short enough (e.g. a small jamb-stub segment
    # of a doorway modeled as several separate wall pieces), the two ends' adjustments can
    # together consume more than the wall's own length, producing an inverted or near-zero
    # range (hi <= lo) - which would otherwise silently drop this face's drywall entirely (a
    # real wall left with exposed, uncovered studs - user report 2026-07-31). Same safety net
    # already used for framing's run_lo/run_hi (corner_pullbacks): fall back to the wall's own
    # full length rather than let a corner computation erase a real wall's coverage.
    for side in ("interior", "exterior"):
        lo, hi = ext[side]
        if hi - lo < MIN_SAFE_SEGMENT_FT:
            ext[side] = [0.0, length]
    # An end stud's CENTERLINE sits exactly at this wall's own boundary (x=0 or x=length) whenever
    # nothing wraps past it - but the stud has real width (FLANGE_FT), so half of it extends past
    # that exact line by design. If the drywall's own edge lands flush there too (no wrap), that
    # overhang is left uncovered - a real, recurring exposed-stud defect (user report 2026-07-31,
    # confirmed live on 5 separate short walls - ST-016-001, ST-023-001, ST-057-002, ST-067-002,
    # ST-070-002 - each off by exactly FLANGE_FT/2). Deliberately LAST, after the degenerate-reset
    # above: an earlier attempt placed this before the reset and the reset silently undid it every
    # time (the widened range for a short wall is still under MIN_SAFE_SEGMENT_FT, so the reset
    # fired and threw the widening away). Only ever WIDENS (takes whichever is more extreme), so a
    # real wrap/butt/reset that already reaches further is left untouched. This can push a board
    # into a real neighboring wall's stud - that's fine, the separate trim_drywall_from_neighbor_
    # studs() post-pass (which runs unconditionally after every wall is placed) always cleans up
    # any resulting overlap, so this never needs its own collinear-style clamp here.
    half_flange = FLANGE_FT / 2.0
    for side in ("interior", "exterior"):
        if ext[side][0] > -half_flange:
            ext[side][0] = -half_flange
        if ext[side][1] < length + half_flange:
            ext[side][1] = length + half_flange
    return {"interior": (ext["interior"][0], ext["interior"][1]),
            "exterior": (ext["exterior"][0], ext["exterior"][1])}


# ------------------------------------------------------------
# Openings  (VERBATIM)
# ------------------------------------------------------------

def get_bbox_corners(bb):
    return [
        XYZ(bb.Min.X, bb.Min.Y, bb.Min.Z),
        XYZ(bb.Min.X, bb.Min.Y, bb.Max.Z),
        XYZ(bb.Min.X, bb.Max.Y, bb.Min.Z),
        XYZ(bb.Min.X, bb.Max.Y, bb.Max.Z),
        XYZ(bb.Max.X, bb.Min.Y, bb.Min.Z),
        XYZ(bb.Max.X, bb.Min.Y, bb.Max.Z),
        XYZ(bb.Max.X, bb.Max.Y, bb.Min.Z),
        XYZ(bb.Max.X, bb.Max.Y, bb.Max.Z)
    ]


def get_opening_rects(wall, start, u, wall_length, wall_height, warnings):
    rects = []
    if not CUT_OPENINGS:
        return rects

    try:
        insert_ids = wall.FindInserts(True, True, True, True)
    except Exception as ex:
        warnings.append("Wall {}: FindInserts failed ({})".format(eid_value(wall.Id), ex))
        insert_ids = []

    door_id = ElementId(BuiltInCategory.OST_Doors)
    win_id = ElementId(BuiltInCategory.OST_Windows)
    wall_id_cat = ElementId(BuiltInCategory.OST_Walls)
    removed = 0
    for eid in insert_ids:
        e = doc.GetElement(eid)
        if not e:
            continue
        # Only REAL doors/windows (and embedded curtain walls) are openings the drywall must
        # wrap. Any other insert is a pre-existing MANUAL cutout - the outlet system replaces
        # those, so delete it instead of treating it as a window.
        is_opening = False
        try:
            c = e.Category
            if c is not None and (c.Id == door_id or c.Id == win_id or c.Id == wall_id_cat):
                is_opening = True
        except Exception:
            is_opening = False
        if not is_opening:
            if REMOVE_MANUAL_CUTOUTS:
                try:
                    doc.Delete(e.Id)
                    removed += 1
                except Exception as dex:
                    warnings.append("Wall {}: could not remove manual cutout {} ({})".format(
                        eid_value(wall.Id), eid_value(eid), dex))
            continue
        try:
            bb = e.get_BoundingBox(None)
        except:
            bb = None
        if not bb:
            continue

        xs = []
        ys = []
        for p in get_bbox_corners(bb):
            local = xyz_sub(p, start)
            xs.append(dot(local, u))
            ys.append(p.Z - start.Z)

        x0 = max(0.0, min(xs) - OPENING_CLEARANCE_FT)
        x1 = min(wall_length, max(xs) + OPENING_CLEARANCE_FT)
        y0 = max(0.0, min(ys) - OPENING_CLEARANCE_FT)
        y1 = min(wall_height, max(ys) + OPENING_CLEARANCE_FT)
        if y0 <= DOOR_FLOOR_SNAP_FT:
            y0 = 0.0        # floor-reaching opening = DOOR: snap to the floor so the bottom
                            # track splits and no board/track sliver crosses the doorway

        if (x1 - x0) > 0.1 and (y1 - y0) > 0.1:
            rects.append((x0, y0, x1, y1))

    if removed:
        warnings.append("Wall {}: removed {} pre-existing manual cutout(s) (non-door/window inserts)".format(
            eid_value(wall.Id), removed))

    return rects


def name_openings(wall, wall_id, wall_tag, orecords, warnings):
    """Give each door / window hosted in this wall a hierarchical Mark: WN-<wall><letter> for
    windows, DR-<wall><letter> for doors (letter enumerates that type on the wall: A, B, C...).
    Written to the instance Mark (schedulable / taggable) and Comments, and recorded in the
    manifest so the door/window <-> wall relationship survives export. Best-effort. Returns
    {"doors": n, "windows": n}."""
    counts = {"doors": 0, "windows": 0}
    try:
        insert_ids = wall.FindInserts(True, True, True, True)
    except Exception as ex:
        warnings.append("Wall {}: FindInserts (naming) failed ({})".format(eid_value(wall.Id), ex))
        return counts

    door_i = 0
    win_i = 0
    for eid in insert_ids:
        e = doc.GetElement(eid)
        if e is None:
            continue
        if is_category(e, BuiltInCategory.OST_Doors):
            door_i += 1
            name, kind = "DR-{}{}".format(wall_tag, letter_seq(door_i)), "DOOR"
            counts["doors"] += 1
        elif is_category(e, BuiltInCategory.OST_Windows):
            win_i += 1
            name, kind = "WN-{}{}".format(wall_tag, letter_seq(win_i)), "WINDOW"
            counts["windows"] += 1
        else:
            continue
        set_mark(e, name)
        set_comments(e, "{} | WALL={} | {} | {}".format(APP_ID, wall_id, kind, name))
        orecords.append({
            "id": name, "wall_number": wall_tag, "host_wall": wall_id,
            "type": kind, "element_id": eid_value(e.Id),
        })
    return counts


# ------------------------------------------------------------
# Rectangle helpers (drywall)
# ------------------------------------------------------------

def rect_intersection(a, b):
    ax0, ay0, ax1, ay1 = a
    bx0, by0, bx1, by1 = b
    ix0 = max(ax0, bx0)
    iy0 = max(ay0, by0)
    ix1 = min(ax1, bx1)
    iy1 = min(ay1, by1)
    if ix1 <= ix0 or iy1 <= iy0:
        return None
    return (ix0, iy0, ix1, iy1)


def subtract_rect(rect, cut):
    """v3-style rectangular subtraction. Used ONLY as a fallback for sheets that overlap more
    than one opening (rare). Returns up to 4 rectangles."""
    inter = rect_intersection(rect, cut)
    if not inter:
        return [rect]

    x0, y0, x1, y1 = rect
    ix0, iy0, ix1, iy1 = inter

    pieces = []
    if iy0 > y0:
        pieces.append((x0, y0, x1, iy0))
    if iy1 < y1:
        pieces.append((x0, iy1, x1, y1))
    if ix0 > x0:
        pieces.append((x0, iy0, ix0, iy1))
    if ix1 < x1:
        pieces.append((ix1, iy0, x1, iy1))

    return [r for r in pieces
            if (r[2] - r[0]) >= MIN_PIECE_WIDTH_FT and (r[3] - r[1]) >= MIN_PIECE_HEIGHT_FT]


def subtract_openings_from_panel(panel_rect, opening_rects):
    pieces = [panel_rect]
    for opening in opening_rects:
        new_pieces = []
        for piece in pieces:
            new_pieces.extend(subtract_rect(piece, opening))
        pieces = new_pieces
        if not pieces:
            break
    return pieces


def rect_area(r):
    return max(0.0, r[2] - r[0]) * max(0.0, r[3] - r[1])


def poly_area(pts):
    a = 0.0
    n = len(pts)
    for i in range(n):
        x0, y0 = pts[i]
        x1, y1 = pts[(i + 1) % n]
        a += x0 * y1 - x1 * y0
    return abs(a) / 2.0


def cut_sheet_single_opening(S, O):
    """Cut ONE opening O out of sheet S, keeping the result as a SINGLE connected piece wherever
    that is physically what happens (notch / L / hole). Returns a list of "shapes":
        ("rect", (x0,y0,x1,y1))              - a plain rectangle
        ("poly", [(x,y), ...])               - a single rectilinear polygon (notch or L)
        ("hole", outer_rect, hole_rect)      - rectangle with an interior rectangular hole
    A course that the opening spans full-height (or full-width) legitimately becomes two
    separate boards (left/right or top/bottom) - those ARE separate boards in the field."""
    inter = rect_intersection(S, O)
    if not inter:
        return [("rect", S)]

    sx0, sy0, sx1, sy1 = S
    ix0, iy0, ix1, iy1 = inter
    tol = 1e-4

    full_w = (ix0 <= sx0 + tol) and (ix1 >= sx1 - tol)
    full_h = (iy0 <= sy0 + tol) and (iy1 >= sy1 - tol)

    if full_w and full_h:
        return []                                   # sheet fully consumed by the opening

    if full_w:                                      # horizontal band removed -> top/bottom boards
        out = []
        if (iy0 - sy0) >= MIN_PIECE_HEIGHT_FT:
            out.append(("rect", (sx0, sy0, sx1, iy0)))
        if (sy1 - iy1) >= MIN_PIECE_HEIGHT_FT:
            out.append(("rect", (sx0, iy1, sx1, sy1)))
        return out

    if full_h:                                      # vertical band removed -> left/right boards
        out = []
        if (ix0 - sx0) >= MIN_PIECE_WIDTH_FT:
            out.append(("rect", (sx0, sy0, ix0, sy1)))
        if (sx1 - ix1) >= MIN_PIECE_WIDTH_FT:
            out.append(("rect", (ix1, sy0, sx1, sy1)))
        return out

    # Neither full: the opening bites a notch/corner/hole out of the sheet -> ONE piece.
    tL = ix0 <= sx0 + tol
    tR = ix1 >= sx1 - tol
    tB = iy0 <= sy0 + tol
    tT = iy1 >= sy1 - tol

    if not (tL or tR or tB or tT):                  # interior opening -> rectangle with a hole
        return [("hole", S, inter)]

    # Build the single rectilinear outer ring for the notch / L cases.
    if tB and tL:                                   # remove bottom-left corner -> L
        ring = [(ix1, sy0), (sx1, sy0), (sx1, sy1), (sx0, sy1), (sx0, iy1), (ix1, iy1)]
    elif tB and tR:                                 # remove bottom-right corner -> L
        ring = [(sx0, sy0), (ix0, sy0), (ix0, iy1), (sx1, iy1), (sx1, sy1), (sx0, sy1)]
    elif tT and tL:                                 # remove top-left corner -> L
        ring = [(sx0, sy0), (sx1, sy0), (sx1, sy1), (ix1, sy1), (ix1, iy0), (sx0, iy0)]
    elif tT and tR:                                 # remove top-right corner -> L
        ring = [(sx0, sy0), (sx1, sy0), (sx1, iy0), (ix0, iy0), (ix0, sy1), (sx0, sy1)]
    elif tB:                                        # notch from the bottom edge
        ring = [(sx0, sy0), (ix0, sy0), (ix0, iy1), (ix1, iy1), (ix1, sy0),
                (sx1, sy0), (sx1, sy1), (sx0, sy1)]
    elif tT:                                        # notch from the top edge
        ring = [(sx0, sy0), (sx1, sy0), (sx1, sy1), (ix1, sy1), (ix1, iy0),
                (ix0, iy0), (ix0, sy1), (sx0, sy1)]
    elif tL:                                        # notch from the left edge
        ring = [(sx0, sy0), (sx1, sy0), (sx1, sy1), (sx0, sy1), (sx0, iy1),
                (ix1, iy1), (ix1, iy0), (sx0, iy0)]
    else:                                           # tR: notch from the right edge
        ring = [(sx0, sy0), (sx1, sy0), (sx1, iy0), (ix0, iy0), (ix0, iy1),
                (sx1, iy1), (sx1, sy1), (sx0, sy1)]

    return [("poly", ring)]


def cut_sheet(S, opening_rects):
    """Cut all overlapping openings out of sheet S. 0 or 1 overlap uses the single-piece logic;
    2+ overlaps fall back to rectangular subtraction (documented, rare). Returns (shapes, multi)."""
    overlaps = [O for O in opening_rects if rect_intersection(S, O) is not None]
    if not overlaps:
        return [("rect", S)], False
    if len(overlaps) == 1:
        return cut_sheet_single_opening(S, overlaps[0]), False
    # Multiple openings on one sheet: cut them all out with a boolean difference so the board
    # stays a single connected piece (notches / L's / holes) rather than rectangles split at the
    # opening corners.
    return [("multicut", S, overlaps)], True


# ------------------------------------------------------------
# Geometry primitives
# ------------------------------------------------------------

def make_point(origin, u, z, x, y):
    return origin.Add(u.Multiply(x)).Add(z.Multiply(y))


def _extrude_loops(loops, extrude_dir, depth, material_id, gstyle_id):
    if material_id is not None:
        gs = gstyle_id if gstyle_id is not None else ElementId.InvalidElementId
        opts = SolidOptions(material_id, gs)
        return GeometryCreationUtilities.CreateExtrusionGeometry(loops, extrude_dir, depth, opts)
    return GeometryCreationUtilities.CreateExtrusionGeometry(loops, extrude_dir, depth)


def make_profile_solid(origin, ax, ay, points2d, extrude_dir, depth, material_id=None, gstyle_id=None):
    """Extrude an arbitrary closed polygon profile (used by framing). ax/ay map the two profile
    coords; tries both windings so the caller need not worry about loop orientation."""
    if depth <= 0 or points2d is None or len(points2d) < 3:
        return None
    verts = [origin.Add(ax.Multiply(p)).Add(ay.Multiply(q)) for (p, q) in points2d]
    for order in (verts, list(reversed(verts))):
        try:
            loop = CurveLoop()
            n = len(order)
            for i in range(n):
                loop.Append(Line.CreateBound(order[i], order[(i + 1) % n]))
            loops = List[CurveLoop]()
            loops.Add(loop)
            return _extrude_loops(loops, extrude_dir, depth, material_id, gstyle_id)
        except:
            continue
    return None


def make_world_axis_box(x0, y0, z0, x1, y1, z1, material_id=None, gstyle_id=None):
    """Build a plain axis-aligned box directly from world-space bounds, with no need for the
    board's original local (u/z/normal) wall frame - used by close_small_cross_wall_gaps() to
    rebuild an extended board purely from its measured bbox. Picks whichever of X or Y is the
    thinner (extrusion) axis - correct for any wall board on an axis-aligned wall, since a
    board's thickness direction is always X or Y, never Z (which always spans the full course
    height, the long axis)."""
    dx, dy, dz = x1 - x0, y1 - y0, z1 - z0
    if dx <= 1e-4 or dy <= 1e-4 or dz <= 1e-4:
        return None
    origin = XYZ(x0, y0, z0)
    if dx <= dy:
        return make_rect_solid(origin, XYZ.BasisY, XYZ.BasisZ, XYZ.BasisX, (0.0, 0.0, dy, dz),
                               dx, material_id, gstyle_id)
    else:
        return make_rect_solid(origin, XYZ.BasisX, XYZ.BasisZ, XYZ.BasisY, (0.0, 0.0, dx, dz),
                               dy, material_id, gstyle_id)


def make_rect_solid(origin, u, z, normal, rect, depth, material_id=None, gstyle_id=None):
    x0, y0, x1, y1 = rect
    if (x1 - x0) < 0.001 or (y1 - y0) < 0.001 or depth <= 0:
        return None
    pts = [(x0, y0), (x1, y0), (x1, y1), (x0, y1)]
    return make_planar_poly_solid(origin, u, z, normal, pts, depth, material_id, gstyle_id)


def make_planar_poly_solid(origin, u, z, normal, pts2d, depth, material_id=None, gstyle_id=None):
    """Extrude a single planar rectilinear polygon (given as (x,y) in the u/z plane) along the
    normal by depth. Dedupes coincident consecutive points; tries both windings."""
    clean = []
    for p in pts2d:
        if not clean or abs(clean[-1][0] - p[0]) > 1e-7 or abs(clean[-1][1] - p[1]) > 1e-7:
            clean.append(p)
    if len(clean) >= 2 and abs(clean[0][0] - clean[-1][0]) < 1e-7 and abs(clean[0][1] - clean[-1][1]) < 1e-7:
        clean = clean[:-1]
    if len(clean) < 3 or depth <= 0:
        return None

    verts = [make_point(origin, u, z, x, y) for (x, y) in clean]
    for order in (verts, list(reversed(verts))):
        try:
            loop = CurveLoop()
            n = len(order)
            for i in range(n):
                loop.Append(Line.CreateBound(order[i], order[(i + 1) % n]))
            loops = List[CurveLoop]()
            loops.Add(loop)
            return _extrude_loops(loops, normal, depth, material_id, gstyle_id)
        except:
            continue
    return None


def make_hole_solid(origin, u, z, normal, outer_rect, hole_rect, depth, material_id=None, gstyle_id=None):
    """Rectangle with an interior rectangular hole, via a real 3D boolean difference (the
    hang-over-then-cut-out operation). Returns the cut Solid, or None on failure."""
    outer = make_rect_solid(origin, u, z, normal, outer_rect, depth, material_id, gstyle_id)
    if outer is None:
        return None
    cutter_origin = origin.Add(normal.Multiply(-HOLE_MARGIN_FT))
    cutter = make_rect_solid(cutter_origin, u, z, normal, hole_rect, depth + 2.0 * HOLE_MARGIN_FT)
    if cutter is None:
        return outer
    try:
        return BooleanOperationsUtils.ExecuteBooleanOperation(
            outer, cutter, BooleanOperationsType.Difference)
    except:
        return outer          # keep the uncut board rather than losing it


def make_multicut_solid(origin, u, z, normal, sheet_rect, cut_rects, depth,
                        material_id=None, gstyle_id=None):
    """Sheet rectangle with MULTIPLE openings cut out via chained boolean differences, so the
    board stays a SINGLE connected piece (notches / L's / holes) instead of rectangles split at
    the opening corners. (A course an opening spans full-height may come back as one solid with
    two lumps; that rare case is the exception.) Returns the cut Solid, or None on failure."""
    solid = make_rect_solid(origin, u, z, normal, sheet_rect, depth, material_id, gstyle_id)
    if solid is None:
        return None
    cutter_origin = origin.Add(normal.Multiply(-HOLE_MARGIN_FT))
    for cr in cut_rects:
        inter = rect_intersection(sheet_rect, cr)
        if not inter:
            continue
        cutter = make_rect_solid(cutter_origin, u, z, normal, inter, depth + 2.0 * HOLE_MARGIN_FT)
        if cutter is None:
            continue
        try:
            solid = BooleanOperationsUtils.ExecuteBooleanOperation(
                solid, cutter, BooleanOperationsType.Difference)
        except:
            pass          # skip this cutter; keep the board built so far
    return solid


def make_tapered_board_solid(layer_origin, u, z, normal, rect, thickness,
                             material_id=None, gstyle_id=None):
    """Rectangular board whose ROOM-FACING side (the +normal end) recesses near its two long
    (top & bottom) horizontal edges - the factory taper that forms the taped valley between
    stacked courses. Built by extruding a (height x thickness) profile along the board LENGTH.
    Falls back to a flat box if the board is too short to hold the taper. Returns the Solid."""
    x0, y0, x1, y1 = rect
    width = x1 - x0
    height = y1 - y0
    if width < 0.001 or height < 0.001 or thickness <= 0:
        return None
    td = min(TAPER_DEPTH_FT, thickness * 0.9)
    tw = TAPER_WIDTH_FT
    if td <= 0 or tw <= 0 or height <= 2.0 * tw + 0.01:
        return make_rect_solid(layer_origin, u, z, normal, rect, thickness, material_id, gstyle_id)
    origin = make_point(layer_origin, u, z, x0, y0)
    # Profile in (h along z = height, d along normal = thickness). Back face d=0; room face d=thk
    # in the middle, recessing to (thk - td) at the very top and bottom edges over tw.
    profile = [(0.0, 0.0), (height, 0.0), (height, thickness - td),
               (height - tw, thickness), (tw, thickness), (0.0, thickness - td)]
    return make_profile_solid(origin, z, normal, profile, u, width, material_id, gstyle_id)


def set_comments(element, text):
    try:
        p = element.get_Parameter(BuiltInParameter.ALL_MODEL_INSTANCE_COMMENTS)
        if p and (not p.IsReadOnly):
            p.Set(text)
    except:
        pass


def create_directshape(solid, data_id, name, comments, warnings):
    if solid is None:
        return None
    try:
        ds = DirectShape.CreateElement(doc, ElementId(BuiltInCategory.OST_GenericModel))
        ds.ApplicationId = APP_ID
        ds.ApplicationDataId = data_id
        shape = List[GeometryObject]()
        shape.Add(solid)
        ds.SetShape(shape)
        try:
            ds.Name = name
        except:
            pass
        set_comments(ds, comments)
        set_mark(ds, name)          # nomenclature also on Mark: schedulable + taggable
        return ds
    except Exception as ex:
        warnings.append("DirectShape create failed for {}: {}".format(data_id, ex))
        return None


# ------------------------------------------------------------
# DirectShape appearance: colored subcategories + materials  (VERBATIM machinery)
# ------------------------------------------------------------

STYLE_SPECS = [
    ("STUD",     "ORIGIN Stud",         (150, 155, 165)),
    ("KINGSTUD", "ORIGIN King Stud",    (120, 140, 180)),
    ("JACK",     "ORIGIN Jack Stud",    (120, 170, 140)),
    ("CRIPPLE",  "ORIGIN Cripple Stud", (170, 170, 120)),
    ("TRACK",    "ORIGIN Track",        (90, 95, 105)),
    ("HEADER",   "ORIGIN Header",       (200, 140, 80)),
    ("SILL",     "ORIGIN Sill",         (200, 140, 80)),
    ("GWB",      "ORIGIN Drywall Base", (235, 228, 214)),   # base layer, warm off-white
    ("GWB2",     "ORIGIN Drywall Face", (222, 212, 190)),   # 2nd (face) layer, slightly darker
    ("SCREW",    "ORIGIN Screw",        (200, 60, 60)),     # fastener markers, red
]


def get_or_create_material(name, rgb):
    for m in FilteredElementCollector(doc).OfClass(Material):
        if m.Name == name:
            return m.Id
    mid = Material.Create(doc, name)
    try:
        m = doc.GetElement(mid)
        m.Color = Color(rgb[0], rgb[1], rgb[2])
        m.Transparency = 0
    except:
        pass
    return mid


def get_or_create_subcategory(parent_cat, name, material_id, rgb):
    try:
        for sc in parent_cat.SubCategories:
            if sc.Name == name:
                return sc
    except:
        pass
    sc = doc.Settings.Categories.NewSubcategory(parent_cat, name)
    try:
        sc.LineColor = Color(rgb[0], rgb[1], rgb[2])
    except:
        pass
    try:
        if material_id and material_id != ElementId.InvalidElementId:
            sc.Material = doc.GetElement(material_id)
    except:
        pass
    return sc


def setup_styles(warnings):
    """Create/find a colored Generic Model subcategory + material per kind. Returns
    {kind: (material_id, graphics_style_id)}. Best-effort; on failure elements are uncolored."""
    styles = {}
    try:
        gm = doc.Settings.Categories.get_Item(BuiltInCategory.OST_GenericModel)
    except Exception as ex:
        warnings.append("Could not access Generic Model category for coloring: {}".format(ex))
        return styles

    created = []
    for kind, name, rgb in STYLE_SPECS:
        try:
            mat_id = get_or_create_material(name, rgb)
            get_or_create_subcategory(gm, name, mat_id, rgb)
            created.append((kind, name, mat_id))
        except Exception as ex:
            warnings.append("Coloring for {} failed: {}".format(kind, ex))

    try:
        doc.Regenerate()
    except:
        pass

    subs_by_name = {}
    try:
        gm = doc.Settings.Categories.get_Item(BuiltInCategory.OST_GenericModel)
        for sc in gm.SubCategories:
            subs_by_name[sc.Name] = sc
    except:
        pass

    for kind, name, mat_id in created:
        gsid = ElementId.InvalidElementId
        sub = subs_by_name.get(name)
        if sub is not None:
            try:
                gs = sub.GetGraphicsStyle(GraphicsStyleType.Projection)
                if gs:
                    gsid = gs.Id
            except:
                pass
        styles[kind] = (mat_id, gsid)
    return styles


# ------------------------------------------------------------
# Cleanup  (VERBATIM; scoped to the walls being processed)
# ------------------------------------------------------------

def ensure_outlet_rfa(warnings):
    """Create families\\TM_outlet_box.rfa AUTOMATICALLY when it does not exist yet, so outlets
    work without any manual setup step. One fixed-size box extrusion per TM model, each bound to
    a Yes/No visibility parameter; each type shows exactly one box. MUST run before the Dynamo
    transaction opens (family documents cannot be created while one is active)."""
    import os
    if os.path.exists(OUTLET_RFA_PATH):
        return True
    app = doc.Application
    template = None
    try:
        cands = []
        base = r"C:\ProgramData\Autodesk"
        for d in sorted(os.listdir(base), reverse=True):
            if d.startswith("RVT"):
                for lang in ("English-Imperial", "English", "ENU"):
                    for nm in ("Generic Model.rft", "Metric Generic Model.rft"):
                        p = os.path.join(base, d, "Family Templates", lang, nm)
                        if os.path.exists(p):
                            cands.append(p)
        try:
            fp = app.FamilyTemplatePath
            for nm in ("Generic Model.rft", "Metric Generic Model.rft"):
                q = os.path.join(fp, nm)
                if os.path.exists(q):
                    cands.insert(0, q)
        except Exception:
            pass
        template = cands[0] if cands else None
    except Exception as ex:
        warnings.append("Outlet family template scan failed: {}".format(ex))
    if template is None:
        warnings.append("No Generic Model.rft template found - outlets skipped "
                        "(run origin_outlet_family_setup.py with a manual template path)")
        return False
    try:
        TransactionManager.Instance.ForceCloseTransaction()
    except Exception:
        pass
    try:
        famdoc = app.NewFamilyDocument(template)
    except Exception as ex:
        warnings.append("NewFamilyDocument failed ({}) - outlets skipped".format(ex))
        return False
    try:
        t = Transaction(famdoc, "ORIGIN outlet box family")
        t.Start()
        try:
            # Electrical Fixture category: the outlet is its OWN class, separate from the
            # Generic Models drywall, so it selects/moves/filters independently.
            try:
                famdoc.OwnerFamily.FamilyCategory = famdoc.Settings.Categories.get_Item(
                    BuiltInCategory.OST_ElectricalFixtures)
            except Exception as cex:
                warnings.append("Outlet family category set failed ({}); staying Generic Model".format(cex))
            fm = famdoc.FamilyManager
            sk = SketchPlane.Create(famdoc, Plane.CreateByNormalAndOrigin(XYZ.BasisZ, XYZ.Zero))
            vis_params = []
            for name in sorted(OUTLET_MODELS.keys()):
                (w_mm, h_mm, d_mm) = OUTLET_MODELS[name]
                hx = (w_mm / 304.8) / 2.0
                hy = (d_mm / 304.8) / 2.0
                pts = [XYZ(-hx, -hy, 0), XYZ(hx, -hy, 0), XYZ(hx, hy, 0), XYZ(-hx, hy, 0)]
                arr = CurveArray()
                for i in range(4):
                    arr.Append(Line.CreateBound(pts[i], pts[(i + 1) % 4]))
                caa = CurveArrArray()
                caa.Append(arr)
                ext = famdoc.FamilyCreate.NewExtrusion(True, caa, sk, h_mm / 304.8)
                fpar = fm.AddParameter("Show {}".format(name), GroupTypeId.Visibility,
                                       SpecTypeId.Boolean.YesNo, False)
                fm.AssociateElementParameterToFamilyParameter(
                    ext.get_Parameter(BuiltInParameter.IS_VISIBLE_PARAM), fpar)
                vis_params.append((name, fpar))
            for name in sorted(OUTLET_MODELS.keys()):
                fm.NewType(name)
                fm.CurrentType = [ft for ft in fm.Types if ft.Name == name][0]
                for (pn, fpar) in vis_params:
                    fm.Set(fpar, 1 if pn == name else 0)
            t.Commit()
        except Exception:
            t.RollBack()
            raise
        rdir = os.path.dirname(OUTLET_RFA_PATH)
        if not os.path.exists(rdir):
            os.makedirs(rdir)
        sao = SaveAsOptions()
        sao.OverwriteExistingFile = True
        famdoc.SaveAs(OUTLET_RFA_PATH, sao)
        return True
    except Exception as ex:
        warnings.append("Outlet family build failed ({}) - outlets skipped".format(ex))
        return False
    finally:
        try:
            famdoc.Close(False)
        except Exception:
            pass


def _bip_str(el, bip):
    """Parameter-based string read (reliable under PythonNet, unlike .Name on some types)."""
    try:
        p = el.get_Parameter(bip)
        if p:
            s = p.AsString()
            if s:
                return s
    except Exception:
        pass
    return None


def _el_name(el):
    """Element/type name that works in Dynamo CPython: direct .Name access on FamilySymbol /
    Family can throw under PythonNet, which made the outlet symbol lookup fail silently."""
    s = _bip_str(el, BuiltInParameter.SYMBOL_NAME_PARAM)
    if s:
        return s
    try:
        return Element.Name.__get__(el)
    except Exception:
        pass
    try:
        return el.Name
    except Exception:
        return None


def preload_outlet_family(warnings):
    """Load the outlet family into the PROJECT before the main Dynamo transaction opens, in its
    own short transaction (loading a family from inside the already-open transaction is the
    fragile path). No-op when the family is already in the project."""
    try:
        for f in FilteredElementCollector(doc).OfClass(Family):
            if _el_name(f) == OUTLET_FAMILY:
                return True
    except Exception:
        pass
    t = None
    try:
        try:
            TransactionManager.Instance.ForceCloseTransaction()
        except Exception:
            pass
        t = Transaction(doc, "ORIGIN load outlet family")
        t.Start()
        loaded = doc.LoadFamily(OUTLET_RFA_PATH)
        t.Commit()
        if not loaded:
            warnings.append("Outlet family preload: LoadFamily returned False")
        return bool(loaded)
    except Exception as ex:
        warnings.append("Outlet family preload failed: {}".format(ex))
        try:
            if t is not None:
                t.RollBack()
        except Exception:
            pass
        return False


_outlet_symbol_cache = [None, False]     # [symbol, resolved?] - one lookup per run


def outlet_symbol(warnings):
    """The TM_outlet_box family symbol (OUTLET_TYPE), loading families\\TM_outlet_box.rfa on
    demand. Returns None (with one warning) when the family is not available yet."""
    if _outlet_symbol_cache[1]:
        return _outlet_symbol_cache[0]
    _outlet_symbol_cache[1] = True

    def find():
        fallback = None
        for fs in FilteredElementCollector(doc).OfClass(FamilySymbol):
            try:
                fam = _bip_str(fs, BuiltInParameter.ALL_MODEL_FAMILY_NAME)
                if fam is None:
                    try:
                        fam = fs.FamilyName
                    except Exception:
                        fam = None
                if fam != OUTLET_FAMILY:
                    continue
                if fallback is None:
                    fallback = fs
                if _el_name(fs) == OUTLET_TYPE:
                    return fs
            except Exception:
                continue
        if fallback is not None:
            warnings.append("Outlet type '{}' not matched by name; using the family's first "
                            "type instead".format(OUTLET_TYPE))
        return fallback

    fs = find()
    if fs is None:
        try:
            import os
            if os.path.exists(OUTLET_RFA_PATH):
                doc.LoadFamily(OUTLET_RFA_PATH)
                fs = find()
        except Exception as ex:
            warnings.append("Outlet family load failed: {}".format(ex))
    if fs is None:
        warnings.append("Outlet family '{}' type '{}' not available - run "
                        "origin_outlet_family_setup.py once in a Dynamo Python node, then "
                        "re-run this graph.".format(OUTLET_FAMILY, OUTLET_TYPE))
    else:
        try:
            if not fs.IsActive:
                fs.Activate()
        except Exception:
            pass
    _outlet_symbol_cache[0] = fs
    return fs


def rects_overlap(a, b):
    """Axis-aligned rect overlap (x0, y0, x1, y1). Used by the outlet candidate filter - this
    helper existed only in the ceiling script; its absence here made every wall fail mid-run
    with NameError the moment the outlet family finally loaded (zero drywall, framing only)."""
    return not (a[2] <= b[0] or b[2] <= a[0] or a[3] <= b[1] or b[3] <= a[1])


def find_wall_outlets(wall_id):
    """Existing tagged outlet instances hosted on this wall (survive re-runs by design)."""
    tag = "WALL={} | OUTLET".format(wall_id)
    out = []
    for fi in FilteredElementCollector(doc).OfClass(FamilyInstance):
        try:
            c = fi.get_Parameter(BuiltInParameter.ALL_MODEL_INSTANCE_COMMENTS)
            if c and tag in (c.AsString() or ""):
                out.append(fi)
        except Exception:
            continue
    return out


def outlet_cutouts_from_existing(wall_id, start, u, orientation, d_loc, width):
    """Cut rects for outlets already on this wall. Position, face and size are derived from each
    tagged instance, so when the user MOVES or type-swaps a box in Revit the recess hole follows
    it on the next run; a deleted box leaves no hole."""
    if OUTLET_STYLE != "recess":
        return []
    cuts = []
    wall_center = d_loc - width / 2.0
    for fi in find_wall_outlets(wall_id):
        try:
            p = fi.Location.Point
        except Exception:
            continue
        tname = None
        try:
            tname = _el_name(fi.Symbol)
        except Exception:
            pass
        (bw_mm, bh_mm, _bd_mm) = OUTLET_MODELS.get(tname, OUTLET_MODELS.get(OUTLET_TYPE, (103.0, 103.0, 38.0)))
        bw = bw_mm / 304.8
        bh = bh_mm / 304.8
        cx = (p.X - start.X) * u.X + (p.Y - start.Y) * u.Y
        zb = p.Z - start.Z
        s = (p.X - start.X) * orientation.X + (p.Y - start.Y) * orientation.Y
        side = "exterior" if s >= wall_center else "interior"
        cuts.append((side, (cx - bw / 2.0, zb, cx + bw / 2.0, zb + bh)))
    return cuts


def emit_outlet(wall, wall_id, wall_tag, start, u, orientation, d_loc, width, stud_xs,
                opening_rects, wall_height, run_lo, run_hi, outlet_records, warnings,
                env_centroid=None):
    """Place ONE outlet on this wall at a random interior stud / face / height. Style "recess"
    (the intrusion the user asked for): the face drywall board gets a socket-sized HOLE and the
    TM box sits INSIDE the wall, front plate at ~OUTLET_RECESS_FRAC of the wall depth (clamped
    so nothing reaches the far face). Style "box": the old surface-mounted look. The wall's
    Comments carry OUTLET_MARKER afterwards, so later runs leave the user's moves/deletes alone
    (the recess hole is re-derived from the existing instance every run and follows it).
    Returns (boxes_placed, [(face_side, cut_rect), ...])."""
    try:
        _bp = wall.get_Parameter(BuiltInParameter.WALL_BASE_OFFSET)
        if _bp and abs(_bp.AsDouble() or 0.0) > 0.5:
            return 0, []        # elevated band (beam/soffit wall) - no receptacle belongs here
    except Exception:
        pass
    cp = None
    try:
        cp = wall.get_Parameter(BuiltInParameter.ALL_MODEL_INSTANCE_COMMENTS)
    except Exception:
        cp = None
    marked = False
    try:
        marked = cp is not None and OUTLET_MARKER in (cp.AsString() or "")
    except Exception:
        marked = False
    if marked and not OUTLET_FORCE_REGENERATE:
        # Requirement: exactly ONE cutout per wall - keep the first box, drop any extras.
        existing_all = find_wall_outlets(wall_id)
        if len(existing_all) > 1:
            for fi in existing_all[1:]:
                try:
                    doc.Delete(fi.Id)
                except Exception:
                    pass
            warnings.append("Wall {}: {} outlets found; trimmed to one".format(wall_id, len(existing_all)))
        # Migration: a preserved box sitting OUTSIDE the wall body is from the old
        # surface-mounted style, and a box whose DEPTH no longer matches OUTLET_RECESS_FRAC is
        # from an older depth setting (depth is script-managed; position/face/type are the
        # user's). Either way: delete it and fall through to place a fresh recessed one.
        stale = []
        if OUTLET_STYLE == "recess":
            for fi in find_wall_outlets(wall_id):
                try:
                    p0 = fi.Location.Point
                    s = (p0.X - start.X) * orientation.X + (p0.Y - start.Y) * orientation.Y
                except Exception:
                    continue
                if s > d_loc + 1e-3 or s < d_loc - width - 1e-3:
                    stale.append(fi.Id)
                    continue
                tname = None
                try:
                    tname = _el_name(fi.Symbol)
                except Exception:
                    pass
                (_wm, _hm, dmm) = OUTLET_MODELS.get(tname, OUTLET_MODELS.get(OUTLET_TYPE, (103.0, 103.0, 38.0)))
                bd0 = dmm / 304.8
                if s >= d_loc - width / 2.0:                    # exterior-side box
                    depth_now = d_loc - (s + bd0 / 2.0)
                else:                                           # interior-side box
                    depth_now = (s - bd0 / 2.0) - (d_loc - width)
                depth_want = min(OUTLET_RECESS_FRAC * width, width - bd0 - 0.02)
                if abs(depth_now - depth_want) > 0.04:
                    stale.append(fi.Id)
        if stale:
            for sid in stale:
                try:
                    doc.Delete(sid)
                except Exception:
                    pass
        else:
            # Preserved wall: no new box, but the recess hole must FOLLOW the existing box
            # (the user may have moved or type-swapped it since the last run).
            return 0, outlet_cutouts_from_existing(wall_id, start, u, orientation, d_loc, width)
    if marked and OUTLET_FORCE_REGENERATE:
        for sid in [fi.Id for fi in find_wall_outlets(wall_id)]:
            try:
                doc.Delete(sid)
            except Exception:
                pass
    fs = outlet_symbol(warnings)
    if fs is None:
        return 0, []
    (bw_mm, bh_mm, bd_mm) = OUTLET_MODELS.get(OUTLET_TYPE, (103.0, 103.0, 38.0))
    bw = bw_mm / 304.8
    bh = bh_mm / 304.8
    bd = bd_mm / 304.8
    # Candidate studs: interior field studs only - not jambs, not inside an opening span, box
    # fully inside the run and clear of every opening across the whole 12-18in height band.
    cands = []
    for sx in stud_xs:
        if is_jamb_line(sx, opening_rects) or is_interior_line(sx, opening_rects):
            continue
        x0 = sx + FLANGE_FT / 2.0            # box starts at the stud's flange face
        x1 = x0 + bw
        if x0 < run_lo + 0.1 or x1 > run_hi - 0.1:
            continue
        band = (x0 - 0.05, OUTLET_HEIGHT_MIN_FT - 0.05, x1 + 0.05,
                OUTLET_HEIGHT_MAX_FT + bh + 0.05)
        ok = True
        for orect in opening_rects:
            if rects_overlap(band, orect):
                ok = False
                break
        if ok:
            cands.append(sx)
    if not cands:
        warnings.append("Wall {}: no stud available for an outlet (openings/corners); skipped".format(wall_id))
        return 0, []
    sx = random.choice(cands)
    if OUTLET_FACES == "inner" and env_centroid is not None:
        # Face the environment: pick the side whose outward normal points toward the centroid
        # of the selected walls, so the robot (inside) can always see the outlet.
        mx = start.X + u.X * (run_lo + run_hi) / 2.0
        my = start.Y + u.Y * (run_lo + run_hi) / 2.0
        toward = (env_centroid[0] - mx) * orientation.X + (env_centroid[1] - my) * orientation.Y
        side = "exterior" if toward > 0.0 else "interior"
    else:
        side = random.choice(["interior", "exterior"])
    hbot = OUTLET_HEIGHT_MIN_FT + random.random() * (OUTLET_HEIGHT_MAX_FT - OUTLET_HEIGHT_MIN_FT)
    normal, face_off = face_normal_and_offset(orientation, d_loc, width, side)
    cx = sx + FLANGE_FT / 2.0 + bw / 2.0
    recess_depth = 0.0
    if OUTLET_STYLE == "recess":
        # INTRUSION: the box sits inside the wall, front plate at ~OUTLET_RECESS_FRAC of the
        # wall thickness (clamped so the box back never reaches the far face). The face board
        # gets a matching hole (returned as a cut rect), so you look INTO the wall and see the
        # box plate as the recess bottom. Nothing shows on the other side of the wall.
        recess_depth = min(OUTLET_RECESS_FRAC * width, width - bd - 0.02)
        if recess_depth < 0.0:
            recess_depth = max(0.0, width - bd - 0.02)
        off_center = face_off - recess_depth - bd / 2.0
    else:
        # Surface-mounted: box center sits bd/2 OUTSIDE the finish plane, fully proud.
        off_center = face_off + bd / 2.0
    p = XYZ(start.X + u.X * cx + normal.X * off_center,
            start.Y + u.Y * cx + normal.Y * off_center,
            start.Z + hbot)
    try:
        from Autodesk.Revit.DB.Structure import StructuralType
        fi = doc.Create.NewFamilyInstance(p, fs, StructuralType.NonStructural)
        ang = math.atan2(u.Y, u.X)
        if abs(ang) > 1e-9:
            axis = Line.CreateBound(p, XYZ(p.X, p.Y, p.Z + 1.0))
            ElementTransformUtils.RotateElement(doc, fi.Id, axis, ang)
    except Exception as ex:
        warnings.append("Wall {}: outlet placement failed ({})".format(wall_id, ex))
        return 0, []
    oid = "EO-{}-001".format(wall_tag)
    comment = "{} | WALL={} | OUTLET | {} | {}".format(APP_ID, wall_id, oid, OUTLET_TYPE)
    try:
        mp = fi.get_Parameter(BuiltInParameter.ALL_MODEL_MARK)
        if mp:
            mp.Set(oid)
        cpi = fi.get_Parameter(BuiltInParameter.ALL_MODEL_INSTANCE_COMMENTS)
        if cpi:
            cpi.Set(comment)
    except Exception:
        pass
    if cp is not None:
        try:
            old = cp.AsString() or ""
            cp.Set((old + " " if old else "") + OUTLET_MARKER)
        except Exception:
            warnings.append("Wall {}: could not write the outlet marker (a re-run may add a second box)".format(wall_id))
    outlet_records.append({
        "outlet_id": oid, "wall_number": wall_tag, "host_wall": wall_id,
        "type": OUTLET_TYPE, "size_mm": list(OUTLET_MODELS.get(OUTLET_TYPE, ())),
        "stud_x_in": round(sx * 12.0, 2), "face": side,
        "height_to_bottom_in": round(hbot * 12.0, 2),
        "style": OUTLET_STYLE, "recess_depth_in": round(recess_depth * 12.0, 2),
        "world_xyz": [round(p.X, 3), round(p.Y, 3), round(p.Z, 3)],
    })
    cuts = []
    if OUTLET_STYLE == "recess":
        x0 = sx + FLANGE_FT / 2.0
        cuts.append((side, (x0, hbot, x0 + bw, hbot + bh)))
    return 1, cuts


def delete_previous(processed_ids, warnings, purge_all=False):
    """Delete previously generated Origin DirectShapes. Normally scoped to the walls being processed
    this run (matched by the host wall's ElementId token WALL=W<eid>). When purge_all=True, remove
    EVERY Origin element in the model regardless of wall - use this to clear orphans left when walls
    were recreated (new ElementIds) or an older build ran."""
    ids = List[ElementId]()
    wall_tokens = ["WALL=" + w + " " for w in processed_ids]

    try:
        for e in FilteredElementCollector(doc).OfClass(DirectShape):
            comment = None
            try:
                p = e.get_Parameter(BuiltInParameter.ALL_MODEL_INSTANCE_COMMENTS)
                comment = p.AsString() if p else None
            except:
                comment = None

            is_ours = False
            try:
                if e.ApplicationId == APP_ID:
                    is_ours = True
            except:
                pass
            if not is_ours and comment and APP_ID in comment:
                is_ours = True
            if not is_ours:
                continue

            if purge_all or (comment and any(tok in comment for tok in wall_tokens)):
                ids.Add(e.Id)
    except Exception as ex:
        warnings.append("Cleanup (DirectShape) failed: {}".format(ex))

    try:
        col = FilteredElementCollector(doc).OfCategory(
            BuiltInCategory.OST_GenericModel).WhereElementIsNotElementType()
        for e in col:
            try:
                pg = e.LookupParameter("Generated_By")
                if not (pg and pg.AsString() == APP_ID):
                    continue
                if purge_all:
                    ids.Add(e.Id)
                    continue
                pw = e.LookupParameter("Wall_ID")
                wid = pw.AsString() if pw else None
                if wid and wid in processed_ids:
                    ids.Add(e.Id)
            except:
                pass
    except Exception as ex:
        warnings.append("Cleanup (family) failed: {}".format(ex))

    count = ids.Count
    if count > 0:
        doc.Delete(ids)
    return count


# ------------------------------------------------------------
# Export-isolation view (Phase 3 hook)
# ------------------------------------------------------------
def ensure_export_view(warnings):
    """Create (or reuse) a 3D view named EXPORT_VIEW_NAME with the base Walls/Doors/Windows
    categories hidden, so only the generated framing + drywall (Generic Models) is visible. The
    assembly sits flush inside the existing wall, so the base wall otherwise hides / z-fights with
    it. This is also the isolation view the Phase-3 USD/Isaac export will use. Best-effort: any
    failure is reported but never aborts generation. Returns a short status string."""
    if not CREATE_EXPORT_VIEW:
        return "disabled"
    try:
        view = None
        for v in FilteredElementCollector(doc).OfClass(View3D):
            try:
                if (not v.IsTemplate) and v.Name == EXPORT_VIEW_NAME:
                    view = v
                    break
            except:
                pass
        if view is None:
            vft = None
            for t in FilteredElementCollector(doc).OfClass(ViewFamilyType):
                try:
                    if t.ViewFamily == ViewFamily.ThreeDimensional:
                        vft = t
                        break
                except:
                    pass
            if vft is None:
                warnings.append("Export view: no 3D ViewFamilyType found; skipped.")
                return "no_view_type"
            view = View3D.CreateIsometric(doc, vft.Id)
            try:
                view.Name = EXPORT_VIEW_NAME
            except:
                pass
        # Isolate to ONLY the generated assembly: hide every model category except Generic Model,
        # so the base wall (and doors/windows/floors/etc.) are absent when you export FROM this
        # view. Guarantees the old wall is not seen in the sim.
        try:
            gm_id = ElementId(BuiltInCategory.OST_GenericModel)
            ef_id = ElementId(BuiltInCategory.OST_ElectricalFixtures)   # outlets stay visible
            for cat in doc.Settings.Categories:
                try:
                    if cat.CategoryType != CategoryType.Model or cat.Id == gm_id or cat.Id == ef_id:
                        continue
                    if view.CanCategoryBeHidden(cat.Id):
                        view.SetCategoryHidden(cat.Id, True)
                except:
                    pass
        except Exception as ex:
            warnings.append("Export view isolation partial: {}".format(ex))
        return EXPORT_VIEW_NAME
    except Exception as ex:
        warnings.append("Export view creation failed: {}".format(ex))
        return "failed"


# ------------------------------------------------------------
# Framing geometry helpers  (Phase 1, VERBATIM from v4)
# ------------------------------------------------------------

def stud_lines(run_lo, run_hi, opening_rects):
    """Stud x-positions across the assembly run [run_lo, run_hi]: 16" OC from run_lo, an end stud
    at run_hi, plus a stud line at every opening jamb. run_lo/run_hi are pulled in from the wall
    ends at corners so studs don't run past where the assembly stops."""
    xs = []
    x = run_lo
    while x <= run_hi + 0.001:
        xs.append(x)
        x += STUD_SPACING_FT
    if not xs:
        xs.append(run_lo)
    if abs(xs[-1] - run_hi) > 0.1:
        xs.append(run_hi)
    for (ox0, oy0, ox1, oy1) in opening_rects:
        xs.append(clamp(ox0, run_lo, run_hi))
        xs.append(clamp(ox1, run_lo, run_hi))
    return unique_sorted([clamp(v, run_lo, run_hi) for v in xs])


def board_bbox(shape):
    """Bounding rect (x0,y0,x1,y1) of any board shape, for screw placement."""
    if shape[0] == "poly":
        xs = [p[0] for p in shape[1]]
        ys = [p[1] for p in shape[1]]
        return (min(xs), min(ys), max(xs), max(ys))
    return shape[1]        # rect / hole / multicut all carry the outer/sheet rect first


def screw_points(bx, stud_xs, opening_rects):
    """Screw (x, y) columns along each stud line crossing board-bbox bx. Per USG/GA-216, every
    screw is set back at least SCREW_EDGE_SETBACK_FT from the board's edges and ends. A stud that
    lands on a board's left/right edge carries a BUTT JOINT (or wall end): its screw column is
    shifted INTO this board by the setback, so the screw sits beside the joint - never on it - and
    the neighboring board straddles the joint from its own side (a screw each side, as required).
    Interior (field) studs get a column on the stud line. Points inside openings are skipped."""
    x0, y0, x1, y1 = bx
    sb = SCREW_EDGE_SETBACK_FT
    tol = SCREW_EDGE_TOL_FT
    pts = []
    for sx in stud_xs:
        if sx < x0 - tol or sx > x1 + tol:
            continue
        if abs(sx - x0) <= tol:
            colx = x0 + sb          # left edge / butt joint -> set back into this board
        elif abs(sx - x1) <= tol:
            colx = x1 - sb          # right edge / butt joint -> set back into this board
        else:
            colx = sx               # field stud
        if colx <= x0 + 1e-3 or colx >= x1 - 1e-3:
            continue
        lo = y0 + sb
        hi = y1 - sb
        cand = []
        if hi < lo:
            cand.append((y0 + y1) / 2.0)      # board too short: one screw at mid-height
        else:
            v = lo
            while v <= hi + 1e-6:
                cand.append(v)
                v += SCREW_SPACING_FT
            if not cand or abs(cand[-1] - hi) > 1e-3:
                cand.append(hi)               # perimeter screw near the far edge, set back
        for cy in cand:
            inside = False
            for (ox0, oy0, ox1, oy1) in opening_rects:
                if ox0 - 0.01 < colx < ox1 + 0.01 and oy0 - 0.01 < cy < oy1 + 0.01:
                    inside = True
                    break
            if not inside:
                pts.append((colx, cy))
    return pts


def stud_segments(sx, wall_height, opening_rects):
    blocks = []
    for (ox0, oy0, ox1, oy1) in opening_rects:
        if ox0 + 0.01 < sx < ox1 - 0.01:
            b0 = max(0.0, oy0)
            b1 = min(wall_height, oy1)
            if b1 > b0:
                blocks.append((b0, b1))
    if not blocks:
        return [(0.0, wall_height)]
    blocks.sort()
    segments = []
    cur = 0.0
    for (b0, b1) in blocks:
        if b0 > cur:
            segments.append((cur, b0))
        cur = max(cur, b1)
    if cur < wall_height:
        segments.append((cur, wall_height))
    return segments


def is_jamb_line(sx, opening_rects, tol=0.02):
    for (ox0, oy0, ox1, oy1) in opening_rects:
        if abs(sx - ox0) <= tol or abs(sx - ox1) <= tol:
            return True
    return False


def is_interior_line(sx, opening_rects):
    for (ox0, oy0, ox1, oy1) in opening_rects:
        if ox0 + 0.01 < sx < ox1 - 0.01:
            return True
    return False


def subtract_intervals(full_lo, full_hi, cuts):
    segments = [(full_lo, full_hi)]
    for (clo, chi) in cuts:
        new_segs = []
        for (lo, hi) in segments:
            if chi <= lo or clo >= hi:
                new_segs.append((lo, hi))
                continue
            if clo > lo:
                new_segs.append((lo, clo))
            if chi < hi:
                new_segs.append((chi, hi))
        segments = new_segs
    return segments


def ds_comment(wall_id, face_name, kind, eid):
    return "{} | WALL={} | {} | {} | {}".format(APP_ID, wall_id, face_name, kind, eid)


# {kind: (material_id, graphics_style_id)}; populated in the transaction.
styles = {}


def jamb_flip(sx, opening_rects, tol=0.02):
    """A jamb stud should present its WEB (closed back of the C) to the opening so the frame/trim
    bears on and fastens to solid steel. The C-profile's web is on the -u side by default (mouth
    opens toward +u), which is correct for a RIGHT jamb (opening on the -u side). For a LEFT jamb
    (opening on the +u side, i.e. sx coincides with an opening's ox0), the stud must be flipped so
    its web faces +u toward the opening. Returns True to flip. A stud that is a right jamb for any
    opening stays un-flipped (can't face two ways; the -u opening wins)."""
    left = False
    right = False
    for (ox0, oy0, ox1, oy1) in opening_rects:
        if abs(sx - ox1) <= tol:
            right = True
        if abs(sx - ox0) <= tol:
            left = True
    return left and not right


def emit_member(origin, ax, ay, extrude_dir, depth, profile, kind, wall_id, wall_tag,
                st_counter, warnings, is_soffit_band=False, min_depth=None):
    """Build one framing member. It is named ST-<wall>-<n> from the flat per-wall framing counter
    st_counter (a 1-element list); the number is consumed only when the DirectShape is actually
    created, so names stay contiguous. The member's true type is passed on in the Comments (kind).
    is_soffit_band=True (a soffit's own elevated band wall) overrides the VISUAL rendering to match
    the drywall finish: material AND shape (user 2026-07-27: matching just the material/color left
    the true C/U-channel's flanges and lips still visibly reading as a differently-shaped member
    than a flat board next to it - "make sure it levels and looks as same like the neighbour
    drywall" - so the true profile is replaced with a flat rectangular slab spanning the SAME
    bounding footprint the channel occupied, which can only fill in the channel's own hollow
    interior and can never extend past its original extent, so no new overlap is introduced).
    The Comments/Mark/manifest still correctly record the member's real kind (STUD/TRACK/etc.);
    only the rendered geometry+color change. min_depth overrides the default MIN_SEG_FT floor -
    callers pass a smaller value (down to near-zero) when depth is known to be a wall's own WHOLE,
    unfragmented run rather than a leftover splitting fragment (see the track-emission call sites:
    a wall shorter than MIN_SEG_FT itself, e.g. a ~2.5in jamb-stub segment in a doorway modeled as
    several separate wall pieces, must still get its own track - user report 2026-07-31, ST-008-
    001/002 had studs but no track/drywall at all). Returns (created 1/0, name or None)."""
    if depth < (MIN_SEG_FT if min_depth is None else min_depth):
        return 0, None
    style_kind = "GWB" if is_soffit_band else kind
    mat_id, gs_id = styles.get(style_kind, (None, None))
    render_profile = profile
    if is_soffit_band and profile:
        xs = [p[0] for p in profile]
        ys = [p[1] for p in profile]
        x0, x1, y0, y1 = min(xs), max(xs), min(ys), max(ys)
        render_profile = [(x0, y0), (x1, y0), (x1, y1), (x0, y1)]
    solid = make_profile_solid(origin, ax, ay, render_profile, extrude_dir, depth, mat_id, gs_id)
    if solid is None:
        return 0, None
    name = "ST-{}-{:03d}".format(wall_tag, st_counter[0] + 1)
    ds = create_directshape(solid, name, name, ds_comment(wall_id, "-", kind, name), warnings)
    if not ds:
        return 0, None
    st_counter[0] += 1
    return 1, name


def emit_framing(wall_id, wall_tag, st_counter, start, u, z, orientation, stud_inner_off,
                 track_inner_off, c_profile, u_profile, stud_depth, stud_xs, run_lo, run_hi,
                 wall_height, opening_rects, frecords, warnings, is_soffit_band=False):
    """Emit all Phase-1 framing across the assembly run [run_lo, run_hi] (pulled in from the wall
    ends at corners so it doesn't overlap a joined wall). stud_inner_off / track_inner_off are
    signed offsets from the Location Line to the interior face of the stud / track; c_profile /
    u_profile carry the through-wall depth. Every member is named ST-<wall>-<n> in one flat
    per-wall sequence (st_counter); its real type is preserved in the Member_Type record field.
    Appends a manifest record per member to frecords."""
    counts = {"studs": 0, "cripples": 0, "kings": 0, "jacks": 0,
              "tracks": 0, "headers": 0, "sills": 0}

    down = XYZ(0, 0, -1)
    depth_off = orientation.Multiply(stud_inner_off)
    track_off = orientation.Multiply(track_inner_off)
    u_neg = u.Multiply(-1.0)     # flange axis for flipped (left-jamb) studs: web faces the opening

    def rec(name, kind, profile, length_ft, grid_index):
        frecords.append({
            "id": name, "wall_number": wall_tag, "host_wall": wall_id,
            "member_type": kind, "function": kind,
            "profile": profile, "web_depth_in": round(stud_depth * 12.0, 3),
            "flange_in": round(FLANGE_FT * 12.0, 3), "lip_in": round(LIP_FT * 12.0, 3),
            "gauge_mils": int(round(MAT_T_FT * 12.0 * 1000.0)),
            "length_in": round(length_ft * 12.0, 3), "grid_index": grid_index,
            "install_order": len(frecords) + 1,
        })

    for si, sx in enumerate(stud_xs):
        jamb = is_jamb_line(sx, opening_rects)
        interior = is_interior_line(sx, opening_rects)
        flip = jamb and jamb_flip(sx, opening_rects)   # left-jamb studs turn their web to the opening
        for (sy0, sy1) in stud_segments(sx, wall_height, opening_rects):
            if (sy1 - sy0) < MIN_SEG_FT:
                continue
            if jamb:
                kind, key = "KINGSTUD", "kings"
            elif interior:
                kind, key = "CRIPPLE", "cripples"
            else:
                kind, key = "STUD", "studs"
            # Flipping the flange axis mirrors the C about sx, so shift the origin +F/2 (not -F/2)
            # to keep the stud centered on the stud line.
            su = (sx + FLANGE_FT / 2.0) if flip else (sx - FLANGE_FT / 2.0)
            flange_axis = u_neg if flip else u
            origin = start.Add(u.Multiply(su)).Add(depth_off).Add(z.Multiply(sy0))
            n, name = emit_member(origin, orientation, flange_axis, z, sy1 - sy0,
                                  c_profile, kind, wall_id, wall_tag, st_counter, warnings,
                                  is_soffit_band)
            counts[key] += n
            if n:
                rec(name, kind, "C", sy1 - sy0, si)

    door_cuts = [(ox0, ox1) for (ox0, oy0, ox1, oy1) in opening_rects if oy0 <= 0.05]
    for (x0, x1) in subtract_intervals(run_lo, run_hi, door_cuts):
        # MIN_SAFE_SEGMENT_FT, not the bare MIN_SEG_FT floor: a leftover this close to a door can
        # only be dropped, never merged (the "neighbor" on its other side is the door opening
        # itself - fusing across it would put track material through the doorway). But that logic
        # only applies to an actual REMNANT of a subtraction - when there are no door_cuts at all,
        # subtract_intervals returns the run UNCHANGED, so this interval IS the wall's own entire
        # run, not a leftover fragment; dropping it for being short leaves a real (if tiny) wall
        # with no track at all (user report 2026-07-31: a 4.5in jamb-stub wall segment got studs
        # but zero track/drywall coverage). Only the floor from an actual cut is safe to enforce.
        if door_cuts and (x1 - x0) < MIN_SAFE_SEGMENT_FT:
            continue
        origin = start.Add(u.Multiply(x0)).Add(track_off).Add(z.Multiply(0.0))
        # min_depth: bypass emit_member's own MIN_SEG_FT floor too, but ONLY when this interval is
        # the wall's own whole run (no door_cuts) - a real fragment (door_cuts nonempty) already
        # cleared the MIN_SAFE_SEGMENT_FT check above and should still respect the normal floor.
        n, name = emit_member(origin, orientation, z, u, x1 - x0,
                              u_profile, "TRACK", wall_id, wall_tag, st_counter, warnings,
                              is_soffit_band, min_depth=(None if door_cuts else 1e-4))
        counts["tracks"] += n
        if n:
            rec(name, "TRACK", "U", x1 - x0, -1)

    ceil_cuts = [(ox0, ox1) for (ox0, oy0, ox1, oy1) in opening_rects if oy1 >= wall_height - 0.05]
    for (x0, x1) in subtract_intervals(run_lo, run_hi, ceil_cuts):
        # Same reasoning as the door-track check above: the floor only applies to an actual
        # leftover from a real cut, never to the wall's own whole (uncut) run.
        if ceil_cuts and (x1 - x0) < MIN_SAFE_SEGMENT_FT:
            continue
        origin = start.Add(u.Multiply(x0)).Add(track_off).Add(z.Multiply(wall_height))
        n, name = emit_member(origin, orientation, down, u, x1 - x0,
                              u_profile, "TRACK", wall_id, wall_tag, st_counter, warnings,
                              is_soffit_band, min_depth=(None if ceil_cuts else 1e-4))
        counts["tracks"] += n
        if n:
            rec(name, "TRACK", "U", x1 - x0, -1)

    for (ox0, oy0, ox1, oy1) in opening_rects:
        span = ox1 - ox0
        is_window = oy0 > 0.05

        if span >= MIN_SEG_FT:
            origin = start.Add(u.Multiply(ox0)).Add(depth_off).Add(z.Multiply(oy1))
            n, name = emit_member(origin, orientation, z, u, span,
                                  c_profile, "HEADER", wall_id, wall_tag, st_counter, warnings,
                                  is_soffit_band)
            counts["headers"] += n
            if n:
                rec(name, "HEADER", "C", span, -1)

        if is_window and span >= MIN_SEG_FT:
            origin = start.Add(u.Multiply(ox0)).Add(depth_off).Add(z.Multiply(oy0 - FLANGE_FT))
            n, name = emit_member(origin, orientation, z, u, span,
                                  c_profile, "SILL", wall_id, wall_tag, st_counter, warnings,
                                  is_soffit_band)
            counts["sills"] += n
            if n:
                rec(name, "SILL", "C", span, -1)

        jack_bottom = oy0 if is_window else 0.0
        jack_h = oy1 - jack_bottom
        if jack_h >= MIN_SEG_FT:
            jx_positions = [clamp(ox0 + FLANGE_FT, run_lo, run_hi),
                            clamp(ox1 - FLANGE_FT, run_lo, run_hi)]
            for jn, jx in enumerate(jx_positions):
                # jn == 0 is the left jamb jack (opening on its +u side) -> flip so the web faces
                # the opening; jn == 1 is the right jamb jack -> default orientation.
                jflip = (jn == 0)
                jsu = (jx + FLANGE_FT / 2.0) if jflip else (jx - FLANGE_FT / 2.0)
                jaxis = u_neg if jflip else u
                origin = start.Add(u.Multiply(jsu)).Add(depth_off).Add(z.Multiply(jack_bottom))
                n, name = emit_member(origin, orientation, jaxis, z, jack_h,
                                      c_profile, "JACK", wall_id, wall_tag, st_counter, warnings,
                                      is_soffit_band)
                counts["jacks"] += n
                if n:
                    rec(name, "JACK", "C", jack_h, -1)

    return counts


# ------------------------------------------------------------
# Drywall layout  (Phase 2, NEW)
# ------------------------------------------------------------

def normalize_shift(shift):
    try:
        s = float(shift)
    except:
        s = 0.0
    while s < 0.0:
        s += PANEL_LENGTH_FT
    while s >= PANEL_LENGTH_FT:
        s -= PANEL_LENGTH_FT
    return s


def generate_courses(wall_height, v_start):
    """Horizontal course bands covering [0, wall_height]. Boundaries at v_start + k*PANEL_HEIGHT
    (v_start staggers courses between stacked layers). Returns [(cy0, cy1, row), ...]."""
    rows = []
    y = v_start
    while y > 0.0:
        y -= PANEL_HEIGHT_FT
    row = 0
    cy = y
    while cy < wall_height - 1e-4:
        cy0 = max(0.0, cy)
        cy1 = min(wall_height, cy + PANEL_HEIGHT_FT)
        if (cy1 - cy0) >= MIN_PIECE_HEIGHT_FT:
            rows.append((cy0, cy1, row))
        cy += PANEL_HEIGHT_FT
        row += 1
    return rows


def row_joint_xs(row_shift, wall_length):
    """Interior vertical butt-joint x-positions for a course laid with the given left shift."""
    xs = []
    x = -row_shift + PANEL_LENGTH_FT
    while x < wall_length - 1e-4:
        if x > 1e-4:
            xs.append(x)
        x += PANEL_LENGTH_FT
    return xs


def joints_conflict(xs, opening_rects, clear):
    for xj in xs:
        for (ox0, oy0, ox1, oy1) in opening_rects:
            if abs(xj - ox0) < clear or abs(xj - ox1) < clear:
                return True
    return False


def adjust_row_shift(row_shift, wall_length, opening_rects):
    """Nudge a course's left shift so no butt joint lands within JOINT_CLEAR_FT of an opening
    jamb (the 'joints toward mid-opening, never at corners' rule). Heuristic; if no nudge clears
    every jamb it returns the original shift."""
    if not AVOID_JOINTS_AT_JAMBS or not opening_rects:
        return row_shift, False
    if not joints_conflict(row_joint_xs(row_shift, wall_length), opening_rects, JOINT_CLEAR_FT):
        return row_shift, False
    for d in (JOINT_CLEAR_FT * 1.5, -JOINT_CLEAR_FT * 1.5, JOINT_CLEAR_FT * 3.0,
              -JOINT_CLEAR_FT * 3.0, PANEL_LENGTH_FT * 0.25, PANEL_LENGTH_FT * 0.5):
        cand = normalize_shift(row_shift + d)
        if not joints_conflict(row_joint_xs(cand, wall_length), opening_rects, JOINT_CLEAR_FT):
            return cand, True
    return row_shift, False


def _is_soffit_ceiling(ceiling):
    """Detect a soffit two ways: (1) the element's own Revit CATEGORY name (e.g. 'Roof Soffits') -
    needs no GetTypeId() hop, so it works even in the bridge's exec() context where
    doc.GetElement(ceiling.GetTypeId()).Name throws 'property cannot be read' (confirmed for both
    Walls and Ceilings via bridge diagnostics; a real soffit's TYPE NAME can be a generic
    "Generic - 4in" with no "soffit" in it at all). (2) the type/family name containing "soffit"
    (the ceiling script's own ceiling_prefix() test - covers a soffit built as a plain
    Ceiling-category type someone named "Soffit - ..."; works in normal Dynamo execution, silently
    skipped, not broken, when GetTypeId() is unavailable)."""
    try:
        cat = ceiling.Category
        if cat is not None and cat.Name and "soffit" in cat.Name.lower():
            return True
    except Exception:
        pass
    names = []
    try:
        ct = doc.GetElement(ceiling.GetTypeId())
        if ct is not None:
            try:
                names.append(ct.Name)
            except Exception:
                pass
            try:
                if ct.FamilyName:
                    names.append(ct.FamilyName)
            except Exception:
                pass
    except Exception:
        pass
    for nm in names:
        try:
            if "soffit" in nm.lower():
                return True
        except Exception:
            pass
    return False


def _is_soffit_band_wall(wall):
    """A wall that is itself part of the soffit assembly (an elevated Generic-2' band forming the
    soffit's wrap) - it must NEVER be clipped against the soffit obstacles, since its whole purpose
    is to butt flush against the ceiling and the other bands with zero gap."""
    try:
        return wall.Name == SOFFIT_BAND_WALL_TYPE_NAME
    except Exception:
        return False


def _solids_of(e):
    out = []
    try:
        opt = Options()
        geo = e.get_Geometry(opt)
        if geo is None:
            return out
        for g in geo:
            if isinstance(g, Solid) and g.Volume > 1e-9:
                out.append(g)
    except Exception:
        pass
    return out


def trim_drywall_from_neighbor_studs(warnings):
    """Post-pass, run once after every wall's own framing+drywall is placed (and after the cross-
    wall gap-fill, so it also covers anything that pass creates): a drywall board must never
    physically intrude into a DIFFERENT wall's framing OR a different wall's own drywall. Two
    independent walls meeting at a corner with a small real gap between their modeled endpoints
    (very common - this whole environment's walls are full of 0.1-0.5ft endpoint offsets) each
    place their own studs/boards from their OWN geometry alone; neither knows the other's exact
    stud/board position, so the two can end up with a real, small physical clash right at the
    corner - confirmed live, 2026-07-31, on multiple independent corners (wall 395748 into
    ST-004-001; wall 383365 into ST-022-003), a systemic pattern fixed generally rather than by
    chasing each corner's exact cause in corner_face_extents. The end-stud-coverage widening in
    corner_face_extents (also 2026-07-31 - a stud's own half-flange overhang past its wall's
    boundary needs covering) deliberately leans on this SAME safety net rather than adding its own
    collinear-style clamp, since widening every wall's board can just as easily reach into a
    neighbor's DRYWALL as into its framing (confirmed live: 30 new DP-vs-DP overlaps model-wide
    the first time widening shipped, all at different-host board-vs-board corners).
    Phase 1: for every DP-* board, finds any ST-* stud/track belonging to a DIFFERENT wall host
    that it really (boolean) intersects, and SUBTRACTS that stud's solid from the board - drywall
    always defers to framing it doesn't own.
    Phase 2: for every PAIR of DP-* boards from DIFFERENT hosts that really intersect, subtracts
    the lexicographically-earlier mark's CURRENT solid from the later one's (deterministic, so a
    pair is never processed both ways) - an arbitrary tie-break is fine here since both boards are
    already independently valid; only the sliver where they overlap needs to go somewhere.
    Both phases only ever remove material (a boolean difference can't create a new overlap
    elsewhere), and a board is left untouched if a subtraction would erase it entirely (defensive;
    not expected to happen at this scale). Returns the total count of boards trimmed (both phases
    combined)."""
    try:
        doc.Regenerate()
    except Exception as ex:
        warnings.append("doc.Regenerate() before neighbor-stud trim failed ({})".format(ex))
    boards = []
    studs = []
    try:
        for ds in FilteredElementCollector(doc).OfClass(DirectShape).ToElements():
            try:
                cm = ds.get_Parameter(BuiltInParameter.ALL_MODEL_INSTANCE_COMMENTS)
                comments = cm.AsString() if cm else None
            except Exception:
                comments = None
            if not comments or not comments.startswith(APP_ID + " |"):
                continue
            host = None
            for tok in comments.split("|"):
                tok = tok.strip()
                if tok.startswith("WALL="):
                    host = tok
            if host is None:
                continue
            try:
                mk = ds.get_Parameter(BuiltInParameter.ALL_MODEL_MARK)
                mark = mk.AsString() if mk else None
            except Exception:
                mark = None
            if not mark:
                continue
            bb = ds.get_BoundingBox(None)
            if bb is None:
                continue
            if mark.startswith("DP-"):
                boards.append({"ds": ds, "mark": mark, "host": host, "bbox": bb})
            elif mark.startswith("ST-"):
                studs.append({"ds": ds, "mark": mark, "host": host, "bbox": bb})
    except Exception as ex:
        warnings.append("trim_drywall_from_neighbor_studs scan failed: {}".format(ex))
        return 0

    trimmed = 0
    pad = 0.05
    for b in boards:
        bb = b["bbox"]
        cur_solids = None
        board_changed = False
        for s in studs:
            if s["host"] == b["host"]:
                continue                            # own wall's framing - never trimmed against
            sbb = s["bbox"]
            if (sbb.Max.X < bb.Min.X - pad or sbb.Min.X > bb.Max.X + pad or
                    sbb.Max.Y < bb.Min.Y - pad or sbb.Min.Y > bb.Max.Y + pad or
                    sbb.Max.Z < bb.Min.Z - pad or sbb.Min.Z > bb.Max.Z + pad):
                continue
            if cur_solids is None:
                cur_solids = _solids_of(b["ds"])
                if not cur_solids:
                    break
            new_solids = []
            for sol in cur_solids:
                stud_solids = _solids_of(s["ds"])
                cut = sol
                for ssol in stud_solids:
                    try:
                        inter = BooleanOperationsUtils.ExecuteBooleanOperation(
                            cut, ssol, BooleanOperationsType.Intersect)
                    except Exception:
                        inter = None
                    if inter is None or inter.Volume <= 1e-7:
                        continue
                    try:
                        diff = BooleanOperationsUtils.ExecuteBooleanOperation(
                            cut, ssol, BooleanOperationsType.Difference)
                    except Exception:
                        diff = None
                    if diff is not None and diff.Volume > 1e-7:
                        cut = diff
                        board_changed = True
                    else:
                        warnings.append("{}: neighbor-stud trim against {} would erase the board - "
                                        "left untouched".format(b["mark"], s["mark"]))
                new_solids.append(cut)
            cur_solids = new_solids
        if board_changed:
            try:
                shape = List[GeometryObject]()
                for sol in cur_solids:
                    shape.Add(sol)
                b["ds"].SetShape(shape)
                trimmed += 1
            except Exception as ex:
                warnings.append("{}: neighbor-stud trim SetShape failed ({})".format(b["mark"], ex))

    # A SetShape() without a following Regenerate() can leave _solids_of() returning STALE (pre-
    # trim) geometry for that same element on its NEXT fetch - the exact bug class already found
    # and fixed for the wall gap-fill's audit and the ceiling merge's bbox update. Phase 2 refetches
    # every board's solids fresh at each pairing, so it needs this regenerate boundary before it
    # starts (confirmed live, 2026-07-31: without it, a board trimmed correctly in one Phase 2
    # pairing silently lost that trim when a later pairing re-fetched its stale pre-trim solid and
    # recomputed/re-applied SetShape from it).
    try:
        doc.Regenerate()
    except Exception as ex:
        warnings.append("doc.Regenerate() before neighbor-board trim (phase 2) failed ({})".format(ex))

    # Phase 2: DP-vs-DP, different hosts (see docstring). Broad-phase bboxes may be stale for a
    # board Phase 1 just trimmed (its real solid only ever shrank, never grew, from that), which
    # only risks a few harmless extra real-boolean checks that come back empty - never a missed
    # true positive - so no bbox refresh is needed between phases.
    n = len(boards)
    for i in range(n):
        bi = boards[i]
        for j in range(i + 1, n):
            bj = boards[j]
            if bi["host"] == bj["host"]:
                continue
            a, b2 = (bi, bj) if bi["mark"] < bj["mark"] else (bj, bi)
            bba, bbb = a["bbox"], b2["bbox"]
            if (bba.Max.X < bbb.Min.X - pad or bbb.Max.X < bba.Min.X - pad or
                    bba.Max.Y < bbb.Min.Y - pad or bbb.Max.Y < bba.Min.Y - pad or
                    bba.Max.Z < bbb.Min.Z - pad or bbb.Max.Z < bba.Min.Z - pad):
                continue
            a_solids = _solids_of(a["ds"])
            b_solids = _solids_of(b2["ds"])
            if not a_solids or not b_solids:
                continue
            new_solids = []
            board_changed = False
            for sol in b_solids:
                cut = sol
                for asol in a_solids:
                    try:
                        inter = BooleanOperationsUtils.ExecuteBooleanOperation(
                            cut, asol, BooleanOperationsType.Intersect)
                    except Exception:
                        inter = None
                    if inter is None or inter.Volume <= 1e-7:
                        continue
                    try:
                        diff = BooleanOperationsUtils.ExecuteBooleanOperation(
                            cut, asol, BooleanOperationsType.Difference)
                    except Exception:
                        diff = None
                    if diff is not None and diff.Volume > 1e-7:
                        cut = diff
                        board_changed = True
                    else:
                        warnings.append("{}: neighbor-board trim against {} would erase the board "
                                        "- left untouched".format(b2["mark"], a["mark"]))
                new_solids.append(cut)
            if board_changed:
                try:
                    shape = List[GeometryObject]()
                    for sol in new_solids:
                        shape.Add(sol)
                    b2["ds"].SetShape(shape)
                    trimmed += 1
                    try:
                        doc.Regenerate()
                    except Exception:
                        pass
                except Exception as ex:
                    warnings.append("{}: neighbor-board trim SetShape failed ({})".format(b2["mark"], ex))
    return trimmed


def validate_wall_coverage(warnings):
    """Post-pass, run once after every wall's own framing+drywall is placed: for every wall host
    tag that has at least one real framing member (a STUD/KINGSTUD/CRIPPLE), confirms it also has
    at least one TRACK and (when GENERATE_DRYWALL is on) at least one DP-<host>-* drywall board -
    catching the "studs exist but nothing covers them" failure mode automatically, in THIS run's
    own output, instead of relying on a person to notice bare framing by eye later. Found three
    separate times during a 2026-07-31 wall-by-wall review (a short jamb-stub wall's corner-extent
    computation inverting to empty, a neighbor's corner-wrap sailing through it, and the absolute
    minimum-piece-size floor rejecting an even shorter wall's own whole run) - each was a REAL,
    dangerous exposed-framing defect that would otherwise have shipped silently. This does not fix
    anything itself; it turns a silent gap into a loud, impossible-to-miss warning in the SAME run
    that created it. Returns the count of wall hosts found with a coverage gap."""
    try:
        doc.Regenerate()
    except Exception as ex:
        warnings.append("doc.Regenerate() before wall coverage validation failed ({})".format(ex))
    by_host = {}
    try:
        for ds in FilteredElementCollector(doc).OfClass(DirectShape).ToElements():
            try:
                cm = ds.get_Parameter(BuiltInParameter.ALL_MODEL_INSTANCE_COMMENTS)
                comments = cm.AsString() if cm else None
            except Exception:
                comments = None
            if not comments or not comments.startswith(APP_ID + " |"):
                continue
            host = None
            for tok in comments.split("|"):
                tok = tok.strip()
                if tok.startswith("WALL="):
                    host = tok
            if host is None:
                continue
            try:
                mk = ds.get_Parameter(BuiltInParameter.ALL_MODEL_MARK)
                mark = mk.AsString() if mk else None
            except Exception:
                mark = None
            if not mark:
                continue
            rec = by_host.setdefault(host, {"framing": 0, "tracks": 0, "boards": 0})
            if mark.startswith("DP-"):
                rec["boards"] += 1
            elif mark.startswith("ST-"):
                if "| TRACK |" in comments:
                    rec["tracks"] += 1
                else:
                    rec["framing"] += 1
    except Exception as ex:
        warnings.append("validate_wall_coverage scan failed: {}".format(ex))
        return 0
    bad = 0
    for host, rec in sorted(by_host.items()):
        if rec["framing"] == 0:
            continue                                # nothing to cover in the first place
        missing = []
        if rec["tracks"] == 0:
            missing.append("no track")
        if GENERATE_DRYWALL and rec["boards"] == 0:
            missing.append("no drywall")
        if missing:
            bad += 1
            warnings.append("COVERAGE GAP {}: {} framing member(s), {} - exposed framing, "
                            "needs investigation".format(host, rec["framing"], ", ".join(missing)))
    return bad


def close_small_cross_wall_gaps(warnings):
    """Post-pass, run once after every wall's own drywall is placed: closes small (<=
    CROSS_WALL_GAP_FILL_MAX_FT) real residual gaps between two DIFFERENT walls' drywall boards at
    the SAME course/Z-band. See CROSS_WALL_GAP_FILL_MAX_FT above for the full rationale (a real
    "post" junction where several walls converge with a slight modeled offset, and each wall's
    own independent corner-butt logic only knows about its OWN end).

    Safety rules (all re-verified from the model's CURRENT state, never assumed):
      - Only ever EXTENDS a board (grows material into an already-measured-empty strip) - never
        shrinks or clips one.
      - Only touches a board that is CURRENTLY a plain rectangular slab: its real solid volume is
        checked against its own bbox volume, so a board with an opening/partition cut is never
        candidate (extending a notched board via a simple bbox rebuild could wrongly fill the cut).
      - After building the extended solid, re-checks by real boolean intersection against every
        OTHER nearby board/stud (excluding the one neighbor it was built to exactly touch) - if
        that finds any new overlap, the extension is abandoned and warned, not forced through.
      - A gap on BOTH axes (diagonal, not face-to-face) is left alone - only a gap that is small
        on exactly one axis while the other axis fully overlaps is a genuine corner-notch case.
      - Which of the two boards grows is decided once, deterministically (lexicographic Mark
        compare), so the same pair is never processed from both directions.
    Returns the count of gaps actually closed."""
    try:
        # Every board this pass needs to see was just created earlier in THIS SAME transaction -
        # FilteredElementCollector can silently miss elements created mid-transaction until the
        # document is regenerated (same lesson already learned for collect_soffit_assembly_solids).
        try:
            doc.Regenerate()
        except Exception as ex:
            warnings.append("doc.Regenerate() before small-gap-fill scan failed ({})".format(ex))
        boards = []
        for ds in FilteredElementCollector(doc).OfClass(DirectShape).ToElements():
            try:
                cm = ds.get_Parameter(BuiltInParameter.ALL_MODEL_INSTANCE_COMMENTS)
                comments = cm.AsString() if cm else None
            except Exception:
                comments = None
            if not comments or not comments.startswith(APP_ID + " |"):
                continue
            try:
                mk = ds.get_Parameter(BuiltInParameter.ALL_MODEL_MARK)
                mark = mk.AsString() if mk else None
            except Exception:
                mark = None
            if not mark or not mark.startswith("DP-"):
                continue
            host = None
            kind_layer = "GWB"
            for tok in comments.split("|"):
                tok = tok.strip()
                if tok.startswith("WALL="):
                    host = tok
                if tok == "L1":
                    kind_layer = "GWB2"
            if host is None:
                continue
            bb = ds.get_BoundingBox(None)
            if bb is None:
                continue
            solids = _solids_of(ds)
            vol = sum(s.Volume for s in solids)
            bbox_vol = (max(0.0, bb.Max.X - bb.Min.X) * max(0.0, bb.Max.Y - bb.Min.Y) *
                        max(0.0, bb.Max.Z - bb.Min.Z))
            is_plain_box = bbox_vol > 1e-9 and abs(vol - bbox_vol) < max(1e-6, bbox_vol * 0.01)
            boards.append({"ds": ds, "mark": mark, "host": host, "bbox": bb,
                           "kind_layer": kind_layer, "is_plain_box": is_plain_box})

        closed = 0
        attempted = set()
        extended = []
        n = len(boards)
        for i in range(n):
            bi = boards[i]
            if bi["mark"] in attempted:
                continue
            for j in range(n):
                if i == j:
                    continue
                bj = boards[j]
                if bj["host"] == bi["host"] or bj["mark"] in attempted:
                    continue
                bbi, bbj = bi["bbox"], bj["bbox"]
                # A meaningful Z-OVERLAP, not an exact course-boundary match: two walls meeting
                # at a corner can have entirely different course boundaries if their heights or
                # base offsets differ (e.g. a full-height wall next to an elevated band wall) -
                # what matters is that they share real height in common to face each other across.
                z_overlap = min(bbi.Max.Z, bbj.Max.Z) - max(bbi.Min.Z, bbj.Min.Z)
                if z_overlap < 0.5:
                    continue
                gx = max(bbi.Min.X - bbj.Max.X, bbj.Min.X - bbi.Max.X, 0.0)
                gy = max(bbi.Min.Y - bbj.Max.Y, bbj.Min.Y - bbi.Max.Y, 0.0)
                if gx > 1e-6 and gy > 1e-6:
                    continue                                    # diagonal, not face-to-face
                gap_ft = gx if gx > gy else gy
                if gap_ft <= 1e-4 or gap_ft > CROSS_WALL_GAP_FILL_MAX_FT:
                    continue
                if not bi["is_plain_box"] or not bj["is_plain_box"]:
                    continue                                    # never guess on a cut board
                grower, neighbor = (bi, bj) if bi["mark"] < bj["mark"] else (bj, bi)
                if grower["mark"] in attempted or neighbor["mark"] in attempted:
                    continue
                gb, nb = grower["bbox"], neighbor["bbox"]
                nx0, ny0, nx1, ny1 = gb.Min.X, gb.Min.Y, gb.Max.X, gb.Max.Y
                if gx > gy:
                    if gb.Max.X <= nb.Min.X:
                        nx1 = nb.Min.X
                    else:
                        nx0 = nb.Max.X
                else:
                    if gb.Max.Y <= nb.Min.Y:
                        ny1 = nb.Min.Y
                    else:
                        ny0 = nb.Max.Y
                mat_id, gs_id = styles.get(grower["kind_layer"], (None, None))
                new_solid = make_world_axis_box(nx0, ny0, gb.Min.Z, nx1, ny1, gb.Max.Z, mat_id, gs_id)
                if new_solid is None:
                    attempted.add(grower["mark"])
                    continue
                bad = False
                for k in range(n):
                    bk = boards[k]
                    if bk["mark"] in (grower["mark"], neighbor["mark"]):
                        continue
                    bbk = bk["bbox"]
                    if (bbk.Max.X < nx0 - 0.01 or bbk.Min.X > nx1 + 0.01 or
                            bbk.Max.Y < ny0 - 0.01 or bbk.Min.Y > ny1 + 0.01 or
                            bbk.Max.Z < gb.Min.Z - 0.01 or bbk.Min.Z > gb.Max.Z + 0.01):
                        continue
                    for s2 in _solids_of(bk["ds"]):
                        try:
                            inter = BooleanOperationsUtils.ExecuteBooleanOperation(
                                new_solid, s2, BooleanOperationsType.Intersect)
                            if inter is not None and inter.Volume > 1e-7:
                                bad = True
                                break
                        except Exception:
                            continue
                    if bad:
                        break
                if bad:
                    attempted.add(grower["mark"])
                    warnings.append("{}: small-gap-fill toward {} skipped - would create a new "
                                    "overlap".format(grower["mark"], neighbor["mark"]))
                    continue
                try:
                    shape = List[GeometryObject]()
                    shape.Add(new_solid)
                    grower["ds"].SetShape(shape)
                    # grower is the SAME dict object stored in boards[] (not a copy), so updating
                    # its bbox here is immediately visible to every later pair's safety check in
                    # this same pass - without this, two SEPARATE growers could each pass their
                    # own check against the ORIGINAL (pre-extension) geometry, then collide with
                    # EACH OTHER once both are actually applied (confirmed as a real bug: a first
                    # version of this pass left 10 genuine new overlaps model-wide before this).
                    # Deliberately NOT re-querying ds.get_BoundingBox() here: immediately after
                    # SetShape(), before any doc.Regenerate(), it can return a STALE box that
                    # doesn't yet reflect the new geometry (confirmed: this stale value silently
                    # let a real overlap slip past both the later safety checks AND the final
                    # audit's pre-filter below, since it made the grower look smaller than it
                    # really is). We already know the true new extent exactly - it's what we just
                    # built the solid from - so construct the bbox from that directly.
                    new_bbox = BoundingBoxXYZ()
                    new_bbox.Min = XYZ(nx0, ny0, gb.Min.Z)
                    new_bbox.Max = XYZ(nx1, ny1, gb.Max.Z)
                    grower["pre_bbox"] = gb
                    grower["bbox"] = new_bbox
                    closed += 1
                    attempted.add(grower["mark"])
                    extended.append(grower)
                except Exception as ex:
                    warnings.append("{}: small-gap-fill SetShape failed ({})".format(grower["mark"], ex))

        # Final audit, unconditional: the per-pair safety check above only ever compares ONE
        # proposed extension against the model's state AT THAT MOMENT - it cannot see a later,
        # independent extension elsewhere in this same pass that ends up overlapping it once BOTH
        # are actually applied. Rather than rely on that per-pair check alone, re-verify every
        # board this pass touched against its FINAL, fully-settled geometry, and revert any that
        # still show a real boolean overlap with anything - this guarantees zero net-new overlap
        # regardless of ordering effects between independent extensions.
        # Every SetShape() call above only updates the element; re-fetching a solid via
        # _solids_of() before a Regenerate() can silently return the PRE-extension geometry
        # (same staleness class already documented for collect_soffit_assembly_solids()), which
        # would make this whole audit compare stale small solids and never find the real overlap.
        try:
            doc.Regenerate()
        except Exception as ex:
            warnings.append("doc.Regenerate() before small-gap-fill final audit failed ({})".format(ex))
        for grower in extended:
            ds = grower["ds"]
            solids = _solids_of(ds)
            if not solids:
                continue
            gbb = grower["bbox"]
            bad_solid = False
            for bk in boards:
                if bk["mark"] == grower["mark"]:
                    continue
                bbk = bk["bbox"]
                if (bbk.Max.X < gbb.Min.X - 0.01 or bbk.Min.X > gbb.Max.X + 0.01 or
                        bbk.Max.Y < gbb.Min.Y - 0.01 or bbk.Min.Y > gbb.Max.Y + 0.01 or
                        bbk.Max.Z < gbb.Min.Z - 0.01 or bbk.Min.Z > gbb.Max.Z + 0.01):
                    continue
                for s1 in solids:
                    for s2 in _solids_of(bk["ds"]):
                        try:
                            inter = BooleanOperationsUtils.ExecuteBooleanOperation(
                                s1, s2, BooleanOperationsType.Intersect)
                            if inter is not None and inter.Volume > 1e-7:
                                bad_solid = True
                                break
                        except Exception:
                            continue
                    if bad_solid:
                        break
                if bad_solid:
                    break
            if bad_solid:
                pb = grower["pre_bbox"]
                mat_id, gs_id = styles.get(grower["kind_layer"], (None, None))
                revert_solid = make_world_axis_box(pb.Min.X, pb.Min.Y, pb.Min.Z,
                                                    pb.Max.X, pb.Max.Y, pb.Max.Z, mat_id, gs_id)
                if revert_solid is None:
                    warnings.append("{}: small-gap-fill final audit found a real overlap but "
                                    "revert rebuild failed - board left extended".format(grower["mark"]))
                    continue
                try:
                    shape = List[GeometryObject]()
                    shape.Add(revert_solid)
                    ds.SetShape(shape)
                    grower["bbox"] = pb
                    closed -= 1
                    warnings.append("{}: small-gap-fill extension reverted - final audit found a "
                                    "real overlap with another board once all extensions were "
                                    "applied".format(grower["mark"]))
                except Exception as ex:
                    warnings.append("{}: small-gap-fill revert SetShape failed ({})".format(
                        grower["mark"], ex))
        return closed
    except Exception as ex:
        warnings.append("close_small_cross_wall_gaps failed: {}".format(ex))
        return 0


def collect_soffit_assembly_solids(warnings, band_wall_tags):
    """Real solid geometry of the whole soffit assembly: the soffit-category Ceiling(s) (a SOURCE
    Revit element, order-independent) PLUS the ALREADY-GENERATED framing/drywall of every
    soffit-band wall, queried by Mark prefix (e.g. "DP-005-"/"ST-005-"). The raw Wall element's own
    get_Geometry() solid was tried first and proved too thin - a generated track's real flange can
    extend past the wall's plain core solid (confirmed: wall 514037's solid stopped exactly at
    X=-33.6883, touching-not-overlapping DP-001-008B, while its generated track ST-006-006 actually
    reached to X=-33.6362/-33.7404 - the real intruding geometry). Band walls are always processed
    FIRST in the main loop below (see the `sorted(...)` on `walls`) specifically so their real
    generated geometry exists and is queryable by the time any other wall needs it as an obstacle."""
    out = []
    if band_wall_tags:
        # The band walls' boards/tracks were just created earlier in THIS SAME transaction -
        # FilteredElementCollector can silently miss newly-created elements until the document is
        # regenerated, even mid-transaction. Force it so the query below actually sees them.
        try:
            doc.Regenerate()
        except Exception as ex:
            warnings.append("doc.Regenerate() before soffit-assembly collection failed ({})".format(ex))
    try:
        for c in FilteredElementCollector(doc).OfClass(Ceiling).WhereElementIsNotElementType():
            if not _is_soffit_ceiling(c):
                continue
            for s in _solids_of(c):
                out.append(("soffit-ceiling", s))
    except Exception as ex:
        warnings.append("Soffit ceiling geometry collection failed ({})".format(ex))
    if band_wall_tags:
        try:
            prefixes = tuple("DP-{}-".format(t) for t in band_wall_tags) + \
                tuple("ST-{}-".format(t) for t in band_wall_tags)
            for ds in FilteredElementCollector(doc).OfClass(DirectShape).ToElements():
                try:
                    mk = ds.get_Parameter(BuiltInParameter.ALL_MODEL_MARK)
                    mark = mk.AsString() if mk else None
                except Exception:
                    mark = None
                if not mark or not mark.startswith(prefixes):
                    continue
                for s in _solids_of(ds):
                    out.append(("soffit-band-wall", s))
        except Exception as ex:
            warnings.append("Soffit band wall geometry collection failed ({})".format(ex))
    return out


def _bbox_of_solid(s):
    bb = s.GetBoundingBox()
    mn = bb.Transform.OfPoint(bb.Min)
    mx = bb.Transform.OfPoint(bb.Max)
    return (mn.X, mn.Y, mn.Z, mx.X, mx.Y, mx.Z)


def _box3d_overlap(a, b):
    return not (a[3] <= b[0] or b[3] <= a[0] or a[4] <= b[1] or b[4] <= a[1] or a[5] <= b[2] or b[5] <= a[2])


def clip_against_soffit_assembly(solid, soffit_solids):
    """Subtract every soffit-assembly solid that broad-phase overlaps solid's real bbox - an exact
    cut right where the wall panel and the soffit assembly actually meet (same flush-butt rule as
    every other wall corner in this pipeline), not a reveal gap. A gap here (previously
    SOFFIT_CUT_CLEARANCE_FT = 0.05 ft / 0.6in) left a real physical VOID between the wall board's
    top and the soffit ceiling's bottom - harmless in Revit's own viewport, but a literal seam/hole
    when exported and rendered in the downstream simulation (user report 2026-07-27, confirmed with
    Omniverse/Isaac Sim screenshots; measured live: DP-001-006A/007B and DP-003-008A/009B/010B each
    had an exact 0.6in void against the soffit ceiling). A flush, zero-clearance cut has ALREADY
    been proven to introduce no real geometric defect (Revit's own Interference Check: "No
    interference found" on this exact configuration) - only a gap creates an actual void to render.
    A board already touching with zero real overlap is left untouched (nothing to subtract); a
    board with a genuine overlap gets trimmed exactly to the soffit's real surface. An emptied/
    near-zero result is TRUSTED (the board is genuinely, entirely inside the soffit's volume) - the
    caller drops it, same pattern already proven for the column-vs-wall fix."""
    if not soffit_solids:
        return solid
    try:
        box = _bbox_of_solid(solid)
    except Exception:
        return solid
    for (_kind, osolid) in soffit_solids:
        try:
            obox = _bbox_of_solid(osolid)
        except Exception:
            continue
        if not _box3d_overlap(box, obox):
            continue
        try:
            clipped = BooleanOperationsUtils.ExecuteBooleanOperation(
                solid, osolid, BooleanOperationsType.Difference)
        except Exception:
            continue
        if clipped is not None:
            solid = clipped
        if solid is None or solid.Volume <= 1e-9:
            return solid
    return solid


def layer_stack(rated):
    """Return [(thickness_ft, type_x_bool), ...] from bottom (against studs) outward."""
    if rated:
        return [(DRYWALL_THICKNESS_RATED_FT, True)] * DRYWALL_LAYERS_RATED
    return [(DRYWALL_THICKNESS_STD_FT, False)] * DRYWALL_LAYERS_STD


def board_comment(wall_id, face_name, board_id, li, t_ft, type_x, is_cut, tapered, waste_sf):
    return ("{} | WALL={} | {} | DRYWALL | {} | L{} | t={}in | typeX={} | cut={} | "
            "taper={} | waste={}sf").format(
        APP_ID, wall_id, face_name, board_id, li, round(t_ft * 12.0, 3),
        int(bool(type_x)), int(bool(is_cut)), int(bool(tapered)), round(waste_sf, 2))


def emit_board(layer_origin, u, z, normal, shape, thickness, kind, wall_id, wall_tag, face_name,
               face_letter, face_seq, li, type_x, is_cut, waste_sf, taper, warnings,
               soffit_solids=None):
    """Build one drywall board (rect / poly / hole / multicut) as a colored DirectShape. When taper
    is True (the board sits in a full 4-ft course, so its top & bottom edges are factory edges) the
    two long horizontal edges get the factory taper - directly for a plain rectangle, and for an
    opening-notched board by intersecting a tapered full-course rectangle with the cut footprint so
    the SURVIVING top/bottom edges keep the taper. Named DP-<wall>-<n><face_letter> from the per-face
    counter face_seq; the number is consumed only on a successful create. Returns (1/0, board_id)."""
    mat_id, gs_id = styles.get(kind, (None, None))
    kind_tag, a, b = (shape[0], shape[1], shape[2] if len(shape) > 2 else None)

    if kind_tag == "rect":
        if taper:
            solid = make_tapered_board_solid(layer_origin, u, z, normal, a, thickness, mat_id, gs_id)
        else:
            solid = make_rect_solid(layer_origin, u, z, normal, a, thickness, mat_id, gs_id)
    elif kind_tag == "poly":
        solid = make_planar_poly_solid(layer_origin, u, z, normal, a, thickness, mat_id, gs_id)
    elif kind_tag == "hole":
        solid = make_hole_solid(layer_origin, u, z, normal, a, b, thickness, mat_id, gs_id)
    elif kind_tag == "multicut":
        solid = make_multicut_solid(layer_origin, u, z, normal, a, b, thickness, mat_id, gs_id)
    else:
        return 0, None
    if solid is None:
        return 0, None

    # Opening-notched board in a full course: rebuild it as a tapered full-course rectangle clipped
    # to the cut footprint, so the surviving factory top/bottom edges keep the taper (flat notched
    # solid above is the fallback if the boolean fails).
    if taper and kind_tag != "rect":
        bxr = board_bbox(shape)
        tap = make_tapered_board_solid(layer_origin, u, z, normal, bxr, thickness, mat_id, gs_id)
        if tap is not None:
            fo = layer_origin.Add(normal.Multiply(-HOLE_MARGIN_FT))
            fd = thickness + 2.0 * HOLE_MARGIN_FT           # over-thick so it envelops the taper in Z
            if kind_tag == "poly":
                foot = make_planar_poly_solid(fo, u, z, normal, a, fd)
            elif kind_tag == "hole":
                foot = make_hole_solid(fo, u, z, normal, a, b, fd)
            else:
                foot = make_multicut_solid(fo, u, z, normal, a, b, fd)
            if foot is not None:
                try:
                    cut = BooleanOperationsUtils.ExecuteBooleanOperation(
                        tap, foot, BooleanOperationsType.Intersect)
                    if cut is not None:
                        solid = cut
                except:
                    pass

    if soffit_solids:
        solid = clip_against_soffit_assembly(solid, soffit_solids)
        if solid is None or solid.Volume <= 1e-9:
            warnings.append("{}-{}L{}: fully within the soffit assembly - board omitted".format(
                wall_tag, face_letter, li))
            return 0, None

    seq = face_seq.get(face_letter, 0) + 1
    board_id = "DP-{}-{:03d}{}".format(wall_tag, seq, face_letter)
    comment = board_comment(wall_id, face_name, board_id, li, thickness, type_x,
                            is_cut, taper, waste_sf)
    ds = create_directshape(solid, board_id, board_id, comment, warnings)
    if not ds:
        return 0, None
    face_seq[face_letter] = seq
    return 1, board_id


def emit_drywall(wall_id, wall_tag, start, u, z, true_orientation, d_loc, width, face_extents,
                 wall_length, wall_height, opening_rects, rated, stud_xs, install_ref, records,
                 screw_records, do_screws, split_positions, warnings, face_extra_cuts=None,
                 soffit_solids=None):
    """Generate layered, staggered drywall on both faces. Each face lays out over its OWN along-wall
    extent face_extents[side] = (lo, hi) so outside corners wrap and inside corners butt (see
    corner_face_extents). Openings are cut as single connected pieces. Places screws along the stud
    lines on the outermost layer. Boards are named DP-<wall>-<n><face> (per-face counter); screws
    SC-<wall>-<n> (flat per-wall). split_positions = along-wall lines where a partition butts in; a
    board is broken there so no panel spans two rooms. Returns a counts dict; install_ref mutable."""
    counts = {"boards": 0, "cut_boards": 0, "hole_boards": 0, "multi_boolean": 0,
              "nudged_rows": 0, "layers": 0, "screws": 0, "partition_splits": 0}
    face_seq = {}          # per-face board counter: {"A": n, "B": n} -> DP-<wall>-<n><face>
    screw_seq = [0]        # flat per-wall screw counter -> SC-<wall>-<n>

    layers = layer_stack(rated)
    outer_li = 0     # li == 0 is the room-facing layer (its outer surface = the finish face)
    full_sheet_area = PANEL_LENGTH_FT * PANEL_HEIGHT_FT

    for face_config in FACE_LAYOUTS:
        if not face_config.get("enabled", True):
            continue
        face_name = face_config["face_name"]
        face_letter = face_config.get("letter", "A")
        normal, face_offset = face_normal_and_offset(true_orientation, d_loc, width,
                                                      face_config["side"])
        origin_face = start.Add(normal.Multiply(face_offset))
        # This face's own along-wall extent (outside corners wrap past the end; inside corners butt).
        flo, fhi = face_extents.get(face_config["side"], (0.0, wall_length))
        # Split THIS face only where a partition is on this face's side (its outward normal points
        # toward the partition body). The other face is unaffected and follows its own layout.
        # z_lo/z_hi (None/None for a real partition) restrict a soffit-band-wall-caused split to
        # the course(s) actually at that band wall's own height - applied per-course below.
        face_splits = [(p, z_lo, z_hi) for (p, sdx, sdy, z_lo, z_hi) in split_positions
                       if (sdx * normal.X + sdy * normal.Y) > 1e-6]
        # Face-specific extra cutouts (outlet recess holes): cut ONLY into this face's boards.
        f_cuts = list(face_extra_cuts.get(face_config["side"], [])) if face_extra_cuts else []

        cum_before = 0.0     # thickness of layers already placed (closer to the finish face)
        for li, (t, type_x) in enumerate(layers):
            counts["layers"] += 1
            # Layer occupies [face - (cum_before + t), face - cum_before] along the outward
            # normal (i.e. stacked inward toward the studs). Extrude +normal by t from the inner
            # start so the outermost layer's face is flush with the wall finish face.
            layer_origin = origin_face.Add(normal.Multiply(-(cum_before + t)))
            kind = "GWB" if li == 0 else "GWB2"

            base_shift = face_config.get("base_edge_shift_ft", 0.0) + li * LAYER_H_STAGGER_FT
            odd_shift = face_config.get("odd_row_additional_shift_ft", 4.0)
            v_start = li * LAYER_V_STAGGER_FT

            for (cy0, cy1, row) in generate_courses(wall_height, v_start):
                row_shift = normalize_shift(base_shift + (odd_shift if row % 2 == 1 else 0.0))
                row_shift, nudged = adjust_row_shift(row_shift, fhi, opening_rects)
                if nudged:
                    counts["nudged_rows"] += 1
                # This course's own applicable splits: a real partition (z_lo is None) always
                # applies; a soffit-band-wall split only applies to a course that actually
                # overlaps that band wall's own Z-range (e.g. the top course, at soffit level).
                course_splits = unique_sorted([p for (p, z_lo, z_hi) in face_splits
                                               if z_lo is None or (z_hi > cy0 and z_lo < cy1)])

                x = flo - row_shift
                col = 0
                while x < fhi - 1e-4:
                    cell_x0 = max(flo, x)
                    cell_x1 = min(fhi, x + PANEL_LENGTH_FT)
                    x += PANEL_LENGTH_FT
                    col += 1
                    # Break the course cell at each partition junction ON THIS FACE so no board
                    # spans two rooms; the opposite face uses its own (possibly empty) split set.
                    # A split landing very close to the cell's own edge would otherwise leave a
                    # confetti-sized sub-board next to a normal one - merge it into its touching
                    # neighbor instead (user report 2026-07-30: small standalone panel slivers).
                    subcells = merge_small_segments(
                        split_interval(cell_x0, cell_x1, course_splits), MIN_SAFE_SEGMENT_FT)
                    if len(subcells) > 1:
                        counts["partition_splits"] += len(subcells) - 1
                    for (raw_x0, raw_x1) in subcells:
                        # Apply the code gap by insetting the sheet on all sides.
                        g = CODE_GAP_FT / 2.0
                        sx0 = raw_x0 + g
                        sx1 = raw_x1 - g
                        sy0 = cy0 + g
                        sy1 = cy1 - g
                        # The width floor exists to drop a genuine confetti FRAGMENT left over after
                        # a real partition split (len(subcells) > 1: some of this cell's width went to
                        # a sibling piece already tried for merging above). It must NOT drop a piece
                        # that is a cell's own WHOLE, unsplit width - on a wall short enough that its
                        # entire usable run is itself under the floor (e.g. a ~2.5in jamb-stub wall
                        # segment in a doorway modeled as several separate wall pieces), that single
                        # piece IS the wall's entire needed coverage, not a fragment - dropping it
                        # left real studs exposed with zero drywall (user report 2026-07-31, ST-008-
                        # 001/002). The height floor is untouched: courses aren't naturally this thin.
                        if (sy1 - sy0) < MIN_PIECE_HEIGHT_FT:
                            continue
                        if len(subcells) > 1 and (sx1 - sx0) < MIN_PIECE_WIDTH_FT:
                            continue

                        sheet = (sx0, sy0, sx1, sy1)
                        # The framing opening_rects = insert bbox + OPENING_CLEARANCE (rough-opening
                        # gap). Pull the DRYWALL cut back IN so it returns to ~DRYWALL_OPENING_REVEAL
                        # from the insert instead of inheriting the full framing clearance (which left
                        # a ~7/8" gap around the window). Never inset past an opening's centre.
                        # EXCEPTION: a floor-reaching opening (a door - its rect's bottom is already
                        # snapped to y0=0.0 by DOOR_FLOOR_SNAP_FT above) must NOT get this inset on
                        # its bottom edge - a door has no reveal at the floor in real construction,
                        # and insetting it left a solid drywall strip sitting right at floor level
                        # spanning the door's full width (0.0396 ft tall - a real robot-navigation
                        # obstacle, user report 2026-07-26, confirmed via boolean intersection against
                        # the door's own insert box: DP-003-001A/001B both had material at Z=0-0.0396
                        # across the door's full X range). The top/side edges keep the normal reveal.
                        _inset = max(0.0, OPENING_CLEARANCE_FT - DRYWALL_OPENING_REVEAL_FT)
                        expanded = [(o[0] + _inset, (o[1] + _inset if o[1] > 1e-6 else o[1]),
                                    o[2] - _inset, o[3] - _inset)
                                    for o in opening_rects] + f_cuts
                        shapes, multi = cut_sheet(sheet, expanded)
                        if multi:
                            counts["multi_boolean"] += 1

                        # Waste = this piece's nominal area minus the area actually placed (cutouts).
                        placed_area = 0.0
                        for sh in shapes:
                            if sh[0] == "rect":
                                placed_area += rect_area(sh[1])
                            elif sh[0] == "poly":
                                placed_area += poly_area(sh[1])
                            elif sh[0] == "hole":
                                placed_area += rect_area(sh[1]) - rect_area(sh[2])
                            elif sh[0] == "multicut":
                                pa = rect_area(sh[1])
                                for cr in sh[2]:
                                    it = rect_intersection(sh[1], cr)
                                    if it:
                                        pa -= rect_area(it)
                                placed_area += max(0.0, pa)
                        sheet_waste = max(0.0, (sx1 - sx0) * (sy1 - sy0) - placed_area)

                        # A full-height course keeps its factory top & bottom (long) edges, so those
                        # taper. Partial courses (ripped to fit) and notched/opening boards do not.
                        full_course = abs((cy1 - cy0) - PANEL_HEIGHT_FT) < 0.02

                        piece_i = 0
                        for sh in shapes:
                            piece_i += 1
                            is_cut = not (sh[0] == "rect"
                                          and abs((sh[1][2] - sh[1][0]) - (PANEL_LENGTH_FT - CODE_GAP_FT)) < 0.02
                                          and abs((sh[1][3] - sh[1][1]) - (PANEL_HEIGHT_FT - CODE_GAP_FT)) < 0.02)
                            # Any board in a full 4-ft course tapers its top/bottom (factory) edges -
                            # including opening-notched boards (emit_board keeps the taper on the
                            # surviving edges). Partial (<4 ft) courses stay square.
                            board_tapered = TAPERED_LONG_EDGES and full_course
                            waste = sheet_waste if piece_i == 1 else 0.0
                            made, board_id = emit_board(layer_origin, u, z, normal, sh, t, kind,
                                                        wall_id, wall_tag, face_name, face_letter,
                                                        face_seq, li, type_x, is_cut, waste,
                                                        board_tapered, warnings, soffit_solids)
                            counts["boards"] += made
                            if made:
                                install_ref[0] += 1
                                if sh[0] == "hole":
                                    counts["hole_boards"] += 1
                                elif is_cut:
                                    counts["cut_boards"] += 1
                                # Along-wall extent (local x from the wall start) + world XY of the two
                                # ends of the board footprint, for bleed diagnosis in the manifest.
                                bxr = board_bbox(sh)
                                wp0 = make_point(start, u, z, bxr[0], 0.0)
                                wp1 = make_point(start, u, z, bxr[2], 0.0)
                                records.append({
                                    "board_id": board_id, "wall_number": wall_tag, "host_wall": wall_id,
                                    "face": face_name, "layer": li, "type_x": bool(type_x),
                                    "thickness_in": round(t * 12.0, 3),
                                    "is_cut": bool(is_cut), "tapered": bool(board_tapered),
                                    "shape": sh[0], "install_order": install_ref[0],
                                    "waste_sf": round(waste, 2),
                                    "x_start_in": round(bxr[0] * 12.0, 1), "x_end_in": round(bxr[2] * 12.0, 1),
                                    "y_start_in": round(bxr[1] * 12.0, 1), "y_end_in": round(bxr[3] * 12.0, 1),
                                    "wx0": round(wp0.X, 3), "wy0": round(wp0.Y, 3),
                                    "wx1": round(wp1.X, 3), "wy1": round(wp1.Y, 3),
                                })

                                # Fasteners: screws along the stud lines on the room-facing surface,
                                # outermost layer only (keeps geometry light). Recorded as coordinates.
                                if do_screws and (li == outer_li or not SCREWS_OUTER_LAYER_ONLY):
                                    bx = board_bbox(sh)
                                    if bx is not None:
                                        # Head sits flush: mostly embedded in the board, protruding
                                        # only SCREW_HEAD_PROUD_FT past the room-facing surface.
                                        surf = layer_origin.Add(normal.Multiply(t))
                                        screw_origin = surf.Add(normal.Multiply(
                                            SCREW_HEAD_PROUD_FT - SCREW_MARKER_DEPTH_FT))
                                        half = SCREW_MARKER_SIZE_FT / 2.0
                                        smat, sgs = styles.get("SCREW", (None, None))
                                        for (spx, spy) in screw_points(bx, stud_xs, opening_rects + f_cuts):
                                            if counts["screws"] >= MAX_SCREWS_PER_WALL:
                                                break
                                            srect = (spx - half, spy - half, spx + half, spy + half)
                                            ssolid = make_rect_solid(screw_origin, u, z, normal, srect,
                                                                     SCREW_MARKER_DEPTH_FT, smat, sgs)
                                            if ssolid is None:
                                                continue
                                            sid = "SC-{}-{:03d}".format(wall_tag, screw_seq[0] + 1)
                                            sds = create_directshape(
                                                ssolid, sid, sid,
                                                ds_comment(wall_id, face_name, "SCREW", sid), warnings)
                                            if sds:
                                                screw_seq[0] += 1
                                                counts["screws"] += 1
                                                pt = make_point(surf, u, z, spx, spy)   # record at the surface
                                                screw_records.append({
                                                    "screw_id": sid, "board_id": board_id,
                                                    "wall_number": wall_tag, "host_wall": wall_id,
                                                    "face": face_name, "layer": li,
                                                    "x_in": round(spx * 12.0, 2), "y_in": round(spy * 12.0, 2),
                                                    "world_x": round(pt.X, 4), "world_y": round(pt.Y, 4),
                                                    "world_z": round(pt.Z, 4),
                                                    "spacing_in": round(SCREW_SPACING_FT * 12.0, 2),
                                                    "length_in": round(t * 12.0 + 0.625, 3),
                                                })

            cum_before += t

    return counts


# ============================================================
# MAIN
# ============================================================

result = {
    "app_id": APP_ID,
    "output_mode": "directshape",
    "phase": "1_framing+2_drywall",
    "generate_framing": GENERATE_FRAMING,
    "generate_drywall": GENERATE_DRYWALL,
    "deleted_previous": 0,
    "walls_requested": 0,
    "walls_processed": 0,
    "walls_skipped": [],
    "wall_numbers": {},                # {W<eid>: "001"} nomenclature number per processed wall
    "rated_walls": 0,
    # openings (existing doors/windows given hierarchical Marks WN-/DR-)
    "doors_named": 0,
    "windows_named": 0,
    "framing_stud_depth_in": 0.0,      # derived stud web depth (last wall processed)
    "wall_diagnostics": [],            # per-wall thickness accounting (see notes if mismatch)
    # framing
    "studs_created": 0,
    "cripples_created": 0,
    "kings_created": 0,
    "jacks_created": 0,
    "tracks_created": 0,
    "headers_created": 0,
    "sills_created": 0,
    # drywall
    "boards_created": 0,
    "cut_boards": 0,
    "hole_boards": 0,
    "drywall_layers": 0,
    "multi_opening_boolean_sheets": 0,
    "jamb_nudged_courses": 0,
    "partition_split_boards": 0,       # extra board joints added where a partition butts in
    "small_gaps_closed": 0,            # cross-wall corner-notch gaps closed by the post-pass
    "boards_trimmed_from_neighbor_studs": 0,  # boards notched to stop intruding a different wall's stud
    "walls_missing_coverage": 0,       # walls with real framing but no track/drywall - see warnings
    "board_records": 0,
    # fasteners
    "screws_created": 0,
    # corners / manifest / view
    "corners_trimmed": 0,              # wall ends pulled back to butt a joined wall
    "corner_debug": [],                # per-wall pull-backs (find a bleeding wall by its Mark number)
    "framing_records": 0,
    "screw_records": 0,
    "opening_records": 0,
    "outlets_created": 0,              # TM outlet boxes placed this run (preserved walls add 0)
    "manifest_path": "",
    "export_view": "",                 # name/status of the base-wall-hidden isolation view
    "warnings": [],
    "notes": []
}
warnings = result["warnings"]

do_delete = as_bool(get_in(5), DELETE_PREVIOUS_ORIGIN_ASSEMBLY)
do_drywall = as_bool(get_in(6), GENERATE_DRYWALL)
force_rated_in = get_in(7)
do_screws = as_bool(get_in(8), GENERATE_SCREWS)
purge_all = as_bool(get_in(9), PURGE_ALL_ORIGIN_ELEMENTS)

walls = get_input_walls(warnings)
result["walls_requested"] = len(walls)

board_records = []
framing_records = []
screw_records = []
opening_records = []
opening_rect_records = []
outlet_records = []
if len(walls) == 0:
    OUT = "No walls found. Select one or more straight walls in Revit, then run Dynamo again."
else:
    # The outlet family file must exist before we open the transaction (family documents cannot
    # be created while one is active). Builds families\TM_outlet_box.rfa automatically on the
    # first run, so no manual setup step is needed.
    if GENERATE_OUTLETS:
        if ensure_outlet_rfa(warnings):
            preload_outlet_family(warnings)
    TransactionManager.Instance.EnsureInTransaction(doc)
    try:
        processed_ids = set("W" + str(eid_value(w.Id)) for w in walls)
        if do_delete or purge_all:
            result["deleted_previous"] = delete_previous(processed_ids, warnings, purge_all)
            if purge_all:
                result["notes"].append(
                    "PURGE_ALL: removed every Origin assembly element in the model (not just the "
                    "processed walls) - clears orphans from recreated walls / older runs.")

        if COLOR_BY_TYPE:
            styles = setup_styles(warnings)     # reassigns the module global read by emitters

        # Assign each selected wall its stable nomenclature number (persisted to the wall Mark).
        wall_numbers = assign_wall_numbers(walls, warnings)

        # Soffit-band walls (the soffit assembly itself) are processed FIRST, so their real
        # generated framing/drywall exists before any OTHER wall needs it as a clip obstacle -
        # collect_soffit_assembly_solids() is called lazily, right when the first non-band wall is
        # reached below, not here (nothing has been generated yet at this point in the script).
        band_wall_tags = set()
        for _w in walls:
            if _is_soffit_band_wall(_w):
                band_wall_tags.add("{:03d}".format(wall_numbers.get(eid_value(_w.Id), 0)))
        walls = sorted(walls, key=lambda w: 0 if _is_soffit_band_wall(w) else 1)
        soffit_assembly_solids = None

        # Precompute geometry for EVERY straight wall in the model once, for corner detection.
        # Neighbors a processed wall butts into may be outside the selection, so scan them all.
        corner_candidates = []
        if HANDLE_CORNERS:
            try:
                for _cw in FilteredElementCollector(doc).OfClass(Wall).WhereElementIsNotElementType():
                    _csg = get_wall_curve_data(_cw)
                    if _csg is not None:
                        corner_candidates.append((_cw, _csg, get_wall_width(_cw)))
            except Exception as _cex:
                warnings.append("Corner candidate scan failed (continuing): {}".format(_cex))

        z = XYZ.BasisZ

        # Centroid of the SELECTED walls = the robot's environment; OUTLET_FACES="inner" places
        # every outlet on the face looking toward it (never on the outside of the building).
        env_centroid = None
        if GENERATE_OUTLETS and OUTLET_FACES == "inner":
            _pts = []
            for _w in walls:
                _cd = get_wall_curve_data(_w)
                if _cd:
                    _pts.append(((_cd[0].X + _cd[1].X) / 2.0, (_cd[0].Y + _cd[1].Y) / 2.0))
            if _pts:
                env_centroid = (sum(p[0] for p in _pts) / len(_pts),
                                sum(p[1] for p in _pts) / len(_pts))
            if len(_pts) < 2:
                warnings.append("OUTLET_FACES='inner' with fewer than 2 selected walls: the "
                                "inner side is ambiguous; falling back may pick either face")

        for wall in walls:
            wall_id = "W" + str(eid_value(wall.Id))
            wall_tag = "{:03d}".format(wall_numbers.get(eid_value(wall.Id), 0))
            result["wall_numbers"][wall_id] = wall_tag
            is_soffit_band = _is_soffit_band_wall(wall)
            if not is_soffit_band and soffit_assembly_solids is None:
                soffit_assembly_solids = (collect_soffit_assembly_solids(warnings, band_wall_tags)
                                          if CLIP_AT_SOFFIT_ASSEMBLY else [])
            try:
                curve_data = get_wall_curve_data(wall)
                if not curve_data:
                    result["walls_skipped"].append(wall_id + ": not a straight wall")
                    continue

                start, end, u, wall_length = curve_data
                # Respect the wall's Base Offset: the location line sits at the LEVEL, so an
                # elevated band (e.g. a 2 ft "beam"/soffit wall with Base Offset 8') was getting
                # its whole assembly generated at the floor, 8 ft below the real element
                # (user report 2026-07-17). Shift the vertical origin to the true base.
                base_off = 0.0
                try:
                    _bp = wall.get_Parameter(BuiltInParameter.WALL_BASE_OFFSET)
                    if _bp:
                        base_off = _bp.AsDouble() or 0.0
                except Exception:
                    base_off = 0.0
                if abs(base_off) > 1e-6:
                    start = XYZ(start.X, start.Y, start.Z + base_off)
                    end = XYZ(end.X, end.Y, end.Z + base_off)
                orientation = safe_normalize(wall.Orientation)
                if orientation is None:
                    result["walls_skipped"].append(wall_id + ": cannot read Orientation")
                    continue

                wall_height = get_wall_height(wall)
                width = get_wall_width(wall)

                d_loc, core_center = wall_ref_geometry(wall, width, warnings)

                opening_rects = get_opening_rects(wall, start, u, wall_length, wall_height, warnings)
                if opening_rects:
                    opening_rect_records.append({
                        "wall_number": wall_tag, "host_wall": wall_id,
                        "rects_in": [[round(v * 12.0, 1) for v in r] for r in opening_rects],
                    })

                # Name the existing doors/windows hosted in this wall (WN-<wall><letter> /
                # DR-<wall><letter>) so their relationship to the wall is explicit.
                oc = name_openings(wall, wall_id, wall_tag, opening_records, warnings)
                result["doors_named"] += oc["doors"]
                result["windows_named"] += oc["windows"]

                if force_rated_in is not None:
                    rated = as_bool(force_rated_in, False)
                elif FORCE_FIRE_RATED is not None:
                    rated = bool(FORCE_FIRE_RATED)
                else:
                    rated = wall_is_fire_rated(wall, warnings)
                if rated:
                    result["rated_walls"] += 1

                # The whole assembly is CENTERED on the existing wall (symmetric, no offset to
                # either side): drywall sits flush inside each finish face, and the stud is
                # centered on the wall's center plane. Stud web depth = wall thickness - drywall on
                # both faces, so the stud butts the back of the drywall and framing + drywall
                # exactly fills the wall. Both framing and drywall reference this one center plane.
                half_w = width / 2.0
                wall_center_off = d_loc - half_w            # Location Line -> wall center, along +normal
                dw_per_face = sum(t for (t, _tx) in layer_stack(rated))
                if DERIVE_STUD_DEPTH_FROM_WALL:
                    stud_depth = width - 2.0 * dw_per_face
                    if stud_depth < MIN_STUD_DEPTH_FT:
                        warnings.append(
                            "Wall {}: derived stud depth {:.2f}in below minimum; clamped to "
                            "{:.2f}in (wall {:.2f}in, drywall {:.2f}in/side). Assembly will exceed "
                            "the wall - model the wall thicker or force non-rated.".format(
                                wall_id, stud_depth * 12.0, MIN_STUD_DEPTH_FT * 12.0,
                                width * 12.0, dw_per_face * 12.0))
                        stud_depth = MIN_STUD_DEPTH_FT
                else:
                    stud_depth = STUD_DEPTH_FT
                stud_inner_off = wall_center_off - stud_depth / 2.0   # stud centered on the wall
                track_inner_off = stud_inner_off - MAT_T_FT           # track wraps the stud
                c_profile, u_profile, track_depth = build_profiles(stud_depth)
                result["framing_stud_depth_in"] = round(stud_depth * 12.0, 3)

                # Per-wall thickness accounting so any mismatch is visible in the Watch output.
                ref_code = -1
                try:
                    _rp = wall.get_Parameter(BuiltInParameter.WALL_KEY_REF_PARAM)
                    if _rp:
                        ref_code = _rp.AsInteger()
                except:
                    pass
                assembly_total = 2.0 * dw_per_face + stud_depth
                result["wall_diagnostics"].append({
                    "wall_id": wall_id,
                    "wall_number": wall_tag,
                    "wall_width_in": round(width * 12.0, 3),
                    # location_line_ref: 0=Centerline 1=CoreCenter 2=FinishExt 3=FinishInt 4=CoreExt 5=CoreInt
                    "location_line_ref": ref_code,
                    "wall_center_off_from_location_in": round(wall_center_off * 12.0, 3),
                    "rated": bool(rated),
                    "drywall_per_face_in": round(dw_per_face * 12.0, 3),
                    "stud_depth_in": round(stud_depth * 12.0, 3),
                    "assembly_total_in": round(assembly_total * 12.0, 3),
                    "assembly_equals_wall": abs(assembly_total - width) < 1e-4,
                })

                # Corner handling: pull the assembly back at any end that meets a perpendicular
                # wall (joined OR merely touching) so it butts cleanly into it (no material poking
                # into the next room). run_lo/run_hi bound both framing and drywall; stud_xs is the
                # shared stud grid (also used for screws).
                du0, du1 = corner_pullbacks(wall, warnings, corner_candidates)
                run_lo = du0
                run_hi = wall_length - du1
                degenerate = False
                if run_hi - run_lo < MIN_SAFE_SEGMENT_FT:
                    # Threshold is MIN_SAFE_SEGMENT_FT (6in), not the bare MIN_SEG_FT (3in) floor
                    # used elsewhere: a run that survives at, say, 4in is technically non-empty but
                    # still produces a razor-thin standalone track/end-stud at that wall's corner
                    # (a real 2-3in confetti sliver, user report 2026-07-30 ST-015-003/ST-053-003 -
                    # both from short wall runs whose pulled-back length barely cleared the old
                    # 3in floor). A short wall accepting its full, un-pulled-back length here (a
                    # small, bounded amount of extra material AT MOST the wall's own short length)
                    # is a far smaller, less visible tradeoff than a genuine confetti-sized piece.
                    run_lo, run_hi = 0.0, wall_length      # degenerate pull-back; use full length
                    degenerate = True
                if du0 > 1e-4:
                    result["corners_trimmed"] += 1
                if du1 > 1e-4:
                    result["corners_trimmed"] += 1
                # Diagnostics: which wall (by its Mark number) got how much pull-back. If a bleeding
                # wall shows end0/end1 = 0 here, its corner wasn't detected (widen CORNER_* / check
                # the wall is straight + non-parallel); if it shows a value but still bleeds, the
                # pull-back is too small.
                result["corner_debug"].append({
                    "wall": wall_tag, "host": wall_id,
                    "length_in": round(wall_length * 12.0, 1),
                    "pull_end0_in": round(du0 * 12.0, 2),
                    "pull_end1_in": round(du1 * 12.0, 2),
                    "run_lo_in": round(run_lo * 12.0, 1), "run_hi_in": round(run_hi * 12.0, 1),
                    "start_xy": [round(start.X, 3), round(start.Y, 3)],
                    "end_xy": [round(end.X, 3), round(end.Y, 3)],
                    "degenerate_reset": degenerate,
                })
                stud_xs = stud_lines(run_lo, run_hi, opening_rects)

                if GENERATE_FRAMING:
                    st_counter = [0]     # flat per-wall framing counter -> ST-<wall>-<n>
                    fc = emit_framing(wall_id, wall_tag, st_counter, start, u, z, orientation,
                                      stud_inner_off, track_inner_off, c_profile, u_profile,
                                      stud_depth, stud_xs, run_lo, run_hi, wall_height,
                                      opening_rects, framing_records, warnings, is_soffit_band)
                    result["studs_created"] += fc["studs"]
                    result["cripples_created"] += fc["cripples"]
                    result["kings_created"] += fc["kings"]
                    result["jacks_created"] += fc["jacks"]
                    result["tracks_created"] += fc["tracks"]
                    result["headers_created"] += fc["headers"]
                    result["sills_created"] += fc["sills"]

                outlet_cuts = {}
                if GENERATE_OUTLETS:
                    # The outlet step must NEVER take the wall's drywall down with it: any
                    # failure here is warned and the wall continues without an outlet.
                    try:
                        oc_made, oc_list = emit_outlet(
                            wall, wall_id, wall_tag, start, u, orientation, d_loc, width, stud_xs,
                            opening_rects, wall_height, run_lo, run_hi, outlet_records, warnings,
                            env_centroid)
                        result["outlets_created"] += oc_made
                        for (oside, orect) in oc_list:
                            outlet_cuts.setdefault(oside, []).append(orect)
                    except Exception as oex:
                        warnings.append("Wall {}: outlet step failed ({}); wall continues without an outlet".format(wall_id, oex))
                        outlet_cuts = {}

                if do_drywall:
                    install_ref = [0]
                    # Per-face drywall extents: OUTSIDE corners wrap to the arris, INSIDE corners
                    # butt (framing is butt-trimmed separately via corner_pullbacks). With corner
                    # trimming off, each face just runs the full wall length.
                    face_extents = corner_face_extents(wall, corner_candidates) if TRIM_DRYWALL_AT_CORNERS else None
                    if not face_extents:
                        face_extents = {"interior": (0.0, wall_length), "exterior": (0.0, wall_length)}
                    # Narrow, explicitly-scoped patches (user-confirmed 2026-07-28, "only this
                    # corner" each time - NOT a general rule for every wall-to-wall butt joint,
                    # which the user was asked about directly and declined). Both pairs are plain
                    # COLLINEAR continuations at the K001 column corner (008->009, 002->010), so
                    # corner_face_extents() (which only handles walls that CROSS at an angle, not
                    # collinear ones) leaves the exterior face running the wall's full length. But
                    # the neighbor's own end stud sits centered exactly on ITS wall's start/end
                    # point (stud_lines() centers an end stud on run_lo/run_hi), so it reaches
                    # FLANGE_FT/2 (5/8") past that point, into this wall's own run - user reports:
                    # DP-008-002B/006B ran up next to ST-009-001, DP-010-001B/003B/006B ran up next
                    # to wall 002's own end stud. Pull this wall's exterior face back by that same
                    # amount at the end nearest the named neighbor, leaving a small reveal there
                    # (confirmed acceptable both times: "let some hollow gap its fine").
                    _neighbor_tag = {"008": 9, "010": 2}.get(wall_tag)
                    if _neighbor_tag is not None:
                        for (_ow, _oseg, _owidth) in corner_candidates:
                            if wall_numbers.get(eid_value(_ow.Id)) != _neighbor_tag:
                                continue
                            _ostart, _oend, _od, _olen = _oseg
                            _lo, _hi = face_extents["exterior"]
                            if end.DistanceTo(_ostart) < 0.5 or end.DistanceTo(_oend) < 0.5:
                                face_extents["exterior"] = (_lo, _hi - FLANGE_FT / 2.0)
                            elif start.DistanceTo(_ostart) < 0.5 or start.DistanceTo(_oend) < 0.5:
                                face_extents["exterior"] = (_lo + FLANGE_FT / 2.0, _hi)
                            break
                    # Along-wall lines where a partition butts into this wall's mid-span; the drywall
                    # breaks a board there so no panel spans two rooms.
                    split_positions = partition_split_positions(wall, corner_candidates)
                    # A soffit-band wall (part of the soffit assembly itself) must never be clipped
                    # against that same assembly - it's supposed to butt flush against it.
                    wall_soffit_solids = [] if is_soffit_band else (soffit_assembly_solids or [])
                    dc = emit_drywall(wall_id, wall_tag, start, u, z, orientation, d_loc, width,
                                      face_extents, wall_length, wall_height, opening_rects, rated,
                                      stud_xs, install_ref, board_records, screw_records,
                                      do_screws, split_positions, warnings, outlet_cuts,
                                      wall_soffit_solids)
                    result["boards_created"] += dc["boards"]
                    result["cut_boards"] += dc["cut_boards"]
                    result["hole_boards"] += dc["hole_boards"]
                    result["drywall_layers"] += dc["layers"]
                    result["multi_opening_boolean_sheets"] += dc["multi_boolean"]
                    result["jamb_nudged_courses"] += dc["nudged_rows"]
                    result["screws_created"] += dc["screws"]
                    result["partition_split_boards"] += dc["partition_splits"]

                result["walls_processed"] += 1

            except Exception as wall_ex:
                result["walls_skipped"].append(wall_id + ": error - " + str(wall_ex))
                warnings.append("Wall {} failed mid-processing: {}".format(wall_id, wall_ex))
                continue

        # Every wall's own drywall is placed now - close small residual gaps BETWEEN different
        # walls' boards at real "post" junctions (see close_small_cross_wall_gaps docstring).
        if GENERATE_DRYWALL:
            result["small_gaps_closed"] = close_small_cross_wall_gaps(warnings)

        # Drywall must never physically intrude into a DIFFERENT wall's framing (see
        # trim_drywall_from_neighbor_studs docstring - a real, recurring corner-clash pattern).
        if GENERATE_DRYWALL and GENERATE_FRAMING:
            result["boards_trimmed_from_neighbor_studs"] = trim_drywall_from_neighbor_studs(warnings)

        # Automatic self-check: any wall with real framing but no track/drywall covering it is a
        # dangerous exposed-framing defect that must be loud in THIS run's own output, not
        # something a person has to notice by eye later (see validate_wall_coverage docstring).
        result["walls_missing_coverage"] = validate_wall_coverage(warnings)

        # Isolation view: hide the base wall so the generated assembly is visible on both faces.
        result["export_view"] = ensure_export_view(warnings)

    except Exception as ex:
        result["notes"].append("FATAL: " + str(ex))
    finally:
        TransactionManager.Instance.TransactionTaskDone()

    result["board_records"] = len(board_records)
    result["framing_records"] = len(framing_records)
    result["screw_records"] = len(screw_records)
    result["opening_records"] = len(opening_records)
    if result["multi_opening_boolean_sheets"] > 0:
        result["notes"].append(
            "{} sheet(s) overlapped >1 opening and were cut with a boolean difference "
            "(single connected board, no joints at opening corners).".format(
                result["multi_opening_boolean_sheets"]))

    # Assembly manifest JSON: sidecar with every element's properties, so metadata survives the
    # USD export regardless of exporter. Written after the transaction (file IO needs no txn).
    if WRITE_MANIFEST:
        manifest = {
            "app_id": APP_ID,
            "schema": "origin_wall_assembly_v4_phase2",
            "units": "world coords in feet; member/board dims in inches",
            "nomenclature": {
                "wall": "NNN (persisted to the wall Mark)",
                "drywall_panel": "DP-<wall>-<seq><face>  (face A/B; seq per face)",
                "framing_member": "ST-<wall>-<seq>  (type in member_type)",
                "screw": "SC-<wall>-<seq>",
                "window": "WN-<wall><letter>",
                "door": "DR-<wall><letter>",
                "outlet": "EO-<wall>-001  (TM box family instance; movable/deletable, preserved on re-runs)",
            },
            "summary": dict((k, result[k]) for k in (
                "walls_processed", "rated_walls", "studs_created", "cripples_created",
                "kings_created", "jacks_created", "tracks_created", "headers_created",
                "sills_created", "boards_created", "screws_created", "corners_trimmed",
                "doors_named", "windows_named")),
            "walls": result["wall_diagnostics"],
            "corner_debug": result["corner_debug"],
            "framing": framing_records,
            "boards": board_records,
            "screws": screw_records,
            "openings": opening_records,
            "opening_rects": opening_rect_records,
            "outlets": outlet_records,
            "warnings": warnings,
        }
        try:
            f = open(MANIFEST_PATH, "w")
            try:
                json.dump(manifest, f, indent=2)
            finally:
                f.close()
            result["manifest_path"] = MANIFEST_PATH
        except Exception as ex:
            result["manifest_path"] = "failed"
            warnings.append("Manifest write failed: {}".format(ex))

    if result["corners_trimmed"] > 0:
        result["notes"].append(
            "{} wall end(s) pulled back at corners to butt a joined wall (no double material). "
            "Verify corner fit in Revit; tiebreak = higher ElementId runs through.".format(
                result["corners_trimmed"]))
    OUT = result
# ----------------------------------------
watch = Watch(python_script)
ceiling_types = CeilingTypes("Generic - 4\"")
python_script_2 = Python(IN[0]=ceiling_types)  # CPython3; unwired: IN[1]
# ---------- python_script_2.python (2404 lines) ----------
# Origin Ceiling Assembly Generator v1 - FRAMING + DRYWALL (FURRED / SUSPENDED)  [NO TAPER / NO SCREW / NO JOINT]
# Dynamo Python Script node for Revit. Version-tolerant: runs on Revit 2025 (Dynamo CPython3, the
# Omniverse-export version) AND 2026/2027 (PythonNet3). No f-strings; eid_value() handles the
# ElementId .Value/.IntegerValue change.
#
# NO-TAPER / NO-SCREW / NO-JOINT VARIANT: identical to origin_ceiling_assembly_v1.py EXCEPT the
# gypsum panels are FLAT, FLUSH slabs and there are NO screws:
#   - factory edge taper OFF (TAPERED_LONG_EDGES = False)
#   - panel-to-panel code gap ZERO (CODE_GAP_FT = 0) -> adjacent boards butt flush, no joint reveal
#   - screws OFF (GENERATE_SCREWS = False) -> no screw markers / records
# Everything else (furring, mains/hangers, splicing, openings, nomenclature) is unchanged. Kept in
# lockstep with the trunk; the ONLY differences are this header, TAPERED_LONG_EDGES, CODE_GAP_FT,
# GENERATE_SCREWS, and MANIFEST_PATH. Same APP_ID + CEILING=C<eid> cleanup token, so running this on
# a ceiling REPLACES the trunk's drywall on that ceiling with this version (interchangeable alternate).
#
# WHAT THIS IS:
#   The ceiling counterpart of origin_wall_assembly_v4_phase2.py. For each selected Revit CEILING
#   it builds a construction-accurate gypsum ceiling as DirectShape solids:
#       - Metal FURRING (hat) channels @ 16" OC, run across the ceiling just above the drywall.
#       - REINFORCEMENT for long spans (ASTM C754): a 7/8" furring channel can only span ~4 ft
#         before the gypsum weight sags it, so when the furring run exceeds MAX_FURRING_SPAN_FT the
#         script adds MAIN carrying channels perpendicular to the furring @ <=48" OC (sitting on top
#         of it). HANGER wires are OFF by default (GENERATE_HANGERS) - they only apply when there is
#         a structural deck/slab ABOVE to anchor into; with no deck the mains fasten directly to the
#         joists/trusses. Small ceilings (run <= limit) stay direct-furred with no mains.
#       - GYPSUM board on the underside (single face, room side), laid in a staggered grid,
#         clipped to the ceiling's boundary polygon, cut around holes/fixtures as SINGLE pieces,
#         tapered long edges on full field boards, 2 layers for fire-rated ceilings.
#       - Drywall SCREWS along the furring lines on the room-facing surface (markers + coords).
#       - A sidecar JSON assembly manifest and a base-ceiling-hidden isolation view.
#
# HOW IT DIFFERS FROM THE WALL SCRIPT (by design):
#   - Single-sided (drywall only on the underside; the top faces the plenum).
#   - Horizontal: the layout plane is world X-Y at the ceiling's bottom-face elevation.
#   - Boundary is the ceiling's polygon (any shape, incl. holes/courtyards), not a straight line.
#     Boards/furring are clipped to it with Revit boolean intersect (robust for concave + holes).
#   - Framing is furring hat-channels, not vertical C-studs.
#
# STILL APPROXIMATE (documented):
#   - The board/furring grid is world-X/Y aligned (not rotated to the room's long edge) - fine for
#     axis-aligned rooms; a rotation pass is a later refinement.
#   - Hosted fixtures are cut from their plan bounding box (may be slightly oversized). Holes drawn
#     into the ceiling sketch are handled automatically (they come through as inner boundary loops).
#   - Layout/visualization geometry, not shop-drawing certification.

import clr
import math
import json

clr.AddReference('RevitAPI')
clr.AddReference('RevitServices')

from Autodesk.Revit.DB import *
from RevitServices.Persistence import DocumentManager
from RevitServices.Transactions import TransactionManager

try:
    clr.AddReference('RevitNodes')
    import Revit
    clr.ImportExtensions(Revit.Elements)
except:
    pass

from System.Collections.Generic import List

doc = DocumentManager.Instance.CurrentDBDocument
uidoc = DocumentManager.Instance.CurrentUIApplication.ActiveUIDocument

# ============================================================
# USER SETTINGS
# ============================================================

APP_ID = "ORIGIN_CEILING_V1"

GENERATE_FURRING = True
GENERATE_DRYWALL = True
GENERATE_SCREWS = False     # NO-SCREW BUILD: hard off (Dynamo IN[8] can still force it on)
COLOR_BY_TYPE = True
DELETE_PREVIOUS = True
PROCESS_ALL_CEILINGS_IF_NONE_SELECTED = False

# Which ceiling elements THIS node processes (per-element "plugin" split, user 2026-07-17):
#   "all"      - every gathered ceiling incl. soffits (legacy single-node behavior)
#   "ceilings" - skip soffit-named elements (the CEILINGS node; soffits have their own node)
#   "soffits"  - ONLY soffit-named elements, self-collected model-wide regardless of the
#                dropdown/selection (the SOFFITS node - like the beams/columns nodes)
PROCESS_MODE = "ceilings"

IN_FT = 1.0 / 12.0

# ---- Furring (hat / DWC channel) ----
FURRING_SPACING_FT = 16.0 * IN_FT        # 16 in. OC (ASTM C754: cross-furring <= 24" OC; 16" for 5/8")
FURRING_FACE_FT = 2.5 * IN_FT            # channel face width (across the run)
FURRING_HEIGHT_FT = 0.875 * IN_FT        # 7/8" DWC furring channel depth
MAT_T_FT = 0.0451 * IN_FT                # steel material thickness (~18 ga)
MIN_SEG_FT = 0.25                        # skip framing/board slivers < 3 in.
# A piece can be >= MIN_SEG_FT (so it doesn't get dropped) and still be a visually/physically
# meaningless sliver - a 3-4in confetti-sized board next to a normal-sized neighbor. A sim/robot
# texture pass can misread that tiny standalone piece as a real discontinuity. Anywhere a
# too-small leftover CAN be safely fused into a touching same-run neighbor, it is, instead of
# being kept standalone or dropped and leaving a hole (user report 2026-07-30, DP-S001-020/021/022
# - a false wall-cut split a whole 4ft course into a 3in sliver between two normal boards).
MIN_SAFE_SEGMENT_FT = 0.5                 # 6 in - below this, merge into a same-run neighbor

# ---- Walls (room separation) ----
# Stop the ceiling drywall at WALLS - same requirement as the wall assembly corners. Every wall's
# plan footprint is subtracted from the clip mask (a board/channel can never enter a wall), and
# the board grid stops-and-restarts at each wall face so no single panel runs under a wall into
# the next room - each room gets its own separate panels for per-room Isaac interaction.
CLIP_CEILING_AT_WALLS = True

# ---- Per-room generation ----
# Generate the ceiling PER ROOM - the same pattern the wall script uses per wall run. Each Revit
# Room's boundary polygon (taken at wall FINISH faces via Room.GetBoundarySegments, continuous
# across doorways because the segments follow the room-bounding walls / room separation lines) is
# an independent bounded region: boards, furring and mains are laid out inside it with their own
# grid origin and are cut at its edges, so nothing is ever generated outside its own room and no
# element spans two rooms. When True this REPLACES the legacy whole-ceiling-grid +
# wall-subtraction path above for any ceiling that has Rooms (set False to compare old vs new
# output on the same model). A ceiling with NO overlapping Room (e.g. a soffit) falls back to
# the legacy path with a warning, so soffits keep working until their own pass. Ceiling area
# covered by no Room gets no panels and is reported in the warnings.
CEILING_PER_ROOM = True
MIN_ROOM_AREA_SF = 1.0        # skip unenclosed/degenerate rooms (Revit reports their area as 0)

# ---- Soffits (separate flow) ----
# A soffit (Ceiling element whose type/family name contains "soffit", host tag S###) is a narrow
# run - straight or L-shaped - spanning from one wall to an adjacent wall. It gets EXACTLY TWO
# custom-cut boards: one per leg of an L (butt joint at the inner corner), or a mid-run split on
# a straight run. Each board must be 2..16 ft (warnings otherwise). Boards clip against the
# wall-subtracted mask so they end at the walls the soffit spans between - no penetration.
# No 4x8 grid, no rooms/zones, no carrying mains (furring only).
SOFFIT_SEPARATE_FLOW = True
SOFFIT_MAX_BOARD_FT = 16.0
SOFFIT_MIN_BOARD_FT = 2.0
# The 2-board rule is for NARROW beam/bulkhead soffits. A soffit whose footprint is wider than
# this on its SHORT axis is a room-sized ceiling drop, not a beam - 2 boards spanning the whole
# area would be oversized, non-standard sheets ("no proper drywall cut", user 2026-07-21). Those
# wide soffits instead fall through to the SAME whole-4x8-per-zone tiling used for ordinary
# ceilings (the "FALLBACK ZONES" path below), so they look and behave like the rest of the model.
SOFFIT_BEAM_MAX_WIDTH_FT = 5.0

# ---- Suspension / reinforcement (ASTM C754) ----
# A 7/8" furring channel can only span so far before the gypsum weight deflects it and the ceiling
# sags. Past MAX_FURRING_SPAN_FT it must be carried by MAIN (carrying) channels at MAIN_SPACING_FT
# perpendicular to the furring (breaking it into <=4 ft spans). Small ceilings (run <= the limit)
# stay direct-furred end-to-end with no mains. ASTM C754 prescriptive limits (non-seismic): furring
# span <= 48", mains <= 48" OC, hangers <= 48" OC and <= 16 sq ft each.
GENERATE_MAINS = True
MAX_FURRING_SPAN_FT = 48.0 * IN_FT       # max unsupported furring span before a main is required
MAIN_SPACING_FT = 48.0 * IN_FT           # carrying channels <= 4 ft OC (perpendicular to furring)
MAIN_DEPTH_FT = 1.5 * IN_FT              # 1-1/2" cold-rolled carrying channel (CRC)
MAIN_FACE_FT = 0.5 * IN_FT               # CRC flange/face width

# HANGER WIRES only exist where the mains can be hung from a structural deck (concrete slab, etc.)
# ABOVE the ceiling. If there is NO deck above (top floor under a roof, or the framing fastens
# DIRECTLY to the joists/trusses above), you don't use hanger rods - leave this False and the mains
# read as direct-fastened to the structure. Set True only when there is a slab/deck above to anchor
# the #12 wires into. ASTM C754 (when used): hangers <= 48" OC along each main, <= 16 sq ft each.
GENERATE_HANGERS = False
HANGER_SPACING_FT = 48.0 * IN_FT         # hanger wires <= 4 ft OC along each main
HANGER_MAX_AREA_SF = 16.0                # informational: each hanger supports <= 16 sq ft
HANGER_DIA_FT = 0.106 / 12.0            # #12 ga hanger wire (~0.106")
HANGER_DROP_FT = 12.0 * IN_FT            # modeled wire length up toward the deck (nominal)
END_SUPPORT_SETBACK_FT = 6.0 * IN_FT     # first hanger within 6" of a main's ends (ASTM C754)

# ---- Splicing: channels ship in stock lengths and are lapped end-to-end, not one long piece ----
# A furring / carrying channel can't be one continuous 40-ft run; it is made of stock-length pieces
# nested/overlapped at each splice and secured (screws / tie wire). Splices are STAGGERED between
# adjacent channels so the joints don't line up. Each stock piece becomes its own element (good for
# per-element sim). ASTM C754 typical: furring lap ~8", carrying-channel lap 12".
SPLICE_CHANNELS = True
FURRING_STOCK_LENGTH_FT = 12.0           # 7/8" furring/hat channel stock length (also 10 ft)
FURRING_SPLICE_LAP_FT = 8.0 * IN_FT      # ~8" nested lap at a furring splice
MAIN_STOCK_LENGTH_FT = 16.0              # 1-1/2" CRC carrying channel stock length (also 20 ft)
MAIN_SPLICE_LAP_FT = 12.0 * IN_FT        # 12" lap at a carrying-channel splice (ASTM C754)
SPLICE_STAGGER_FT = 4.0                  # shift splices this much between adjacent channels
SPLICE_NEST_OFFSET = True                # nudge a lapping piece by one material thickness (nested look)

# ---- Drywall ----
PANEL_LENGTH_FT = 8.0                    # board long dimension (along X); 12.0 for 4x12
PANEL_WIDTH_FT = 4.0                     # board short dimension (course step, along Y)
DRYWALL_THICKNESS_STD_FT = 0.5 * IN_FT
DRYWALL_THICKNESS_RATED_FT = 0.625 * IN_FT
DRYWALL_LAYERS_RATED = 2
DRYWALL_LAYERS_STD = 1
CODE_GAP_FT = 0.0 * IN_FT                # FLAT BUILD: no gap between boards (panels butt flush)
LAYER_H_STAGGER_FT = PANEL_LENGTH_FT / 2.0
LAYER_V_STAGGER_FT = PANEL_WIDTH_FT / 2.0
ODD_ROW_SHIFT_FT = 4.0                   # stagger odd courses

# Maximize whole 4x8 sheets: kill the odd-row stagger so every row starts at its region's origin
# - far fewer cut pieces (a full-sheet grid with a single rip at each far edge). Joints then line
# up row-to-row, which is not how sheets are hung on a real job, but it is what the sim needs
# (user 2026-07-16: "I want 4x8 drywall everywhere possible"). Set False for staggered courses.
MAXIMIZE_WHOLE_PANELS = True
TAPERED_LONG_EDGES = False               # FLAT BUILD: no factory taper - panels are flat slabs
TAPER_DEPTH_FT = 0.0625 * IN_FT
TAPER_WIDTH_FT = 2.25 * IN_FT
MIN_PIECE_WIDTH_FT = 0.25
MIN_PIECE_HEIGHT_FT = 0.25

# ---- Fasteners ----
SCREW_SPACING_FT = 12.0 * IN_FT          # field screws 12" OC (ceilings) along each furring line
SCREW_EDGE_SETBACK_FT = 0.5 * IN_FT      # set screws back from board edges/ends (USG/GA min 3/8")
SCREW_EDGE_TOL_FT = 0.05                 # a furring line / board end within this of an edge = a joint
SCREW_MARKER_SIZE_FT = 0.5 * IN_FT
SCREW_MARKER_DEPTH_FT = 0.15 * IN_FT     # total head thickness (mostly embedded)
SCREW_HEAD_PROUD_FT = 0.02 * IN_FT       # subtle proud amount below the drywall
SCREWS_OUTER_LAYER_ONLY = True
MAX_SCREWS_PER_CEILING = 8000

# ---- Openings / fixtures ----
CUT_FIXTURES = True                      # cut around family instances hosted on the ceiling
FIXTURE_CLEARANCE_FT = 0.05

# Columns (and beams) are generated by their OWN plugins (ORIGIN Columns / ORIGIN Beams) with no
# knowledge of the ceiling, and the ceiling generator previously had no knowledge of THEM - a
# ceiling/soffit board could run straight through a column/beam with no cutout (user report
# 2026-07-21, screenshot: ceiling panel intruding a corner column). Their plan footprints are
# punched out of the ceiling clip mask the SAME way hosted fixtures already are (append to the
# fixtures rect list) - flows through every mode (rooms, zones, narrow-soffit) automatically.
CUT_AT_COLUMNS = True
CUT_AT_BEAMS = True
# Must equal the column/beam plugins' own DRYWALL_T_FT (0.5in) so the ceiling cutout edge lands
# exactly on the column/beam board's real outer face - a bigger value (the old 0.05ft/0.6in)
# leaves the boards short of the cutout by the difference, a visible "vacuum gap" in the sim
# (user report 2026-07-27, DP-S001-004 vs DP-K001-005/007).
COLUMN_BEAM_CLEARANCE_FT = 0.5 * IN_FT

# ---- Fire rating override: None = auto-detect; True/False = force ----
FORCE_FIRE_RATED = None

# ---- Export ----
CREATE_EXPORT_VIEW = True
EXPORT_VIEW_NAME = "ORIGIN Assembly"
WRITE_MANIFEST = True
MANIFEST_PATH = r"C:\Users\Origoncad\Downloads\origin_revit_drywall_scripts_v2_two_faces\origin_ceiling_manifest_notaper_noscrew_nojoint.json"

HOLE_MARGIN_FT = 0.05

# Dynamo inputs:
#   IN[0] = selected ceiling(s) (or current selection)
#   IN[5] = delete previous (override)
#   IN[6] = generate drywall (override)
#   IN[7] = force fire-rated (override)
#   IN[8] = generate screws (override)
# ============================================================


# ------------------------------------------------------------
# Small helpers  (shared with the wall script)
# ------------------------------------------------------------

def unwrap(item):
    try:
        return UnwrapElement(item)
    except:
        return item


def get_in(index, default=None):
    try:
        val = IN[index]
    except:
        return default
    return val if val is not None else default


def ensure_list(x):
    if x is None:
        return []
    if isinstance(x, list):
        return x
    return [x]


def as_bool(value, default):
    if value is None:
        return default
    if isinstance(value, bool):
        return value
    if isinstance(value, int):
        return value != 0
    if isinstance(value, str):
        return value.strip().lower() in ["true", "yes", "1", "y"]
    return default


def eid_value(eid):
    try:
        return eid.Value
    except:
        pass
    try:
        return eid.IntegerValue
    except:
        return -1


def clamp(value, lo, hi):
    return max(lo, min(hi, value))


def unique_sorted(values, tolerance=0.01):
    out = []
    for v in sorted(values):
        if not out or abs(out[-1] - v) > tolerance:
            out.append(v)
    return out


# ------------------------------------------------------------
# Nomenclature helpers (hierarchical element naming)
#   host tag : C### (ceiling) or S### (soffit, type name contains 'soffit'), on the ceiling Mark
#   drywall  : DP-<host>-<seq>        (single underside face -> no face letter)
#   furring  : ST-<host>-<seq>
#   screw    : SC-<host>-<seq>
# ------------------------------------------------------------

def set_mark(element, name):
    """Best-effort write of the nomenclature name to an element's Mark (schedulable/taggable)."""
    try:
        mk = element.get_Parameter(BuiltInParameter.ALL_MODEL_MARK)
        if mk and (not mk.IsReadOnly):
            mk.Set(name)
    except:
        pass


def _host_mark_param(elem):
    try:
        p = elem.get_Parameter(BuiltInParameter.ALL_MODEL_MARK)
        if p:
            return p
    except:
        pass
    try:
        return elem.LookupParameter("Mark")
    except:
        return None


def _parse_ceiling_mark(s):
    """('C'|'S', number) a ceiling Mark encodes (e.g. 'C001', 'S12'), or (None, None)."""
    if not s:
        return None, None
    t = s.strip().upper()
    if len(t) < 2 or t[0] not in ("C", "S") or not t[1:].isdigit():
        return None, None
    try:
        n = int(t[1:])
    except:
        return None, None
    return (t[0], n) if n > 0 else (None, None)


def ceiling_prefix(ceiling):
    """'S' for a soffit (type or family name contains 'soffit'), else 'C'."""
    names = []
    try:
        ct = doc.GetElement(ceiling.GetTypeId())
        if ct is not None:
            try:
                names.append(ct.Name)
            except:
                pass
            try:
                if ct.FamilyName:
                    names.append(ct.FamilyName)
            except:
                pass
    except:
        pass
    for nm in names:
        try:
            if "soffit" in nm.lower():
                return "S"
        except:
            pass
    return "C"


def assign_ceiling_numbers(ceilings, warnings):
    """Give each selected ceiling a stable, per-type-unique host tag: 'C###' (ceiling) or 'S###'
    (soffit). Reuses the tag already in the ceiling's Mark when its prefix still matches the
    element's current type; new numbers are the smallest free within that prefix across ALL
    ceilings in the model, written back to Mark so reruns stay stable. Selected ceilings are
    numbered in ElementId order. Returns {ceiling_eid_value: 'C001'/'S001'}. Runs in a
    transaction. Best-effort: Mark write failures are reported, not fatal."""
    taken = {"C": set(), "S": set()}
    try:
        for c in FilteredElementCollector(doc).OfClass(Ceiling).WhereElementIsNotElementType():
            p = _host_mark_param(c)
            pr, n = _parse_ceiling_mark(p.AsString()) if p else (None, None)
            if pr in ("C", "S") and n is not None:
                taken[pr].add(n)
    except Exception as ex:
        warnings.append("Ceiling-number scan failed (continuing): {}".format(ex))

    selected = sorted(ceilings, key=lambda c: eid_value(c.Id))
    assigned = {}
    used_here = {"C": set(), "S": set()}
    # Pass 1: honor an existing Mark whose prefix matches the ceiling's current type prefix.
    for c in selected:
        pref = ceiling_prefix(c)
        p = _host_mark_param(c)
        pr, n = _parse_ceiling_mark(p.AsString()) if p else (None, None)
        if pr == pref and n is not None and n not in used_here[pref]:
            assigned[eid_value(c.Id)] = "{}{:03d}".format(pref, n)
            used_here[pref].add(n)
    # Pass 2: assign the rest the smallest free number within their prefix; persist to Mark.
    nxt = {"C": 1, "S": 1}
    for c in selected:
        key = eid_value(c.Id)
        pref = ceiling_prefix(c)
        if key not in assigned:
            while nxt[pref] in taken[pref] or nxt[pref] in used_here[pref]:
                nxt[pref] += 1
            used_here[pref].add(nxt[pref])
            taken[pref].add(nxt[pref])
            assigned[key] = "{}{:03d}".format(pref, nxt[pref])
        tag = assigned[key]
        p = _host_mark_param(c)
        if p is not None and not p.IsReadOnly:
            try:
                if (p.AsString() or "") != tag:
                    p.Set(tag)
            except Exception as ex:
                warnings.append("Could not set Mark on ceiling {}: {}".format(eid_value(c.Id), ex))
    return assigned


# ------------------------------------------------------------
# 2D polygon helpers (world X-Y)
# ------------------------------------------------------------

def poly_bbox(poly):
    xs = [p[0] for p in poly]
    ys = [p[1] for p in poly]
    return (min(xs), min(ys), max(xs), max(ys))


def poly_area(pts):
    a = 0.0
    n = len(pts)
    for i in range(n):
        x0, y0 = pts[i]
        x1, y1 = pts[(i + 1) % n]
        a += x0 * y1 - x1 * y0
    return abs(a) / 2.0


def point_in_polygon(px, py, poly):
    """Ray-casting point-in-polygon. poly = list of (x, y)."""
    inside = False
    n = len(poly)
    j = n - 1
    for i in range(n):
        xi, yi = poly[i]
        xj, yj = poly[j]
        if ((yi > py) != (yj > py)) and (px < (xj - xi) * (py - yi) / (yj - yi + 1e-12) + xi):
            inside = not inside
        j = i
    return inside


def rects_overlap(a, b):
    return not (a[2] <= b[0] or b[2] <= a[0] or a[3] <= b[1] or b[3] <= a[1])


def merge_small_pieces(pieces, min_safe_ft):
    """2D analog of the wall build's merge_small_segments(): fuse any rect whose narrower
    dimension is under min_safe_ft into a touching neighbor RECT IN THE SAME LIST that shares its
    full X-range (stacked in Y) or full Y-range (stacked in X), instead of keeping it as its own
    tiny sliver or dropping it and leaving a hole. Only merges along a shared full edge (so the
    result is always still a plain rectangle) - an arbitrary L-shaped merge is not attempted, and
    a rect with no same-range neighbor to absorb it into is left as-is (the caller's existing
    MIN_PIECE_WIDTH/HEIGHT check still drops a genuinely isolated tiny leftover). Fixes the class
    of bug where a wall that only touches a zone's boundary edge (without truly crossing into it)
    still injects a spurious internal seam, leaving a confetti-sized board between two normal
    ones (user report 2026-07-30, DP-S001-020/021/022 - a whole 4ft course chopped into 3 pieces
    with a 3in sliver in the middle, no real wall ever running through that course)."""
    pcs = [list(p) for p in pieces]
    changed = True
    while changed:
        changed = False
        for i, (x0, y0, x1, y1) in enumerate(pcs):
            if min(x1 - x0, y1 - y0) >= min_safe_ft:
                continue
            for j, (ox0, oy0, ox1, oy1) in enumerate(pcs):
                if i == j:
                    continue
                if abs(ox0 - x0) < 1e-4 and abs(ox1 - x1) < 1e-4:      # same X-range
                    if abs(oy1 - y0) < 1e-4:
                        pcs[j][3] = y1
                    elif abs(oy0 - y1) < 1e-4:
                        pcs[j][1] = y0
                    else:
                        continue
                elif abs(oy0 - y0) < 1e-4 and abs(oy1 - y1) < 1e-4:    # same Y-range
                    if abs(ox1 - x0) < 1e-4:
                        pcs[j][2] = x1
                    elif abs(ox0 - x1) < 1e-4:
                        pcs[j][0] = x0
                    else:
                        continue
                else:
                    continue
                del pcs[i]
                changed = True
                break
            if changed:
                break
    return [tuple(p) for p in pcs]


def rect_area(r):
    return max(0.0, r[2] - r[0]) * max(0.0, r[3] - r[1])


# ------------------------------------------------------------
# Ceiling reading
# ------------------------------------------------------------

def apply_process_mode(ceilings, warnings):
    """PROCESS_MODE='ceilings' drops soffit-named elements (the Soffits node owns them)."""
    if PROCESS_MODE != "ceilings":
        return ceilings
    kept = [e for e in ceilings if ceiling_prefix(e) != "S"]
    if len(kept) != len(ceilings):
        warnings.append("{} soffit(s) skipped here - the ORIGIN Soffits node handles them".format(
            len(ceilings) - len(kept)))
    return kept


def get_input_ceilings(warnings):
    ceilings = []
    if PROCESS_MODE == "soffits":
        # The Soffits plugin self-collects every soffit-named ceiling, model-wide.
        for e in FilteredElementCollector(doc).OfClass(Ceiling).WhereElementIsNotElementType():
            if ceiling_prefix(e) == "S":
                ceilings.append(e)
        return ceilings
    data = get_in(0)
    if data:
        for item in ensure_list(data):
            e = unwrap(item)
            if isinstance(e, Ceiling):
                ceilings.append(e)
    if ceilings:
        return apply_process_mode(ceilings, warnings)
    try:
        for eid in list(uidoc.Selection.GetElementIds()):
            e = doc.GetElement(eid)
            if isinstance(e, Ceiling):
                ceilings.append(e)
    except Exception as ex:
        warnings.append("Could not read selection: {}".format(ex))
    if ceilings:
        return apply_process_mode(ceilings, warnings)
    if PROCESS_ALL_CEILINGS_IF_NONE_SELECTED:
        for e in FilteredElementCollector(doc).OfClass(Ceiling).WhereElementIsNotElementType():
            ceilings.append(e)
    return apply_process_mode(ceilings, warnings)


def get_ceiling_loops(ceiling, warnings):
    """Return (loops, z) where loops = list of polygons [[(x,y),...], ...] with the LARGEST-area
    loop first (outer) and the rest treated as holes, and z = the bottom-face elevation. Extracted
    from the ceiling's geometry (the downward-facing planar face), tessellating any curved edges."""
    opt = Options()
    opt.ComputeReferences = False
    opt.IncludeNonVisibleObjects = False
    try:
        opt.DetailLevel = ViewDetailLevel.Medium
    except:
        pass

    best_face = None
    best_z = None
    try:
        geo = ceiling.get_Geometry(opt)
        for g in geo:
            solid = g if isinstance(g, Solid) else None
            if solid is None or solid.Volume <= 0:
                continue
            for face in solid.Faces:
                if not isinstance(face, PlanarFace):
                    continue
                nrm = face.FaceNormal
                if nrm.Z < -0.9:                       # downward-facing = room-side bottom face
                    z = face.Origin.Z
                    if best_face is None or z < best_z:   # lowest such face
                        best_face = face
                        best_z = z
    except Exception as ex:
        warnings.append("Ceiling {}: geometry read failed ({})".format(eid_value(ceiling.Id), ex))
        return None, None

    if best_face is None:
        return None, None

    loops = []
    try:
        curve_loops = best_face.GetEdgesAsCurveLoops()
        for cl in curve_loops:
            pts = []
            for c in cl:
                try:
                    tess = c.Tessellate()
                except:
                    tess = [c.GetEndPoint(0), c.GetEndPoint(1)]
                for p in tess:
                    if not pts or abs(pts[-1][0] - p.X) > 1e-6 or abs(pts[-1][1] - p.Y) > 1e-6:
                        pts.append((p.X, p.Y))
            if len(pts) >= 2 and abs(pts[0][0] - pts[-1][0]) < 1e-6 and abs(pts[0][1] - pts[-1][1]) < 1e-6:
                pts = pts[:-1]
            if len(pts) >= 3:
                loops.append(pts)
    except Exception as ex:
        warnings.append("Ceiling {}: loop extraction failed ({})".format(eid_value(ceiling.Id), ex))
        return None, None

    if not loops:
        return None, None
    loops.sort(key=poly_area, reverse=True)     # largest = outer, rest = holes
    return loops, best_z


def ceiling_is_fire_rated(ceiling, warnings):
    if FORCE_FIRE_RATED is not None:
        return bool(FORCE_FIRE_RATED)
    try:
        ct = doc.GetElement(ceiling.GetTypeId())
    except:
        ct = None
    if ct is None:
        return False
    try:
        p = ct.LookupParameter("Fire Rating")
        if p is not None and p.HasValue:
            st = p.StorageType
            if st == StorageType.String:
                s = p.AsString()
                if s and any(ch.isdigit() for ch in s):
                    return True
            elif st == StorageType.Double and p.AsDouble() > 0.01:
                return True
            elif st == StorageType.Integer and p.AsInteger() > 0:
                return True
    except:
        pass
    try:
        name = ct.Name.lower()
        for kw in ("fire", "rated", "type x", "type-x", "1 hr", "2 hr", "1-hr", "2-hr", "1hr", "2hr"):
            if kw in name:
                return True
    except:
        pass
    return False


def get_fixture_rects(ceiling, warnings):
    """Plan-view (x0,y0,x1,y1) bounding rects of family instances hosted on this ceiling
    (lights, diffusers, access panels). Best-effort."""
    rects = []
    if not CUT_FIXTURES:
        return rects
    cid = ceiling.Id
    try:
        col = FilteredElementCollector(doc).OfClass(FamilyInstance).WhereElementIsNotElementType()
        for fi in col:
            host = None
            try:
                host = fi.Host
            except:
                host = None
            if host is None or host.Id != cid:
                continue
            try:
                bb = fi.get_BoundingBox(None)
            except:
                bb = None
            if not bb:
                continue
            x0 = bb.Min.X - FIXTURE_CLEARANCE_FT
            y0 = bb.Min.Y - FIXTURE_CLEARANCE_FT
            x1 = bb.Max.X + FIXTURE_CLEARANCE_FT
            y1 = bb.Max.Y + FIXTURE_CLEARANCE_FT
            if (x1 - x0) > 0.1 and (y1 - y0) > 0.1:
                rects.append((x0, y0, x1, y1))
    except Exception as ex:
        warnings.append("Ceiling {}: fixture scan failed ({})".format(eid_value(ceiling.Id), ex))
    return rects


# ------------------------------------------------------------
# Geometry primitives  (shared with the wall script)
# ------------------------------------------------------------

def make_point(origin, u, v, x, y):
    return origin.Add(u.Multiply(x)).Add(v.Multiply(y))


def _extrude_loops(loops, extrude_dir, depth, material_id, gstyle_id):
    if material_id is not None:
        gs = gstyle_id if gstyle_id is not None else ElementId.InvalidElementId
        opts = SolidOptions(material_id, gs)
        return GeometryCreationUtilities.CreateExtrusionGeometry(loops, extrude_dir, depth, opts)
    return GeometryCreationUtilities.CreateExtrusionGeometry(loops, extrude_dir, depth)


def make_planar_poly_solid(origin, u, v, normal, pts2d, depth, material_id=None, gstyle_id=None):
    clean = []
    for p in pts2d:
        if not clean or abs(clean[-1][0] - p[0]) > 1e-7 or abs(clean[-1][1] - p[1]) > 1e-7:
            clean.append(p)
    if len(clean) >= 2 and abs(clean[0][0] - clean[-1][0]) < 1e-7 and abs(clean[0][1] - clean[-1][1]) < 1e-7:
        clean = clean[:-1]
    if len(clean) < 3 or depth <= 0:
        return None
    verts = [make_point(origin, u, v, x, y) for (x, y) in clean]
    for order in (verts, list(reversed(verts))):
        try:
            loop = CurveLoop()
            n = len(order)
            for i in range(n):
                loop.Append(Line.CreateBound(order[i], order[(i + 1) % n]))
            loops = List[CurveLoop]()
            loops.Add(loop)
            return _extrude_loops(loops, normal, depth, material_id, gstyle_id)
        except:
            continue
    return None


def make_rect_solid(origin, u, v, normal, rect, depth, material_id=None, gstyle_id=None):
    x0, y0, x1, y1 = rect
    if (x1 - x0) < 0.001 or (y1 - y0) < 0.001 or depth <= 0:
        return None
    pts = [(x0, y0), (x1, y0), (x1, y1), (x0, y1)]
    return make_planar_poly_solid(origin, u, v, normal, pts, depth, material_id, gstyle_id)


def make_profile_solid(origin, ax, ay, points2d, extrude_dir, depth, material_id=None, gstyle_id=None):
    if depth <= 0 or points2d is None or len(points2d) < 3:
        return None
    verts = [origin.Add(ax.Multiply(p)).Add(ay.Multiply(q)) for (p, q) in points2d]
    for order in (verts, list(reversed(verts))):
        try:
            loop = CurveLoop()
            n = len(order)
            for i in range(n):
                loop.Append(Line.CreateBound(order[i], order[(i + 1) % n]))
            loops = List[CurveLoop]()
            loops.Add(loop)
            return _extrude_loops(loops, extrude_dir, depth, material_id, gstyle_id)
        except:
            continue
    return None


def boolean_op(a, b, op):
    if a is None:
        return None
    if b is None:
        return a
    try:
        return BooleanOperationsUtils.ExecuteBooleanOperation(a, b, op)
    except:
        return a


def solid_ok(s):
    """A usable, non-empty solid (a boolean clip that lands fully outside returns ~0 volume)."""
    try:
        return s is not None and s.Volume > 1e-7
    except:
        return s is not None


def make_tapered_board_solid(origin_at_z, u, v, normal, rect, thickness, material_id=None, gstyle_id=None):
    """Ceiling board whose ROOM-FACING (bottom, -normal) side recesses near its two long edges
    (the factory taper). Built by extruding a (width x thickness) profile along the board LENGTH
    (u = X). normal = +Z (up). The taper is on the bottom, so it recesses at low thickness-q."""
    x0, y0, x1, y1 = rect
    length = x1 - x0
    width = y1 - y0
    if length < 0.001 or width < 0.001 or thickness <= 0:
        return None
    td = min(TAPER_DEPTH_FT, thickness * 0.9)
    tw = TAPER_WIDTH_FT
    if td <= 0 or tw <= 0 or width <= 2.0 * tw + 0.01:
        return make_rect_solid(origin_at_z, u, v, normal, rect, thickness, material_id, gstyle_id)
    origin = make_point(origin_at_z, u, v, x0, y0)
    # profile: (w along v = board width, d along normal = thickness). Room side is d=0 (bottom);
    # it recesses to d=td at the two long edges (w=0 and w=width) over tw. Top (d=thickness) flat.
    profile = [(0.0, td), (tw, 0.0), (width - tw, 0.0), (width, td),
               (width, thickness), (0.0, thickness)]
    return make_profile_solid(origin, v, normal, profile, u, length, material_id, gstyle_id)


def create_directshape(solid, data_id, name, comments, warnings):
    if solid is None:
        return None
    try:
        ds = DirectShape.CreateElement(doc, ElementId(BuiltInCategory.OST_GenericModel))
        ds.ApplicationId = APP_ID
        ds.ApplicationDataId = data_id
        shape = List[GeometryObject]()
        shape.Add(solid)
        ds.SetShape(shape)
        try:
            ds.Name = name
        except:
            pass
        try:
            p = ds.get_Parameter(BuiltInParameter.ALL_MODEL_INSTANCE_COMMENTS)
            if p and not p.IsReadOnly:
                p.Set(comments)
        except:
            pass
        set_mark(ds, name)          # nomenclature also on Mark: schedulable + taggable
        return ds
    except Exception as ex:
        warnings.append("DirectShape create failed for {}: {}".format(data_id, ex))
        return None


def _ds_solids(ds):
    out = []
    try:
        opt = Options()
        geo = ds.get_Geometry(opt)
        if geo is None:
            return out
        for g in geo:
            if isinstance(g, Solid) and g.Volume > 1e-9:
                out.append(g)
    except Exception:
        pass
    return out


def merge_undersized_ceiling_boards(cid, warnings, min_safe_ft=None):
    """Post-pass, run once per ceiling right after all its rooms/zones are emitted: the boolean
    clip against a room/zone's real (possibly irregular) boundary - build_boundary_solid's mask,
    which can include a wall, a fixture, a column/beam footprint, or just an odd-shaped real
    boundary - has NO size floor of its own, so a grid cell whose real remaining footprint AFTER
    clipping is a thin sliver still survives as its own tiny board. merge_small_pieces() cannot
    catch this: it only merges within ONE grid cell's own wall_x_cuts/y_cuts sub-pieces, not
    across the different cells/rows that a mask-driven remainder can span (confirmed live,
    2026-07-30: DP-S001-039/041/043/048 were four separate ~3.6in slivers stacked across four
    different rows, all clipped down by the same zone-boundary edge that doesn't land on an 8ft
    grid line - each row's OWN per-cell merge never saw the others). Finds every DP-<host>-* board
    on this ceiling whose bbox short dimension is under the safe floor, finds its immediate
    same-layer neighbor sharing the full perpendicular range and touching edge (same row or same
    column), and replaces the pair with ONE board via a real boolean union of their already-valid
    solids - no re-derivation of the zone mask needed, since the union of two solids that are each
    already inside the mask is trivially still inside it. Returns (merged_count, removed_marks)."""
    if min_safe_ft is None:
        min_safe_ft = MIN_SAFE_SEGMENT_FT
    try:
        try:
            doc.Regenerate()
        except Exception as ex:
            warnings.append("doc.Regenerate() before ceiling {} small-board merge failed ({})".format(cid, ex))
        boards = []
        tag = "CEILING=" + cid
        for ds in FilteredElementCollector(doc).OfClass(DirectShape).ToElements():
            try:
                cm = ds.get_Parameter(BuiltInParameter.ALL_MODEL_INSTANCE_COMMENTS)
                comments = cm.AsString() if cm else None
            except Exception:
                comments = None
            if not comments or not comments.startswith(APP_ID + " |") or tag not in comments:
                continue
            try:
                mk = ds.get_Parameter(BuiltInParameter.ALL_MODEL_MARK)
                mark = mk.AsString() if mk else None
            except Exception:
                mark = None
            if not mark or not mark.startswith("DP-"):
                continue
            bb = ds.get_BoundingBox(None)
            if bb is None:
                continue
            layer = None
            for tok in comments.split("|"):
                tok = tok.strip()
                if len(tok) >= 2 and tok[0] == "L" and tok[1:].isdigit():
                    layer = tok
            boards.append({"ds": ds, "mark": mark, "bbox": bb, "layer": layer})

        tol = max(CODE_GAP_FT * 4.0, 0.02)
        merged = 0
        removed = set()
        new_bboxes = {}       # neighbor mark -> [minX,minY,maxX,maxY] after absorbing a small board
        for b in boards:
            if b["mark"] in removed:
                continue
            bb = b["bbox"]
            dx = bb.Max.X - bb.Min.X
            dy = bb.Max.Y - bb.Min.Y
            short = min(dx, dy)
            if short >= min_safe_ft:
                continue
            thin_x = dx < dy
            best = None
            best_gap = None
            for o in boards:
                if o is b or o["mark"] in removed or o["layer"] != b["layer"]:
                    continue
                ob = o["bbox"]
                gap = None
                if thin_x:
                    if abs(ob.Min.Y - bb.Min.Y) > tol or abs(ob.Max.Y - bb.Max.Y) > tol:
                        continue
                    if abs(ob.Max.X - bb.Min.X) <= tol:
                        gap = bb.Min.X - ob.Max.X
                    elif abs(ob.Min.X - bb.Max.X) <= tol:
                        gap = ob.Min.X - bb.Max.X
                    else:
                        continue
                else:
                    if abs(ob.Min.X - bb.Min.X) > tol or abs(ob.Max.X - bb.Max.X) > tol:
                        continue
                    if abs(ob.Max.Y - bb.Min.Y) <= tol:
                        gap = bb.Min.Y - ob.Max.Y
                    elif abs(ob.Min.Y - bb.Max.Y) <= tol:
                        gap = ob.Min.Y - bb.Max.Y
                    else:
                        continue
                if best is None or abs(gap) < best_gap:
                    best = o
                    best_gap = abs(gap)
            if best is None:
                continue
            small_solids = _ds_solids(b["ds"])
            nb_solids = _ds_solids(best["ds"])
            if not small_solids or not nb_solids:
                continue
            union_solid = None
            for s1 in nb_solids:
                for s2 in small_solids:
                    try:
                        u = BooleanOperationsUtils.ExecuteBooleanOperation(
                            s1, s2, BooleanOperationsType.Union)
                        if u is not None and u.Volume > 0:
                            union_solid = u
                    except Exception:
                        continue
            if union_solid is None:
                warnings.append("{}: ceiling small-board merge into {} failed (union produced "
                                "nothing)".format(b["mark"], best["mark"]))
                continue
            expect_vol = sum(s.Volume for s in nb_solids) + sum(s.Volume for s in small_solids)
            if union_solid.Volume < expect_vol * 0.9:
                warnings.append("{}: ceiling small-board merge into {} skipped - union volume "
                                "looks wrong ({:.4f} vs expected ~{:.4f})".format(
                                    b["mark"], best["mark"], union_solid.Volume, expect_vol))
                continue
            nb_before = best["bbox"]
            try:
                shape = List[GeometryObject]()
                shape.Add(union_solid)
                best["ds"].SetShape(shape)
                # Constructed directly from the two known-good pre-merge boxes, NOT re-queried via
                # ds.get_BoundingBox() - immediately after SetShape(), before a doc.Regenerate(),
                # that call can return a STALE box (same bug already found and fixed in the wall
                # script's close_small_cross_wall_gaps() 2026-07-30), which would corrupt this same
                # neighbor's adjacency check if it gets merged again later in this same pass.
                new_bbox = BoundingBoxXYZ()
                new_bbox.Min = XYZ(min(bb.Min.X, nb_before.Min.X), min(bb.Min.Y, nb_before.Min.Y),
                                    min(bb.Min.Z, nb_before.Min.Z))
                new_bbox.Max = XYZ(max(bb.Max.X, nb_before.Max.X), max(bb.Max.Y, nb_before.Max.Y),
                                    max(bb.Max.Z, nb_before.Max.Z))
                best["bbox"] = new_bbox
                new_bboxes[best["mark"]] = [round(new_bbox.Min.X, 3), round(new_bbox.Min.Y, 3),
                                            round(new_bbox.Max.X, 3), round(new_bbox.Max.Y, 3)]
                doc.Delete(b["ds"].Id)
                removed.add(b["mark"])
                merged += 1
            except Exception as ex:
                warnings.append("{}: ceiling small-board merge SetShape/Delete failed ({})".format(
                    b["mark"], ex))
        return merged, removed, new_bboxes
    except Exception as ex:
        warnings.append("merge_undersized_ceiling_boards failed for {}: {}".format(cid, ex))
        return 0, set(), {}


# ------------------------------------------------------------
# Colored subcategories + materials  (shared machinery)
# ------------------------------------------------------------

STYLE_SPECS = [
    ("FURRING", "ORIGIN Furring Channel", (150, 155, 165)),
    ("MAIN",    "ORIGIN Carrying Channel", (95, 110, 140)),   # main runners, deeper blue-grey
    ("HANGER",  "ORIGIN Hanger Wire",      (210, 180, 90)),   # hanger wires, brass-ish
    ("GWB",     "ORIGIN Drywall Base",    (235, 228, 214)),
    ("GWB2",    "ORIGIN Drywall Face",    (222, 212, 190)),
    ("SCREW",   "ORIGIN Screw",           (200, 60, 60)),
]


def get_or_create_material(name, rgb):
    for m in FilteredElementCollector(doc).OfClass(Material):
        if m.Name == name:
            return m.Id
    mid = Material.Create(doc, name)
    try:
        m = doc.GetElement(mid)
        m.Color = Color(rgb[0], rgb[1], rgb[2])
        m.Transparency = 0
    except:
        pass
    return mid


def get_or_create_subcategory(parent_cat, name, material_id, rgb):
    try:
        for sc in parent_cat.SubCategories:
            if sc.Name == name:
                return sc
    except:
        pass
    sc = doc.Settings.Categories.NewSubcategory(parent_cat, name)
    try:
        sc.LineColor = Color(rgb[0], rgb[1], rgb[2])
    except:
        pass
    try:
        if material_id and material_id != ElementId.InvalidElementId:
            sc.Material = doc.GetElement(material_id)
    except:
        pass
    return sc


def setup_styles(warnings):
    styles = {}
    try:
        gm = doc.Settings.Categories.get_Item(BuiltInCategory.OST_GenericModel)
    except Exception as ex:
        warnings.append("Could not access Generic Model category: {}".format(ex))
        return styles
    created = []
    for kind, name, rgb in STYLE_SPECS:
        try:
            mid = get_or_create_material(name, rgb)
            get_or_create_subcategory(gm, name, mid, rgb)
            created.append((kind, name, mid))
        except Exception as ex:
            warnings.append("Coloring for {} failed: {}".format(kind, ex))
    try:
        doc.Regenerate()
    except:
        pass
    subs = {}
    try:
        gm = doc.Settings.Categories.get_Item(BuiltInCategory.OST_GenericModel)
        for sc in gm.SubCategories:
            subs[sc.Name] = sc
    except:
        pass
    for kind, name, mid in created:
        gsid = ElementId.InvalidElementId
        sub = subs.get(name)
        if sub is not None:
            try:
                gs = sub.GetGraphicsStyle(GraphicsStyleType.Projection)
                if gs:
                    gsid = gs.Id
            except:
                pass
        styles[kind] = (mid, gsid)
    return styles


styles = {}


# ------------------------------------------------------------
# Cleanup (scoped to processed ceilings)
# ------------------------------------------------------------

def delete_previous(processed_ids, warnings):
    ids = List[ElementId]()
    tokens = ["CEILING=" + c + " " for c in processed_ids]
    try:
        for e in FilteredElementCollector(doc).OfClass(DirectShape):
            comment = None
            try:
                p = e.get_Parameter(BuiltInParameter.ALL_MODEL_INSTANCE_COMMENTS)
                comment = p.AsString() if p else None
            except:
                comment = None
            is_ours = False
            try:
                if e.ApplicationId == APP_ID:
                    is_ours = True
            except:
                pass
            if not is_ours and comment and APP_ID in comment:
                is_ours = True
            if not is_ours:
                continue
            if comment and any(tok in comment for tok in tokens):
                ids.Add(e.Id)
    except Exception as ex:
        warnings.append("Cleanup failed: {}".format(ex))
    count = ids.Count
    if count > 0:
        doc.Delete(ids)
    return count


def ensure_export_view(warnings):
    if not CREATE_EXPORT_VIEW:
        return "disabled"
    try:
        view = None
        for v in FilteredElementCollector(doc).OfClass(View3D):
            try:
                if (not v.IsTemplate) and v.Name == EXPORT_VIEW_NAME:
                    view = v
                    break
            except:
                pass
        if view is None:
            vft = None
            for t in FilteredElementCollector(doc).OfClass(ViewFamilyType):
                try:
                    if t.ViewFamily == ViewFamily.ThreeDimensional:
                        vft = t
                        break
                except:
                    pass
            if vft is None:
                warnings.append("Export view: no 3D ViewFamilyType found; skipped.")
                return "no_view_type"
            view = View3D.CreateIsometric(doc, vft.Id)
            try:
                view.Name = EXPORT_VIEW_NAME
            except:
                pass
        # Isolate to ONLY the generated assembly: hide every model category except Generic Model,
        # so the base ceiling (and walls/etc.) are absent when you export FROM this view.
        try:
            gm_id = ElementId(BuiltInCategory.OST_GenericModel)
            for cat in doc.Settings.Categories:
                try:
                    if cat.CategoryType != CategoryType.Model or cat.Id == gm_id:
                        continue
                    if view.CanCategoryBeHidden(cat.Id):
                        view.SetCategoryHidden(cat.Id, True)
                except:
                    pass
        except Exception as ex:
            warnings.append("Export view isolation partial: {}".format(ex))
        return EXPORT_VIEW_NAME
    except Exception as ex:
        warnings.append("Export view creation failed: {}".format(ex))
        return "failed"


# ------------------------------------------------------------
# Layout helpers
# ------------------------------------------------------------

def layer_stack(rated):
    if rated:
        return [(DRYWALL_THICKNESS_RATED_FT, True)] * DRYWALL_LAYERS_RATED
    return [(DRYWALL_THICKNESS_STD_FT, False)] * DRYWALL_LAYERS_STD


def furring_profile():
    """Hat/furring channel: closed face at q=0 (drywall side), legs rising to FURRING_HEIGHT."""
    D = FURRING_FACE_FT
    H = FURRING_HEIGHT_FT
    t = MAT_T_FT
    return [(0, 0), (0, H), (t, H), (t, t), (D - t, t), (D - t, H), (D, H), (D, 0)]


def channel_profile(depth, face):
    """Generic open channel (used for the carrying/main channel): back at q=0, legs up to 'depth',
    width 'face'. p across the run, q up."""
    D = face
    H = depth
    t = MAT_T_FT
    return [(0, 0), (0, H), (t, H), (t, t), (D - t, t), (D - t, H), (D, H), (D, 0)]


def splice_segments(lo, hi, stock, lap, stagger):
    """Break a channel run [lo, hi] into stock-length pieces that overlap (nest) by 'lap' at each
    splice - real channels ship in stock lengths and are lapped end-to-end, not one long piece.
    'stagger' shifts the first splice so joints don't line up across adjacent channels. Returns
    overlapping [(a, b), ...] left-to-right (each piece <= stock; interior pieces overlap by lap)."""
    total = hi - lo
    if not SPLICE_CHANNELS or total <= stock + 1e-6:
        return [(lo, hi)]
    step = max(stock - lap, MIN_SEG_FT)
    first = stock - (stagger % step)          # shorten the first piece by the stagger phase
    if first < lap + MIN_SEG_FT:
        first = stock
    segs = []
    a = lo
    b = min(lo + first, hi)
    segs.append((a, b))
    while b < hi - 1e-6:
        a = b - lap                            # next piece laps back over the previous by 'lap'
        b = min(a + stock, hi)
        if b - a < MIN_SEG_FT:
            break
        segs.append((a, b))
    return segs


def normalize_shift(shift, period):
    s = float(shift)
    while s < 0.0:
        s += period
    while s >= period:
        s -= period
    return s


def build_boundary_solid(outer, holes, fixtures, z_lo, tall):
    """Extrude the ceiling outline (outer minus holes minus fixture cutters) into a tall clip mask
    spanning z_lo .. z_lo+tall, used to boolean-clip boards and furring to the room shape."""
    origin = XYZ(0.0, 0.0, z_lo)
    u = XYZ.BasisX
    v = XYZ.BasisY
    up = XYZ.BasisZ
    solid = make_planar_poly_solid(origin, u, v, up, outer, tall)
    if solid is None:
        return None
    for h in holes:
        hs = make_planar_poly_solid(XYZ(0.0, 0.0, z_lo - HOLE_MARGIN_FT), u, v, up, h, tall + 2 * HOLE_MARGIN_FT)
        solid = boolean_op(solid, hs, BooleanOperationsType.Difference)
    for fx in fixtures:
        fs = make_rect_solid(XYZ(0.0, 0.0, z_lo - HOLE_MARGIN_FT), u, v, up, fx, tall + 2 * HOLE_MARGIN_FT)
        solid = boolean_op(solid, fs, BooleanOperationsType.Difference)
    return solid


def collect_room_regions(warnings):
    """Every placed, bounded Room in the model as an independent ceiling region:
    (room_id, number, level_eid, outer_poly, inner_polys, bbox). Boundaries come from
    Room.GetBoundarySegments at FINISH faces, so a room polygon stops at the wall surface and is
    continuous across doorways (segments follow the room-bounding walls / room separation lines).
    Unenclosed or degenerate rooms are skipped with a warning instead of corrupting the run."""
    regions = []
    try:
        col = list(FilteredElementCollector(doc).OfCategory(BuiltInCategory.OST_Rooms)
                   .WhereElementIsNotElementType())
    except Exception as ex:
        warnings.append("Room collection failed: {}".format(ex))
        return regions
    opts = SpatialElementBoundaryOptions()
    try:
        opts.SpatialElementBoundaryLocation = SpatialElementBoundaryLocation.Finish
    except Exception:
        pass
    for r in col:
        rid = "R" + str(eid_value(r.Id))
        try:
            area = r.Area
        except Exception:
            area = 0.0
        if not area or area < MIN_ROOM_AREA_SF:
            warnings.append("Room {} skipped: not enclosed / zero area".format(rid))
            continue
        try:
            loops = r.GetBoundarySegments(opts)
        except Exception as ex:
            warnings.append("Room {}: GetBoundarySegments failed ({})".format(rid, ex))
            continue
        polys = []
        for loop in (loops or []):
            pts = []
            for seg in loop:
                try:
                    for p in seg.GetCurve().Tessellate():
                        if not pts or abs(pts[-1][0] - p.X) > 1e-6 or abs(pts[-1][1] - p.Y) > 1e-6:
                            pts.append((p.X, p.Y))
                except Exception:
                    continue
            if len(pts) >= 3 and abs(pts[0][0] - pts[-1][0]) < 1e-6 and abs(pts[0][1] - pts[-1][1]) < 1e-6:
                pts = pts[:-1]
            if len(pts) >= 3:
                polys.append(pts)
        if not polys:
            warnings.append("Room {} skipped: no usable boundary polygon".format(rid))
            continue
        polys.sort(key=poly_area, reverse=True)     # largest loop = the room outline, rest = holes
        num = ""
        try:
            num = r.Number
        except Exception:
            pass
        lev = -1
        try:
            lev = eid_value(r.LevelId)
        except Exception:
            pass
        regions.append((rid, num, lev, polys[0], polys[1:], poly_bbox(polys[0])))
    return regions


def collect_column_beam_footprints(warnings):
    """Plan-view (x0, y0, x1, y1, z0, z1) footprint of every column and beam in the model, for
    punching a hole in the ceiling clip mask at each one (same mechanism as hosted fixtures) so
    no ceiling/soffit board runs through a column or beam. Z-range kept so a footprint only
    cuts a ceiling it actually spans past (e.g. a beam under a lower ceiling doesn't cut one
    on a floor above)."""
    rects = []
    cats = []
    if CUT_AT_COLUMNS:
        cats += [BuiltInCategory.OST_Columns, BuiltInCategory.OST_StructuralColumns]
    if CUT_AT_BEAMS:
        cats += [BuiltInCategory.OST_StructuralFraming]
    c = COLUMN_BEAM_CLEARANCE_FT
    for bic in cats:
        try:
            for e in FilteredElementCollector(doc).OfCategory(bic).WhereElementIsNotElementType():
                try:
                    bb = e.get_BoundingBox(None)
                except Exception:
                    bb = None
                if bb is None:
                    continue
                x0, y0, x1, y1 = bb.Min.X - c, bb.Min.Y - c, bb.Max.X + c, bb.Max.Y + c
                if (x1 - x0) > 0.1 and (y1 - y0) > 0.1:
                    rects.append((x0, y0, x1, y1, bb.Min.Z, bb.Max.Z))
        except Exception as ex:
            warnings.append("Column/beam footprint scan failed ({}): {}".format(bic, ex))
    return rects


def collect_wall_plans(warnings):
    """Plan footprint of every straight wall in the model, for clipping the ceiling drywall at
    walls: returns a list of (poly4, bbox, axis, f_lo, f_hi) where axis is 'x' when the wall runs
    along Y (its two faces are the X lines f_lo/f_hi), 'y' when it runs along X, or None for an
    oblique wall (clip-only - no forced board joints)."""
    plans = []
    try:
        wcol = FilteredElementCollector(doc).OfClass(Wall).WhereElementIsNotElementType()
    except Exception as ex:
        warnings.append("Wall collection for ceiling clipping failed: {}".format(ex))
        return plans
    for w in wcol:
        try:
            loc = w.Location
            crv = loc.Curve if isinstance(loc, LocationCurve) else None
            if not isinstance(crv, Line):
                continue
            p0 = crv.GetEndPoint(0)
            p1 = crv.GetEndPoint(1)
            dx = p1.X - p0.X
            dy = p1.Y - p0.Y
            ln = math.sqrt(dx * dx + dy * dy)
            if ln < 1e-6:
                continue
            ux = dx / ln
            uy = dy / ln
            hw = w.Width / 2.0
            nx = -uy
            ny = ux
            # A footprint from the LOCATION LINE assumes the line is the wall CENTERLINE - false
            # when the wall's Location Line is set to a face (the subtraction then misses half
            # the wall and ceiling boards penetrate it). For axis-aligned walls use the element's
            # model bbox instead: exact faces regardless of location-line setting or joins.
            poly = None
            axis, f_lo, f_hi = None, 0.0, 0.0
            if abs(ux) < 0.02 or abs(uy) < 0.02:
                try:
                    bb = w.get_BoundingBox(None)
                except Exception:
                    bb = None
                if bb is not None:
                    x0, y0, x1, y1 = bb.Min.X, bb.Min.Y, bb.Max.X, bb.Max.Y
                    poly = [(x0, y0), (x1, y0), (x1, y1), (x0, y1)]
                    if abs(ux) < 0.02:          # wall runs along Y -> faces are X lines
                        axis, f_lo, f_hi = "x", x0, x1
                    else:                       # wall runs along X -> faces are Y lines
                        axis, f_lo, f_hi = "y", y0, y1
            if poly is None:                    # oblique wall, or bbox unavailable
                poly = [(p0.X + nx * hw, p0.Y + ny * hw), (p1.X + nx * hw, p1.Y + ny * hw),
                        (p1.X - nx * hw, p1.Y - ny * hw), (p0.X - nx * hw, p0.Y - ny * hw)]
                if abs(ux) < 0.02:
                    axis, f_lo, f_hi = "x", p0.X - hw, p0.X + hw
                elif abs(uy) < 0.02:
                    axis, f_lo, f_hi = "y", p0.Y - hw, p0.Y + hw
            plans.append((poly, poly_bbox(poly), axis, f_lo, f_hi))
        except Exception:
            continue
    return plans


def board_fully_inside(rect, outer, holes, fixtures):
    """True if the board rect is safely inside the outer polygon and clear of every hole/fixture,
    so it can be emitted whole (and tapered) with no boolean clip. Corner test + overlap test;
    a concave outer edge cutting through an all-corners-inside rect is a rare unhandled case."""
    x0, y0, x1, y1 = rect
    for (cx, cy) in [(x0, y0), (x1, y0), (x1, y1), (x0, y1)]:
        if not point_in_polygon(cx, cy, outer):
            return False
    for h in holes:
        if rects_overlap(rect, poly_bbox(h)):
            return False
    for fx in fixtures:
        if rects_overlap(rect, fx):
            return False
    return True


# ------------------------------------------------------------
# Emit
# ------------------------------------------------------------

def ds_comment(ceiling_id, kind, eid):
    return "{} | CEILING={} | {} | {}".format(APP_ID, ceiling_id, kind, eid)


def emit_furring(ceiling_id, host_tag, st_counter, z_top, boundary_solid, xlo, xhi, ylo, yhi,
                 warnings, frecords, room_id=None):
    """Furring hat-channels @16" OC running along X, just above the drywall (bottom face at z_top).
    Long lines are spliced into stock-length pieces that lap at each joint (splice_segments), with
    the splices staggered row-to-row. Each piece is clipped to the ceiling outline and named
    ST-<host>-<n> (flat per-ceiling framing sequence). Returns (pieces_made, splice_joints)."""
    if not GENERATE_FURRING:
        return 0, 0
    mat, gs = styles.get("FURRING", (None, None))
    prof = furring_profile()
    made = 0
    splices = 0
    fi = 0
    y = ylo
    while y <= yhi + 1e-6:
        if (xhi - xlo) >= MIN_SEG_FT:
            # A long furring line ships as stock-length pieces lapped at each splice; stagger the
            # splices row-to-row so joints don't line up. cross-section (p across Y, q up Z),
            # centered on the furring line y; extrude along X.
            segs = splice_segments(xlo, xhi, FURRING_STOCK_LENGTH_FT, FURRING_SPLICE_LAP_FT,
                                   fi * SPLICE_STAGGER_FT)
            if len(segs) > 1:
                splices += len(segs) - 1
            for si, (ax, bx) in enumerate(segs):
                seg_len = bx - ax
                if seg_len < MIN_SEG_FT:
                    continue
                dz = MAT_T_FT if (SPLICE_NEST_OFFSET and si % 2 == 1) else 0.0   # nested-lap look
                origin = XYZ(ax, y - FURRING_FACE_FT / 2.0, z_top + dz)
                raw = make_profile_solid(origin, XYZ.BasisY, XYZ.BasisZ, prof, XYZ.BasisX, seg_len, mat, gs)
                clipped = boolean_op(raw, boundary_solid, BooleanOperationsType.Intersect)
                if not solid_ok(clipped):
                    continue
                name = "ST-{}-{:03d}".format(host_tag, st_counter[0] + 1)
                ds = create_directshape(clipped, name, name,
                                        ds_comment(ceiling_id, "FURRING", name), warnings)
                if ds:
                    st_counter[0] += 1
                    made += 1
                    try:
                        fbb = clipped.GetBoundingBox()
                        fmn = fbb.Transform.OfPoint(fbb.Min)
                        fmx = fbb.Transform.OfPoint(fbb.Max)
                        fbox = [round(fmn.X, 3), round(fmn.Y, 3), round(fmx.X, 3), round(fmx.Y, 3)]
                    except Exception:
                        fbox = None
                    frecords.append({
                        "id": name, "ceiling_number": host_tag, "host_ceiling": ceiling_id,
                        "member_type": "FURRING",
                        "profile": "HAT", "depth_in": round(FURRING_HEIGHT_FT * 12.0, 3),
                        "face_in": round(FURRING_FACE_FT * 12.0, 3),
                        "length_in": round(seg_len * 12.0, 3), "line_y_in": round(y * 12.0, 2),
                        "piece": si + 1, "pieces": len(segs),
                        "bbox_ft": fbox, "room_id": room_id,
                        "install_order": len(frecords) + 1,
                    })
        fi += 1
        y += FURRING_SPACING_FT
    return made, splices


def furring_lines(ylo, yhi):
    ys = []
    y = ylo
    while y <= yhi + 1e-6:
        ys.append(y)
        y += FURRING_SPACING_FT
    return ys


def point_inside_room(px, py, outer, holes, fixtures):
    """True if (px, py) is inside the ceiling outline and clear of holes/fixtures."""
    if not point_in_polygon(px, py, outer):
        return False
    for h in holes:
        if point_in_polygon(px, py, h):
            return False
    for fx in fixtures:
        if fx[0] < px < fx[2] and fx[1] < py < fx[3]:
            return False
    return True


def emit_mains(ceiling_id, host_tag, st_counter, z_top, boundary_solid, outer, holes, fixtures,
               xlo, xhi, ylo, yhi, warnings, frecords, room_id=None):
    """Reinforcement for long spans: when the furring run (xhi-xlo) exceeds MAX_FURRING_SPAN_FT, the
    furring can't carry the gypsum without sagging, so add MAIN carrying channels perpendicular to
    the furring at MAIN_SPACING_FT (sitting just above the furring), each hung from the structure by
    HANGER wires at HANGER_SPACING_FT. Furring then spans <= MAX_FURRING_SPAN_FT between mains. Mains
    are clipped to the ceiling outline; hangers are placed only where they land inside the room.
    Mains ship in stock lengths too, so long ones are spliced (lapped) and staggered between mains.
    Named ST-<host>-<n> (shared framing sequence). Returns (mains_made, hangers_made, splice_joints)."""
    if not GENERATE_MAINS or (xhi - xlo) <= MAX_FURRING_SPAN_FT + 1e-6:
        return 0, 0, 0
    mat, gs = styles.get("MAIN", (None, None))
    hmat, hgs = styles.get("HANGER", (None, None))
    prof = channel_profile(MAIN_DEPTH_FT, MAIN_FACE_FT)
    z_main = z_top + FURRING_HEIGHT_FT          # mains sit on top of the furring
    z_hang = z_main + MAIN_DEPTH_FT             # hanger wires rise from the top of the main
    mains = 0
    hangers = 0
    splices = 0

    # Interior main x-positions every MAIN_SPACING; the furring is also supported at the two ends
    # (perimeter), so only interior supports are needed.
    mx = xlo + MAIN_SPACING_FT
    mi = 0
    while mx < xhi - 1e-6:
        if (yhi - ylo) >= MIN_SEG_FT:
            # A long carrying channel also ships in stock lengths, lapped at each splice; stagger
            # the splices between adjacent mains.
            segs = splice_segments(ylo, yhi, MAIN_STOCK_LENGTH_FT, MAIN_SPLICE_LAP_FT,
                                   mi * SPLICE_STAGGER_FT)
            if len(segs) > 1:
                splices += len(segs) - 1
            made_here = False
            for si, (ay, by) in enumerate(segs):
                seg_len = by - ay
                if seg_len < MIN_SEG_FT:
                    continue
                dz = MAT_T_FT if (SPLICE_NEST_OFFSET and si % 2 == 1) else 0.0
                origin = XYZ(mx - MAIN_FACE_FT / 2.0, ay, z_main + dz)
                raw = make_profile_solid(origin, XYZ.BasisX, XYZ.BasisZ, prof, XYZ.BasisY, seg_len, mat, gs)
                clipped = boolean_op(raw, boundary_solid, BooleanOperationsType.Intersect)
                if not solid_ok(clipped):
                    continue
                name = "ST-{}-{:03d}".format(host_tag, st_counter[0] + 1)
                ds = create_directshape(clipped, name, name,
                                        ds_comment(ceiling_id, "MAIN", name), warnings)
                if ds:
                    st_counter[0] += 1
                    mains += 1
                    made_here = True
                    try:
                        mbb = clipped.GetBoundingBox()
                        mmn = mbb.Transform.OfPoint(mbb.Min)
                        mmx = mbb.Transform.OfPoint(mbb.Max)
                        mbox = [round(mmn.X, 3), round(mmn.Y, 3), round(mmx.X, 3), round(mmx.Y, 3)]
                    except Exception:
                        mbox = None
                    frecords.append({
                        "id": name, "ceiling_number": host_tag, "host_ceiling": ceiling_id,
                        "member_type": "MAIN", "profile": "CRC",
                        "depth_in": round(MAIN_DEPTH_FT * 12.0, 3),
                        "face_in": round(MAIN_FACE_FT * 12.0, 3),
                        "length_in": round(seg_len * 12.0, 3), "line_x_in": round(mx * 12.0, 2),
                        "piece": si + 1, "pieces": len(segs),
                        "bbox_ft": mbox, "room_id": room_id,
                        "install_order": len(frecords) + 1,
                    })
            # Hanger wires along this main line - only when there is a deck above to anchor into
            # (GENERATE_HANGERS). Within 6" of ends, then every HANGER_SPACING.
            if made_here and GENERATE_HANGERS:
                hpos = [ylo + END_SUPPORT_SETBACK_FT]
                yy = ylo + END_SUPPORT_SETBACK_FT + HANGER_SPACING_FT
                while yy < yhi - END_SUPPORT_SETBACK_FT + 1e-6:
                    hpos.append(yy)
                    yy += HANGER_SPACING_FT
                hpos.append(yhi - END_SUPPORT_SETBACK_FT)
                half = HANGER_DIA_FT / 2.0
                for hy in unique_sorted(hpos):
                    if not point_inside_room(mx, hy, outer, holes, fixtures):
                        continue
                    hrect = (mx - half, hy - half, mx + half, hy + half)
                    hs = make_rect_solid(XYZ(0.0, 0.0, z_hang), XYZ.BasisX, XYZ.BasisY,
                                         XYZ.BasisZ, hrect, HANGER_DROP_FT, hmat, hgs)
                    if not solid_ok(hs):
                        continue
                    hname = "ST-{}-{:03d}".format(host_tag, st_counter[0] + 1)
                    hds = create_directshape(hs, hname, hname,
                                             ds_comment(ceiling_id, "HANGER", hname), warnings)
                    if hds:
                        st_counter[0] += 1
                        hangers += 1
                        frecords.append({
                            "id": hname, "ceiling_number": host_tag, "host_ceiling": ceiling_id,
                            "member_type": "HANGER", "gauge": "#12", "room_id": room_id,
                            "x_in": round(mx * 12.0, 2), "y_in": round(hy * 12.0, 2),
                            "drop_in": round(HANGER_DROP_FT * 12.0, 2),
                            "install_order": len(frecords) + 1,
                        })
        mx += MAIN_SPACING_FT
        mi += 1
    return mains, hangers, splices
def emit_drywall(ceiling_id, host_tag, z_bottom, outer, holes, fixtures, boundary_solid, rated,
                 records, screw_records, do_screws, warnings,
                 wall_x_cuts=(), wall_y_cuts=(), wall_bboxes=(),
                 room_id=None, board_seq=None, screw_seq=None, force_clip=False):
    """Single-face gypsum on the underside: staggered board grid in world X-Y, clipped to the
    ceiling outline. Boards are hung with their bottom face flush at z_bottom, thickness upward.
    Layer 0 is the room-facing layer. Boards are named DP-<host>-<n> (single face -> no letter);
    screws SC-<host>-<n> (flat per-ceiling). Returns a counts dict."""
    counts = {"boards": 0, "cut_boards": 0, "layers": 0, "screws": 0}
    if board_seq is None:
        board_seq = [0]    # per-ceiling board counter -> DP-<host>-<n>
    if screw_seq is None:
        screw_seq = [0]    # flat per-ceiling screw counter -> SC-<host>-<n>
    bx0, by0, bx1, by1 = poly_bbox(outer)
    layers = layer_stack(rated)
    u = XYZ.BasisX
    v = XYZ.BasisY
    up = XYZ.BasisZ
    down = XYZ(0, 0, -1)
    fur_ys = furring_lines(by0, by1)

    cum_below = 0.0     # thickness already placed BELOW (closer to room) - layer 0 is room-facing
    for li, (t, type_x) in enumerate(layers):
        counts["layers"] += 1
        # Layer 0 bottom flush at z_bottom; each further layer sits above the previous.
        z0 = z_bottom + cum_below
        origin_z = XYZ(0.0, 0.0, z0)
        kind = "GWB" if li == 0 else "GWB2"
        base_shift = li * LAYER_H_STAGGER_FT
        v_off = li * LAYER_V_STAGGER_FT

        # courses step in Y by PANEL_WIDTH, offset by v_off for layer staggering
        ystart = by0 + v_off
        while ystart > by0:
            ystart -= PANEL_WIDTH_FT
        row = 0
        cy = ystart
        while cy < by1 - 1e-4:
            cy0 = max(by0, cy)
            cy1 = min(by1, cy + PANEL_WIDTH_FT)
            cy += PANEL_WIDTH_FT
            row += 1
            if (cy1 - cy0) < MIN_PIECE_HEIGHT_FT:
                continue
            full_course = abs((cy1 - cy0) - PANEL_WIDTH_FT) < 0.02
            if MAXIMIZE_WHOLE_PANELS:
                row_shift = 0.0
            else:
                row_shift = normalize_shift(base_shift + (ODD_ROW_SHIFT_FT if row % 2 == 1 else 0.0),
                                            PANEL_LENGTH_FT)
            x = bx0 - row_shift
            col = 0
            while x < bx1 - 1e-4:
                rx0 = max(bx0, x)
                rx1 = min(bx1, x + PANEL_LENGTH_FT)
                x += PANEL_LENGTH_FT
                col += 1
                # Split this cell ONLY where a wall truly severs it: a face line splits a piece
                # just when that wall's run fully covers the piece on the other axis; where a
                # wall ENDS inside a piece, the piece first splits at the wall's END line so the
                # part beyond the stub stays whole. This keeps exactly ONE pair of face lines
                # (the track-width gap) along real wall runs - no doubled joints elsewhere.
                pieces = []
                stack = [(rx0, cy0, rx1, cy1)]
                guard = 0
                while stack and guard < 256:
                    guard += 1
                    (px0, py0, px1, py1) = stack.pop()
                    did = False
                    for (c, w0, w1) in wall_x_cuts:
                        if not (px0 + 1e-6 < c < px1 - 1e-6):
                            continue
                        if w0 > py1 - 1e-6 or w1 < py0 + 1e-6:
                            continue                        # wall nowhere in this piece's y-range
                        if w0 > py0 + 1e-6:                 # wall STARTS inside: split at its end line
                            stack.append((px0, py0, px1, w0))
                            stack.append((px0, w0, px1, py1))
                        elif w1 < py1 - 1e-6:               # wall ENDS inside: split at its end line
                            stack.append((px0, py0, px1, w1))
                            stack.append((px0, w1, px1, py1))
                        else:                               # wall severs the piece: split at the face
                            stack.append((px0, py0, c, py1))
                            stack.append((c, py0, px1, py1))
                        did = True
                        break
                    if did:
                        continue
                    for (c, w0, w1) in wall_y_cuts:
                        if not (py0 + 1e-6 < c < py1 - 1e-6):
                            continue
                        if w0 > px1 - 1e-6 or w1 < px0 + 1e-6:
                            continue
                        if w0 > px0 + 1e-6:
                            stack.append((px0, py0, w0, py1))
                            stack.append((w0, py0, px1, py1))
                        elif w1 < px1 - 1e-6:
                            stack.append((px0, py0, w1, py1))
                            stack.append((w1, py0, px1, py1))
                        else:
                            stack.append((px0, py0, px1, c))
                            stack.append((px0, c, px1, py1))
                        did = True
                        break
                    if not did:
                        pieces.append((px0, py0, px1, py1))
                # A wall that only touches this cell's boundary edge (without truly crossing into
                # it) can still inject a spurious internal seam above - fuse any resulting
                # confetti-sized piece into a same-range neighbor before emitting.
                pieces = merge_small_pieces(pieces, MIN_SAFE_SEGMENT_FT)
                for (px0, py0, px1, py1) in pieces:
                    g = CODE_GAP_FT / 2.0
                    sx0 = px0 + g
                    sx1 = px1 - g
                    sy0 = py0 + g
                    sy1 = py1 - g
                    if (sx1 - sx0) < MIN_PIECE_WIDTH_FT or (sy1 - sy0) < MIN_PIECE_HEIGHT_FT:
                        continue
                    rect = (sx0, sy0, sx1, sy1)
                    if not rects_overlap(rect, (bx0, by0, bx1, by1)):
                        continue

                    mat, gs = styles.get(kind, (None, None))
                    # force_clip: the caller's outer is only a bbox approximation of the region
                    # (fallback zones), so every board must take the boolean path against the mask
                    whole = (not force_clip) and board_fully_inside(rect, outer, holes, fixtures)
                    if whole:
                        for wb in wall_bboxes:          # near/over a wall -> take the boolean path so
                            if rects_overlap(rect, wb):  # the wall subtraction in the mask trims it
                                whole = False
                                break
                    is_full_size = (abs((sx1 - sx0) - (PANEL_LENGTH_FT - CODE_GAP_FT)) < 0.02 and
                                    abs((sy1 - sy0) - (PANEL_WIDTH_FT - CODE_GAP_FT)) < 0.02)
                    # Taper is WIDTH-gated (the rule: "if any part of the board is in a full 4-ft course,
                    # its top/bottom horizontal edges are factory-tapered"). ANY board in a full 4-ft
                    # course tapers - including a boundary-clipped one (the tapered rect is clipped to the
                    # outline, so the surviving factory edges keep the taper). Only ripped (<4 ft width)
                    # courses are square.
                    board_tapered = TAPERED_LONG_EDGES and full_course

                    if whole:
                        if board_tapered:
                            solid = make_tapered_board_solid(origin_z, u, v, up, rect, t, mat, gs)
                        else:
                            solid = make_rect_solid(origin_z, u, v, up, rect, t, mat, gs)
                        is_cut = not is_full_size
                    else:
                        if board_tapered:
                            raw = make_tapered_board_solid(origin_z, u, v, up, rect, t, mat, gs)
                        else:
                            raw = make_rect_solid(origin_z, u, v, up, rect, t, mat, gs)
                        solid = boolean_op(raw, boundary_solid, BooleanOperationsType.Intersect)
                        is_cut = True

                    if not solid_ok(solid):        # None, or clipped away to nothing (board outside)
                        continue
                    board_id = "DP-{}-{:03d}".format(host_tag, board_seq[0] + 1)
                    comment = "{} | CEILING={} | {} | DRYWALL | {} | L{} | t={}in | typeX={} | cut={} | taper={}".format(
                        APP_ID, ceiling_id, "-", board_id, li, round(t * 12.0, 3),
                        int(bool(type_x)), int(bool(is_cut)), int(bool(board_tapered)))
                    ds = create_directshape(solid, board_id, board_id, comment, warnings)
                    if not ds:
                        continue
                    board_seq[0] += 1
                    counts["boards"] += 1
                    if is_cut:
                        counts["cut_boards"] += 1
                    try:
                        sbb = solid.GetBoundingBox()
                        smn = sbb.Transform.OfPoint(sbb.Min)
                        smx = sbb.Transform.OfPoint(sbb.Max)
                        sbox = [round(smn.X, 3), round(smn.Y, 3), round(smx.X, 3), round(smx.Y, 3)]
                    except Exception:
                        sbox = None
                    records.append({
                        "board_id": board_id, "ceiling_number": host_tag, "host_ceiling": ceiling_id,
                        "layer": li, "type_x": bool(type_x), "thickness_in": round(t * 12.0, 3),
                        "is_cut": bool(is_cut), "tapered": bool(board_tapered),
                        "bbox_ft": sbox, "room_id": room_id,
                        "install_order": len(records) + 1,
                    })

                    # Screws: on the room-facing (bottom) surface of layer 0, along furring lines. Per
                    # USG/GA, set back >= 3/8" from board edges/ends. A furring line on the board's
                    # Y-edge carries the tapered long-edge joint: offset the screw INTO the board
                    # (staying within the ~2.5" furring face so it still bites steel), so it sits beside
                    # the joint - never on it - and the neighbor board straddles from its side.
                    if do_screws and (li == 0 or not SCREWS_OUTER_LAYER_ONLY):
                        smat, sgs = styles.get("SCREW", (None, None))
                        half = SCREW_MARKER_SIZE_FT / 2.0
                        sb = SCREW_EDGE_SETBACK_FT
                        tol = SCREW_EDGE_TOL_FT
                        for fy in fur_ys:
                            if fy < sy0 - tol or fy > sy1 + tol:
                                continue
                            if abs(fy - sy0) <= tol:
                                coly = sy0 + sb
                            elif abs(fy - sy1) <= tol:
                                coly = sy1 - sb
                            else:
                                coly = fy
                            if coly <= sy0 + 1e-3 or coly >= sy1 - 1e-3:
                                continue
                            sxp = sx0 + sb
                            xend = sx1 - sb
                            cand = []
                            if xend < sxp:
                                cand.append((sx0 + sx1) / 2.0)
                            else:
                                vx = sxp
                                while vx <= xend + 1e-6:
                                    cand.append(vx)
                                    vx += SCREW_SPACING_FT
                                if not cand or abs(cand[-1] - xend) > 1e-3:
                                    cand.append(xend)
                            for sxx in cand:
                                if counts["screws"] >= MAX_SCREWS_PER_CEILING:
                                    break
                                inside_fx = False
                                for fx in fixtures:
                                    if fx[0] - 0.01 < sxx < fx[2] + 0.01 and fx[1] - 0.01 < coly < fx[3] + 0.01:
                                        inside_fx = True
                                        break
                                if inside_fx:
                                    continue
                                # marker sits at the bottom face (z0), protruding down by proud, most
                                # of its depth embedded upward into the board.
                                sz = z0 - SCREW_HEAD_PROUD_FT
                                sorigin = XYZ(0.0, 0.0, sz)
                                srect = (sxx - half, coly - half, sxx + half, coly + half)
                                ssolid = make_rect_solid(sorigin, u, v, up, srect, SCREW_MARKER_DEPTH_FT, smat, sgs)
                                if ssolid is None:
                                    continue
                                sid = "SC-{}-{:03d}".format(host_tag, screw_seq[0] + 1)
                                sds = create_directshape(ssolid, sid, sid,
                                                         ds_comment(ceiling_id, "SCREW", sid), warnings)
                                if sds:
                                    screw_seq[0] += 1
                                    counts["screws"] += 1
                                    screw_records.append({
                                        "screw_id": sid, "board_id": board_id, "room_id": room_id,
                                        "ceiling_number": host_tag, "host_ceiling": ceiling_id,
                                        "x_in": round(sxx * 12.0, 2), "y_in": round(coly * 12.0, 2),
                                        "world_x": round(sxx, 4), "world_y": round(coly, 4),
                                        "world_z": round(z0, 4),
                                        "spacing_in": round(SCREW_SPACING_FT * 12.0, 2),
                                        "length_in": round(t * 12.0 + 0.625, 3),
                                    })
        cum_below += t
    return counts


def simplify_rectilinear(poly, tol=0.02):
    """Drop collinear/duplicate vertices from a tessellated rectilinear outline."""
    pts = []
    n = len(poly)
    for i in range(n):
        ax, ay = poly[i - 1]
        bx, by = poly[i]
        cx, cy = poly[(i + 1) % n]
        cross = (bx - ax) * (cy - ay) - (by - ay) * (cx - ax)
        if abs(cross) > tol:
            pts.append((bx, by))
    return pts


def soffit_board_rects(outer, warnings, tag):
    """Exactly TWO board rectangles covering a soffit run: an L-shaped outline (6 rectilinear
    corners) splits at its inner corner - one board per leg, butt joint between them; a straight
    rectangle splits at mid-run. Anything else falls back to bbox halves with a warning (the
    mask still clips the boards to the true shape)."""
    bx0, by0, bx1, by1 = poly_bbox(outer)
    pts = simplify_rectilinear(outer)
    if len(pts) == 6:
        reflex = None
        for (px, py) in pts:
            if bx0 + 0.05 < px < bx1 - 0.05 and by0 + 0.05 < py < by1 - 0.05:
                reflex = (px, py)
                break
        missing = None
        eps = 0.05
        for (qx, qy) in [(bx0, by0), (bx1, by0), (bx1, by1), (bx0, by1)]:
            tx = qx + (eps if qx == bx0 else -eps)
            ty = qy + (eps if qy == by0 else -eps)
            if not point_in_polygon(tx, ty, outer):
                missing = (qx, qy)
                break
        if reflex is not None and missing is not None:
            cx, cy = reflex
            mx, my = missing
            if mx == bx1 and my == by1:        # notch top-right
                return [(bx0, by0, cx, by1), (cx, by0, bx1, cy)]
            if mx == bx1 and my == by0:        # notch bottom-right
                return [(bx0, by0, cx, by1), (cx, cy, bx1, by1)]
            if mx == bx0 and my == by1:        # notch top-left
                return [(cx, by0, bx1, by1), (bx0, by0, cx, cy)]
            if mx == bx0 and my == by0:        # notch bottom-left
                return [(cx, by0, bx1, by1), (bx0, cy, cx, by1)]
        warnings.append("Soffit {}: could not resolve the L corner; using bbox halves".format(tag))
    elif len(pts) != 4:
        warnings.append("Soffit {}: outline has {} corners (expected 4 or 6); using bbox halves".format(tag, len(pts)))
    if (bx1 - bx0) >= (by1 - by0):
        xm = (bx0 + bx1) / 2.0
        return [(bx0, by0, xm, by1), (xm, by0, bx1, by1)]
    ym = (by0 + by1) / 2.0
    return [(bx0, by0, bx1, ym), (bx0, ym, bx1, by1)]


def emit_soffit_boards(ceiling_id, host_tag, z_bottom, rects, boundary_solid, rated,
                       records, board_seq, warnings):
    """Emit the soffit's TWO custom-cut boards per layer, boolean-clipped to the wall-subtracted
    mask (a board ends at the wall it spans to - it can never penetrate it). Warns when a board
    leg is longer than SOFFIT_MAX_BOARD_FT, shorter than SOFFIT_MIN_BOARD_FT, or when a layer
    does not come out at exactly two boards."""
    made = 0
    layers = layer_stack(rated)
    u = XYZ.BasisX
    v = XYZ.BasisY
    up = XYZ.BasisZ
    cum_below = 0.0
    for li, (t, type_x) in enumerate(layers):
        z0 = z_bottom + cum_below
        origin_z = XYZ(0.0, 0.0, z0)
        kind = "GWB" if li == 0 else "GWB2"
        mat, gs = styles.get(kind, (None, None))
        made_layer = 0
        for (px0, py0, px1, py1) in rects:
            long_ft = max(px1 - px0, py1 - py0)
            if long_ft > SOFFIT_MAX_BOARD_FT + 1e-6:
                warnings.append("Soffit {}: board leg {:.1f} ft exceeds the {} ft max".format(
                    ceiling_id, long_ft, SOFFIT_MAX_BOARD_FT))
            if long_ft < SOFFIT_MIN_BOARD_FT - 1e-6:
                warnings.append("Soffit {}: board leg {:.1f} ft is under the {} ft min".format(
                    ceiling_id, long_ft, SOFFIT_MIN_BOARD_FT))
            raw = make_rect_solid(origin_z, u, v, up, (px0, py0, px1, py1), t, mat, gs)
            solid = boolean_op(raw, boundary_solid, BooleanOperationsType.Intersect)
            if not solid_ok(solid):
                continue
            board_id = "DP-{}-{:03d}".format(host_tag, board_seq[0] + 1)
            comment = "{} | CEILING={} | {} | DRYWALL | {} | L{} | t={}in | typeX={} | cut=1 | taper=0".format(
                APP_ID, ceiling_id, "-", board_id, li, round(t * 12.0, 3), int(bool(type_x)))
            ds = create_directshape(solid, board_id, board_id, comment, warnings)
            if not ds:
                continue
            board_seq[0] += 1
            made += 1
            made_layer += 1
            try:
                sbb = solid.GetBoundingBox()
                smn = sbb.Transform.OfPoint(sbb.Min)
                smx = sbb.Transform.OfPoint(sbb.Max)
                sbox = [round(smn.X, 3), round(smn.Y, 3), round(smx.X, 3), round(smx.Y, 3)]
            except Exception:
                sbox = None
            records.append({
                "board_id": board_id, "ceiling_number": host_tag, "host_ceiling": ceiling_id,
                "layer": li, "type_x": bool(type_x), "thickness_in": round(t * 12.0, 3),
                "is_cut": True, "tapered": False,
                "bbox_ft": sbox, "room_id": "SOFFIT",
                "install_order": len(records) + 1,
            })
        if made_layer != 2:
            warnings.append("Soffit {}: layer {} produced {} boards (expected exactly 2)".format(
                ceiling_id, li, made_layer))
        cum_below += t
    return made


# ============================================================
# MAIN
# ============================================================

result = {
    "app_id": APP_ID,
    "output_mode": "directshape",
    "phase": "ceiling_v1_furred",
    "deleted_previous": 0,
    "ceilings_requested": 0,
    "ceilings_processed": 0,
    "ceilings_skipped": [],
    "ceiling_numbers": {},             # {C<eid>: "C001"/"S001"} nomenclature host tag per ceiling
    "rated_ceilings": 0,
    "furring_created": 0,
    "mains_created": 0,                 # carrying channels added where the furring span needs support
    "hangers_created": 0,              # hanger wires holding the mains up
    "reinforced_ceilings": 0,          # ceilings whose span required mains
    "splice_joints": 0,                # lap splices where channels join end-to-end (stock lengths)
    "boards_created": 0,
    "cut_boards": 0,
    "small_boards_merged": 0,          # undersized post-clip boards merged into a neighbor (see below)
    "screws_created": 0,
    "drywall_layers": 0,
    "fixtures_cut": 0,
    "rooms_found": 0,                  # bounded Rooms collected for per-room generation
    "rooms_used": 0,                   # room regions that actually met a processed ceiling
    "soffits_processed": 0,            # ceilings routed through the separate soffit flow
    "board_records": 0,
    "framing_records": 0,
    "screw_records": 0,
    "manifest_path": "",
    "export_view": "",
    "warnings": [],
    "notes": []
}
warnings = result["warnings"]

do_delete = as_bool(get_in(5), DELETE_PREVIOUS)
do_drywall = as_bool(get_in(6), GENERATE_DRYWALL)
do_screws = as_bool(get_in(8), GENERATE_SCREWS)

ceilings = get_input_ceilings(warnings)
result["ceilings_requested"] = len(ceilings)

board_records = []
framing_records = []
screw_records = []
room_records = []

if len(ceilings) == 0:
    OUT = "No ceilings found. Select one or more Revit Ceiling elements, then run Dynamo again."
else:
    TransactionManager.Instance.EnsureInTransaction(doc)
    try:
        processed_ids = set("C" + str(eid_value(c.Id)) for c in ceilings)
        if do_delete:
            result["deleted_previous"] = delete_previous(processed_ids, warnings)
        if COLOR_BY_TYPE:
            styles = setup_styles(warnings)

        # Assign each ceiling its stable nomenclature host tag (C###/S###), persisted to the Mark.
        ceiling_numbers = assign_ceiling_numbers(ceilings, warnings)

        # Wall plan footprints for clipping the ceiling drywall at walls (collected once per run).
        wall_plans = collect_wall_plans(warnings) if CLIP_CEILING_AT_WALLS else []

        # Room boundary polygons for per-room generation (collected once per run).
        room_regions = collect_room_regions(warnings) if CEILING_PER_ROOM else []
        result["rooms_found"] = len(room_regions)

        # Column/beam footprints (collected once per run; filtered per-ceiling by Z-overlap below).
        colbeam_footprints = (collect_column_beam_footprints(warnings)
                              if (CUT_AT_COLUMNS or CUT_AT_BEAMS) else [])

        for ceiling in ceilings:
            cid = "C" + str(eid_value(ceiling.Id))
            host_tag = ceiling_numbers.get(eid_value(ceiling.Id), "C000")
            result["ceiling_numbers"][cid] = host_tag
            is_soffit = SOFFIT_SEPARATE_FLOW and host_tag.startswith("S")
            try:
                loops, z_bottom = get_ceiling_loops(ceiling, warnings)
                if not loops or z_bottom is None:
                    result["ceilings_skipped"].append(cid + ": could not read boundary")
                    continue
                outer = loops[0]
                holes = loops[1:]

                # A soffit only gets the 2-board beam rule when it is actually narrow (its SHORT
                # footprint dimension fits the rule); a wide one is a room-sized ceiling drop and
                # is routed to normal per-zone tiling instead (see SOFFIT_BEAM_MAX_WIDTH_FT).
                is_narrow_soffit = is_soffit
                if is_soffit:
                    _sbx0, _sby0, _sbx1, _sby1 = poly_bbox(outer)
                    _short = min(_sbx1 - _sbx0, _sby1 - _sby0)
                    if _short > SOFFIT_BEAM_MAX_WIDTH_FT:
                        is_narrow_soffit = False
                        warnings.append(
                            "Soffit {}: footprint {:.1f} x {:.1f} ft is too wide for the 2-board "
                            "beam rule (short side > {:.1f} ft) - using standard zone tiling instead".format(
                                cid, _sbx1 - _sbx0, _sby1 - _sby0, SOFFIT_BEAM_MAX_WIDTH_FT))

                rated = ceiling_is_fire_rated(ceiling, warnings)
                if rated:
                    result["rated_ceilings"] += 1
                fixtures = get_fixture_rects(ceiling, warnings)
                result["fixtures_cut"] += len(fixtures)

                layers = layer_stack(rated)
                dw_total = sum(t for (t, _tx) in layers)
                # Clip mask spans from just below the drywall bottom up past the furring AND the main
                # carrying channels (which sit on top of the furring) so the mains aren't clipped.
                tall = dw_total + FURRING_HEIGHT_FT + MAIN_DEPTH_FT + 4.0 * HOLE_MARGIN_FT

                # Punch out every column/beam that actually spans PAST this ceiling's drywall band
                # (z_bottom .. z_bottom+tall) - same "fixture hole" mechanism, so no board/furring
                # runs through a column or beam (user report 2026-07-21).
                cb_z0 = z_bottom - HOLE_MARGIN_FT
                cb_z1 = z_bottom + tall
                for (cx0, cy0, cx1, cy1, cz0, cz1) in colbeam_footprints:
                    if cz1 > cb_z0 and cz0 < cb_z1:
                        fixtures.append((cx0, cy0, cx1, cy1))

                boundary_solid = build_boundary_solid(outer, holes, fixtures,
                                                      z_bottom - HOLE_MARGIN_FT, tall)
                if boundary_solid is None:
                    result["ceilings_skipped"].append(cid + ": boundary solid failed")
                    continue

                # Per-room mode: pick this ceiling's rooms (same level first, any level as a
                # fallback). A ceiling with no overlapping Room (e.g. a soffit) falls back to the
                # legacy whole-grid path below so it still gets generated.
                per_room_regions = None
                if CEILING_PER_ROOM and room_regions and not is_narrow_soffit:
                    obb_c = poly_bbox(outer)
                    clev = -1
                    try:
                        clev = eid_value(ceiling.LevelId)
                    except Exception:
                        pass
                    regions = [rg for rg in room_regions
                               if rg[2] == clev and rects_overlap(rg[5], obb_c)]
                    if not regions:
                        regions = [rg for rg in room_regions if rects_overlap(rg[5], obb_c)]
                        if regions:
                            warnings.append("Ceiling {}: no Rooms on its own level; using {} plan-overlapping room(s) from other levels".format(cid, len(regions)))
                    if regions:
                        per_room_regions = regions
                    else:
                        warnings.append("Ceiling {}: no Room overlaps it - falling back to the legacy whole-grid path".format(cid))

                # Legacy path only: subtract every intersecting wall's footprint from the clip
                # mask and note the wall-face lines so the board grid stops at them.
                wall_x_cuts = []
                wall_y_cuts = []
                wall_bboxes = []
                if per_room_regions is None and CLIP_CEILING_AT_WALLS and wall_plans:
                    obb = poly_bbox(outer)
                    for (wpoly, wbb, waxis, f_lo, f_hi) in wall_plans:
                        if not rects_overlap(wbb, obb):
                            continue
                        cutter = make_planar_poly_solid(XYZ(0.0, 0.0, z_bottom - HOLE_MARGIN_FT),
                                                        XYZ.BasisX, XYZ.BasisY, XYZ.BasisZ,
                                                        wpoly, tall)
                        if cutter is not None:
                            cut = boolean_op(boundary_solid, cutter, BooleanOperationsType.Difference)
                            if solid_ok(cut):
                                boundary_solid = cut
                        wall_bboxes.append(wbb)
                        # keep each cut LOCAL: carry the wall's extent along the other axis so a
                        # face line only cuts the rows/courses that wall actually crosses
                        if waxis == "x":
                            wall_x_cuts.extend([(f_lo, wbb[1], wbb[3]), (f_hi, wbb[1], wbb[3])])
                        elif waxis == "y":
                            wall_y_cuts.extend([(f_lo, wbb[0], wbb[2]), (f_hi, wbb[0], wbb[2])])
                    wall_x_cuts.sort()
                    wall_y_cuts.sort()

                if is_narrow_soffit:
                    # SOFFIT FLOW: exactly TWO custom-cut boards per soffit - one per leg of an
                    # L-shaped run (butt joint at the inner corner) or a mid-run split on a
                    # straight run - clipped against the wall-subtracted mask so they end at the
                    # walls the soffit spans between. No 4x8 grid, no rooms/zones, no mains.
                    result["soffits_processed"] += 1
                    z_top = z_bottom + dw_total
                    st_counter = [0]
                    board_seq = [0]
                    if do_drywall:
                        rects = soffit_board_rects(outer, warnings, cid)
                        made = emit_soffit_boards(cid, host_tag, z_bottom, rects, boundary_solid,
                                                  rated, board_records, board_seq, warnings)
                        result["boards_created"] += made
                        result["cut_boards"] += made
                        result["drywall_layers"] += len(layer_stack(rated))
                    if GENERATE_FURRING:
                        sbx0, sby0, sbx1, sby1 = poly_bbox(outer)
                        f_made, f_spl = emit_furring(
                            cid, host_tag, st_counter, z_top, boundary_solid,
                            sbx0, sbx1, sby0, sby1, warnings, framing_records, room_id="SOFFIT")
                        result["furring_created"] += f_made
                        result["splice_joints"] += f_spl
                elif per_room_regions is not None:
                    # PER-ROOM generation: each room polygon is its own bounded region (the same
                    # role a wall run plays in the wall script). Boards/furring/mains are laid out
                    # on the room's own bbox/grid and cut at the room boundary by the room mask -
                    # nothing exists outside its room, so there is nothing to subtract afterward.
                    z_top = z_bottom + dw_total     # furring bottom sits on top of the drywall
                    st_counter = [0]     # flat per-ceiling framing counter -> ST-<host>-<n>
                    board_seq = [0]      # flat per-ceiling board counter (shared across rooms)
                    screw_seq = [0]
                    covered = 0.0
                    for (rid, rnum, rlev, r_outer, r_inners, rbb) in per_room_regions:
                        room_prism = make_planar_poly_solid(
                            XYZ(0.0, 0.0, z_bottom - HOLE_MARGIN_FT),
                            XYZ.BasisX, XYZ.BasisY, XYZ.BasisZ, r_outer, tall)
                        if room_prism is None:
                            warnings.append("Room {}: boundary prism failed; room skipped".format(rid))
                            continue
                        for ip in r_inners:
                            ips = make_planar_poly_solid(
                                XYZ(0.0, 0.0, z_bottom - 2.0 * HOLE_MARGIN_FT),
                                XYZ.BasisX, XYZ.BasisY, XYZ.BasisZ, ip, tall + 4.0 * HOLE_MARGIN_FT)
                            room_prism = boolean_op(room_prism, ips, BooleanOperationsType.Difference)
                        room_mask = boolean_op(room_prism, boundary_solid,
                                               BooleanOperationsType.Intersect)
                        if not solid_ok(room_mask):
                            continue                # this room does not actually meet this ceiling
                        covered += room_mask.Volume
                        result["rooms_used"] += 1
                        room_records.append({
                            "room_id": rid, "room_number": rnum, "host_ceiling": cid,
                            "outer_ft": [[round(px, 3), round(py, 3)] for (px, py) in r_outer],
                        })
                        rholes = holes + r_inners
                        rbx0, rby0, rbx1, rby1 = rbb
                        if do_drywall:
                            dc = emit_drywall(cid, host_tag, z_bottom, r_outer, rholes, fixtures,
                                              room_mask, rated, board_records, screw_records,
                                              do_screws, warnings, (), (), (),
                                              room_id=rid, board_seq=board_seq, screw_seq=screw_seq)
                            result["boards_created"] += dc["boards"]
                            result["cut_boards"] += dc["cut_boards"]
                            result["drywall_layers"] += dc["layers"]
                            result["screws_created"] += dc["screws"]
                        if GENERATE_FURRING:
                            f_made, f_spl = emit_furring(
                                cid, host_tag, st_counter, z_top, room_mask, rbx0, rbx1, rby0, rby1,
                                warnings, framing_records, room_id=rid)
                            result["furring_created"] += f_made
                            result["splice_joints"] += f_spl
                            m_made, h_made, m_spl = emit_mains(
                                cid, host_tag, st_counter, z_top, room_mask, r_outer, rholes,
                                fixtures, rbx0, rbx1, rby0, rby1, warnings, framing_records,
                                room_id=rid)
                            result["mains_created"] += m_made
                            result["hangers_created"] += h_made
                            result["splice_joints"] += m_spl
                            if m_made > 0:
                                result["reinforced_ceilings"] += 1
                    try:
                        if boundary_solid.Volume > 1e-6 and covered < 0.98 * boundary_solid.Volume:
                            pct = 100.0 * (1.0 - covered / boundary_solid.Volume)
                            warnings.append("Ceiling {}: {:.1f}% of its area is covered by no Room - that area got no boards/furring".format(cid, pct))
                    except Exception:
                        pass
                else:
                    # FALLBACK ZONES: after the wall subtraction the clip mask is a set of
                    # disconnected room-shaped volumes. Split it into those zones and anchor a
                    # fresh full-sheet grid at EACH zone's own corner (same idea as per-room mode
                    # with real Rooms) - maximum whole 4x8 sheets per enclosed area, and no
                    # element can span two zones because each is laid out and clipped separately.
                    vols = [boundary_solid]
                    try:
                        sv = SolidUtils.SplitVolumes(boundary_solid)
                        # SplitVolumes returns an IList<Solid> - under this engine (CPython3) that
                        # marshals to a plain Python list (no .Count), under others it's a .NET
                        # collection (no len()); len(list(...)) works for both without guessing.
                        sv_list = list(sv) if sv is not None else []
                        if len(sv_list) > 0:
                            vols = sv_list
                    except Exception as ex:
                        warnings.append("Ceiling {}: SplitVolumes failed ({}); one zone".format(cid, ex))
                    z_top = z_bottom + dw_total     # furring bottom sits on top of the drywall
                    st_counter = [0]     # flat per-ceiling framing counter -> ST-<host>-<n>
                    board_seq = [0]      # flat per-ceiling board counter (shared across zones)
                    screw_seq = [0]
                    zi = 0
                    for vol in vols:
                        if not solid_ok(vol):
                            continue
                        zi += 1
                        zid = "{}-Z{:02d}".format(cid, zi)
                        try:
                            vbb = vol.GetBoundingBox()
                            vmn = vbb.Transform.OfPoint(vbb.Min)
                            vmx = vbb.Transform.OfPoint(vbb.Max)
                        except Exception:
                            warnings.append("Zone {}: no bbox; skipped".format(zid))
                            continue
                        zx0, zy0, zx1, zy1 = vmn.X, vmn.Y, vmx.X, vmx.Y
                        if (zx1 - zx0) < 0.5 or (zy1 - zy0) < 0.5:
                            warnings.append("Zone {} skipped: sliver {:.2f} x {:.2f} ft (ceiling overhang past a wall?)".format(zid, zx1 - zx0, zy1 - zy0))
                            continue
                        zouter = [(zx0, zy0), (zx1, zy0), (zx1, zy1), (zx0, zy1)]
                        # Per-zone wall cuts: ONLY walls that actually TOUCH this zone may split
                        # its boards - a stub poking into the zone must end the board on both
                        # sides (no panel ever sits on two sides of a wall), while a NEIGHBORING
                        # zone's wall in a bbox-overlap area must not (those false splits were
                        # shredding whole sheets). The exact wall footprint was subtracted from
                        # the mask, so touching is tested with a slightly inflated prism.
                        zx_cuts = []
                        zy_cuts = []
                        for (wpoly, wbb, waxis, f_lo, f_hi) in wall_plans:
                            if not rects_overlap(wbb, (zx0, zy0, zx1, zy1)):
                                continue
                            tol = 0.25
                            grown = [(wbb[0] - tol, wbb[1] - tol), (wbb[2] + tol, wbb[1] - tol),
                                     (wbb[2] + tol, wbb[3] + tol), (wbb[0] - tol, wbb[3] + tol)]
                            gp = make_planar_poly_solid(XYZ(0.0, 0.0, z_bottom - HOLE_MARGIN_FT),
                                                        XYZ.BasisX, XYZ.BasisY, XYZ.BasisZ,
                                                        grown, tall)
                            if gp is None:
                                continue
                            touch = boolean_op(gp, vol, BooleanOperationsType.Intersect)
                            if not solid_ok(touch):
                                continue
                            if waxis == "x":
                                zx_cuts.extend([(f_lo, wbb[1], wbb[3]), (f_hi, wbb[1], wbb[3])])
                            elif waxis == "y":
                                zy_cuts.extend([(f_lo, wbb[0], wbb[2]), (f_hi, wbb[0], wbb[2])])
                        zx_cuts.sort()
                        zy_cuts.sort()
                        if do_drywall:
                            dc = emit_drywall(cid, host_tag, z_bottom, zouter, holes, fixtures,
                                              vol, rated, board_records, screw_records,
                                              do_screws, warnings,
                                              zx_cuts, zy_cuts, (),
                                              room_id=zid, board_seq=board_seq,
                                              screw_seq=screw_seq, force_clip=True)
                            result["boards_created"] += dc["boards"]
                            result["cut_boards"] += dc["cut_boards"]
                            result["drywall_layers"] += dc["layers"]
                            result["screws_created"] += dc["screws"]
                        if GENERATE_FURRING:
                            f_made, f_spl = emit_furring(
                                cid, host_tag, st_counter, z_top, vol, zx0, zx1, zy0, zy1,
                                warnings, framing_records, room_id=zid)
                            result["furring_created"] += f_made
                            result["splice_joints"] += f_spl
                            # Reinforce: carrying channels + hangers when the span needs support.
                            m_made, h_made, m_spl = emit_mains(
                                cid, host_tag, st_counter, z_top, vol, zouter, holes, fixtures,
                                zx0, zx1, zy0, zy1, warnings, framing_records, room_id=zid)
                            result["mains_created"] += m_made
                            result["hangers_created"] += h_made
                            result["splice_joints"] += m_spl
                            if m_made > 0:
                                result["reinforced_ceilings"] += 1

                if do_drywall:
                    small_merged, small_removed, merged_bboxes = merge_undersized_ceiling_boards(cid, warnings)
                    if small_merged:
                        result["boards_created"] -= small_merged
                        result["cut_boards"] -= sum(1 for r in board_records
                                                    if r["board_id"] in small_removed and r.get("is_cut"))
                        for r in board_records:
                            if r["board_id"] in merged_bboxes:
                                r["is_cut"] = True
                                r["bbox_ft"] = merged_bboxes[r["board_id"]]
                        board_records[:] = [r for r in board_records
                                           if r["board_id"] not in small_removed]
                        result["small_boards_merged"] += small_merged

                result["ceilings_processed"] += 1
            except Exception as cex:
                result["ceilings_skipped"].append(cid + ": error - " + str(cex))
                warnings.append("Ceiling {} failed: {}".format(cid, cex))
                continue

        result["export_view"] = ensure_export_view(warnings)
    except Exception as ex:
        result["notes"].append("FATAL: " + str(ex))
    finally:
        TransactionManager.Instance.TransactionTaskDone()

    result["board_records"] = len(board_records)
    result["framing_records"] = len(framing_records)
    result["screw_records"] = len(screw_records)

    if WRITE_MANIFEST:
        manifest = {
            "app_id": APP_ID,
            "schema": "origin_ceiling_assembly_v1",
            "units": "world coords in feet; member/board dims in inches",
            "nomenclature": {
                "host": "C### (ceiling) / S### (soffit), persisted to the ceiling Mark",
                "drywall_panel": "DP-<host>-<seq>  (single underside face; no face letter)",
                "framing_member": "ST-<host>-<seq>  (member_type = FURRING / MAIN / HANGER)",
                "screw": "SC-<host>-<seq>",
            },
            "summary": dict((k, result[k]) for k in (
                "ceilings_processed", "rated_ceilings", "furring_created", "mains_created",
                "hangers_created", "reinforced_ceilings", "splice_joints", "boards_created",
                "screws_created", "fixtures_cut", "rooms_found", "rooms_used",
                "soffits_processed")),
            "rooms": room_records,
            "framing": framing_records,
            "boards": board_records,
            "screws": screw_records,
            "skipped": result.get("ceilings_skipped", []),
            "warnings": warnings,
        }
        try:
            f = open(MANIFEST_PATH, "w")
            try:
                json.dump(manifest, f, indent=2)
            finally:
                f.close()
            result["manifest_path"] = MANIFEST_PATH
        except Exception as ex:
            result["manifest_path"] = "failed"
            warnings.append("Manifest write failed: {}".format(ex))

    OUT = result
# ----------------------------------------
watch_2 = Watch(python_script_2)
origin_beams = Python()  # CPython3; unwired: IN[0], IN[1]
# ---------- origin_beams.python (403 lines) ----------
# origin_beam_assembly_v1.py
# ============================================================
# ORIGIN drywall assembly - BEAMS v1 (Dynamo Python node, PythonNet3/CPython3)
#
# The BEAMS plugin (split out of the combined beam+column node, user 2026-07-17): every
# structural-framing member gets a soffit-style box along its run - one board under the
# bottom (wrapping under the sides) plus a board on each side face; no top (the beam top
# meets the slab). Runs split into <=16 ft pieces (min 2 ft warned). Boards sit OUTSIDE the
# beam faces by DRYWALL_T_FT.
#
# Conventions: DirectShapes (Generic Models, visible in the ORIGIN Assembly view); host tag
# B### persisted to the Mark; boards DP-<host>-<seq>; comment "APP_ID | HOST=<eid> | ..." is
# the cleanup key; own manifest with warnings. Self-collecting - no node wiring needed.
# Also purges the legacy combined ORIGIN_BEAMCOL_V1 output (one-time migration).
#
# v1 limits: axis-aligned bbox wrap (angled beams get a loose box); no clipping against
# walls/ceilings at junctions.
# ============================================================

import clr
import json

clr.AddReference('RevitAPI')
clr.AddReference('RevitServices')

from Autodesk.Revit.DB import *
from RevitServices.Persistence import DocumentManager
from RevitServices.Transactions import TransactionManager

doc = DocumentManager.Instance.CurrentDBDocument

APP_ID = "ORIGIN_BEAM_V1"
LEGACY_APP_IDS = ["ORIGIN_BEAMCOL_V1"]

DELETE_PREVIOUS = True
# Beam boards previously got NO material at all (Revit's undifferentiated default appearance),
# unlike every other generated board in the pipeline. Uses the SAME material/subcategory name
# as the wall script's drywall boards, so Revit reuses the existing one instead of creating a
# duplicate - beam boards now match exactly (2026-07-21, alongside the same fix for columns).
COLOR_BOARDS = True
DRYWALL_STYLE_NAME = "ORIGIN Drywall Base"
DRYWALL_STYLE_RGB = (235, 228, 214)

IN_FT = 1.0 / 12.0
DRYWALL_T_FT = 0.5 * IN_FT
# 16 ft was far larger than a real gypsum sheet (stock is commonly 8 ft, up to 12 ft) - a run
# under 16 ft got ONE giant board per face instead of realistic stacked panels (same fix as the
# column plugin, 2026-07-22). 8 ft matches the wall script's own PANEL_LENGTH_FT convention, so
# any run longer than one standard sheet is guaranteed to split into >= 2 stacked panels.
MAX_BOARD_FT = 8.0
MIN_BOARD_FT = 2.0
MIN_ELEM_FT = 0.5
# Same fix as the column plugin (2026-07-22): the beam's own corner-wrap boards (the faces that
# extend DRYWALL_T_FT past the beam's own footprint so its OWN corners look continuous) have
# nowhere to go but into a neighboring wall's body when the beam sits flush against one. Subtract
# every nearby wall's bounding box from each board so it can never enter a wall.
CLIP_AGAINST_WALLS = True

MANIFEST_PATH = r"C:\Users\Origoncad\Downloads\origin_revit_drywall_scripts_v2_two_faces\origin_beam_manifest.json"

result = {
    "app_id": APP_ID,
    "beams_processed": 0,
    "boards_created": 0,
    "deleted_previous": 0,
    "skipped": [],
    "manifest_path": "",
    "warnings": [],
}
warnings = result["warnings"]
board_records = []


def eid_value(eid):
    try:
        return eid.Value
    except Exception:
        return eid.IntegerValue


def el_bbox(e):
    try:
        bb = e.get_BoundingBox(None)
        if bb is None:
            return None
        return (bb.Min.X, bb.Min.Y, bb.Min.Z, bb.Max.X, bb.Max.Y, bb.Max.Z)
    except Exception:
        return None


def collect_other_pipeline_solids(warnings):
    """Real solid + bbox of every OTHER Origin-pipeline DirectShape in the model (wall drywall
    boards, studs/tracks, ceiling boards, etc. - anything NOT tagged with THIS script's own
    APP_ID). A wall's raw BOUNDING BOX is too crude to clip against - a beam's thin butt-face
    board can sit entirely inside a wall's bbox while never actually touching the wall's real
    (already-correct) drywall board there, and clipping against the bbox wrongly erases it. The
    wall's actual generated boards/studs are the real geometry that must never be penetrated."""
    solids = []
    try:
        for ds in FilteredElementCollector(doc).OfClass(DirectShape).ToElements():
            try:
                p = ds.get_Parameter(BuiltInParameter.ALL_MODEL_INSTANCE_COMMENTS)
                comment = (p.AsString() or "") if p else ""
            except Exception:
                comment = ""
            if not comment or comment.startswith(APP_ID + " |"):
                continue        # untagged, or one of THIS beam's own boards (self-overlap is by design)
            try:
                bb = ds.get_BoundingBox(None)
                if bb is None:
                    continue
                box = (bb.Min.X, bb.Min.Y, bb.Min.Z, bb.Max.X, bb.Max.Y, bb.Max.Z)
            except Exception:
                continue
            opt = Options()
            geo = ds.get_Geometry(opt)
            if geo is None:
                continue
            for g in geo:
                if isinstance(g, Solid) and g.Volume > 1e-9:
                    solids.append((box, g))
    except Exception as ex:
        warnings.append("Nearby-solid collection failed ({})".format(ex))
    return solids


def boxes_overlap(a, b):
    return not (a[3] <= b[0] or b[3] <= a[0] or a[4] <= b[1] or b[4] <= a[1] or a[5] <= b[2] or b[5] <= a[2])


def clip_against_others(solid, box, other_solids):
    """Subtract every nearby real solid from solid so it can never overlap already-placed
    drywall/framing. Unlike a bbox clip, an empty/near-zero result here is TRUSTED (it means
    this board is genuinely, fully covered by something already there) rather than reverted -
    the caller drops the board in that case."""
    if not other_solids:
        return solid
    for (obox, osolid) in other_solids:
        if not boxes_overlap(box, obox):
            continue
        try:
            clipped = BooleanOperationsUtils.ExecuteBooleanOperation(
                solid, osolid, BooleanOperationsType.Difference)
        except Exception:
            continue
        if clipped is not None:
            solid = clipped
        if solid is None or solid.Volume <= 1e-9:
            return solid
    return solid


def get_or_create_material(name, rgb):
    for m in FilteredElementCollector(doc).OfClass(Material):
        if m.Name == name:
            return m.Id
    mid = Material.Create(doc, name)
    try:
        m = doc.GetElement(mid)
        m.Color = Color(rgb[0], rgb[1], rgb[2])
        m.Transparency = 0
    except Exception:
        pass
    return mid


def get_or_create_subcategory(parent_cat, name, material_id, rgb):
    try:
        for sc in parent_cat.SubCategories:
            if sc.Name == name:
                return sc
    except Exception:
        pass
    sc = doc.Settings.Categories.NewSubcategory(parent_cat, name)
    try:
        sc.LineColor = Color(rgb[0], rgb[1], rgb[2])
    except Exception:
        pass
    try:
        if material_id and material_id != ElementId.InvalidElementId:
            sc.Material = doc.GetElement(material_id)
    except Exception:
        pass
    return sc


def setup_board_style(warnings):
    """Create/find the shared drywall-colored Generic Model subcategory + material (same name
    as the wall script uses) so beam boards match the rest of the model. Returns
    (material_id, graphics_style_id); (None, None) on any failure - boards stay uncolored."""
    if not COLOR_BOARDS:
        return None, None
    try:
        gm = doc.Settings.Categories.get_Item(BuiltInCategory.OST_GenericModel)
        mat_id = get_or_create_material(DRYWALL_STYLE_NAME, DRYWALL_STYLE_RGB)
        sub = get_or_create_subcategory(gm, DRYWALL_STYLE_NAME, mat_id, DRYWALL_STYLE_RGB)
        try:
            doc.Regenerate()
        except Exception:
            pass
        gsid = None
        gs = sub.GetGraphicsStyle(GraphicsStyleType.Projection)
        if gs:
            gsid = gs.Id
        return mat_id, gsid
    except Exception as ex:
        warnings.append("Board coloring setup failed: {}".format(ex))
        return None, None


def make_box(x0, y0, z0, x1, y1, z1, material_id=None, gstyle_id=None):
    if x1 - x0 < 1e-4 or y1 - y0 < 1e-4 or z1 - z0 < 1e-4:
        return None
    pts = [XYZ(x0, y0, z0), XYZ(x1, y0, z0), XYZ(x1, y1, z0), XYZ(x0, y1, z0)]
    lines = []
    for i in range(4):
        lines.append(Line.CreateBound(pts[i], pts[(i + 1) % 4]))
    loop = CurveLoop.Create(lines)
    from System.Collections.Generic import List as NetList
    nl = NetList[CurveLoop]()
    nl.Add(loop)
    if material_id is not None and gstyle_id is not None:
        opts = SolidOptions(material_id, gstyle_id)
        return GeometryCreationUtilities.CreateExtrusionGeometry(nl, XYZ.BasisZ, z1 - z0, opts)
    return GeometryCreationUtilities.CreateExtrusionGeometry(nl, XYZ.BasisZ, z1 - z0)


def create_ds(solid, name, comment):
    try:
        ds = DirectShape.CreateElement(doc, ElementId(BuiltInCategory.OST_GenericModel))
        ds.SetShape([solid])
        try:
            p = ds.get_Parameter(BuiltInParameter.ALL_MODEL_INSTANCE_COMMENTS)
            if p:
                p.Set(comment)
            m = ds.get_Parameter(BuiltInParameter.ALL_MODEL_MARK)
            if m:
                m.Set(name)
            ds.Name = name
        except Exception:
            pass
        return ds
    except Exception as ex:
        warnings.append("{}: DirectShape failed ({})".format(name, ex))
        return None


def split_len(lo, hi):
    total = hi - lo
    n = 1
    while total / n > MAX_BOARD_FT:
        n += 1
    step = total / n
    return [(lo + i * step, lo + (i + 1) * step) for i in range(n)]


def set_mark(e, tag):
    try:
        m = e.get_Parameter(BuiltInParameter.ALL_MODEL_MARK)
        if m and not m.IsReadOnly:
            m.Set(tag)
    except Exception:
        pass


def emit_board(host_tag, host_eid, seq, box, material_id=None, gstyle_id=None, other_solids=None):
    solid = make_box(*box, material_id=material_id, gstyle_id=gstyle_id)
    if solid is None:
        return 0
    solid = clip_against_others(solid, box, other_solids)
    if solid is None or solid.Volume <= 1e-9:
        warnings.append("{}-{:03d}: fully covered by existing drywall/framing - board omitted".format(host_tag, seq))
        return 0
    name = "DP-{}-{:03d}".format(host_tag, seq)
    comment = "{} | HOST={} | DRYWALL | BEAM | {}".format(APP_ID, host_eid, name)
    if create_ds(solid, name, comment) is None:
        return 0
    long_ft = max(box[3] - box[0], box[4] - box[1], box[5] - box[2])
    if long_ft > MAX_BOARD_FT + 1e-6:
        warnings.append("{}: board {:.1f} ft exceeds {} ft".format(name, long_ft, MAX_BOARD_FT))
    if long_ft < MIN_BOARD_FT - 1e-6:
        warnings.append("{}: board {:.1f} ft is under the {} ft min".format(name, long_ft, MIN_BOARD_FT))
    try:
        sbb = solid.GetBoundingBox()
        smn = sbb.Transform.OfPoint(sbb.Min)
        smx = sbb.Transform.OfPoint(sbb.Max)
        real_bbox = [round(smn.X, 3), round(smn.Y, 3), round(smn.Z, 3),
                     round(smx.X, 3), round(smx.Y, 3), round(smx.Z, 3)]
    except Exception:
        real_bbox = [round(v, 3) for v in box]
    board_records.append({
        "board_id": name, "host": host_tag, "host_eid": host_eid,
        "bbox_ft": real_bbox,
        "thickness_in": round(DRYWALL_T_FT * 12.0, 2),
    })
    return 1


def wrap_beam(e, host_tag, material_id=None, gstyle_id=None, other_solids=None):
    bb = el_bbox(e)
    if bb is None:
        result["skipped"].append("{}: no bbox".format(host_tag))
        return 0
    x0, y0, z0, x1, y1, z1 = bb
    if (z1 - z0) < 0.05:
        result["skipped"].append("{}: degenerate body".format(host_tag))
        return 0
    t = DRYWALL_T_FT
    along_x = (x1 - x0) >= (y1 - y0)
    if max(x1 - x0, y1 - y0) < MIN_ELEM_FT:
        result["skipped"].append("{}: too short".format(host_tag))
        return 0
    made = 0
    seq = 0
    host_eid = "B" + str(eid_value(e.Id))
    if along_x:
        for (a, b) in split_len(x0, x1):
            for box in [
                (a, y0 - t, z0 - t, b, y1 + t, z0),
                (a, y0 - t, z0, b, y0, z1),
                (a, y1, z0, b, y1 + t, z1),
            ]:
                seq += 1
                made += emit_board(host_tag, host_eid, seq, box, material_id, gstyle_id, other_solids)
    else:
        for (a, b) in split_len(y0, y1):
            for box in [
                (x0 - t, a, z0 - t, x1 + t, b, z0),
                (x0 - t, a, z0, x0, b, z1),
                (x1, a, z0, x1 + t, b, z1),
            ]:
                seq += 1
                made += emit_board(host_tag, host_eid, seq, box, material_id, gstyle_id, other_solids)
    return made


def delete_previous():
    n = 0
    tags = [APP_ID + " |"] + [t + " |" for t in LEGACY_APP_IDS]
    stale = []
    for ds in FilteredElementCollector(doc).OfClass(DirectShape):
        try:
            p = ds.get_Parameter(BuiltInParameter.ALL_MODEL_INSTANCE_COMMENTS)
            s = (p.AsString() or "") if p else ""
            if any(s.startswith(t) for t in tags):
                stale.append(ds.Id)
        except Exception:
            continue
    for sid in stale:
        try:
            doc.Delete(sid)
            n += 1
        except Exception:
            pass
    return n


TransactionManager.Instance.EnsureInTransaction(doc)
try:
    if DELETE_PREVIOUS:
        result["deleted_previous"] = delete_previous()
    mat_id, gstyle_id = setup_board_style(warnings)
    other_solids = collect_other_pipeline_solids(warnings) if CLIP_AGAINST_WALLS else []
    beams = []
    try:
        beams = list(FilteredElementCollector(doc)
                     .OfCategory(BuiltInCategory.OST_StructuralFraming)
                     .WhereElementIsNotElementType())
    except Exception as ex:
        warnings.append("Beam collection failed ({})".format(ex))
    bi = 0
    for e in beams:
        bi += 1
        tag = "B{:03d}".format(bi)
        set_mark(e, tag)
        made = wrap_beam(e, tag, mat_id, gstyle_id, other_solids)
        if made:
            result["beams_processed"] += 1
            result["boards_created"] += made
except Exception as ex:
    warnings.append("FATAL: {}".format(ex))
finally:
    TransactionManager.Instance.TransactionTaskDone()

try:
    manifest = {
        "app_id": APP_ID,
        "nomenclature": {"beam": "B###", "board": "DP-<host>-<seq>"},
        "summary": {k: result[k] for k in ("beams_processed", "boards_created", "deleted_previous")},
        "boards": board_records,
        "skipped": result["skipped"],
        "warnings": warnings,
    }
    f = open(MANIFEST_PATH, "w")
    try:
        json.dump(manifest, f, indent=2)
    finally:
        f.close()
    result["manifest_path"] = MANIFEST_PATH
except Exception as ex:
    warnings.append("Manifest write failed: {}".format(ex))

OUT = result
# ----------------------------------------
beams_result = Watch(origin_beams)
origin_soffits = Python()  # CPython3; unwired: IN[0], IN[1]
# ---------- origin_soffits.python (2403 lines) ----------
# Origin Ceiling Assembly Generator v1 - FRAMING + DRYWALL (FURRED / SUSPENDED)  [NO TAPER / NO SCREW / NO JOINT]
# Dynamo Python Script node for Revit. Version-tolerant: runs on Revit 2025 (Dynamo CPython3, the
# Omniverse-export version) AND 2026/2027 (PythonNet3). No f-strings; eid_value() handles the
# ElementId .Value/.IntegerValue change.
#
# NO-TAPER / NO-SCREW / NO-JOINT VARIANT: identical to origin_ceiling_assembly_v1.py EXCEPT the
# gypsum panels are FLAT, FLUSH slabs and there are NO screws:
#   - factory edge taper OFF (TAPERED_LONG_EDGES = False)
#   - panel-to-panel code gap ZERO (CODE_GAP_FT = 0) -> adjacent boards butt flush, no joint reveal
#   - screws OFF (GENERATE_SCREWS = False) -> no screw markers / records
# Everything else (furring, mains/hangers, splicing, openings, nomenclature) is unchanged. Kept in
# lockstep with the trunk; the ONLY differences are this header, TAPERED_LONG_EDGES, CODE_GAP_FT,
# GENERATE_SCREWS, and MANIFEST_PATH. Same APP_ID + CEILING=C<eid> cleanup token, so running this on
# a ceiling REPLACES the trunk's drywall on that ceiling with this version (interchangeable alternate).
#
# WHAT THIS IS:
#   The ceiling counterpart of origin_wall_assembly_v4_phase2.py. For each selected Revit CEILING
#   it builds a construction-accurate gypsum ceiling as DirectShape solids:
#       - Metal FURRING (hat) channels @ 16" OC, run across the ceiling just above the drywall.
#       - REINFORCEMENT for long spans (ASTM C754): a 7/8" furring channel can only span ~4 ft
#         before the gypsum weight sags it, so when the furring run exceeds MAX_FURRING_SPAN_FT the
#         script adds MAIN carrying channels perpendicular to the furring @ <=48" OC (sitting on top
#         of it). HANGER wires are OFF by default (GENERATE_HANGERS) - they only apply when there is
#         a structural deck/slab ABOVE to anchor into; with no deck the mains fasten directly to the
#         joists/trusses. Small ceilings (run <= limit) stay direct-furred with no mains.
#       - GYPSUM board on the underside (single face, room side), laid in a staggered grid,
#         clipped to the ceiling's boundary polygon, cut around holes/fixtures as SINGLE pieces,
#         tapered long edges on full field boards, 2 layers for fire-rated ceilings.
#       - Drywall SCREWS along the furring lines on the room-facing surface (markers + coords).
#       - A sidecar JSON assembly manifest and a base-ceiling-hidden isolation view.
#
# HOW IT DIFFERS FROM THE WALL SCRIPT (by design):
#   - Single-sided (drywall only on the underside; the top faces the plenum).
#   - Horizontal: the layout plane is world X-Y at the ceiling's bottom-face elevation.
#   - Boundary is the ceiling's polygon (any shape, incl. holes/courtyards), not a straight line.
#     Boards/furring are clipped to it with Revit boolean intersect (robust for concave + holes).
#   - Framing is furring hat-channels, not vertical C-studs.
#
# STILL APPROXIMATE (documented):
#   - The board/furring grid is world-X/Y aligned (not rotated to the room's long edge) - fine for
#     axis-aligned rooms; a rotation pass is a later refinement.
#   - Hosted fixtures are cut from their plan bounding box (may be slightly oversized). Holes drawn
#     into the ceiling sketch are handled automatically (they come through as inner boundary loops).
#   - Layout/visualization geometry, not shop-drawing certification.

import clr
import math
import json

clr.AddReference('RevitAPI')
clr.AddReference('RevitServices')

from Autodesk.Revit.DB import *
from RevitServices.Persistence import DocumentManager
from RevitServices.Transactions import TransactionManager

try:
    clr.AddReference('RevitNodes')
    import Revit
    clr.ImportExtensions(Revit.Elements)
except:
    pass

from System.Collections.Generic import List

doc = DocumentManager.Instance.CurrentDBDocument
uidoc = DocumentManager.Instance.CurrentUIApplication.ActiveUIDocument

# ============================================================
# USER SETTINGS
# ============================================================

APP_ID = "ORIGIN_CEILING_V1"

GENERATE_FURRING = True
GENERATE_DRYWALL = True
GENERATE_SCREWS = False     # NO-SCREW BUILD: hard off (Dynamo IN[8] can still force it on)
COLOR_BY_TYPE = True
DELETE_PREVIOUS = True
PROCESS_ALL_CEILINGS_IF_NONE_SELECTED = False

# Which ceiling elements THIS node processes (per-element "plugin" split, user 2026-07-17):
#   "all"      - every gathered ceiling incl. soffits (legacy single-node behavior)
#   "ceilings" - skip soffit-named elements (the CEILINGS node; soffits have their own node)
#   "soffits"  - ONLY soffit-named elements, self-collected model-wide regardless of the
#                dropdown/selection (the SOFFITS node - like the beams/columns nodes)
PROCESS_MODE = "soffits"

IN_FT = 1.0 / 12.0

# ---- Furring (hat / DWC channel) ----
FURRING_SPACING_FT = 16.0 * IN_FT        # 16 in. OC (ASTM C754: cross-furring <= 24" OC; 16" for 5/8")
FURRING_FACE_FT = 2.5 * IN_FT            # channel face width (across the run)
FURRING_HEIGHT_FT = 0.875 * IN_FT        # 7/8" DWC furring channel depth
MAT_T_FT = 0.0451 * IN_FT                # steel material thickness (~18 ga)
MIN_SEG_FT = 0.25                        # skip framing/board slivers < 3 in.
# A piece can be >= MIN_SEG_FT (so it doesn't get dropped) and still be a visually/physically
# meaningless sliver - a 3-4in confetti-sized board next to a normal-sized neighbor. A sim/robot
# texture pass can misread that tiny standalone piece as a real discontinuity. Anywhere a
# too-small leftover CAN be safely fused into a touching same-run neighbor, it is, instead of
# being kept standalone or dropped and leaving a hole (user report 2026-07-30, DP-S001-020/021/022
# - a false wall-cut split a whole 4ft course into a 3in sliver between two normal boards).
MIN_SAFE_SEGMENT_FT = 0.5                 # 6 in - below this, merge into a same-run neighbor

# ---- Walls (room separation) ----
# Stop the ceiling drywall at WALLS - same requirement as the wall assembly corners. Every wall's
# plan footprint is subtracted from the clip mask (a board/channel can never enter a wall), and
# the board grid stops-and-restarts at each wall face so no single panel runs under a wall into
# the next room - each room gets its own separate panels for per-room Isaac interaction.
CLIP_CEILING_AT_WALLS = True

# ---- Per-room generation ----
# Generate the ceiling PER ROOM - the same pattern the wall script uses per wall run. Each Revit
# Room's boundary polygon (taken at wall FINISH faces via Room.GetBoundarySegments, continuous
# across doorways because the segments follow the room-bounding walls / room separation lines) is
# an independent bounded region: boards, furring and mains are laid out inside it with their own
# grid origin and are cut at its edges, so nothing is ever generated outside its own room and no
# element spans two rooms. When True this REPLACES the legacy whole-ceiling-grid +
# wall-subtraction path above for any ceiling that has Rooms (set False to compare old vs new
# output on the same model). A ceiling with NO overlapping Room (e.g. a soffit) falls back to
# the legacy path with a warning, so soffits keep working until their own pass. Ceiling area
# covered by no Room gets no panels and is reported in the warnings.
CEILING_PER_ROOM = True
MIN_ROOM_AREA_SF = 1.0        # skip unenclosed/degenerate rooms (Revit reports their area as 0)

# ---- Soffits (separate flow) ----
# A soffit (Ceiling element whose type/family name contains "soffit", host tag S###) is a narrow
# run - straight or L-shaped - spanning from one wall to an adjacent wall. It gets EXACTLY TWO
# custom-cut boards: one per leg of an L (butt joint at the inner corner), or a mid-run split on
# a straight run. Each board must be 2..16 ft (warnings otherwise). Boards clip against the
# wall-subtracted mask so they end at the walls the soffit spans between - no penetration.
# No 4x8 grid, no rooms/zones, no carrying mains (furring only).
SOFFIT_SEPARATE_FLOW = True
SOFFIT_MAX_BOARD_FT = 16.0
SOFFIT_MIN_BOARD_FT = 2.0
# The 2-board rule is for NARROW beam/bulkhead soffits. A soffit whose footprint is wider than
# this on its SHORT axis is a room-sized ceiling drop, not a beam - 2 boards spanning the whole
# area would be oversized, non-standard sheets ("no proper drywall cut", user 2026-07-21). Those
# wide soffits instead fall through to the SAME whole-4x8-per-zone tiling used for ordinary
# ceilings (the "FALLBACK ZONES" path below), so they look and behave like the rest of the model.
SOFFIT_BEAM_MAX_WIDTH_FT = 5.0

# ---- Suspension / reinforcement (ASTM C754) ----
# A 7/8" furring channel can only span so far before the gypsum weight deflects it and the ceiling
# sags. Past MAX_FURRING_SPAN_FT it must be carried by MAIN (carrying) channels at MAIN_SPACING_FT
# perpendicular to the furring (breaking it into <=4 ft spans). Small ceilings (run <= the limit)
# stay direct-furred end-to-end with no mains. ASTM C754 prescriptive limits (non-seismic): furring
# span <= 48", mains <= 48" OC, hangers <= 48" OC and <= 16 sq ft each.
GENERATE_MAINS = True
MAX_FURRING_SPAN_FT = 48.0 * IN_FT       # max unsupported furring span before a main is required
MAIN_SPACING_FT = 48.0 * IN_FT           # carrying channels <= 4 ft OC (perpendicular to furring)
MAIN_DEPTH_FT = 1.5 * IN_FT              # 1-1/2" cold-rolled carrying channel (CRC)
MAIN_FACE_FT = 0.5 * IN_FT               # CRC flange/face width

# HANGER WIRES only exist where the mains can be hung from a structural deck (concrete slab, etc.)
# ABOVE the ceiling. If there is NO deck above (top floor under a roof, or the framing fastens
# DIRECTLY to the joists/trusses above), you don't use hanger rods - leave this False and the mains
# read as direct-fastened to the structure. Set True only when there is a slab/deck above to anchor
# the #12 wires into. ASTM C754 (when used): hangers <= 48" OC along each main, <= 16 sq ft each.
GENERATE_HANGERS = False
HANGER_SPACING_FT = 48.0 * IN_FT         # hanger wires <= 4 ft OC along each main
HANGER_MAX_AREA_SF = 16.0                # informational: each hanger supports <= 16 sq ft
HANGER_DIA_FT = 0.106 / 12.0            # #12 ga hanger wire (~0.106")
HANGER_DROP_FT = 12.0 * IN_FT            # modeled wire length up toward the deck (nominal)
END_SUPPORT_SETBACK_FT = 6.0 * IN_FT     # first hanger within 6" of a main's ends (ASTM C754)

# ---- Splicing: channels ship in stock lengths and are lapped end-to-end, not one long piece ----
# A furring / carrying channel can't be one continuous 40-ft run; it is made of stock-length pieces
# nested/overlapped at each splice and secured (screws / tie wire). Splices are STAGGERED between
# adjacent channels so the joints don't line up. Each stock piece becomes its own element (good for
# per-element sim). ASTM C754 typical: furring lap ~8", carrying-channel lap 12".
SPLICE_CHANNELS = True
FURRING_STOCK_LENGTH_FT = 12.0           # 7/8" furring/hat channel stock length (also 10 ft)
FURRING_SPLICE_LAP_FT = 8.0 * IN_FT      # ~8" nested lap at a furring splice
MAIN_STOCK_LENGTH_FT = 16.0              # 1-1/2" CRC carrying channel stock length (also 20 ft)
MAIN_SPLICE_LAP_FT = 12.0 * IN_FT        # 12" lap at a carrying-channel splice (ASTM C754)
SPLICE_STAGGER_FT = 4.0                  # shift splices this much between adjacent channels
SPLICE_NEST_OFFSET = True                # nudge a lapping piece by one material thickness (nested look)

# ---- Drywall ----
PANEL_LENGTH_FT = 8.0                    # board long dimension (along X); 12.0 for 4x12
PANEL_WIDTH_FT = 4.0                     # board short dimension (course step, along Y)
DRYWALL_THICKNESS_STD_FT = 0.5 * IN_FT
DRYWALL_THICKNESS_RATED_FT = 0.625 * IN_FT
DRYWALL_LAYERS_RATED = 2
DRYWALL_LAYERS_STD = 1
CODE_GAP_FT = 0.0 * IN_FT                # FLAT BUILD: no gap between boards (panels butt flush)
LAYER_H_STAGGER_FT = PANEL_LENGTH_FT / 2.0
LAYER_V_STAGGER_FT = PANEL_WIDTH_FT / 2.0
ODD_ROW_SHIFT_FT = 4.0                   # stagger odd courses

# Maximize whole 4x8 sheets: kill the odd-row stagger so every row starts at its region's origin
# - far fewer cut pieces (a full-sheet grid with a single rip at each far edge). Joints then line
# up row-to-row, which is not how sheets are hung on a real job, but it is what the sim needs
# (user 2026-07-16: "I want 4x8 drywall everywhere possible"). Set False for staggered courses.
MAXIMIZE_WHOLE_PANELS = True
TAPERED_LONG_EDGES = False               # FLAT BUILD: no factory taper - panels are flat slabs
TAPER_DEPTH_FT = 0.0625 * IN_FT
TAPER_WIDTH_FT = 2.25 * IN_FT
MIN_PIECE_WIDTH_FT = 0.25
MIN_PIECE_HEIGHT_FT = 0.25

# ---- Fasteners ----
SCREW_SPACING_FT = 12.0 * IN_FT          # field screws 12" OC (ceilings) along each furring line
SCREW_EDGE_SETBACK_FT = 0.5 * IN_FT      # set screws back from board edges/ends (USG/GA min 3/8")
SCREW_EDGE_TOL_FT = 0.05                 # a furring line / board end within this of an edge = a joint
SCREW_MARKER_SIZE_FT = 0.5 * IN_FT
SCREW_MARKER_DEPTH_FT = 0.15 * IN_FT     # total head thickness (mostly embedded)
SCREW_HEAD_PROUD_FT = 0.02 * IN_FT       # subtle proud amount below the drywall
SCREWS_OUTER_LAYER_ONLY = True
MAX_SCREWS_PER_CEILING = 8000

# ---- Openings / fixtures ----
CUT_FIXTURES = True                      # cut around family instances hosted on the ceiling
FIXTURE_CLEARANCE_FT = 0.05

# Columns (and beams) are generated by their OWN plugins (ORIGIN Columns / ORIGIN Beams) with no
# knowledge of the ceiling, and the ceiling generator previously had no knowledge of THEM - a
# ceiling/soffit board could run straight through a column/beam with no cutout (user report
# 2026-07-21, screenshot: ceiling panel intruding a corner column). Their plan footprints are
# punched out of the ceiling clip mask the SAME way hosted fixtures already are (append to the
# fixtures rect list) - flows through every mode (rooms, zones, narrow-soffit) automatically.
CUT_AT_COLUMNS = True
CUT_AT_BEAMS = True
# Must equal the column/beam plugins' own DRYWALL_T_FT (0.5in) so the ceiling cutout edge lands
# exactly on the column/beam board's real outer face - a bigger value (the old 0.05ft/0.6in)
# leaves the boards short of the cutout by the difference, a visible "vacuum gap" in the sim
# (user report 2026-07-27, DP-S001-004 vs DP-K001-005/007).
COLUMN_BEAM_CLEARANCE_FT = 0.5 * IN_FT

# ---- Fire rating override: None = auto-detect; True/False = force ----
FORCE_FIRE_RATED = None

# ---- Export ----
CREATE_EXPORT_VIEW = True
EXPORT_VIEW_NAME = "ORIGIN Assembly"
WRITE_MANIFEST = True
MANIFEST_PATH = r"C:\Users\Origoncad\Downloads\origin_revit_drywall_scripts_v2_two_faces\origin_soffit_manifest.json"

HOLE_MARGIN_FT = 0.05

# Dynamo inputs:
#   IN[0] = selected ceiling(s) (or current selection)
#   IN[5] = delete previous (override)
#   IN[6] = generate drywall (override)
#   IN[7] = force fire-rated (override)
#   IN[8] = generate screws (override)
# ============================================================


# ------------------------------------------------------------
# Small helpers  (shared with the wall script)
# ------------------------------------------------------------

def unwrap(item):
    try:
        return UnwrapElement(item)
    except:
        return item


def get_in(index, default=None):
    try:
        val = IN[index]
    except:
        return default
    return val if val is not None else default


def ensure_list(x):
    if x is None:
        return []
    if isinstance(x, list):
        return x
    return [x]


def as_bool(value, default):
    if value is None:
        return default
    if isinstance(value, bool):
        return value
    if isinstance(value, int):
        return value != 0
    if isinstance(value, str):
        return value.strip().lower() in ["true", "yes", "1", "y"]
    return default


def eid_value(eid):
    try:
        return eid.Value
    except:
        pass
    try:
        return eid.IntegerValue
    except:
        return -1


def clamp(value, lo, hi):
    return max(lo, min(hi, value))


def unique_sorted(values, tolerance=0.01):
    out = []
    for v in sorted(values):
        if not out or abs(out[-1] - v) > tolerance:
            out.append(v)
    return out


# ------------------------------------------------------------
# Nomenclature helpers (hierarchical element naming)
#   host tag : C### (ceiling) or S### (soffit, type name contains 'soffit'), on the ceiling Mark
#   drywall  : DP-<host>-<seq>        (single underside face -> no face letter)
#   furring  : ST-<host>-<seq>
#   screw    : SC-<host>-<seq>
# ------------------------------------------------------------

def set_mark(element, name):
    """Best-effort write of the nomenclature name to an element's Mark (schedulable/taggable)."""
    try:
        mk = element.get_Parameter(BuiltInParameter.ALL_MODEL_MARK)
        if mk and (not mk.IsReadOnly):
            mk.Set(name)
    except:
        pass


def _host_mark_param(elem):
    try:
        p = elem.get_Parameter(BuiltInParameter.ALL_MODEL_MARK)
        if p:
            return p
    except:
        pass
    try:
        return elem.LookupParameter("Mark")
    except:
        return None


def _parse_ceiling_mark(s):
    """('C'|'S', number) a ceiling Mark encodes (e.g. 'C001', 'S12'), or (None, None)."""
    if not s:
        return None, None
    t = s.strip().upper()
    if len(t) < 2 or t[0] not in ("C", "S") or not t[1:].isdigit():
        return None, None
    try:
        n = int(t[1:])
    except:
        return None, None
    return (t[0], n) if n > 0 else (None, None)


def ceiling_prefix(ceiling):
    """'S' for a soffit (type or family name contains 'soffit'), else 'C'."""
    names = []
    try:
        ct = doc.GetElement(ceiling.GetTypeId())
        if ct is not None:
            try:
                names.append(ct.Name)
            except:
                pass
            try:
                if ct.FamilyName:
                    names.append(ct.FamilyName)
            except:
                pass
    except:
        pass
    for nm in names:
        try:
            if "soffit" in nm.lower():
                return "S"
        except:
            pass
    return "C"


def assign_ceiling_numbers(ceilings, warnings):
    """Give each selected ceiling a stable, per-type-unique host tag: 'C###' (ceiling) or 'S###'
    (soffit). Reuses the tag already in the ceiling's Mark when its prefix still matches the
    element's current type; new numbers are the smallest free within that prefix across ALL
    ceilings in the model, written back to Mark so reruns stay stable. Selected ceilings are
    numbered in ElementId order. Returns {ceiling_eid_value: 'C001'/'S001'}. Runs in a
    transaction. Best-effort: Mark write failures are reported, not fatal."""
    taken = {"C": set(), "S": set()}
    try:
        for c in FilteredElementCollector(doc).OfClass(Ceiling).WhereElementIsNotElementType():
            p = _host_mark_param(c)
            pr, n = _parse_ceiling_mark(p.AsString()) if p else (None, None)
            if pr in ("C", "S") and n is not None:
                taken[pr].add(n)
    except Exception as ex:
        warnings.append("Ceiling-number scan failed (continuing): {}".format(ex))

    selected = sorted(ceilings, key=lambda c: eid_value(c.Id))
    assigned = {}
    used_here = {"C": set(), "S": set()}
    # Pass 1: honor an existing Mark whose prefix matches the ceiling's current type prefix.
    for c in selected:
        pref = ceiling_prefix(c)
        p = _host_mark_param(c)
        pr, n = _parse_ceiling_mark(p.AsString()) if p else (None, None)
        if pr == pref and n is not None and n not in used_here[pref]:
            assigned[eid_value(c.Id)] = "{}{:03d}".format(pref, n)
            used_here[pref].add(n)
    # Pass 2: assign the rest the smallest free number within their prefix; persist to Mark.
    nxt = {"C": 1, "S": 1}
    for c in selected:
        key = eid_value(c.Id)
        pref = ceiling_prefix(c)
        if key not in assigned:
            while nxt[pref] in taken[pref] or nxt[pref] in used_here[pref]:
                nxt[pref] += 1
            used_here[pref].add(nxt[pref])
            taken[pref].add(nxt[pref])
            assigned[key] = "{}{:03d}".format(pref, nxt[pref])
        tag = assigned[key]
        p = _host_mark_param(c)
        if p is not None and not p.IsReadOnly:
            try:
                if (p.AsString() or "") != tag:
                    p.Set(tag)
            except Exception as ex:
                warnings.append("Could not set Mark on ceiling {}: {}".format(eid_value(c.Id), ex))
    return assigned


# ------------------------------------------------------------
# 2D polygon helpers (world X-Y)
# ------------------------------------------------------------

def poly_bbox(poly):
    xs = [p[0] for p in poly]
    ys = [p[1] for p in poly]
    return (min(xs), min(ys), max(xs), max(ys))


def poly_area(pts):
    a = 0.0
    n = len(pts)
    for i in range(n):
        x0, y0 = pts[i]
        x1, y1 = pts[(i + 1) % n]
        a += x0 * y1 - x1 * y0
    return abs(a) / 2.0


def point_in_polygon(px, py, poly):
    """Ray-casting point-in-polygon. poly = list of (x, y)."""
    inside = False
    n = len(poly)
    j = n - 1
    for i in range(n):
        xi, yi = poly[i]
        xj, yj = poly[j]
        if ((yi > py) != (yj > py)) and (px < (xj - xi) * (py - yi) / (yj - yi + 1e-12) + xi):
            inside = not inside
        j = i
    return inside


def rects_overlap(a, b):
    return not (a[2] <= b[0] or b[2] <= a[0] or a[3] <= b[1] or b[3] <= a[1])


def merge_small_pieces(pieces, min_safe_ft):
    """2D analog of the wall build's merge_small_segments(): fuse any rect whose narrower
    dimension is under min_safe_ft into a touching neighbor RECT IN THE SAME LIST that shares its
    full X-range (stacked in Y) or full Y-range (stacked in X), instead of keeping it as its own
    tiny sliver or dropping it and leaving a hole. Only merges along a shared full edge (so the
    result is always still a plain rectangle) - an arbitrary L-shaped merge is not attempted, and
    a rect with no same-range neighbor to absorb it into is left as-is (the caller's existing
    MIN_PIECE_WIDTH/HEIGHT check still drops a genuinely isolated tiny leftover). Fixes the class
    of bug where a wall that only touches a zone's boundary edge (without truly crossing into it)
    still injects a spurious internal seam, leaving a confetti-sized board between two normal
    ones (user report 2026-07-30, DP-S001-020/021/022 - a whole 4ft course chopped into 3 pieces
    with a 3in sliver in the middle, no real wall ever running through that course)."""
    pcs = [list(p) for p in pieces]
    changed = True
    while changed:
        changed = False
        for i, (x0, y0, x1, y1) in enumerate(pcs):
            if min(x1 - x0, y1 - y0) >= min_safe_ft:
                continue
            for j, (ox0, oy0, ox1, oy1) in enumerate(pcs):
                if i == j:
                    continue
                if abs(ox0 - x0) < 1e-4 and abs(ox1 - x1) < 1e-4:      # same X-range
                    if abs(oy1 - y0) < 1e-4:
                        pcs[j][3] = y1
                    elif abs(oy0 - y1) < 1e-4:
                        pcs[j][1] = y0
                    else:
                        continue
                elif abs(oy0 - y0) < 1e-4 and abs(oy1 - y1) < 1e-4:    # same Y-range
                    if abs(ox1 - x0) < 1e-4:
                        pcs[j][2] = x1
                    elif abs(ox0 - x1) < 1e-4:
                        pcs[j][0] = x0
                    else:
                        continue
                else:
                    continue
                del pcs[i]
                changed = True
                break
            if changed:
                break
    return [tuple(p) for p in pcs]


def rect_area(r):
    return max(0.0, r[2] - r[0]) * max(0.0, r[3] - r[1])


# ------------------------------------------------------------
# Ceiling reading
# ------------------------------------------------------------

def apply_process_mode(ceilings, warnings):
    """PROCESS_MODE='ceilings' drops soffit-named elements (the Soffits node owns them)."""
    if PROCESS_MODE != "ceilings":
        return ceilings
    kept = [e for e in ceilings if ceiling_prefix(e) != "S"]
    if len(kept) != len(ceilings):
        warnings.append("{} soffit(s) skipped here - the ORIGIN Soffits node handles them".format(
            len(ceilings) - len(kept)))
    return kept


def get_input_ceilings(warnings):
    ceilings = []
    if PROCESS_MODE == "soffits":
        # The Soffits plugin self-collects every soffit-named ceiling, model-wide.
        for e in FilteredElementCollector(doc).OfClass(Ceiling).WhereElementIsNotElementType():
            if ceiling_prefix(e) == "S":
                ceilings.append(e)
        return ceilings
    data = get_in(0)
    if data:
        for item in ensure_list(data):
            e = unwrap(item)
            if isinstance(e, Ceiling):
                ceilings.append(e)
    if ceilings:
        return apply_process_mode(ceilings, warnings)
    try:
        for eid in list(uidoc.Selection.GetElementIds()):
            e = doc.GetElement(eid)
            if isinstance(e, Ceiling):
                ceilings.append(e)
    except Exception as ex:
        warnings.append("Could not read selection: {}".format(ex))
    if ceilings:
        return apply_process_mode(ceilings, warnings)
    if PROCESS_ALL_CEILINGS_IF_NONE_SELECTED:
        for e in FilteredElementCollector(doc).OfClass(Ceiling).WhereElementIsNotElementType():
            ceilings.append(e)
    return apply_process_mode(ceilings, warnings)


def get_ceiling_loops(ceiling, warnings):
    """Return (loops, z) where loops = list of polygons [[(x,y),...], ...] with the LARGEST-area
    loop first (outer) and the rest treated as holes, and z = the bottom-face elevation. Extracted
    from the ceiling's geometry (the downward-facing planar face), tessellating any curved edges."""
    opt = Options()
    opt.ComputeReferences = False
    opt.IncludeNonVisibleObjects = False
    try:
        opt.DetailLevel = ViewDetailLevel.Medium
    except:
        pass

    best_face = None
    best_z = None
    try:
        geo = ceiling.get_Geometry(opt)
        for g in geo:
            solid = g if isinstance(g, Solid) else None
            if solid is None or solid.Volume <= 0:
                continue
            for face in solid.Faces:
                if not isinstance(face, PlanarFace):
                    continue
                nrm = face.FaceNormal
                if nrm.Z < -0.9:                       # downward-facing = room-side bottom face
                    z = face.Origin.Z
                    if best_face is None or z < best_z:   # lowest such face
                        best_face = face
                        best_z = z
    except Exception as ex:
        warnings.append("Ceiling {}: geometry read failed ({})".format(eid_value(ceiling.Id), ex))
        return None, None

    if best_face is None:
        return None, None

    loops = []
    try:
        curve_loops = best_face.GetEdgesAsCurveLoops()
        for cl in curve_loops:
            pts = []
            for c in cl:
                try:
                    tess = c.Tessellate()
                except:
                    tess = [c.GetEndPoint(0), c.GetEndPoint(1)]
                for p in tess:
                    if not pts or abs(pts[-1][0] - p.X) > 1e-6 or abs(pts[-1][1] - p.Y) > 1e-6:
                        pts.append((p.X, p.Y))
            if len(pts) >= 2 and abs(pts[0][0] - pts[-1][0]) < 1e-6 and abs(pts[0][1] - pts[-1][1]) < 1e-6:
                pts = pts[:-1]
            if len(pts) >= 3:
                loops.append(pts)
    except Exception as ex:
        warnings.append("Ceiling {}: loop extraction failed ({})".format(eid_value(ceiling.Id), ex))
        return None, None

    if not loops:
        return None, None
    loops.sort(key=poly_area, reverse=True)     # largest = outer, rest = holes
    return loops, best_z


def ceiling_is_fire_rated(ceiling, warnings):
    if FORCE_FIRE_RATED is not None:
        return bool(FORCE_FIRE_RATED)
    try:
        ct = doc.GetElement(ceiling.GetTypeId())
    except:
        ct = None
    if ct is None:
        return False
    try:
        p = ct.LookupParameter("Fire Rating")
        if p is not None and p.HasValue:
            st = p.StorageType
            if st == StorageType.String:
                s = p.AsString()
                if s and any(ch.isdigit() for ch in s):
                    return True
            elif st == StorageType.Double and p.AsDouble() > 0.01:
                return True
            elif st == StorageType.Integer and p.AsInteger() > 0:
                return True
    except:
        pass
    try:
        name = ct.Name.lower()
        for kw in ("fire", "rated", "type x", "type-x", "1 hr", "2 hr", "1-hr", "2-hr", "1hr", "2hr"):
            if kw in name:
                return True
    except:
        pass
    return False


def get_fixture_rects(ceiling, warnings):
    """Plan-view (x0,y0,x1,y1) bounding rects of family instances hosted on this ceiling
    (lights, diffusers, access panels). Best-effort."""
    rects = []
    if not CUT_FIXTURES:
        return rects
    cid = ceiling.Id
    try:
        col = FilteredElementCollector(doc).OfClass(FamilyInstance).WhereElementIsNotElementType()
        for fi in col:
            host = None
            try:
                host = fi.Host
            except:
                host = None
            if host is None or host.Id != cid:
                continue
            try:
                bb = fi.get_BoundingBox(None)
            except:
                bb = None
            if not bb:
                continue
            x0 = bb.Min.X - FIXTURE_CLEARANCE_FT
            y0 = bb.Min.Y - FIXTURE_CLEARANCE_FT
            x1 = bb.Max.X + FIXTURE_CLEARANCE_FT
            y1 = bb.Max.Y + FIXTURE_CLEARANCE_FT
            if (x1 - x0) > 0.1 and (y1 - y0) > 0.1:
                rects.append((x0, y0, x1, y1))
    except Exception as ex:
        warnings.append("Ceiling {}: fixture scan failed ({})".format(eid_value(ceiling.Id), ex))
    return rects


# ------------------------------------------------------------
# Geometry primitives  (shared with the wall script)
# ------------------------------------------------------------

def make_point(origin, u, v, x, y):
    return origin.Add(u.Multiply(x)).Add(v.Multiply(y))


def _extrude_loops(loops, extrude_dir, depth, material_id, gstyle_id):
    if material_id is not None:
        gs = gstyle_id if gstyle_id is not None else ElementId.InvalidElementId
        opts = SolidOptions(material_id, gs)
        return GeometryCreationUtilities.CreateExtrusionGeometry(loops, extrude_dir, depth, opts)
    return GeometryCreationUtilities.CreateExtrusionGeometry(loops, extrude_dir, depth)


def make_planar_poly_solid(origin, u, v, normal, pts2d, depth, material_id=None, gstyle_id=None):
    clean = []
    for p in pts2d:
        if not clean or abs(clean[-1][0] - p[0]) > 1e-7 or abs(clean[-1][1] - p[1]) > 1e-7:
            clean.append(p)
    if len(clean) >= 2 and abs(clean[0][0] - clean[-1][0]) < 1e-7 and abs(clean[0][1] - clean[-1][1]) < 1e-7:
        clean = clean[:-1]
    if len(clean) < 3 or depth <= 0:
        return None
    verts = [make_point(origin, u, v, x, y) for (x, y) in clean]
    for order in (verts, list(reversed(verts))):
        try:
            loop = CurveLoop()
            n = len(order)
            for i in range(n):
                loop.Append(Line.CreateBound(order[i], order[(i + 1) % n]))
            loops = List[CurveLoop]()
            loops.Add(loop)
            return _extrude_loops(loops, normal, depth, material_id, gstyle_id)
        except:
            continue
    return None


def make_rect_solid(origin, u, v, normal, rect, depth, material_id=None, gstyle_id=None):
    x0, y0, x1, y1 = rect
    if (x1 - x0) < 0.001 or (y1 - y0) < 0.001 or depth <= 0:
        return None
    pts = [(x0, y0), (x1, y0), (x1, y1), (x0, y1)]
    return make_planar_poly_solid(origin, u, v, normal, pts, depth, material_id, gstyle_id)


def make_profile_solid(origin, ax, ay, points2d, extrude_dir, depth, material_id=None, gstyle_id=None):
    if depth <= 0 or points2d is None or len(points2d) < 3:
        return None
    verts = [origin.Add(ax.Multiply(p)).Add(ay.Multiply(q)) for (p, q) in points2d]
    for order in (verts, list(reversed(verts))):
        try:
            loop = CurveLoop()
            n = len(order)
            for i in range(n):
                loop.Append(Line.CreateBound(order[i], order[(i + 1) % n]))
            loops = List[CurveLoop]()
            loops.Add(loop)
            return _extrude_loops(loops, extrude_dir, depth, material_id, gstyle_id)
        except:
            continue
    return None


def boolean_op(a, b, op):
    if a is None:
        return None
    if b is None:
        return a
    try:
        return BooleanOperationsUtils.ExecuteBooleanOperation(a, b, op)
    except:
        return a


def solid_ok(s):
    """A usable, non-empty solid (a boolean clip that lands fully outside returns ~0 volume)."""
    try:
        return s is not None and s.Volume > 1e-7
    except:
        return s is not None


def make_tapered_board_solid(origin_at_z, u, v, normal, rect, thickness, material_id=None, gstyle_id=None):
    """Ceiling board whose ROOM-FACING (bottom, -normal) side recesses near its two long edges
    (the factory taper). Built by extruding a (width x thickness) profile along the board LENGTH
    (u = X). normal = +Z (up). The taper is on the bottom, so it recesses at low thickness-q."""
    x0, y0, x1, y1 = rect
    length = x1 - x0
    width = y1 - y0
    if length < 0.001 or width < 0.001 or thickness <= 0:
        return None
    td = min(TAPER_DEPTH_FT, thickness * 0.9)
    tw = TAPER_WIDTH_FT
    if td <= 0 or tw <= 0 or width <= 2.0 * tw + 0.01:
        return make_rect_solid(origin_at_z, u, v, normal, rect, thickness, material_id, gstyle_id)
    origin = make_point(origin_at_z, u, v, x0, y0)
    # profile: (w along v = board width, d along normal = thickness). Room side is d=0 (bottom);
    # it recesses to d=td at the two long edges (w=0 and w=width) over tw. Top (d=thickness) flat.
    profile = [(0.0, td), (tw, 0.0), (width - tw, 0.0), (width, td),
               (width, thickness), (0.0, thickness)]
    return make_profile_solid(origin, v, normal, profile, u, length, material_id, gstyle_id)


def create_directshape(solid, data_id, name, comments, warnings):
    if solid is None:
        return None
    try:
        ds = DirectShape.CreateElement(doc, ElementId(BuiltInCategory.OST_GenericModel))
        ds.ApplicationId = APP_ID
        ds.ApplicationDataId = data_id
        shape = List[GeometryObject]()
        shape.Add(solid)
        ds.SetShape(shape)
        try:
            ds.Name = name
        except:
            pass
        try:
            p = ds.get_Parameter(BuiltInParameter.ALL_MODEL_INSTANCE_COMMENTS)
            if p and not p.IsReadOnly:
                p.Set(comments)
        except:
            pass
        set_mark(ds, name)          # nomenclature also on Mark: schedulable + taggable
        return ds
    except Exception as ex:
        warnings.append("DirectShape create failed for {}: {}".format(data_id, ex))
        return None


def _ds_solids(ds):
    out = []
    try:
        opt = Options()
        geo = ds.get_Geometry(opt)
        if geo is None:
            return out
        for g in geo:
            if isinstance(g, Solid) and g.Volume > 1e-9:
                out.append(g)
    except Exception:
        pass
    return out
def merge_undersized_ceiling_boards(cid, warnings, min_safe_ft=None):
    """Post-pass, run once per ceiling right after all its rooms/zones are emitted: the boolean
    clip against a room/zone's real (possibly irregular) boundary - build_boundary_solid's mask,
    which can include a wall, a fixture, a column/beam footprint, or just an odd-shaped real
    boundary - has NO size floor of its own, so a grid cell whose real remaining footprint AFTER
    clipping is a thin sliver still survives as its own tiny board. merge_small_pieces() cannot
    catch this: it only merges within ONE grid cell's own wall_x_cuts/y_cuts sub-pieces, not
    across the different cells/rows that a mask-driven remainder can span (confirmed live,
    2026-07-30: DP-S001-039/041/043/048 were four separate ~3.6in slivers stacked across four
    different rows, all clipped down by the same zone-boundary edge that doesn't land on an 8ft
    grid line - each row's OWN per-cell merge never saw the others). Finds every DP-<host>-* board
    on this ceiling whose bbox short dimension is under the safe floor, finds its immediate
    same-layer neighbor sharing the full perpendicular range and touching edge (same row or same
    column), and replaces the pair with ONE board via a real boolean union of their already-valid
    solids - no re-derivation of the zone mask needed, since the union of two solids that are each
    already inside the mask is trivially still inside it. Returns (merged_count, removed_marks)."""
    if min_safe_ft is None:
        min_safe_ft = MIN_SAFE_SEGMENT_FT
    try:
        try:
            doc.Regenerate()
        except Exception as ex:
            warnings.append("doc.Regenerate() before ceiling {} small-board merge failed ({})".format(cid, ex))
        boards = []
        tag = "CEILING=" + cid
        for ds in FilteredElementCollector(doc).OfClass(DirectShape).ToElements():
            try:
                cm = ds.get_Parameter(BuiltInParameter.ALL_MODEL_INSTANCE_COMMENTS)
                comments = cm.AsString() if cm else None
            except Exception:
                comments = None
            if not comments or not comments.startswith(APP_ID + " |") or tag not in comments:
                continue
            try:
                mk = ds.get_Parameter(BuiltInParameter.ALL_MODEL_MARK)
                mark = mk.AsString() if mk else None
            except Exception:
                mark = None
            if not mark or not mark.startswith("DP-"):
                continue
            bb = ds.get_BoundingBox(None)
            if bb is None:
                continue
            layer = None
            for tok in comments.split("|"):
                tok = tok.strip()
                if len(tok) >= 2 and tok[0] == "L" and tok[1:].isdigit():
                    layer = tok
            boards.append({"ds": ds, "mark": mark, "bbox": bb, "layer": layer})

        tol = max(CODE_GAP_FT * 4.0, 0.02)
        merged = 0
        removed = set()
        new_bboxes = {}       # neighbor mark -> [minX,minY,maxX,maxY] after absorbing a small board
        for b in boards:
            if b["mark"] in removed:
                continue
            bb = b["bbox"]
            dx = bb.Max.X - bb.Min.X
            dy = bb.Max.Y - bb.Min.Y
            short = min(dx, dy)
            if short >= min_safe_ft:
                continue
            thin_x = dx < dy
            best = None
            best_gap = None
            for o in boards:
                if o is b or o["mark"] in removed or o["layer"] != b["layer"]:
                    continue
                ob = o["bbox"]
                gap = None
                if thin_x:
                    if abs(ob.Min.Y - bb.Min.Y) > tol or abs(ob.Max.Y - bb.Max.Y) > tol:
                        continue
                    if abs(ob.Max.X - bb.Min.X) <= tol:
                        gap = bb.Min.X - ob.Max.X
                    elif abs(ob.Min.X - bb.Max.X) <= tol:
                        gap = ob.Min.X - bb.Max.X
                    else:
                        continue
                else:
                    if abs(ob.Min.X - bb.Min.X) > tol or abs(ob.Max.X - bb.Max.X) > tol:
                        continue
                    if abs(ob.Max.Y - bb.Min.Y) <= tol:
                        gap = bb.Min.Y - ob.Max.Y
                    elif abs(ob.Min.Y - bb.Max.Y) <= tol:
                        gap = ob.Min.Y - bb.Max.Y
                    else:
                        continue
                if best is None or abs(gap) < best_gap:
                    best = o
                    best_gap = abs(gap)
            if best is None:
                continue
            small_solids = _ds_solids(b["ds"])
            nb_solids = _ds_solids(best["ds"])
            if not small_solids or not nb_solids:
                continue
            union_solid = None
            for s1 in nb_solids:
                for s2 in small_solids:
                    try:
                        u = BooleanOperationsUtils.ExecuteBooleanOperation(
                            s1, s2, BooleanOperationsType.Union)
                        if u is not None and u.Volume > 0:
                            union_solid = u
                    except Exception:
                        continue
            if union_solid is None:
                warnings.append("{}: ceiling small-board merge into {} failed (union produced "
                                "nothing)".format(b["mark"], best["mark"]))
                continue
            expect_vol = sum(s.Volume for s in nb_solids) + sum(s.Volume for s in small_solids)
            if union_solid.Volume < expect_vol * 0.9:
                warnings.append("{}: ceiling small-board merge into {} skipped - union volume "
                                "looks wrong ({:.4f} vs expected ~{:.4f})".format(
                                    b["mark"], best["mark"], union_solid.Volume, expect_vol))
                continue
            nb_before = best["bbox"]
            try:
                shape = List[GeometryObject]()
                shape.Add(union_solid)
                best["ds"].SetShape(shape)
                # Constructed directly from the two known-good pre-merge boxes, NOT re-queried via
                # ds.get_BoundingBox() - immediately after SetShape(), before a doc.Regenerate(),
                # that call can return a STALE box (same bug already found and fixed in the wall
                # script's close_small_cross_wall_gaps() 2026-07-30), which would corrupt this same
                # neighbor's adjacency check if it gets merged again later in this same pass.
                new_bbox = BoundingBoxXYZ()
                new_bbox.Min = XYZ(min(bb.Min.X, nb_before.Min.X), min(bb.Min.Y, nb_before.Min.Y),
                                    min(bb.Min.Z, nb_before.Min.Z))
                new_bbox.Max = XYZ(max(bb.Max.X, nb_before.Max.X), max(bb.Max.Y, nb_before.Max.Y),
                                    max(bb.Max.Z, nb_before.Max.Z))
                best["bbox"] = new_bbox
                new_bboxes[best["mark"]] = [round(new_bbox.Min.X, 3), round(new_bbox.Min.Y, 3),
                                            round(new_bbox.Max.X, 3), round(new_bbox.Max.Y, 3)]
                doc.Delete(b["ds"].Id)
                removed.add(b["mark"])
                merged += 1
            except Exception as ex:
                warnings.append("{}: ceiling small-board merge SetShape/Delete failed ({})".format(
                    b["mark"], ex))
        return merged, removed, new_bboxes
    except Exception as ex:
        warnings.append("merge_undersized_ceiling_boards failed for {}: {}".format(cid, ex))
        return 0, set(), {}


# ------------------------------------------------------------
# Colored subcategories + materials  (shared machinery)
# ------------------------------------------------------------

STYLE_SPECS = [
    ("FURRING", "ORIGIN Furring Channel", (150, 155, 165)),
    ("MAIN",    "ORIGIN Carrying Channel", (95, 110, 140)),   # main runners, deeper blue-grey
    ("HANGER",  "ORIGIN Hanger Wire",      (210, 180, 90)),   # hanger wires, brass-ish
    ("GWB",     "ORIGIN Drywall Base",    (235, 228, 214)),
    ("GWB2",    "ORIGIN Drywall Face",    (222, 212, 190)),
    ("SCREW",   "ORIGIN Screw",           (200, 60, 60)),
]


def get_or_create_material(name, rgb):
    for m in FilteredElementCollector(doc).OfClass(Material):
        if m.Name == name:
            return m.Id
    mid = Material.Create(doc, name)
    try:
        m = doc.GetElement(mid)
        m.Color = Color(rgb[0], rgb[1], rgb[2])
        m.Transparency = 0
    except:
        pass
    return mid


def get_or_create_subcategory(parent_cat, name, material_id, rgb):
    try:
        for sc in parent_cat.SubCategories:
            if sc.Name == name:
                return sc
    except:
        pass
    sc = doc.Settings.Categories.NewSubcategory(parent_cat, name)
    try:
        sc.LineColor = Color(rgb[0], rgb[1], rgb[2])
    except:
        pass
    try:
        if material_id and material_id != ElementId.InvalidElementId:
            sc.Material = doc.GetElement(material_id)
    except:
        pass
    return sc


def setup_styles(warnings):
    styles = {}
    try:
        gm = doc.Settings.Categories.get_Item(BuiltInCategory.OST_GenericModel)
    except Exception as ex:
        warnings.append("Could not access Generic Model category: {}".format(ex))
        return styles
    created = []
    for kind, name, rgb in STYLE_SPECS:
        try:
            mid = get_or_create_material(name, rgb)
            get_or_create_subcategory(gm, name, mid, rgb)
            created.append((kind, name, mid))
        except Exception as ex:
            warnings.append("Coloring for {} failed: {}".format(kind, ex))
    try:
        doc.Regenerate()
    except:
        pass
    subs = {}
    try:
        gm = doc.Settings.Categories.get_Item(BuiltInCategory.OST_GenericModel)
        for sc in gm.SubCategories:
            subs[sc.Name] = sc
    except:
        pass
    for kind, name, mid in created:
        gsid = ElementId.InvalidElementId
        sub = subs.get(name)
        if sub is not None:
            try:
                gs = sub.GetGraphicsStyle(GraphicsStyleType.Projection)
                if gs:
                    gsid = gs.Id
            except:
                pass
        styles[kind] = (mid, gsid)
    return styles


styles = {}


# ------------------------------------------------------------
# Cleanup (scoped to processed ceilings)
# ------------------------------------------------------------

def delete_previous(processed_ids, warnings):
    ids = List[ElementId]()
    tokens = ["CEILING=" + c + " " for c in processed_ids]
    try:
        for e in FilteredElementCollector(doc).OfClass(DirectShape):
            comment = None
            try:
                p = e.get_Parameter(BuiltInParameter.ALL_MODEL_INSTANCE_COMMENTS)
                comment = p.AsString() if p else None
            except:
                comment = None
            is_ours = False
            try:
                if e.ApplicationId == APP_ID:
                    is_ours = True
            except:
                pass
            if not is_ours and comment and APP_ID in comment:
                is_ours = True
            if not is_ours:
                continue
            if comment and any(tok in comment for tok in tokens):
                ids.Add(e.Id)
    except Exception as ex:
        warnings.append("Cleanup failed: {}".format(ex))
    count = ids.Count
    if count > 0:
        doc.Delete(ids)
    return count


def ensure_export_view(warnings):
    if not CREATE_EXPORT_VIEW:
        return "disabled"
    try:
        view = None
        for v in FilteredElementCollector(doc).OfClass(View3D):
            try:
                if (not v.IsTemplate) and v.Name == EXPORT_VIEW_NAME:
                    view = v
                    break
            except:
                pass
        if view is None:
            vft = None
            for t in FilteredElementCollector(doc).OfClass(ViewFamilyType):
                try:
                    if t.ViewFamily == ViewFamily.ThreeDimensional:
                        vft = t
                        break
                except:
                    pass
            if vft is None:
                warnings.append("Export view: no 3D ViewFamilyType found; skipped.")
                return "no_view_type"
            view = View3D.CreateIsometric(doc, vft.Id)
            try:
                view.Name = EXPORT_VIEW_NAME
            except:
                pass
        # Isolate to ONLY the generated assembly: hide every model category except Generic Model,
        # so the base ceiling (and walls/etc.) are absent when you export FROM this view.
        try:
            gm_id = ElementId(BuiltInCategory.OST_GenericModel)
            for cat in doc.Settings.Categories:
                try:
                    if cat.CategoryType != CategoryType.Model or cat.Id == gm_id:
                        continue
                    if view.CanCategoryBeHidden(cat.Id):
                        view.SetCategoryHidden(cat.Id, True)
                except:
                    pass
        except Exception as ex:
            warnings.append("Export view isolation partial: {}".format(ex))
        return EXPORT_VIEW_NAME
    except Exception as ex:
        warnings.append("Export view creation failed: {}".format(ex))
        return "failed"


# ------------------------------------------------------------
# Layout helpers
# ------------------------------------------------------------

def layer_stack(rated):
    if rated:
        return [(DRYWALL_THICKNESS_RATED_FT, True)] * DRYWALL_LAYERS_RATED
    return [(DRYWALL_THICKNESS_STD_FT, False)] * DRYWALL_LAYERS_STD


def furring_profile():
    """Hat/furring channel: closed face at q=0 (drywall side), legs rising to FURRING_HEIGHT."""
    D = FURRING_FACE_FT
    H = FURRING_HEIGHT_FT
    t = MAT_T_FT
    return [(0, 0), (0, H), (t, H), (t, t), (D - t, t), (D - t, H), (D, H), (D, 0)]


def channel_profile(depth, face):
    """Generic open channel (used for the carrying/main channel): back at q=0, legs up to 'depth',
    width 'face'. p across the run, q up."""
    D = face
    H = depth
    t = MAT_T_FT
    return [(0, 0), (0, H), (t, H), (t, t), (D - t, t), (D - t, H), (D, H), (D, 0)]


def splice_segments(lo, hi, stock, lap, stagger):
    """Break a channel run [lo, hi] into stock-length pieces that overlap (nest) by 'lap' at each
    splice - real channels ship in stock lengths and are lapped end-to-end, not one long piece.
    'stagger' shifts the first splice so joints don't line up across adjacent channels. Returns
    overlapping [(a, b), ...] left-to-right (each piece <= stock; interior pieces overlap by lap)."""
    total = hi - lo
    if not SPLICE_CHANNELS or total <= stock + 1e-6:
        return [(lo, hi)]
    step = max(stock - lap, MIN_SEG_FT)
    first = stock - (stagger % step)          # shorten the first piece by the stagger phase
    if first < lap + MIN_SEG_FT:
        first = stock
    segs = []
    a = lo
    b = min(lo + first, hi)
    segs.append((a, b))
    while b < hi - 1e-6:
        a = b - lap                            # next piece laps back over the previous by 'lap'
        b = min(a + stock, hi)
        if b - a < MIN_SEG_FT:
            break
        segs.append((a, b))
    return segs


def normalize_shift(shift, period):
    s = float(shift)
    while s < 0.0:
        s += period
    while s >= period:
        s -= period
    return s


def build_boundary_solid(outer, holes, fixtures, z_lo, tall):
    """Extrude the ceiling outline (outer minus holes minus fixture cutters) into a tall clip mask
    spanning z_lo .. z_lo+tall, used to boolean-clip boards and furring to the room shape."""
    origin = XYZ(0.0, 0.0, z_lo)
    u = XYZ.BasisX
    v = XYZ.BasisY
    up = XYZ.BasisZ
    solid = make_planar_poly_solid(origin, u, v, up, outer, tall)
    if solid is None:
        return None
    for h in holes:
        hs = make_planar_poly_solid(XYZ(0.0, 0.0, z_lo - HOLE_MARGIN_FT), u, v, up, h, tall + 2 * HOLE_MARGIN_FT)
        solid = boolean_op(solid, hs, BooleanOperationsType.Difference)
    for fx in fixtures:
        fs = make_rect_solid(XYZ(0.0, 0.0, z_lo - HOLE_MARGIN_FT), u, v, up, fx, tall + 2 * HOLE_MARGIN_FT)
        solid = boolean_op(solid, fs, BooleanOperationsType.Difference)
    return solid


def collect_room_regions(warnings):
    """Every placed, bounded Room in the model as an independent ceiling region:
    (room_id, number, level_eid, outer_poly, inner_polys, bbox). Boundaries come from
    Room.GetBoundarySegments at FINISH faces, so a room polygon stops at the wall surface and is
    continuous across doorways (segments follow the room-bounding walls / room separation lines).
    Unenclosed or degenerate rooms are skipped with a warning instead of corrupting the run."""
    regions = []
    try:
        col = list(FilteredElementCollector(doc).OfCategory(BuiltInCategory.OST_Rooms)
                   .WhereElementIsNotElementType())
    except Exception as ex:
        warnings.append("Room collection failed: {}".format(ex))
        return regions
    opts = SpatialElementBoundaryOptions()
    try:
        opts.SpatialElementBoundaryLocation = SpatialElementBoundaryLocation.Finish
    except Exception:
        pass
    for r in col:
        rid = "R" + str(eid_value(r.Id))
        try:
            area = r.Area
        except Exception:
            area = 0.0
        if not area or area < MIN_ROOM_AREA_SF:
            warnings.append("Room {} skipped: not enclosed / zero area".format(rid))
            continue
        try:
            loops = r.GetBoundarySegments(opts)
        except Exception as ex:
            warnings.append("Room {}: GetBoundarySegments failed ({})".format(rid, ex))
            continue
        polys = []
        for loop in (loops or []):
            pts = []
            for seg in loop:
                try:
                    for p in seg.GetCurve().Tessellate():
                        if not pts or abs(pts[-1][0] - p.X) > 1e-6 or abs(pts[-1][1] - p.Y) > 1e-6:
                            pts.append((p.X, p.Y))
                except Exception:
                    continue
            if len(pts) >= 3 and abs(pts[0][0] - pts[-1][0]) < 1e-6 and abs(pts[0][1] - pts[-1][1]) < 1e-6:
                pts = pts[:-1]
            if len(pts) >= 3:
                polys.append(pts)
        if not polys:
            warnings.append("Room {} skipped: no usable boundary polygon".format(rid))
            continue
        polys.sort(key=poly_area, reverse=True)     # largest loop = the room outline, rest = holes
        num = ""
        try:
            num = r.Number
        except Exception:
            pass
        lev = -1
        try:
            lev = eid_value(r.LevelId)
        except Exception:
            pass
        regions.append((rid, num, lev, polys[0], polys[1:], poly_bbox(polys[0])))
    return regions

def collect_column_beam_footprints(warnings):
    """Plan-view (x0, y0, x1, y1, z0, z1) footprint of every column and beam in the model, for
    punching a hole in the ceiling clip mask at each one (same mechanism as hosted fixtures) so
    no ceiling/soffit board runs through a column or beam. Z-range kept so a footprint only
    cuts a ceiling it actually spans past (e.g. a beam under a lower ceiling doesn't cut one
    on a floor above)."""
    rects = []
    cats = []
    if CUT_AT_COLUMNS:
        cats += [BuiltInCategory.OST_Columns, BuiltInCategory.OST_StructuralColumns]
    if CUT_AT_BEAMS:
        cats += [BuiltInCategory.OST_StructuralFraming]
    c = COLUMN_BEAM_CLEARANCE_FT
    for bic in cats:
        try:
            for e in FilteredElementCollector(doc).OfCategory(bic).WhereElementIsNotElementType():
                try:
                    bb = e.get_BoundingBox(None)
                except Exception:
                    bb = None
                if bb is None:
                    continue
                x0, y0, x1, y1 = bb.Min.X - c, bb.Min.Y - c, bb.Max.X + c, bb.Max.Y + c
                if (x1 - x0) > 0.1 and (y1 - y0) > 0.1:
                    rects.append((x0, y0, x1, y1, bb.Min.Z, bb.Max.Z))
        except Exception as ex:
            warnings.append("Column/beam footprint scan failed ({}): {}".format(bic, ex))
    return rects


def collect_wall_plans(warnings):
    """Plan footprint of every straight wall in the model, for clipping the ceiling drywall at
    walls: returns a list of (poly4, bbox, axis, f_lo, f_hi) where axis is 'x' when the wall runs
    along Y (its two faces are the X lines f_lo/f_hi), 'y' when it runs along X, or None for an
    oblique wall (clip-only - no forced board joints)."""
    plans = []
    try:
        wcol = FilteredElementCollector(doc).OfClass(Wall).WhereElementIsNotElementType()
    except Exception as ex:
        warnings.append("Wall collection for ceiling clipping failed: {}".format(ex))
        return plans
    for w in wcol:
        try:
            loc = w.Location
            crv = loc.Curve if isinstance(loc, LocationCurve) else None
            if not isinstance(crv, Line):
                continue
            p0 = crv.GetEndPoint(0)
            p1 = crv.GetEndPoint(1)
            dx = p1.X - p0.X
            dy = p1.Y - p0.Y
            ln = math.sqrt(dx * dx + dy * dy)
            if ln < 1e-6:
                continue
            ux = dx / ln
            uy = dy / ln
            hw = w.Width / 2.0
            nx = -uy
            ny = ux
            # A footprint from the LOCATION LINE assumes the line is the wall CENTERLINE - false
            # when the wall's Location Line is set to a face (the subtraction then misses half
            # the wall and ceiling boards penetrate it). For axis-aligned walls use the element's
            # model bbox instead: exact faces regardless of location-line setting or joins.
            poly = None
            axis, f_lo, f_hi = None, 0.0, 0.0
            if abs(ux) < 0.02 or abs(uy) < 0.02:
                try:
                    bb = w.get_BoundingBox(None)
                except Exception:
                    bb = None
                if bb is not None:
                    x0, y0, x1, y1 = bb.Min.X, bb.Min.Y, bb.Max.X, bb.Max.Y
                    poly = [(x0, y0), (x1, y0), (x1, y1), (x0, y1)]
                    if abs(ux) < 0.02:          # wall runs along Y -> faces are X lines
                        axis, f_lo, f_hi = "x", x0, x1
                    else:                       # wall runs along X -> faces are Y lines
                        axis, f_lo, f_hi = "y", y0, y1
            if poly is None:                    # oblique wall, or bbox unavailable
                poly = [(p0.X + nx * hw, p0.Y + ny * hw), (p1.X + nx * hw, p1.Y + ny * hw),
                        (p1.X - nx * hw, p1.Y - ny * hw), (p0.X - nx * hw, p0.Y - ny * hw)]
                if abs(ux) < 0.02:
                    axis, f_lo, f_hi = "x", p0.X - hw, p0.X + hw
                elif abs(uy) < 0.02:
                    axis, f_lo, f_hi = "y", p0.Y - hw, p0.Y + hw
            plans.append((poly, poly_bbox(poly), axis, f_lo, f_hi))
        except Exception:
            continue
    return plans


def board_fully_inside(rect, outer, holes, fixtures):
    """True if the board rect is safely inside the outer polygon and clear of every hole/fixture,
    so it can be emitted whole (and tapered) with no boolean clip. Corner test + overlap test;
    a concave outer edge cutting through an all-corners-inside rect is a rare unhandled case."""
    x0, y0, x1, y1 = rect
    for (cx, cy) in [(x0, y0), (x1, y0), (x1, y1), (x0, y1)]:
        if not point_in_polygon(cx, cy, outer):
            return False
    for h in holes:
        if rects_overlap(rect, poly_bbox(h)):
            return False
    for fx in fixtures:
        if rects_overlap(rect, fx):
            return False
    return True


# ------------------------------------------------------------
# Emit
# ------------------------------------------------------------

def ds_comment(ceiling_id, kind, eid):
    return "{} | CEILING={} | {} | {}".format(APP_ID, ceiling_id, kind, eid)


def emit_furring(ceiling_id, host_tag, st_counter, z_top, boundary_solid, xlo, xhi, ylo, yhi,
                 warnings, frecords, room_id=None):
    """Furring hat-channels @16" OC running along X, just above the drywall (bottom face at z_top).
    Long lines are spliced into stock-length pieces that lap at each joint (splice_segments), with
    the splices staggered row-to-row. Each piece is clipped to the ceiling outline and named
    ST-<host>-<n> (flat per-ceiling framing sequence). Returns (pieces_made, splice_joints)."""
    if not GENERATE_FURRING:
        return 0, 0
    mat, gs = styles.get("FURRING", (None, None))
    prof = furring_profile()
    made = 0
    splices = 0
    fi = 0
    y = ylo
    while y <= yhi + 1e-6:
        if (xhi - xlo) >= MIN_SEG_FT:
            # A long furring line ships as stock-length pieces lapped at each splice; stagger the
            # splices row-to-row so joints don't line up. cross-section (p across Y, q up Z),
            # centered on the furring line y; extrude along X.
            segs = splice_segments(xlo, xhi, FURRING_STOCK_LENGTH_FT, FURRING_SPLICE_LAP_FT,
                                   fi * SPLICE_STAGGER_FT)
            if len(segs) > 1:
                splices += len(segs) - 1
            for si, (ax, bx) in enumerate(segs):
                seg_len = bx - ax
                if seg_len < MIN_SEG_FT:
                    continue
                dz = MAT_T_FT if (SPLICE_NEST_OFFSET and si % 2 == 1) else 0.0   # nested-lap look
                origin = XYZ(ax, y - FURRING_FACE_FT / 2.0, z_top + dz)
                raw = make_profile_solid(origin, XYZ.BasisY, XYZ.BasisZ, prof, XYZ.BasisX, seg_len, mat, gs)
                clipped = boolean_op(raw, boundary_solid, BooleanOperationsType.Intersect)
                if not solid_ok(clipped):
                    continue
                name = "ST-{}-{:03d}".format(host_tag, st_counter[0] + 1)
                ds = create_directshape(clipped, name, name,
                                        ds_comment(ceiling_id, "FURRING", name), warnings)
                if ds:
                    st_counter[0] += 1
                    made += 1
                    try:
                        fbb = clipped.GetBoundingBox()
                        fmn = fbb.Transform.OfPoint(fbb.Min)
                        fmx = fbb.Transform.OfPoint(fbb.Max)
                        fbox = [round(fmn.X, 3), round(fmn.Y, 3), round(fmx.X, 3), round(fmx.Y, 3)]
                    except Exception:
                        fbox = None
                    frecords.append({
                        "id": name, "ceiling_number": host_tag, "host_ceiling": ceiling_id,
                        "member_type": "FURRING",
                        "profile": "HAT", "depth_in": round(FURRING_HEIGHT_FT * 12.0, 3),
                        "face_in": round(FURRING_FACE_FT * 12.0, 3),
                        "length_in": round(seg_len * 12.0, 3), "line_y_in": round(y * 12.0, 2),
                        "piece": si + 1, "pieces": len(segs),
                        "bbox_ft": fbox, "room_id": room_id,
                        "install_order": len(frecords) + 1,
                    })
        fi += 1
        y += FURRING_SPACING_FT
    return made, splices


def furring_lines(ylo, yhi):
    ys = []
    y = ylo
    while y <= yhi + 1e-6:
        ys.append(y)
        y += FURRING_SPACING_FT
    return ys


def point_inside_room(px, py, outer, holes, fixtures):
    """True if (px, py) is inside the ceiling outline and clear of holes/fixtures."""
    if not point_in_polygon(px, py, outer):
        return False
    for h in holes:
        if point_in_polygon(px, py, h):
            return False
    for fx in fixtures:
        if fx[0] < px < fx[2] and fx[1] < py < fx[3]:
            return False
    return True


def emit_mains(ceiling_id, host_tag, st_counter, z_top, boundary_solid, outer, holes, fixtures,
               xlo, xhi, ylo, yhi, warnings, frecords, room_id=None):
    """Reinforcement for long spans: when the furring run (xhi-xlo) exceeds MAX_FURRING_SPAN_FT, the
    furring can't carry the gypsum without sagging, so add MAIN carrying channels perpendicular to
    the furring at MAIN_SPACING_FT (sitting just above the furring), each hung from the structure by
    HANGER wires at HANGER_SPACING_FT. Furring then spans <= MAX_FURRING_SPAN_FT between mains. Mains
    are clipped to the ceiling outline; hangers are placed only where they land inside the room.
    Mains ship in stock lengths too, so long ones are spliced (lapped) and staggered between mains.
    Named ST-<host>-<n> (shared framing sequence). Returns (mains_made, hangers_made, splice_joints)."""
    if not GENERATE_MAINS or (xhi - xlo) <= MAX_FURRING_SPAN_FT + 1e-6:
        return 0, 0, 0
    mat, gs = styles.get("MAIN", (None, None))
    hmat, hgs = styles.get("HANGER", (None, None))
    prof = channel_profile(MAIN_DEPTH_FT, MAIN_FACE_FT)
    z_main = z_top + FURRING_HEIGHT_FT          # mains sit on top of the furring
    z_hang = z_main + MAIN_DEPTH_FT             # hanger wires rise from the top of the main
    mains = 0
    hangers = 0
    splices = 0

    # Interior main x-positions every MAIN_SPACING; the furring is also supported at the two ends
    # (perimeter), so only interior supports are needed.
    mx = xlo + MAIN_SPACING_FT
    mi = 0
    while mx < xhi - 1e-6:
        if (yhi - ylo) >= MIN_SEG_FT:
            # A long carrying channel also ships in stock lengths, lapped at each splice; stagger
            # the splices between adjacent mains.
            segs = splice_segments(ylo, yhi, MAIN_STOCK_LENGTH_FT, MAIN_SPLICE_LAP_FT,
                                   mi * SPLICE_STAGGER_FT)
            if len(segs) > 1:
                splices += len(segs) - 1
            made_here = False
            for si, (ay, by) in enumerate(segs):
                seg_len = by - ay
                if seg_len < MIN_SEG_FT:
                    continue
                dz = MAT_T_FT if (SPLICE_NEST_OFFSET and si % 2 == 1) else 0.0
                origin = XYZ(mx - MAIN_FACE_FT / 2.0, ay, z_main + dz)
                raw = make_profile_solid(origin, XYZ.BasisX, XYZ.BasisZ, prof, XYZ.BasisY, seg_len, mat, gs)
                clipped = boolean_op(raw, boundary_solid, BooleanOperationsType.Intersect)
                if not solid_ok(clipped):
                    continue
                name = "ST-{}-{:03d}".format(host_tag, st_counter[0] + 1)
                ds = create_directshape(clipped, name, name,
                                        ds_comment(ceiling_id, "MAIN", name), warnings)
                if ds:
                    st_counter[0] += 1
                    mains += 1
                    made_here = True
                    try:
                        mbb = clipped.GetBoundingBox()
                        mmn = mbb.Transform.OfPoint(mbb.Min)
                        mmx = mbb.Transform.OfPoint(mbb.Max)
                        mbox = [round(mmn.X, 3), round(mmn.Y, 3), round(mmx.X, 3), round(mmx.Y, 3)]
                    except Exception:
                        mbox = None
                    frecords.append({
                        "id": name, "ceiling_number": host_tag, "host_ceiling": ceiling_id,
                        "member_type": "MAIN", "profile": "CRC",
                        "depth_in": round(MAIN_DEPTH_FT * 12.0, 3),
                        "face_in": round(MAIN_FACE_FT * 12.0, 3),
                        "length_in": round(seg_len * 12.0, 3), "line_x_in": round(mx * 12.0, 2),
                        "piece": si + 1, "pieces": len(segs),
                        "bbox_ft": mbox, "room_id": room_id,
                        "install_order": len(frecords) + 1,
                    })
            # Hanger wires along this main line - only when there is a deck above to anchor into
            # (GENERATE_HANGERS). Within 6" of ends, then every HANGER_SPACING.
            if made_here and GENERATE_HANGERS:
                hpos = [ylo + END_SUPPORT_SETBACK_FT]
                yy = ylo + END_SUPPORT_SETBACK_FT + HANGER_SPACING_FT
                while yy < yhi - END_SUPPORT_SETBACK_FT + 1e-6:
                    hpos.append(yy)
                    yy += HANGER_SPACING_FT
                hpos.append(yhi - END_SUPPORT_SETBACK_FT)
                half = HANGER_DIA_FT / 2.0
                for hy in unique_sorted(hpos):
                    if not point_inside_room(mx, hy, outer, holes, fixtures):
                        continue
                    hrect = (mx - half, hy - half, mx + half, hy + half)
                    hs = make_rect_solid(XYZ(0.0, 0.0, z_hang), XYZ.BasisX, XYZ.BasisY,
                                         XYZ.BasisZ, hrect, HANGER_DROP_FT, hmat, hgs)
                    if not solid_ok(hs):
                        continue
                    hname = "ST-{}-{:03d}".format(host_tag, st_counter[0] + 1)
                    hds = create_directshape(hs, hname, hname,
                                             ds_comment(ceiling_id, "HANGER", hname), warnings)
                    if hds:
                        st_counter[0] += 1
                        hangers += 1
                        frecords.append({
                            "id": hname, "ceiling_number": host_tag, "host_ceiling": ceiling_id,
                            "member_type": "HANGER", "gauge": "#12", "room_id": room_id,
                            "x_in": round(mx * 12.0, 2), "y_in": round(hy * 12.0, 2),
                            "drop_in": round(HANGER_DROP_FT * 12.0, 2),
                            "install_order": len(frecords) + 1,
                        })
        mx += MAIN_SPACING_FT
        mi += 1
    return mains, hangers, splices


def emit_drywall(ceiling_id, host_tag, z_bottom, outer, holes, fixtures, boundary_solid, rated,
                 records, screw_records, do_screws, warnings,
                 wall_x_cuts=(), wall_y_cuts=(), wall_bboxes=(),
                 room_id=None, board_seq=None, screw_seq=None, force_clip=False):
    """Single-face gypsum on the underside: staggered board grid in world X-Y, clipped to the
    ceiling outline. Boards are hung with their bottom face flush at z_bottom, thickness upward.
    Layer 0 is the room-facing layer. Boards are named DP-<host>-<n> (single face -> no letter);
    screws SC-<host>-<n> (flat per-ceiling). Returns a counts dict."""
    counts = {"boards": 0, "cut_boards": 0, "layers": 0, "screws": 0}
    if board_seq is None:
        board_seq = [0]    # per-ceiling board counter -> DP-<host>-<n>
    if screw_seq is None:
        screw_seq = [0]    # flat per-ceiling screw counter -> SC-<host>-<n>
    bx0, by0, bx1, by1 = poly_bbox(outer)
    layers = layer_stack(rated)
    u = XYZ.BasisX
    v = XYZ.BasisY
    up = XYZ.BasisZ
    down = XYZ(0, 0, -1)
    fur_ys = furring_lines(by0, by1)

    cum_below = 0.0     # thickness already placed BELOW (closer to room) - layer 0 is room-facing
    for li, (t, type_x) in enumerate(layers):
        counts["layers"] += 1
        # Layer 0 bottom flush at z_bottom; each further layer sits above the previous.
        z0 = z_bottom + cum_below
        origin_z = XYZ(0.0, 0.0, z0)
        kind = "GWB" if li == 0 else "GWB2"
        base_shift = li * LAYER_H_STAGGER_FT
        v_off = li * LAYER_V_STAGGER_FT

        # courses step in Y by PANEL_WIDTH, offset by v_off for layer staggering
        ystart = by0 + v_off
        while ystart > by0:
            ystart -= PANEL_WIDTH_FT
        row = 0
        cy = ystart
        while cy < by1 - 1e-4:
            cy0 = max(by0, cy)
            cy1 = min(by1, cy + PANEL_WIDTH_FT)
            cy += PANEL_WIDTH_FT
            row += 1
            if (cy1 - cy0) < MIN_PIECE_HEIGHT_FT:
                continue
            full_course = abs((cy1 - cy0) - PANEL_WIDTH_FT) < 0.02
            if MAXIMIZE_WHOLE_PANELS:
                row_shift = 0.0
            else:
                row_shift = normalize_shift(base_shift + (ODD_ROW_SHIFT_FT if row % 2 == 1 else 0.0),
                                            PANEL_LENGTH_FT)
            x = bx0 - row_shift
            col = 0
            while x < bx1 - 1e-4:
                rx0 = max(bx0, x)
                rx1 = min(bx1, x + PANEL_LENGTH_FT)
                x += PANEL_LENGTH_FT
                col += 1
                # Split this cell ONLY where a wall truly severs it: a face line splits a piece
                # just when that wall's run fully covers the piece on the other axis; where a
                # wall ENDS inside a piece, the piece first splits at the wall's END line so the
                # part beyond the stub stays whole. This keeps exactly ONE pair of face lines
                # (the track-width gap) along real wall runs - no doubled joints elsewhere.
                pieces = []
                stack = [(rx0, cy0, rx1, cy1)]
                guard = 0
                while stack and guard < 256:
                    guard += 1
                    (px0, py0, px1, py1) = stack.pop()
                    did = False
                    for (c, w0, w1) in wall_x_cuts:
                        if not (px0 + 1e-6 < c < px1 - 1e-6):
                            continue
                        if w0 > py1 - 1e-6 or w1 < py0 + 1e-6:
                            continue                        # wall nowhere in this piece's y-range
                        if w0 > py0 + 1e-6:                 # wall STARTS inside: split at its end line
                            stack.append((px0, py0, px1, w0))
                            stack.append((px0, w0, px1, py1))
                        elif w1 < py1 - 1e-6:               # wall ENDS inside: split at its end line
                            stack.append((px0, py0, px1, w1))
                            stack.append((px0, w1, px1, py1))
                        else:                               # wall severs the piece: split at the face
                            stack.append((px0, py0, c, py1))
                            stack.append((c, py0, px1, py1))
                        did = True
                        break
                    if did:
                        continue
                    for (c, w0, w1) in wall_y_cuts:
                        if not (py0 + 1e-6 < c < py1 - 1e-6):
                            continue
                        if w0 > px1 - 1e-6 or w1 < px0 + 1e-6:
                            continue
                        if w0 > px0 + 1e-6:
                            stack.append((px0, py0, w0, py1))
                            stack.append((w0, py0, px1, py1))
                        elif w1 < px1 - 1e-6:
                            stack.append((px0, py0, w1, py1))
                            stack.append((w1, py0, px1, py1))
                        else:
                            stack.append((px0, py0, px1, c))
                            stack.append((px0, c, px1, py1))
                        did = True
                        break
                    if not did:
                        pieces.append((px0, py0, px1, py1))
                # A wall that only touches this cell's boundary edge (without truly crossing into
                # it) can still inject a spurious internal seam above - fuse any resulting
                # confetti-sized piece into a same-range neighbor before emitting.
                pieces = merge_small_pieces(pieces, MIN_SAFE_SEGMENT_FT)
                for (px0, py0, px1, py1) in pieces:
                    g = CODE_GAP_FT / 2.0
                    sx0 = px0 + g
                    sx1 = px1 - g
                    sy0 = py0 + g
                    sy1 = py1 - g
                    if (sx1 - sx0) < MIN_PIECE_WIDTH_FT or (sy1 - sy0) < MIN_PIECE_HEIGHT_FT:
                        continue
                    rect = (sx0, sy0, sx1, sy1)
                    if not rects_overlap(rect, (bx0, by0, bx1, by1)):
                        continue

                    mat, gs = styles.get(kind, (None, None))
                    # force_clip: the caller's outer is only a bbox approximation of the region
                    # (fallback zones), so every board must take the boolean path against the mask
                    whole = (not force_clip) and board_fully_inside(rect, outer, holes, fixtures)
                    if whole:
                        for wb in wall_bboxes:          # near/over a wall -> take the boolean path so
                            if rects_overlap(rect, wb):  # the wall subtraction in the mask trims it
                                whole = False
                                break
                    is_full_size = (abs((sx1 - sx0) - (PANEL_LENGTH_FT - CODE_GAP_FT)) < 0.02 and
                                    abs((sy1 - sy0) - (PANEL_WIDTH_FT - CODE_GAP_FT)) < 0.02)
                    # Taper is WIDTH-gated (the rule: "if any part of the board is in a full 4-ft course,
                    # its top/bottom horizontal edges are factory-tapered"). ANY board in a full 4-ft
                    # course tapers - including a boundary-clipped one (the tapered rect is clipped to the
                    # outline, so the surviving factory edges keep the taper). Only ripped (<4 ft width)
                    # courses are square.
                    board_tapered = TAPERED_LONG_EDGES and full_course

                    if whole:
                        if board_tapered:
                            solid = make_tapered_board_solid(origin_z, u, v, up, rect, t, mat, gs)
                        else:
                            solid = make_rect_solid(origin_z, u, v, up, rect, t, mat, gs)
                        is_cut = not is_full_size
                    else:
                        if board_tapered:
                            raw = make_tapered_board_solid(origin_z, u, v, up, rect, t, mat, gs)
                        else:
                            raw = make_rect_solid(origin_z, u, v, up, rect, t, mat, gs)
                        solid = boolean_op(raw, boundary_solid, BooleanOperationsType.Intersect)
                        is_cut = True

                    if not solid_ok(solid):        # None, or clipped away to nothing (board outside)
                        continue
                    board_id = "DP-{}-{:03d}".format(host_tag, board_seq[0] + 1)
                    comment = "{} | CEILING={} | {} | DRYWALL | {} | L{} | t={}in | typeX={} | cut={} | taper={}".format(
                        APP_ID, ceiling_id, "-", board_id, li, round(t * 12.0, 3),
                        int(bool(type_x)), int(bool(is_cut)), int(bool(board_tapered)))
                    ds = create_directshape(solid, board_id, board_id, comment, warnings)
                    if not ds:
                        continue
                    board_seq[0] += 1
                    counts["boards"] += 1
                    if is_cut:
                        counts["cut_boards"] += 1
                    try:
                        sbb = solid.GetBoundingBox()
                        smn = sbb.Transform.OfPoint(sbb.Min)
                        smx = sbb.Transform.OfPoint(sbb.Max)
                        sbox = [round(smn.X, 3), round(smn.Y, 3), round(smx.X, 3), round(smx.Y, 3)]
                    except Exception:
                        sbox = None
                    records.append({
                        "board_id": board_id, "ceiling_number": host_tag, "host_ceiling": ceiling_id,
                        "layer": li, "type_x": bool(type_x), "thickness_in": round(t * 12.0, 3),
                        "is_cut": bool(is_cut), "tapered": bool(board_tapered),
                        "bbox_ft": sbox, "room_id": room_id,
                        "install_order": len(records) + 1,
                    })

                    # Screws: on the room-facing (bottom) surface of layer 0, along furring lines. Per
                    # USG/GA, set back >= 3/8" from board edges/ends. A furring line on the board's
                    # Y-edge carries the tapered long-edge joint: offset the screw INTO the board
                    # (staying within the ~2.5" furring face so it still bites steel), so it sits beside
                    # the joint - never on it - and the neighbor board straddles from its side.
                    if do_screws and (li == 0 or not SCREWS_OUTER_LAYER_ONLY):
                        smat, sgs = styles.get("SCREW", (None, None))
                        half = SCREW_MARKER_SIZE_FT / 2.0
                        sb = SCREW_EDGE_SETBACK_FT
                        tol = SCREW_EDGE_TOL_FT
                        for fy in fur_ys:
                            if fy < sy0 - tol or fy > sy1 + tol:
                                continue
                            if abs(fy - sy0) <= tol:
                                coly = sy0 + sb
                            elif abs(fy - sy1) <= tol:
                                coly = sy1 - sb
                            else:
                                coly = fy
                            if coly <= sy0 + 1e-3 or coly >= sy1 - 1e-3:
                                continue
                            sxp = sx0 + sb
                            xend = sx1 - sb
                            cand = []
                            if xend < sxp:
                                cand.append((sx0 + sx1) / 2.0)
                            else:
                                vx = sxp
                                while vx <= xend + 1e-6:
                                    cand.append(vx)
                                    vx += SCREW_SPACING_FT
                                if not cand or abs(cand[-1] - xend) > 1e-3:
                                    cand.append(xend)
                            for sxx in cand:
                                if counts["screws"] >= MAX_SCREWS_PER_CEILING:
                                    break
                                inside_fx = False
                                for fx in fixtures:
                                    if fx[0] - 0.01 < sxx < fx[2] + 0.01 and fx[1] - 0.01 < coly < fx[3] + 0.01:
                                        inside_fx = True
                                        break
                                if inside_fx:
                                    continue
                                # marker sits at the bottom face (z0), protruding down by proud, most
                                # of its depth embedded upward into the board.
                                sz = z0 - SCREW_HEAD_PROUD_FT
                                sorigin = XYZ(0.0, 0.0, sz)
                                srect = (sxx - half, coly - half, sxx + half, coly + half)
                                ssolid = make_rect_solid(sorigin, u, v, up, srect, SCREW_MARKER_DEPTH_FT, smat, sgs)
                                if ssolid is None:
                                    continue
                                sid = "SC-{}-{:03d}".format(host_tag, screw_seq[0] + 1)
                                sds = create_directshape(ssolid, sid, sid,
                                                         ds_comment(ceiling_id, "SCREW", sid), warnings)
                                if sds:
                                    screw_seq[0] += 1
                                    counts["screws"] += 1
                                    screw_records.append({
                                        "screw_id": sid, "board_id": board_id, "room_id": room_id,
                                        "ceiling_number": host_tag, "host_ceiling": ceiling_id,
                                        "x_in": round(sxx * 12.0, 2), "y_in": round(coly * 12.0, 2),
                                        "world_x": round(sxx, 4), "world_y": round(coly, 4),
                                        "world_z": round(z0, 4),
                                        "spacing_in": round(SCREW_SPACING_FT * 12.0, 2),
                                        "length_in": round(t * 12.0 + 0.625, 3),
                                    })
        cum_below += t
    return counts


def simplify_rectilinear(poly, tol=0.02):
    """Drop collinear/duplicate vertices from a tessellated rectilinear outline."""
    pts = []
    n = len(poly)
    for i in range(n):
        ax, ay = poly[i - 1]
        bx, by = poly[i]
        cx, cy = poly[(i + 1) % n]
        cross = (bx - ax) * (cy - ay) - (by - ay) * (cx - ax)
        if abs(cross) > tol:
            pts.append((bx, by))
    return pts


def soffit_board_rects(outer, warnings, tag):
    """Exactly TWO board rectangles covering a soffit run: an L-shaped outline (6 rectilinear
    corners) splits at its inner corner - one board per leg, butt joint between them; a straight
    rectangle splits at mid-run. Anything else falls back to bbox halves with a warning (the
    mask still clips the boards to the true shape)."""
    bx0, by0, bx1, by1 = poly_bbox(outer)
    pts = simplify_rectilinear(outer)
    if len(pts) == 6:
        reflex = None
        for (px, py) in pts:
            if bx0 + 0.05 < px < bx1 - 0.05 and by0 + 0.05 < py < by1 - 0.05:
                reflex = (px, py)
                break
        missing = None
        eps = 0.05
        for (qx, qy) in [(bx0, by0), (bx1, by0), (bx1, by1), (bx0, by1)]:
            tx = qx + (eps if qx == bx0 else -eps)
            ty = qy + (eps if qy == by0 else -eps)
            if not point_in_polygon(tx, ty, outer):
                missing = (qx, qy)
                break
        if reflex is not None and missing is not None:
            cx, cy = reflex
            mx, my = missing
            if mx == bx1 and my == by1:        # notch top-right
                return [(bx0, by0, cx, by1), (cx, by0, bx1, cy)]
            if mx == bx1 and my == by0:        # notch bottom-right
                return [(bx0, by0, cx, by1), (cx, cy, bx1, by1)]
            if mx == bx0 and my == by1:        # notch top-left
                return [(cx, by0, bx1, by1), (bx0, by0, cx, cy)]
            if mx == bx0 and my == by0:        # notch bottom-left
                return [(cx, by0, bx1, by1), (bx0, cy, cx, by1)]
        warnings.append("Soffit {}: could not resolve the L corner; using bbox halves".format(tag))
    elif len(pts) != 4:
        warnings.append("Soffit {}: outline has {} corners (expected 4 or 6); using bbox halves".format(tag, len(pts)))
    if (bx1 - bx0) >= (by1 - by0):
        xm = (bx0 + bx1) / 2.0
        return [(bx0, by0, xm, by1), (xm, by0, bx1, by1)]
    ym = (by0 + by1) / 2.0
    return [(bx0, by0, bx1, ym), (bx0, ym, bx1, by1)]


def emit_soffit_boards(ceiling_id, host_tag, z_bottom, rects, boundary_solid, rated,
                       records, board_seq, warnings):
    """Emit the soffit's TWO custom-cut boards per layer, boolean-clipped to the wall-subtracted
    mask (a board ends at the wall it spans to - it can never penetrate it). Warns when a board
    leg is longer than SOFFIT_MAX_BOARD_FT, shorter than SOFFIT_MIN_BOARD_FT, or when a layer
    does not come out at exactly two boards."""
    made = 0
    layers = layer_stack(rated)
    u = XYZ.BasisX
    v = XYZ.BasisY
    up = XYZ.BasisZ
    cum_below = 0.0
    for li, (t, type_x) in enumerate(layers):
        z0 = z_bottom + cum_below
        origin_z = XYZ(0.0, 0.0, z0)
        kind = "GWB" if li == 0 else "GWB2"
        mat, gs = styles.get(kind, (None, None))
        made_layer = 0
        for (px0, py0, px1, py1) in rects:
            long_ft = max(px1 - px0, py1 - py0)
            if long_ft > SOFFIT_MAX_BOARD_FT + 1e-6:
                warnings.append("Soffit {}: board leg {:.1f} ft exceeds the {} ft max".format(
                    ceiling_id, long_ft, SOFFIT_MAX_BOARD_FT))
            if long_ft < SOFFIT_MIN_BOARD_FT - 1e-6:
                warnings.append("Soffit {}: board leg {:.1f} ft is under the {} ft min".format(
                    ceiling_id, long_ft, SOFFIT_MIN_BOARD_FT))
            raw = make_rect_solid(origin_z, u, v, up, (px0, py0, px1, py1), t, mat, gs)
            solid = boolean_op(raw, boundary_solid, BooleanOperationsType.Intersect)
            if not solid_ok(solid):
                continue
            board_id = "DP-{}-{:03d}".format(host_tag, board_seq[0] + 1)
            comment = "{} | CEILING={} | {} | DRYWALL | {} | L{} | t={}in | typeX={} | cut=1 | taper=0".format(
                APP_ID, ceiling_id, "-", board_id, li, round(t * 12.0, 3), int(bool(type_x)))
            ds = create_directshape(solid, board_id, board_id, comment, warnings)
            if not ds:
                continue
            board_seq[0] += 1
            made += 1
            made_layer += 1
            try:
                sbb = solid.GetBoundingBox()
                smn = sbb.Transform.OfPoint(sbb.Min)
                smx = sbb.Transform.OfPoint(sbb.Max)
                sbox = [round(smn.X, 3), round(smn.Y, 3), round(smx.X, 3), round(smx.Y, 3)]
            except Exception:
                sbox = None
            records.append({
                "board_id": board_id, "ceiling_number": host_tag, "host_ceiling": ceiling_id,
                "layer": li, "type_x": bool(type_x), "thickness_in": round(t * 12.0, 3),
                "is_cut": True, "tapered": False,
                "bbox_ft": sbox, "room_id": "SOFFIT",
                "install_order": len(records) + 1,
            })
        if made_layer != 2:
            warnings.append("Soffit {}: layer {} produced {} boards (expected exactly 2)".format(
                ceiling_id, li, made_layer))
        cum_below += t
    return made


# ============================================================
# MAIN
# ============================================================

result = {
    "app_id": APP_ID,
    "output_mode": "directshape",
    "phase": "ceiling_v1_furred",
    "deleted_previous": 0,
    "ceilings_requested": 0,
    "ceilings_processed": 0,
    "ceilings_skipped": [],
    "ceiling_numbers": {},             # {C<eid>: "C001"/"S001"} nomenclature host tag per ceiling
    "rated_ceilings": 0,
    "furring_created": 0,
    "mains_created": 0,                 # carrying channels added where the furring span needs support
    "hangers_created": 0,              # hanger wires holding the mains up
    "reinforced_ceilings": 0,          # ceilings whose span required mains
    "splice_joints": 0,                # lap splices where channels join end-to-end (stock lengths)
    "boards_created": 0,
    "cut_boards": 0,
    "small_boards_merged": 0,          # undersized post-clip boards merged into a neighbor (see below)
    "screws_created": 0,
    "drywall_layers": 0,
    "fixtures_cut": 0,
    "rooms_found": 0,                  # bounded Rooms collected for per-room generation
    "rooms_used": 0,                   # room regions that actually met a processed ceiling
    "soffits_processed": 0,            # ceilings routed through the separate soffit flow
    "board_records": 0,
    "framing_records": 0,
    "screw_records": 0,
    "manifest_path": "",
    "export_view": "",
    "warnings": [],
    "notes": []
}
warnings = result["warnings"]

do_delete = as_bool(get_in(5), DELETE_PREVIOUS)
do_drywall = as_bool(get_in(6), GENERATE_DRYWALL)
do_screws = as_bool(get_in(8), GENERATE_SCREWS)

ceilings = get_input_ceilings(warnings)
result["ceilings_requested"] = len(ceilings)

board_records = []
framing_records = []
screw_records = []
room_records = []

if len(ceilings) == 0:
    OUT = "No ceilings found. Select one or more Revit Ceiling elements, then run Dynamo again."
else:
    TransactionManager.Instance.EnsureInTransaction(doc)
    try:
        processed_ids = set("C" + str(eid_value(c.Id)) for c in ceilings)
        if do_delete:
            result["deleted_previous"] = delete_previous(processed_ids, warnings)
        if COLOR_BY_TYPE:
            styles = setup_styles(warnings)

        # Assign each ceiling its stable nomenclature host tag (C###/S###), persisted to the Mark.
        ceiling_numbers = assign_ceiling_numbers(ceilings, warnings)

        # Wall plan footprints for clipping the ceiling drywall at walls (collected once per run).
        wall_plans = collect_wall_plans(warnings) if CLIP_CEILING_AT_WALLS else []

        # Room boundary polygons for per-room generation (collected once per run).
        room_regions = collect_room_regions(warnings) if CEILING_PER_ROOM else []
        result["rooms_found"] = len(room_regions)

        # Column/beam footprints (collected once per run; filtered per-ceiling by Z-overlap below).
        colbeam_footprints = (collect_column_beam_footprints(warnings)
                              if (CUT_AT_COLUMNS or CUT_AT_BEAMS) else [])

        for ceiling in ceilings:
            cid = "C" + str(eid_value(ceiling.Id))
            host_tag = ceiling_numbers.get(eid_value(ceiling.Id), "C000")
            result["ceiling_numbers"][cid] = host_tag
            is_soffit = SOFFIT_SEPARATE_FLOW and host_tag.startswith("S")
            try:
                loops, z_bottom = get_ceiling_loops(ceiling, warnings)
                if not loops or z_bottom is None:
                    result["ceilings_skipped"].append(cid + ": could not read boundary")
                    continue
                outer = loops[0]
                holes = loops[1:]

                # A soffit only gets the 2-board beam rule when it is actually narrow (its SHORT
                # footprint dimension fits the rule); a wide one is a room-sized ceiling drop and
                # is routed to normal per-zone tiling instead (see SOFFIT_BEAM_MAX_WIDTH_FT).
                is_narrow_soffit = is_soffit
                if is_soffit:
                    _sbx0, _sby0, _sbx1, _sby1 = poly_bbox(outer)
                    _short = min(_sbx1 - _sbx0, _sby1 - _sby0)
                    if _short > SOFFIT_BEAM_MAX_WIDTH_FT:
                        is_narrow_soffit = False
                        warnings.append(
                            "Soffit {}: footprint {:.1f} x {:.1f} ft is too wide for the 2-board "
                            "beam rule (short side > {:.1f} ft) - using standard zone tiling instead".format(
                                cid, _sbx1 - _sbx0, _sby1 - _sby0, SOFFIT_BEAM_MAX_WIDTH_FT))

                rated = ceiling_is_fire_rated(ceiling, warnings)
                if rated:
                    result["rated_ceilings"] += 1
                fixtures = get_fixture_rects(ceiling, warnings)
                result["fixtures_cut"] += len(fixtures)

                layers = layer_stack(rated)
                dw_total = sum(t for (t, _tx) in layers)
                # Clip mask spans from just below the drywall bottom up past the furring AND the main
                # carrying channels (which sit on top of the furring) so the mains aren't clipped.
                tall = dw_total + FURRING_HEIGHT_FT + MAIN_DEPTH_FT + 4.0 * HOLE_MARGIN_FT

                # Punch out every column/beam that actually spans PAST this ceiling's drywall band
                # (z_bottom .. z_bottom+tall) - same "fixture hole" mechanism, so no board/furring
                # runs through a column or beam (user report 2026-07-21).
                cb_z0 = z_bottom - HOLE_MARGIN_FT
                cb_z1 = z_bottom + tall
                for (cx0, cy0, cx1, cy1, cz0, cz1) in colbeam_footprints:
                    if cz1 > cb_z0 and cz0 < cb_z1:
                        fixtures.append((cx0, cy0, cx1, cy1))

                boundary_solid = build_boundary_solid(outer, holes, fixtures,
                                                      z_bottom - HOLE_MARGIN_FT, tall)
                if boundary_solid is None:
                    result["ceilings_skipped"].append(cid + ": boundary solid failed")
                    continue

                # Per-room mode: pick this ceiling's rooms (same level first, any level as a
                # fallback). A ceiling with no overlapping Room (e.g. a soffit) falls back to the
                # legacy whole-grid path below so it still gets generated.
                per_room_regions = None
                if CEILING_PER_ROOM and room_regions and not is_narrow_soffit:
                    obb_c = poly_bbox(outer)
                    clev = -1
                    try:
                        clev = eid_value(ceiling.LevelId)
                    except Exception:
                        pass
                    regions = [rg for rg in room_regions
                               if rg[2] == clev and rects_overlap(rg[5], obb_c)]
                    if not regions:
                        regions = [rg for rg in room_regions if rects_overlap(rg[5], obb_c)]
                        if regions:
                            warnings.append("Ceiling {}: no Rooms on its own level; using {} plan-overlapping room(s) from other levels".format(cid, len(regions)))
                    if regions:
                        per_room_regions = regions
                    else:
                        warnings.append("Ceiling {}: no Room overlaps it - falling back to the legacy whole-grid path".format(cid))

                # Legacy path only: subtract every intersecting wall's footprint from the clip
                # mask and note the wall-face lines so the board grid stops at them.
                wall_x_cuts = []
                wall_y_cuts = []
                wall_bboxes = []
                if per_room_regions is None and CLIP_CEILING_AT_WALLS and wall_plans:
                    obb = poly_bbox(outer)
                    for (wpoly, wbb, waxis, f_lo, f_hi) in wall_plans:
                        if not rects_overlap(wbb, obb):
                            continue
                        cutter = make_planar_poly_solid(XYZ(0.0, 0.0, z_bottom - HOLE_MARGIN_FT),
                                                        XYZ.BasisX, XYZ.BasisY, XYZ.BasisZ,
                                                        wpoly, tall)
                        if cutter is not None:
                            cut = boolean_op(boundary_solid, cutter, BooleanOperationsType.Difference)
                            if solid_ok(cut):
                                boundary_solid = cut
                        wall_bboxes.append(wbb)
                        # keep each cut LOCAL: carry the wall's extent along the other axis so a
                        # face line only cuts the rows/courses that wall actually crosses
                        if waxis == "x":
                            wall_x_cuts.extend([(f_lo, wbb[1], wbb[3]), (f_hi, wbb[1], wbb[3])])
                        elif waxis == "y":
                            wall_y_cuts.extend([(f_lo, wbb[0], wbb[2]), (f_hi, wbb[0], wbb[2])])
                    wall_x_cuts.sort()
                    wall_y_cuts.sort()

                if is_narrow_soffit:
                    # SOFFIT FLOW: exactly TWO custom-cut boards per soffit - one per leg of an
                    # L-shaped run (butt joint at the inner corner) or a mid-run split on a
                    # straight run - clipped against the wall-subtracted mask so they end at the
                    # walls the soffit spans between. No 4x8 grid, no rooms/zones, no mains.
                    result["soffits_processed"] += 1
                    z_top = z_bottom + dw_total
                    st_counter = [0]
                    board_seq = [0]
                    if do_drywall:
                        rects = soffit_board_rects(outer, warnings, cid)
                        made = emit_soffit_boards(cid, host_tag, z_bottom, rects, boundary_solid,
                                                  rated, board_records, board_seq, warnings)
                        result["boards_created"] += made
                        result["cut_boards"] += made
                        result["drywall_layers"] += len(layer_stack(rated))
                    if GENERATE_FURRING:
                        sbx0, sby0, sbx1, sby1 = poly_bbox(outer)
                        f_made, f_spl = emit_furring(
                            cid, host_tag, st_counter, z_top, boundary_solid,
                            sbx0, sbx1, sby0, sby1, warnings, framing_records, room_id="SOFFIT")
                        result["furring_created"] += f_made
                        result["splice_joints"] += f_spl
                elif per_room_regions is not None:
                    # PER-ROOM generation: each room polygon is its own bounded region (the same
                    # role a wall run plays in the wall script). Boards/furring/mains are laid out
                    # on the room's own bbox/grid and cut at the room boundary by the room mask -
                    # nothing exists outside its room, so there is nothing to subtract afterward.
                    z_top = z_bottom + dw_total     # furring bottom sits on top of the drywall
                    st_counter = [0]     # flat per-ceiling framing counter -> ST-<host>-<n>
                    board_seq = [0]      # flat per-ceiling board counter (shared across rooms)
                    screw_seq = [0]
                    covered = 0.0
                    for (rid, rnum, rlev, r_outer, r_inners, rbb) in per_room_regions:
                        room_prism = make_planar_poly_solid(
                            XYZ(0.0, 0.0, z_bottom - HOLE_MARGIN_FT),
                            XYZ.BasisX, XYZ.BasisY, XYZ.BasisZ, r_outer, tall)
                        if room_prism is None:
                            warnings.append("Room {}: boundary prism failed; room skipped".format(rid))
                            continue
                        for ip in r_inners:
                            ips = make_planar_poly_solid(
                                XYZ(0.0, 0.0, z_bottom - 2.0 * HOLE_MARGIN_FT),
                                XYZ.BasisX, XYZ.BasisY, XYZ.BasisZ, ip, tall + 4.0 * HOLE_MARGIN_FT)
                            room_prism = boolean_op(room_prism, ips, BooleanOperationsType.Difference)
                        room_mask = boolean_op(room_prism, boundary_solid,
                                               BooleanOperationsType.Intersect)
                        if not solid_ok(room_mask):
                            continue                # this room does not actually meet this ceiling
                        covered += room_mask.Volume
                        result["rooms_used"] += 1
                        room_records.append({
                            "room_id": rid, "room_number": rnum, "host_ceiling": cid,
                            "outer_ft": [[round(px, 3), round(py, 3)] for (px, py) in r_outer],
                        })
                        rholes = holes + r_inners
                        rbx0, rby0, rbx1, rby1 = rbb
                        if do_drywall:
                            dc = emit_drywall(cid, host_tag, z_bottom, r_outer, rholes, fixtures,
                                              room_mask, rated, board_records, screw_records,
                                              do_screws, warnings, (), (), (),
                                              room_id=rid, board_seq=board_seq, screw_seq=screw_seq)
                            result["boards_created"] += dc["boards"]
                            result["cut_boards"] += dc["cut_boards"]
                            result["drywall_layers"] += dc["layers"]
                            result["screws_created"] += dc["screws"]
                        if GENERATE_FURRING:
                            f_made, f_spl = emit_furring(
                                cid, host_tag, st_counter, z_top, room_mask, rbx0, rbx1, rby0, rby1,
                                warnings, framing_records, room_id=rid)
                            result["furring_created"] += f_made
                            result["splice_joints"] += f_spl
                            m_made, h_made, m_spl = emit_mains(
                                cid, host_tag, st_counter, z_top, room_mask, r_outer, rholes,
                                fixtures, rbx0, rbx1, rby0, rby1, warnings, framing_records,
                                room_id=rid)
                            result["mains_created"] += m_made
                            result["hangers_created"] += h_made
                            result["splice_joints"] += m_spl
                            if m_made > 0:
                                result["reinforced_ceilings"] += 1
                    try:
                        if boundary_solid.Volume > 1e-6 and covered < 0.98 * boundary_solid.Volume:
                            pct = 100.0 * (1.0 - covered / boundary_solid.Volume)
                            warnings.append("Ceiling {}: {:.1f}% of its area is covered by no Room - that area got no boards/furring".format(cid, pct))
                    except Exception:
                        pass
                else:
                    # FALLBACK ZONES: after the wall subtraction the clip mask is a set of
                    # disconnected room-shaped volumes. Split it into those zones and anchor a
                    # fresh full-sheet grid at EACH zone's own corner (same idea as per-room mode
                    # with real Rooms) - maximum whole 4x8 sheets per enclosed area, and no
                    # element can span two zones because each is laid out and clipped separately.
                    vols = [boundary_solid]
                    try:
                        sv = SolidUtils.SplitVolumes(boundary_solid)
                        # SplitVolumes returns an IList<Solid> - under this engine (CPython3) that
                        # marshals to a plain Python list (no .Count), under others it's a .NET
                        # collection (no len()); len(list(...)) works for both without guessing.
                        sv_list = list(sv) if sv is not None else []
                        if len(sv_list) > 0:
                            vols = sv_list
                    except Exception as ex:
                        warnings.append("Ceiling {}: SplitVolumes failed ({}); one zone".format(cid, ex))
                    z_top = z_bottom + dw_total     # furring bottom sits on top of the drywall
                    st_counter = [0]     # flat per-ceiling framing counter -> ST-<host>-<n>
                    board_seq = [0]      # flat per-ceiling board counter (shared across zones)
                    screw_seq = [0]
                    zi = 0
                    for vol in vols:
                        if not solid_ok(vol):
                            continue
                        zi += 1
                        zid = "{}-Z{:02d}".format(cid, zi)
                        try:
                            vbb = vol.GetBoundingBox()
                            vmn = vbb.Transform.OfPoint(vbb.Min)
                            vmx = vbb.Transform.OfPoint(vbb.Max)
                        except Exception:
                            warnings.append("Zone {}: no bbox; skipped".format(zid))
                            continue
                        zx0, zy0, zx1, zy1 = vmn.X, vmn.Y, vmx.X, vmx.Y
                        if (zx1 - zx0) < 0.5 or (zy1 - zy0) < 0.5:
                            warnings.append("Zone {} skipped: sliver {:.2f} x {:.2f} ft (ceiling overhang past a wall?)".format(zid, zx1 - zx0, zy1 - zy0))
                            continue
                        zouter = [(zx0, zy0), (zx1, zy0), (zx1, zy1), (zx0, zy1)]
                        # Per-zone wall cuts: ONLY walls that actually TOUCH this zone may split
                        # its boards - a stub poking into the zone must end the board on both
                        # sides (no panel ever sits on two sides of a wall), while a NEIGHBORING
                        # zone's wall in a bbox-overlap area must not (those false splits were
                        # shredding whole sheets). The exact wall footprint was subtracted from
                        # the mask, so touching is tested with a slightly inflated prism.
                        zx_cuts = []
                        zy_cuts = []
                        for (wpoly, wbb, waxis, f_lo, f_hi) in wall_plans:
                            if not rects_overlap(wbb, (zx0, zy0, zx1, zy1)):
                                continue
                            tol = 0.25
                            grown = [(wbb[0] - tol, wbb[1] - tol), (wbb[2] + tol, wbb[1] - tol),
                                     (wbb[2] + tol, wbb[3] + tol), (wbb[0] - tol, wbb[3] + tol)]
                            gp = make_planar_poly_solid(XYZ(0.0, 0.0, z_bottom - HOLE_MARGIN_FT),
                                                        XYZ.BasisX, XYZ.BasisY, XYZ.BasisZ,
                                                        grown, tall)
                            if gp is None:
                                continue
                            touch = boolean_op(gp, vol, BooleanOperationsType.Intersect)
                            if not solid_ok(touch):
                                continue
                            if waxis == "x":
                                zx_cuts.extend([(f_lo, wbb[1], wbb[3]), (f_hi, wbb[1], wbb[3])])
                            elif waxis == "y":
                                zy_cuts.extend([(f_lo, wbb[0], wbb[2]), (f_hi, wbb[0], wbb[2])])
                        zx_cuts.sort()
                        zy_cuts.sort()
                        if do_drywall:
                            dc = emit_drywall(cid, host_tag, z_bottom, zouter, holes, fixtures,
                                              vol, rated, board_records, screw_records,
                                              do_screws, warnings,
                                              zx_cuts, zy_cuts, (),
                                              room_id=zid, board_seq=board_seq,
                                              screw_seq=screw_seq, force_clip=True)
                            result["boards_created"] += dc["boards"]
                            result["cut_boards"] += dc["cut_boards"]
                            result["drywall_layers"] += dc["layers"]
                            result["screws_created"] += dc["screws"]
                        if GENERATE_FURRING:
                            f_made, f_spl = emit_furring(
                                cid, host_tag, st_counter, z_top, vol, zx0, zx1, zy0, zy1,
                                warnings, framing_records, room_id=zid)
                            result["furring_created"] += f_made
                            result["splice_joints"] += f_spl
                            # Reinforce: carrying channels + hangers when the span needs support.
                            m_made, h_made, m_spl = emit_mains(
                                cid, host_tag, st_counter, z_top, vol, zouter, holes, fixtures,
                                zx0, zx1, zy0, zy1, warnings, framing_records, room_id=zid)
                            result["mains_created"] += m_made
                            result["hangers_created"] += h_made
                            result["splice_joints"] += m_spl
                            if m_made > 0:
                                result["reinforced_ceilings"] += 1

                if do_drywall:
                    small_merged, small_removed, merged_bboxes = merge_undersized_ceiling_boards(cid, warnings)
                    if small_merged:
                        result["boards_created"] -= small_merged
                        result["cut_boards"] -= sum(1 for r in board_records
                                                    if r["board_id"] in small_removed and r.get("is_cut"))
                        for r in board_records:
                            if r["board_id"] in merged_bboxes:
                                r["is_cut"] = True
                                r["bbox_ft"] = merged_bboxes[r["board_id"]]
                        board_records[:] = [r for r in board_records
                                           if r["board_id"] not in small_removed]
                        result["small_boards_merged"] += small_merged

                result["ceilings_processed"] += 1
            except Exception as cex:
                result["ceilings_skipped"].append(cid + ": error - " + str(cex))
                warnings.append("Ceiling {} failed: {}".format(cid, cex))
                continue

        result["export_view"] = ensure_export_view(warnings)
    except Exception as ex:
        result["notes"].append("FATAL: " + str(ex))
    finally:
        TransactionManager.Instance.TransactionTaskDone()

    result["board_records"] = len(board_records)
    result["framing_records"] = len(framing_records)
    result["screw_records"] = len(screw_records)

    if WRITE_MANIFEST:
        manifest = {
            "app_id": APP_ID,
            "schema": "origin_ceiling_assembly_v1",
            "units": "world coords in feet; member/board dims in inches",
            "nomenclature": {
                "host": "C### (ceiling) / S### (soffit), persisted to the ceiling Mark",
                "drywall_panel": "DP-<host>-<seq>  (single underside face; no face letter)",
                "framing_member": "ST-<host>-<seq>  (member_type = FURRING / MAIN / HANGER)",
                "screw": "SC-<host>-<seq>",
            },
            "summary": dict((k, result[k]) for k in (
                "ceilings_processed", "rated_ceilings", "furring_created", "mains_created",
                "hangers_created", "reinforced_ceilings", "splice_joints", "boards_created",
                "screws_created", "fixtures_cut", "rooms_found", "rooms_used",
                "soffits_processed")),
            "rooms": room_records,
            "framing": framing_records,
            "boards": board_records,
            "screws": screw_records,
            "skipped": result.get("ceilings_skipped", []),
            "warnings": warnings,
        }
        try:
            f = open(MANIFEST_PATH, "w")
            try:
                json.dump(manifest, f, indent=2)
            finally:
                f.close()
            result["manifest_path"] = MANIFEST_PATH
        except Exception as ex:
            result["manifest_path"] = "failed"
            warnings.append("Manifest write failed: {}".format(ex))

    OUT = result
# ----------------------------------------
soffits_result = Watch(origin_soffits)
origin_columns = Python()  # CPython3; unwired: IN[0], IN[1]
# ---------- origin_columns.python (394 lines) ----------
# origin_column_assembly_v1.py
# ============================================================
# ORIGIN drywall assembly - COLUMNS v1 (Dynamo Python node, PythonNet3/CPython3)
#
# The COLUMNS plugin (split out of the combined beam+column node, user 2026-07-17): every
# architectural + structural column gets a 4-board vertical box - the two X-face boards wrap
# the corners, the two Y-face boards butt between them - full height, split into <=16 ft
# pieces (min 2 ft warned). Boards sit OUTSIDE the column faces by DRYWALL_T_FT.
#
# Conventions: DirectShapes (Generic Models, visible in the ORIGIN Assembly view); host tag
# K### persisted to the Mark; boards DP-<host>-<seq>; comment "APP_ID | HOST=<eid> | ..." is
# the cleanup key; own manifest with warnings. Self-collecting - no node wiring needed.
# Also purges the legacy combined ORIGIN_BEAMCOL_V1 output (one-time migration).
#
# v1 limits: axis-aligned bbox wrap (angled columns get a loose box); no clipping against
# walls/ceilings at junctions.
# ============================================================

import clr
import json

clr.AddReference('RevitAPI')
clr.AddReference('RevitServices')

from Autodesk.Revit.DB import *
from RevitServices.Persistence import DocumentManager
from RevitServices.Transactions import TransactionManager

doc = DocumentManager.Instance.CurrentDBDocument

APP_ID = "ORIGIN_COLUMN_V1"
LEGACY_APP_IDS = ["ORIGIN_BEAMCOL_V1"]

DELETE_PREVIOUS = True
# Column boards previously got NO material at all (Revit's undifferentiated default appearance),
# unlike every other generated board in the pipeline - the likely cause of a column looking like
# a "plain wall with no drywall" instead of matching the rest of the model (user report
# 2026-07-21). Uses the SAME material/subcategory name as the wall script's drywall boards, so
# Revit reuses the existing one instead of creating a duplicate - column boards now match exactly.
COLOR_BOARDS = True
DRYWALL_STYLE_NAME = "ORIGIN Drywall Base"
DRYWALL_STYLE_RGB = (235, 228, 214)

IN_FT = 1.0 / 12.0
DRYWALL_T_FT = 0.5 * IN_FT
# 16 ft was far larger than a real gypsum sheet (stock is commonly 8 ft, up to 12 ft) - a column
# under 16 ft tall (e.g. the user's 10 ft column) got ONE giant board per face instead of
# realistic stacked panels (user report 2026-07-22: "it should be at least 2 drywall panels").
# 8 ft matches the wall script's own PANEL_LENGTH_FT convention, so any run taller than one
# standard sheet is guaranteed to split into >= 2 stacked panels.
MAX_BOARD_FT = 8.0
MIN_BOARD_FT = 2.0
MIN_ELEM_FT = 0.5
# The column's own corner-wrap boards (the two faces that extend DRYWALL_T_FT past the column's
# own footprint so its OWN corners look continuous) have nowhere to go but into a neighboring
# wall's own drywall/framing when the column sits flush in a wall corner (user report 2026-07-22:
# "outer side is right, put the same on the inner side" - the two faces nearest the walls were the
# ones intruding). Subtract every OTHER pipeline element's REAL solid (not a crude wall bounding
# box - too blunt, wrongly erases boards that only share bbox space with open air inside a wall's
# envelope) from each board so it can never overlap already-placed drywall/framing.
CLIP_AGAINST_WALLS = True

MANIFEST_PATH = r"C:\Users\Origoncad\Downloads\origin_revit_drywall_scripts_v2_two_faces\origin_column_manifest.json"

result = {
    "app_id": APP_ID,
    "columns_processed": 0,
    "boards_created": 0,
    "deleted_previous": 0,
    "skipped": [],
    "manifest_path": "",
    "warnings": [],
}
warnings = result["warnings"]
board_records = []


def eid_value(eid):
    try:
        return eid.Value
    except Exception:
        return eid.IntegerValue


def el_bbox(e):
    try:
        bb = e.get_BoundingBox(None)
        if bb is None:
            return None
        return (bb.Min.X, bb.Min.Y, bb.Min.Z, bb.Max.X, bb.Max.Y, bb.Max.Z)
    except Exception:
        return None


def collect_other_pipeline_solids(warnings):
    """Real solid + bbox of every OTHER Origin-pipeline DirectShape in the model (wall drywall
    boards, studs/tracks, ceiling boards, etc. - anything NOT tagged with THIS script's own
    APP_ID). A wall's raw BOUNDING BOX is too crude to clip against - a column's thin butt-face
    board can sit entirely inside a wall's bbox while never actually touching the wall's real
    (already-correct) drywall board there, and clipping against the bbox wrongly erases it. The
    wall's actual generated boards/studs are the real geometry that must never be penetrated."""
    solids = []
    try:
        for ds in FilteredElementCollector(doc).OfClass(DirectShape).ToElements():
            try:
                p = ds.get_Parameter(BuiltInParameter.ALL_MODEL_INSTANCE_COMMENTS)
                comment = (p.AsString() or "") if p else ""
            except Exception:
                comment = ""
            if not comment or comment.startswith(APP_ID + " |"):
                continue        # untagged, or one of THIS column's own boards (self-overlap is by design)
            try:
                bb = ds.get_BoundingBox(None)
                if bb is None:
                    continue
                box = (bb.Min.X, bb.Min.Y, bb.Min.Z, bb.Max.X, bb.Max.Y, bb.Max.Z)
            except Exception:
                continue
            opt = Options()
            geo = ds.get_Geometry(opt)
            if geo is None:
                continue
            for g in geo:
                if isinstance(g, Solid) and g.Volume > 1e-9:
                    solids.append((box, g))
    except Exception as ex:
        warnings.append("Nearby-solid collection failed ({})".format(ex))
    return solids


def boxes_overlap(a, b):
    return not (a[3] <= b[0] or b[3] <= a[0] or a[4] <= b[1] or b[4] <= a[1] or a[5] <= b[2] or b[5] <= a[2])


def clip_against_others(solid, box, other_solids):
    """Subtract every nearby real solid from solid so it can never overlap already-placed
    drywall/framing. Unlike a bbox clip, an empty/near-zero result here is TRUSTED (it means
    this board is genuinely, fully covered by something already there) rather than reverted -
    the caller drops the board in that case."""
    if not other_solids:
        return solid
    for (obox, osolid) in other_solids:
        if not boxes_overlap(box, obox):
            continue
        try:
            clipped = BooleanOperationsUtils.ExecuteBooleanOperation(
                solid, osolid, BooleanOperationsType.Difference)
        except Exception:
            continue
        if clipped is not None:
            solid = clipped
        if solid is None or solid.Volume <= 1e-9:
            return solid
    return solid


def get_or_create_material(name, rgb):
    for m in FilteredElementCollector(doc).OfClass(Material):
        if m.Name == name:
            return m.Id
    mid = Material.Create(doc, name)
    try:
        m = doc.GetElement(mid)
        m.Color = Color(rgb[0], rgb[1], rgb[2])
        m.Transparency = 0
    except Exception:
        pass
    return mid


def get_or_create_subcategory(parent_cat, name, material_id, rgb):
    try:
        for sc in parent_cat.SubCategories:
            if sc.Name == name:
                return sc
    except Exception:
        pass
    sc = doc.Settings.Categories.NewSubcategory(parent_cat, name)
    try:
        sc.LineColor = Color(rgb[0], rgb[1], rgb[2])
    except Exception:
        pass
    try:
        if material_id and material_id != ElementId.InvalidElementId:
            sc.Material = doc.GetElement(material_id)
    except Exception:
        pass
    return sc


def setup_board_style(warnings):
    """Create/find the shared drywall-colored Generic Model subcategory + material (same name
    as the wall script uses) so column boards match the rest of the model. Returns
    (material_id, graphics_style_id); (None, None) on any failure - boards stay uncolored."""
    if not COLOR_BOARDS:
        return None, None
    try:
        gm = doc.Settings.Categories.get_Item(BuiltInCategory.OST_GenericModel)
        mat_id = get_or_create_material(DRYWALL_STYLE_NAME, DRYWALL_STYLE_RGB)
        sub = get_or_create_subcategory(gm, DRYWALL_STYLE_NAME, mat_id, DRYWALL_STYLE_RGB)
        try:
            doc.Regenerate()
        except Exception:
            pass
        gsid = None
        gs = sub.GetGraphicsStyle(GraphicsStyleType.Projection)
        if gs:
            gsid = gs.Id
        return mat_id, gsid
    except Exception as ex:
        warnings.append("Board coloring setup failed: {}".format(ex))
        return None, None


def make_box(x0, y0, z0, x1, y1, z1, material_id=None, gstyle_id=None):
    if x1 - x0 < 1e-4 or y1 - y0 < 1e-4 or z1 - z0 < 1e-4:
        return None
    pts = [XYZ(x0, y0, z0), XYZ(x1, y0, z0), XYZ(x1, y1, z0), XYZ(x0, y1, z0)]
    lines = []
    for i in range(4):
        lines.append(Line.CreateBound(pts[i], pts[(i + 1) % 4]))
    loop = CurveLoop.Create(lines)
    from System.Collections.Generic import List as NetList
    nl = NetList[CurveLoop]()
    nl.Add(loop)
    if material_id is not None and gstyle_id is not None:
        opts = SolidOptions(material_id, gstyle_id)
        return GeometryCreationUtilities.CreateExtrusionGeometry(nl, XYZ.BasisZ, z1 - z0, opts)
    return GeometryCreationUtilities.CreateExtrusionGeometry(nl, XYZ.BasisZ, z1 - z0)


def create_ds(solid, name, comment):
    try:
        ds = DirectShape.CreateElement(doc, ElementId(BuiltInCategory.OST_GenericModel))
        ds.SetShape([solid])
        try:
            p = ds.get_Parameter(BuiltInParameter.ALL_MODEL_INSTANCE_COMMENTS)
            if p:
                p.Set(comment)
            m = ds.get_Parameter(BuiltInParameter.ALL_MODEL_MARK)
            if m:
                m.Set(name)
            ds.Name = name
        except Exception:
            pass
        return ds
    except Exception as ex:
        warnings.append("{}: DirectShape failed ({})".format(name, ex))
        return None


def split_len(lo, hi):
    total = hi - lo
    n = 1
    while total / n > MAX_BOARD_FT:
        n += 1
    step = total / n
    return [(lo + i * step, lo + (i + 1) * step) for i in range(n)]


def set_mark(e, tag):
    try:
        m = e.get_Parameter(BuiltInParameter.ALL_MODEL_MARK)
        if m and not m.IsReadOnly:
            m.Set(tag)
    except Exception:
        pass


def emit_board(host_tag, host_eid, seq, box, material_id=None, gstyle_id=None, other_solids=None):
    solid = make_box(*box, material_id=material_id, gstyle_id=gstyle_id)
    if solid is None:
        return 0
    solid = clip_against_others(solid, box, other_solids)
    if solid is None or solid.Volume <= 1e-9:
        warnings.append("{}-{:03d}: fully covered by existing drywall/framing - board omitted".format(host_tag, seq))
        return 0
    name = "DP-{}-{:03d}".format(host_tag, seq)
    comment = "{} | HOST={} | DRYWALL | COLUMN | {}".format(APP_ID, host_eid, name)
    if create_ds(solid, name, comment) is None:
        return 0
    long_ft = max(box[3] - box[0], box[4] - box[1], box[5] - box[2])
    if long_ft > MAX_BOARD_FT + 1e-6:
        warnings.append("{}: board {:.1f} ft exceeds {} ft".format(name, long_ft, MAX_BOARD_FT))
    if long_ft < MIN_BOARD_FT - 1e-6:
        warnings.append("{}: board {:.1f} ft is under the {} ft min".format(name, long_ft, MIN_BOARD_FT))
    try:
        sbb = solid.GetBoundingBox()
        smn = sbb.Transform.OfPoint(sbb.Min)
        smx = sbb.Transform.OfPoint(sbb.Max)
        real_bbox = [round(smn.X, 3), round(smn.Y, 3), round(smn.Z, 3),
                     round(smx.X, 3), round(smx.Y, 3), round(smx.Z, 3)]
    except Exception:
        real_bbox = [round(v, 3) for v in box]
    board_records.append({
        "board_id": name, "host": host_tag, "host_eid": host_eid,
        "bbox_ft": real_bbox,
        "thickness_in": round(DRYWALL_T_FT * 12.0, 2),
    })
    return 1


def wrap_column(e, host_tag, material_id=None, gstyle_id=None, other_solids=None):
    bb = el_bbox(e)
    if bb is None:
        result["skipped"].append("{}: no bbox".format(host_tag))
        return 0
    x0, y0, z0, x1, y1, z1 = bb
    if min(x1 - x0, y1 - y0) < 0.05 or (z1 - z0) < MIN_ELEM_FT:
        result["skipped"].append("{}: degenerate body".format(host_tag))
        return 0
    t = DRYWALL_T_FT
    made = 0
    seq = 0
    host_eid = "K" + str(eid_value(e.Id))
    for (za, zb) in split_len(z0, z1):
        for box in [
            (x0 - t, y0 - t, za, x0, y1 + t, zb),
            (x1, y0 - t, za, x1 + t, y1 + t, zb),
            (x0, y0 - t, za, x1, y0, zb),
            (x0, y1, za, x1, y1 + t, zb),
        ]:
            seq += 1
            made += emit_board(host_tag, host_eid, seq, box, material_id, gstyle_id, other_solids)
    return made


def delete_previous():
    n = 0
    tags = [APP_ID + " |"] + [t + " |" for t in LEGACY_APP_IDS]
    stale = []
    for ds in FilteredElementCollector(doc).OfClass(DirectShape):
        try:
            p = ds.get_Parameter(BuiltInParameter.ALL_MODEL_INSTANCE_COMMENTS)
            s = (p.AsString() or "") if p else ""
            if any(s.startswith(t) for t in tags):
                stale.append(ds.Id)
        except Exception:
            continue
    for sid in stale:
        try:
            doc.Delete(sid)
            n += 1
        except Exception:
            pass
    return n


TransactionManager.Instance.EnsureInTransaction(doc)
try:
    if DELETE_PREVIOUS:
        result["deleted_previous"] = delete_previous()
    mat_id, gstyle_id = setup_board_style(warnings)
    other_solids = collect_other_pipeline_solids(warnings) if CLIP_AGAINST_WALLS else []
    cols = []
    for bic in (BuiltInCategory.OST_Columns, BuiltInCategory.OST_StructuralColumns):
        try:
            cols.extend(list(FilteredElementCollector(doc).OfCategory(bic)
                             .WhereElementIsNotElementType()))
        except Exception as ex:
            warnings.append("Column collection failed ({})".format(ex))
    ki = 0
    for e in cols:
        ki += 1
        tag = "K{:03d}".format(ki)
        set_mark(e, tag)
        made = wrap_column(e, tag, mat_id, gstyle_id, other_solids)
        if made:
            result["columns_processed"] += 1
            result["boards_created"] += made
except Exception as ex:
    warnings.append("FATAL: {}".format(ex))
finally:
    TransactionManager.Instance.TransactionTaskDone()

try:
    manifest = {
        "app_id": APP_ID,
        "nomenclature": {"column": "K###", "board": "DP-<host>-<seq>"},
        "summary": {k: result[k] for k in ("columns_processed", "boards_created", "deleted_previous")},
        "boards": board_records,
        "skipped": result["skipped"],
        "warnings": warnings,
    }
    f = open(MANIFEST_PATH, "w")
    try:
        json.dump(manifest, f, indent=2)
    finally:
        f.close()
    result["manifest_path"] = MANIFEST_PATH
except Exception as ex:
    warnings.append("Manifest write failed: {}".format(ex))

OUT = result
# ----------------------------------------
columns_result = Watch(origin_columns)
