# Dynamo graph test - Copy.dyn "test" (Dynamo 3.6.2.11575)

wall_types = WallTypes("Exterior Partition")
wall_types_2 = WallTypes("Intrior Partition")  # graph input
python_script = Python(IN[0]=wall_types, IN[1]=wall_types_2)  # CPython3; unwired: IN[2], IN[3]
# ---------- python_script.python (1520 lines) ----------
# Origin Wall Assembly Generator v4 - PHASE 1 + PHASE 2 (FRAMING + DRYWALL)
# Dynamo Python Script node for Revit (target: Revit 2027, PythonNet3 / CPython3 engine).
#
# WHAT THIS IS:
#   The unified construction-accurate wall-assembly generator. It builds, for each selected
#   straight wall, in ONE run and ONE transaction:
#
#     PHASE 1 - METAL FRAMING (carried over VERBATIM from origin_drywall_assembly_v4.py,
#               which is Revit-confirmed):
#                 - Vertical C-studs @ 16" OC, king studs on jambs, cripples above headers /
#                   below sills, jack studs, flat-laid C headers, window C sills.
#                 - U-tracks: continuous bottom (split at doors) and top (split only if an
#                   opening reaches the ceiling).
#                 - True lipped-C and U cold-formed cross-sections (extruded profiles).
#
#     PHASE 2 - DRYWALL (NEW):
#                 - Horizontal courses of gypsum board on BOTH wall faces.
#                 - Staggered butt joints (per row, per face, and per layer).
#                 - OPENINGS ARE CUT AS A SINGLE CONNECTED PIECE (L / notch / hole), NOT as
#                   separate rectangles split at the opening edges. This honors the locked
#                   drywall-opening rule: hang-over-then-cut-out, joints toward mid-opening,
#                   NEVER a butt joint at an opening corner (renovation-headquarters.com rules).
#                 - Fire-rated walls get 2 layers of 5/8" Type X per side (staggered between
#                   layers); non-rated walls get 1 layer of 1/2". Rating is auto-detected.
#                 - 1/8" code gaps at butt joints; tapered long edges recorded as metadata.
#                 - Board sizes 4x8 (default) or 4x12 (setting).
#                 - Per-board property schema written into the DirectShape Comments so it
#                   survives export (full sidecar JSON manifest is Phase 3).
#
# PHASE 3 (NOT here): fastener solids + coordinates, assembly manifest JSON, export-isolation
#   view that hides the base Revit wall. Hooks are left in place (board records accumulate).
#
# STILL APPROXIMATE (documented, inherited):
#   - Straight vertical walls only. Curved / slanted walls are skipped.
#   - Openings are approximated from hosted-insert bounding boxes (may be slightly oversized).
#   - A single sheet that overlaps MORE THAN ONE opening falls back to rectangular subtraction
#     for that sheet only (rare; reported in OUT["notes"]).
#   - This is layout / visualization geometry, not shop-drawing certification.

import clr
import math

clr.AddReference('RevitAPI')
clr.AddReference('RevitServices')

from Autodesk.Revit.DB import *
from Autodesk.Revit.DB.Structure import StructuralType
from RevitServices.Persistence import DocumentManager
from RevitServices.Transactions import TransactionManager

try:
    clr.AddReference('RevitNodes')
    import Revit
    clr.ImportExtensions(Revit.Elements)
except:
    pass

from System.Collections.Generic import List

doc = DocumentManager.Instance.CurrentDBDocument
uidoc = DocumentManager.Instance.CurrentUIApplication.ActiveUIDocument

# ============================================================
# USER SETTINGS
# ============================================================

APP_ID = "ORIGIN_ASSEMBLY_V4"          # shared with the Phase-1 script so cleanup unifies

# Phase toggles. This script owns the whole assembly; a rerun rebuilds every enabled phase.
GENERATE_FRAMING = True
GENERATE_DRYWALL = True

# DirectShape-only (self-contained solids, no families needed). Family mode is Phase 3+.
OUTPUT_MODE = "directshape"

# Each member/board type gets its own colored Generic Model subcategory (toggle in V/G).
COLOR_BY_TYPE = True

# Safety.
DELETE_PREVIOUS_ORIGIN_ASSEMBLY = True
PROCESS_ALL_WALLS_IF_NONE_SELECTED = False

# ---- Units: Revit internal units are feet; inch = 1/12 ft ----
IN_FT = 1.0 / 12.0

# ---- Framing dimensions (Phase 1, verbatim from v4) ----
STUD_SPACING_FT = 16.0 * IN_FT          # 16 in. OC
STUD_DEPTH_FT = 3.625 * IN_FT           # nominal/fallback C-stud web depth (used only if not derived)
FLANGE_FT = 1.25 * IN_FT                # C-stud flange width
LIP_FT = 0.1875 * IN_FT                 # C-stud return lip
MAT_T_FT = 0.0451 * IN_FT               # steel material thickness (~18 ga)
TRACK_FLANGE_FT = 1.25 * IN_FT
MIN_SEG_FT = 0.25                       # skip framing pieces shorter than 3 in.

# Stud web depth: when True, depth = wall thickness - drywall on BOTH faces, so the stud web
# butts the back of the drywall and framing+drywall exactly fills the modeled wall. When False,
# use the fixed STUD_DEPTH_FT above. Track depth follows (wraps the stud + 2x material thickness).
DERIVE_STUD_DEPTH_FROM_WALL = True
MIN_STUD_DEPTH_FT = 1.25 * IN_FT        # floor on the derived depth (very thin / over-clad walls)

# ---- Drywall layout (Phase 2) ----
# Board face size. Default 4x8 (8 ft long). Set 12.0 for 4x12 sheets (fewer joints).
PANEL_LENGTH_FT = 8.0
PANEL_HEIGHT_FT = 4.0                    # sheets hung horizontally: 4 ft course height

# Layer build-up. Rated walls: 2 layers of 5/8" Type X. Non-rated: 1 layer of 1/2".
DRYWALL_THICKNESS_STD_FT = 0.5 * IN_FT
DRYWALL_THICKNESS_RATED_FT = 0.625 * IN_FT
DRYWALL_LAYERS_RATED = 2
DRYWALL_LAYERS_STD = 1

# Joint control.
CODE_GAP_FT = (1.0 / 8.0) * IN_FT        # 1/8" total gap between adjacent boards
LAYER_H_STAGGER_FT = PANEL_LENGTH_FT / 2.0   # shift vertical joints between stacked layers
LAYER_V_STAGGER_FT = PANEL_HEIGHT_FT / 2.0   # shift horizontal joints between stacked layers
AVOID_JOINTS_AT_JAMBS = True             # nudge a course so no butt joint lands on an opening jamb
JOINT_CLEAR_FT = 4.0 * IN_FT             # keep butt joints at least this far from a jamb
DRYWALL_OPENING_GAP_FT = 0.25 * IN_FT    # extra clearance cut around openings (1/4")
TAPERED_LONG_EDGES = True                # record tapered long edges as metadata (no bevel geometry)

MIN_PIECE_WIDTH_FT = 0.25                # skip board slivers narrower than 3 in.
MIN_PIECE_HEIGHT_FT = 0.25
HOLE_MARGIN_FT = 0.05                    # cutter over-travel for boolean hole cuts

# Both faces are generated. exterior = +Wall.Orientation; interior = -Wall.Orientation.
# base_edge_shift staggers where the first board edge lands; Face B is offset one stud bay so
# the two faces do not simply mirror. odd_row_additional_shift staggers odd courses.
FACE_LAYOUTS = [
    {
        "face_name": "FACE_A_INTERIOR",
        "side": "interior",
        "enabled": True,
        "base_edge_shift_ft": 0.0,
        "odd_row_additional_shift_ft": 4.0,
    },
    {
        "face_name": "FACE_B_EXTERIOR",
        "side": "exterior",
        "enabled": True,
        "base_edge_shift_ft": 16.0 * IN_FT,
        "odd_row_additional_shift_ft": 4.0,
    },
]

# Opening detection (shared by framing + drywall).
CUT_OPENINGS = True
OPENING_CLEARANCE_FT = 0.05

# Fire-rating override: None = auto-detect; True/False = force. (Dynamo IN[7] also overrides.)
FORCE_FIRE_RATED = None

# Dynamo inputs:
#   IN[0] = selected wall(s) (or use current Revit selection if empty)
#   IN[5] = optional delete previous: True/False (overrides DELETE_PREVIOUS_ORIGIN_ASSEMBLY)
#   IN[6] = optional generate drywall: True/False (overrides GENERATE_DRYWALL)
#   IN[7] = optional force fire-rated: True/False (overrides auto-detection)
# ============================================================


# ============================================================
# Cross-section profiles (Phase 1, verbatim from v4)
# ============================================================

def build_profiles(stud_depth):
    """Build the lipped-C stud profile and the U-track profile for a given through-wall stud
    depth. Track wraps the stud, so its depth = stud_depth + 2x material thickness. Returns
    (c_profile, u_profile, track_depth)."""
    D = stud_depth
    F = FLANGE_FT
    L = LIP_FT
    t = MAT_T_FT
    c = [(0, 0), (0, F), (L, F), (L, F - t), (t, F - t), (t, t),
         (D - t, t), (D - t, F - t), (D - L, F - t), (D - L, F), (D, F), (D, 0)]

    Dt = D + 2.0 * t
    Ht = TRACK_FLANGE_FT
    u = [(0, 0), (0, Ht), (t, Ht), (t, t), (Dt - t, t), (Dt - t, Ht), (Dt, Ht), (Dt, 0)]
    return c, u, Dt


# ------------------------------------------------------------
# Small vector / input helpers  (VERBATIM)
# ------------------------------------------------------------

def unwrap(item):
    try:
        return UnwrapElement(item)
    except:
        return item


def get_in(index, default=None):
    try:
        val = IN[index]
    except:
        return default
    return val if val is not None else default


def ensure_list(x):
    if x is None:
        return []
    if isinstance(x, list):
        return x
    return [x]


def as_bool(value, default):
    if value is None:
        return default
    if isinstance(value, bool):
        return value
    if isinstance(value, int):
        return value != 0
    if isinstance(value, str):
        return value.strip().lower() in ["true", "yes", "1", "y"]
    return default


def eid_value(eid):
    """Numeric value of an ElementId. Revit 2024+ uses 64-bit .Value (removed .IntegerValue)."""
    try:
        return eid.Value
    except:
        pass
    try:
        return eid.IntegerValue
    except:
        return -1


def xyz_sub(a, b):
    return XYZ(a.X - b.X, a.Y - b.Y, a.Z - b.Z)


def xyz_mul(v, s):
    return XYZ(v.X * s, v.Y * s, v.Z * s)


def dot(a, b):
    return a.X * b.X + a.Y * b.Y + a.Z * b.Z


def safe_normalize(v):
    length = math.sqrt(v.X * v.X + v.Y * v.Y + v.Z * v.Z)
    if length < 1e-9:
        return None
    return XYZ(v.X / length, v.Y / length, v.Z / length)


def clamp(value, lo, hi):
    return max(lo, min(hi, value))


def unique_sorted(values, tolerance=0.01):
    out = []
    for v in sorted(values):
        if not out or abs(out[-1] - v) > tolerance:
            out.append(v)
    return out


# ------------------------------------------------------------
# Wall reading  (VERBATIM)
# ------------------------------------------------------------

def get_input_walls(warnings):
    walls = []

    input_data = get_in(0)
    if input_data:
        for item in ensure_list(input_data):
            e = unwrap(item)
            if isinstance(e, Wall):
                walls.append(e)
    if walls:
        return walls

    try:
        for eid in list(uidoc.Selection.GetElementIds()):
            e = doc.GetElement(eid)
            if isinstance(e, Wall):
                walls.append(e)
    except Exception as ex:
        warnings.append("Could not read Revit selection: {}".format(ex))
    if walls:
        return walls

    if PROCESS_ALL_WALLS_IF_NONE_SELECTED:
        for e in FilteredElementCollector(doc).OfClass(Wall).WhereElementIsNotElementType():
            walls.append(e)

    return walls


def get_wall_curve_data(wall):
    loc = wall.Location
    if not loc or not hasattr(loc, "Curve"):
        return None

    curve = loc.Curve
    if curve.GetType().Name != "Line":       # straight walls only
        return None

    start = curve.GetEndPoint(0)
    end = curve.GetEndPoint(1)
    length = curve.Length
    direction = safe_normalize(xyz_sub(end, start))
    if direction is None or length <= 0:
        return None

    return start, end, direction, length


def get_wall_height(wall):
    try:
        hp = wall.get_Parameter(BuiltInParameter.WALL_USER_HEIGHT_PARAM)
        if hp:
            h = hp.AsDouble()
            if h and h > 0.1:
                return h
    except:
        pass
    try:
        bb = wall.get_BoundingBox(None)
        if bb:
            h = bb.Max.Z - bb.Min.Z
            if h and h > 0.1:
                return h
    except:
        pass
    return 9.0


def get_wall_width(wall):
    try:
        wt = wall.WallType
        if wt and wt.Width and wt.Width > 0:
            return wt.Width
    except:
        pass
    try:
        if wall.Width and wall.Width > 0:
            return wall.Width
    except:
        pass
    return 0.5


def wall_is_fire_rated(wall, warnings):
    """Detect a fire-rated wall via the wall type's 'Fire Rating' parameter or type name.
    Returns True/False. Best-effort; unreadable => False (non-rated, 1 layer)."""
    try:
        wt = wall.WallType
        p = wt.LookupParameter("Fire Rating")
        if p is not None:
            try:
                if p.StorageType == StorageType.String:
                    s = p.AsString()
                    if s and any(ch.isdigit() for ch in s) and s.strip() not in ("0", "0 min", ""):
                        return True
                elif p.StorageType in (StorageType.Double, StorageType.Integer):
                    if p.AsDouble() and p.AsDouble() > 0.01:
                        return True
            except:
                pass
        name = (wt.Name or "").lower()
        for kw in ("fire", "rated", "type x", "type-x", "1 hr", "2 hr", "1-hr", "2-hr", "1hr", "2hr", " ul "):
            if kw in name:
                return True
    except Exception as ex:
        warnings.append("Fire-rating check failed for a wall ({}); assuming non-rated.".format(ex))
    return False


def wall_ref_geometry(wall, width, warnings):
    """Distance from the EXTERIOR face to (Location Line, core mid-plane), both measured toward
    the interior along the exterior normal. Accounts for the Location Line reference and the
    compound structure so faces/studs land on their true surfaces."""
    ext_noncore = 0.0
    int_noncore = 0.0
    core_width = width

    try:
        cs = wall.WallType.GetCompoundStructure()
        if cs:
            layers = cs.GetLayers()
            first_core = cs.GetFirstCoreLayerIndex()
            last_core = cs.GetLastCoreLayerIndex()
            idx = 0
            for layer in layers:                 # ordered exterior -> interior
                w = layer.Width
                if idx < first_core:
                    ext_noncore += w
                elif idx > last_core:
                    int_noncore += w
                idx += 1
            core_width = width - ext_noncore - int_noncore
    except Exception as ex:
        warnings.append("Wall {}: compound structure unreadable, assuming single layer ({})".format(
            eid_value(wall.Id), ex))

    ref = 0
    try:
        p = wall.get_Parameter(BuiltInParameter.WALL_KEY_REF_PARAM)
        if p:
            ref = p.AsInteger()
    except:
        pass

    # WallLocationLine: 0 WallCenterline, 1 CoreCenterline, 2 FinishFaceExt, 3 FinishFaceInt,
    #                   4 CoreExt, 5 CoreInt
    if ref == 1:
        d_loc = ext_noncore + core_width / 2.0
    elif ref == 2:
        d_loc = 0.0
    elif ref == 3:
        d_loc = width
    elif ref == 4:
        d_loc = ext_noncore
    elif ref == 5:
        d_loc = width - int_noncore
    else:
        d_loc = width / 2.0

    core_center_from_ext = ext_noncore + core_width / 2.0
    return d_loc, core_center_from_ext


def face_normal_and_offset(true_orientation, d_loc, width, side_name):
    """Return (outward_normal, offset_along_that_normal_from_start) for the requested face.
    Exterior face = start + true_orientation * d_loc; interior face = start - true_orientation *
    (width - d_loc)."""
    is_exterior_cfg = str(side_name).lower().startswith("ext")
    if is_exterior_cfg:
        return true_orientation, d_loc
    return xyz_mul(true_orientation, -1.0), (width - d_loc)


# ------------------------------------------------------------
# Openings  (VERBATIM)
# ------------------------------------------------------------

def get_bbox_corners(bb):
    return [
        XYZ(bb.Min.X, bb.Min.Y, bb.Min.Z),
        XYZ(bb.Min.X, bb.Min.Y, bb.Max.Z),
        XYZ(bb.Min.X, bb.Max.Y, bb.Min.Z),
        XYZ(bb.Min.X, bb.Max.Y, bb.Max.Z),
        XYZ(bb.Max.X, bb.Min.Y, bb.Min.Z),
        XYZ(bb.Max.X, bb.Min.Y, bb.Max.Z),
        XYZ(bb.Max.X, bb.Max.Y, bb.Min.Z),
        XYZ(bb.Max.X, bb.Max.Y, bb.Max.Z)
    ]


def get_opening_rects(wall, start, u, wall_length, wall_height, warnings):
    rects = []
    if not CUT_OPENINGS:
        return rects

    try:
        insert_ids = wall.FindInserts(True, True, True, True)
    except Exception as ex:
        warnings.append("Wall {}: FindInserts failed ({})".format(eid_value(wall.Id), ex))
        insert_ids = []

    for eid in insert_ids:
        e = doc.GetElement(eid)
        if not e:
            continue
        try:
            bb = e.get_BoundingBox(None)
        except:
            bb = None
        if not bb:
            continue

        xs = []
        ys = []
        for p in get_bbox_corners(bb):
            local = xyz_sub(p, start)
            xs.append(dot(local, u))
            ys.append(p.Z - start.Z)

        x0 = max(0.0, min(xs) - OPENING_CLEARANCE_FT)
        x1 = min(wall_length, max(xs) + OPENING_CLEARANCE_FT)
        y0 = max(0.0, min(ys) - OPENING_CLEARANCE_FT)
        y1 = min(wall_height, max(ys) + OPENING_CLEARANCE_FT)

        if (x1 - x0) > 0.1 and (y1 - y0) > 0.1:
            rects.append((x0, y0, x1, y1))

    return rects


# ------------------------------------------------------------
# Rectangle helpers (drywall)
# ------------------------------------------------------------

def rect_intersection(a, b):
    ax0, ay0, ax1, ay1 = a
    bx0, by0, bx1, by1 = b
    ix0 = max(ax0, bx0)
    iy0 = max(ay0, by0)
    ix1 = min(ax1, bx1)
    iy1 = min(ay1, by1)
    if ix1 <= ix0 or iy1 <= iy0:
        return None
    return (ix0, iy0, ix1, iy1)


def subtract_rect(rect, cut):
    """v3-style rectangular subtraction. Used ONLY as a fallback for sheets that overlap more
    than one opening (rare). Returns up to 4 rectangles."""
    inter = rect_intersection(rect, cut)
    if not inter:
        return [rect]

    x0, y0, x1, y1 = rect
    ix0, iy0, ix1, iy1 = inter

    pieces = []
    if iy0 > y0:
        pieces.append((x0, y0, x1, iy0))
    if iy1 < y1:
        pieces.append((x0, iy1, x1, y1))
    if ix0 > x0:
        pieces.append((x0, iy0, ix0, iy1))
    if ix1 < x1:
        pieces.append((ix1, iy0, x1, iy1))

    return [r for r in pieces
            if (r[2] - r[0]) >= MIN_PIECE_WIDTH_FT and (r[3] - r[1]) >= MIN_PIECE_HEIGHT_FT]


def subtract_openings_from_panel(panel_rect, opening_rects):
    pieces = [panel_rect]
    for opening in opening_rects:
        new_pieces = []
        for piece in pieces:
            new_pieces.extend(subtract_rect(piece, opening))
        pieces = new_pieces
        if not pieces:
            break
    return pieces


def rect_area(r):
    return max(0.0, r[2] - r[0]) * max(0.0, r[3] - r[1])


def poly_area(pts):
    a = 0.0
    n = len(pts)
    for i in range(n):
        x0, y0 = pts[i]
        x1, y1 = pts[(i + 1) % n]
        a += x0 * y1 - x1 * y0
    return abs(a) / 2.0


def cut_sheet_single_opening(S, O):
    """Cut ONE opening O out of sheet S, keeping the result as a SINGLE connected piece wherever
    that is physically what happens (notch / L / hole). Returns a list of "shapes":
        ("rect", (x0,y0,x1,y1))              - a plain rectangle
        ("poly", [(x,y), ...])               - a single rectilinear polygon (notch or L)
        ("hole", outer_rect, hole_rect)      - rectangle with an interior rectangular hole
    A course that the opening spans full-height (or full-width) legitimately becomes two
    separate boards (left/right or top/bottom) - those ARE separate boards in the field."""
    inter = rect_intersection(S, O)
    if not inter:
        return [("rect", S)]

    sx0, sy0, sx1, sy1 = S
    ix0, iy0, ix1, iy1 = inter
    tol = 1e-4

    full_w = (ix0 <= sx0 + tol) and (ix1 >= sx1 - tol)
    full_h = (iy0 <= sy0 + tol) and (iy1 >= sy1 - tol)

    if full_w and full_h:
        return []                                   # sheet fully consumed by the opening

    if full_w:                                      # horizontal band removed -> top/bottom boards
        out = []
        if (iy0 - sy0) >= MIN_PIECE_HEIGHT_FT:
            out.append(("rect", (sx0, sy0, sx1, iy0)))
        if (sy1 - iy1) >= MIN_PIECE_HEIGHT_FT:
            out.append(("rect", (sx0, iy1, sx1, sy1)))
        return out

    if full_h:                                      # vertical band removed -> left/right boards
        out = []
        if (ix0 - sx0) >= MIN_PIECE_WIDTH_FT:
            out.append(("rect", (sx0, sy0, ix0, sy1)))
        if (sx1 - ix1) >= MIN_PIECE_WIDTH_FT:
            out.append(("rect", (ix1, sy0, sx1, sy1)))
        return out

    # Neither full: the opening bites a notch/corner/hole out of the sheet -> ONE piece.
    tL = ix0 <= sx0 + tol
    tR = ix1 >= sx1 - tol
    tB = iy0 <= sy0 + tol
    tT = iy1 >= sy1 - tol

    if not (tL or tR or tB or tT):                  # interior opening -> rectangle with a hole
        return [("hole", S, inter)]

    # Build the single rectilinear outer ring for the notch / L cases.
    if tB and tL:                                   # remove bottom-left corner -> L
        ring = [(ix1, sy0), (sx1, sy0), (sx1, sy1), (sx0, sy1), (sx0, iy1), (ix1, iy1)]
    elif tB and tR:                                 # remove bottom-right corner -> L
        ring = [(sx0, sy0), (ix0, sy0), (ix0, iy1), (sx1, iy1), (sx1, sy1), (sx0, sy1)]
    elif tT and tL:                                 # remove top-left corner -> L
        ring = [(sx0, sy0), (sx1, sy0), (sx1, sy1), (ix1, sy1), (ix1, iy0), (sx0, iy0)]
    elif tT and tR:                                 # remove top-right corner -> L
        ring = [(sx0, sy0), (sx1, sy0), (sx1, iy0), (ix0, iy0), (ix0, sy1), (sx0, sy1)]
    elif tB:                                        # notch from the bottom edge
        ring = [(sx0, sy0), (ix0, sy0), (ix0, iy1), (ix1, iy1), (ix1, sy0),
                (sx1, sy0), (sx1, sy1), (sx0, sy1)]
    elif tT:                                        # notch from the top edge
        ring = [(sx0, sy0), (sx1, sy0), (sx1, sy1), (ix1, sy1), (ix1, iy0),
                (ix0, iy0), (ix0, sy1), (sx0, sy1)]
    elif tL:                                        # notch from the left edge
        ring = [(sx0, sy0), (sx1, sy0), (sx1, sy1), (sx0, sy1), (sx0, iy1),
                (ix1, iy1), (ix1, iy0), (sx0, iy0)]
    else:                                           # tR: notch from the right edge
        ring = [(sx0, sy0), (sx1, sy0), (sx1, iy0), (ix0, iy0), (ix0, iy1),
                (sx1, iy1), (sx1, sy1), (sx0, sy1)]

    return [("poly", ring)]


def cut_sheet(S, opening_rects):
    """Cut all overlapping openings out of sheet S. 0 or 1 overlap uses the single-piece logic;
    2+ overlaps fall back to rectangular subtraction (documented, rare). Returns (shapes, multi)."""
    overlaps = [O for O in opening_rects if rect_intersection(S, O) is not None]
    if not overlaps:
        return [("rect", S)], False
    if len(overlaps) == 1:
        return cut_sheet_single_opening(S, overlaps[0]), False
    # Multiple openings on one sheet: cut them all out with a boolean difference so the board
    # stays a single connected piece (notches / L's / holes) rather than rectangles split at the
    # opening corners.
    return [("multicut", S, overlaps)], True


# ------------------------------------------------------------
# Geometry primitives
# ------------------------------------------------------------

def make_point(origin, u, z, x, y):
    return origin.Add(u.Multiply(x)).Add(z.Multiply(y))


def _extrude_loops(loops, extrude_dir, depth, material_id, gstyle_id):
    if material_id is not None:
        gs = gstyle_id if gstyle_id is not None else ElementId.InvalidElementId
        opts = SolidOptions(material_id, gs)
        return GeometryCreationUtilities.CreateExtrusionGeometry(loops, extrude_dir, depth, opts)
    return GeometryCreationUtilities.CreateExtrusionGeometry(loops, extrude_dir, depth)


def make_profile_solid(origin, ax, ay, points2d, extrude_dir, depth, material_id=None, gstyle_id=None):
    """Extrude an arbitrary closed polygon profile (used by framing). ax/ay map the two profile
    coords; tries both windings so the caller need not worry about loop orientation."""
    if depth <= 0 or points2d is None or len(points2d) < 3:
        return None
    verts = [origin.Add(ax.Multiply(p)).Add(ay.Multiply(q)) for (p, q) in points2d]
    for order in (verts, list(reversed(verts))):
        try:
            loop = CurveLoop()
            n = len(order)
            for i in range(n):
                loop.Append(Line.CreateBound(order[i], order[(i + 1) % n]))
            loops = List[CurveLoop]()
            loops.Add(loop)
            return _extrude_loops(loops, extrude_dir, depth, material_id, gstyle_id)
        except:
            continue
    return None


def make_rect_solid(origin, u, z, normal, rect, depth, material_id=None, gstyle_id=None):
    x0, y0, x1, y1 = rect
    if (x1 - x0) < 0.001 or (y1 - y0) < 0.001 or depth <= 0:
        return None
    pts = [(x0, y0), (x1, y0), (x1, y1), (x0, y1)]
    return make_planar_poly_solid(origin, u, z, normal, pts, depth, material_id, gstyle_id)


def make_planar_poly_solid(origin, u, z, normal, pts2d, depth, material_id=None, gstyle_id=None):
    """Extrude a single planar rectilinear polygon (given as (x,y) in the u/z plane) along the
    normal by depth. Dedupes coincident consecutive points; tries both windings."""
    clean = []
    for p in pts2d:
        if not clean or abs(clean[-1][0] - p[0]) > 1e-7 or abs(clean[-1][1] - p[1]) > 1e-7:
            clean.append(p)
    if len(clean) >= 2 and abs(clean[0][0] - clean[-1][0]) < 1e-7 and abs(clean[0][1] - clean[-1][1]) < 1e-7:
        clean = clean[:-1]
    if len(clean) < 3 or depth <= 0:
        return None

    verts = [make_point(origin, u, z, x, y) for (x, y) in clean]
    for order in (verts, list(reversed(verts))):
        try:
            loop = CurveLoop()
            n = len(order)
            for i in range(n):
                loop.Append(Line.CreateBound(order[i], order[(i + 1) % n]))
            loops = List[CurveLoop]()
            loops.Add(loop)
            return _extrude_loops(loops, normal, depth, material_id, gstyle_id)
        except:
            continue
    return None


def make_hole_solid(origin, u, z, normal, outer_rect, hole_rect, depth, material_id=None, gstyle_id=None):
    """Rectangle with an interior rectangular hole, via a real 3D boolean difference (the
    hang-over-then-cut-out operation). Returns the cut Solid, or None on failure."""
    outer = make_rect_solid(origin, u, z, normal, outer_rect, depth, material_id, gstyle_id)
    if outer is None:
        return None
    cutter_origin = origin.Add(normal.Multiply(-HOLE_MARGIN_FT))
    cutter = make_rect_solid(cutter_origin, u, z, normal, hole_rect, depth + 2.0 * HOLE_MARGIN_FT)
    if cutter is None:
        return outer
    try:
        return BooleanOperationsUtils.ExecuteBooleanOperation(
            outer, cutter, BooleanOperationsType.Difference)
    except:
        return outer          # keep the uncut board rather than losing it


def make_multicut_solid(origin, u, z, normal, sheet_rect, cut_rects, depth,
                        material_id=None, gstyle_id=None):
    """Sheet rectangle with MULTIPLE openings cut out via chained boolean differences, so the
    board stays a SINGLE connected piece (notches / L's / holes) instead of rectangles split at
    the opening corners. (A course an opening spans full-height may come back as one solid with
    two lumps; that rare case is the exception.) Returns the cut Solid, or None on failure."""
    solid = make_rect_solid(origin, u, z, normal, sheet_rect, depth, material_id, gstyle_id)
    if solid is None:
        return None
    cutter_origin = origin.Add(normal.Multiply(-HOLE_MARGIN_FT))
    for cr in cut_rects:
        inter = rect_intersection(sheet_rect, cr)
        if not inter:
            continue
        cutter = make_rect_solid(cutter_origin, u, z, normal, inter, depth + 2.0 * HOLE_MARGIN_FT)
        if cutter is None:
            continue
        try:
            solid = BooleanOperationsUtils.ExecuteBooleanOperation(
                solid, cutter, BooleanOperationsType.Difference)
        except:
            pass          # skip this cutter; keep the board built so far
    return solid


def set_comments(element, text):
    try:
        p = element.get_Parameter(BuiltInParameter.ALL_MODEL_INSTANCE_COMMENTS)
        if p and (not p.IsReadOnly):
            p.Set(text)
    except:
        pass


def create_directshape(solid, data_id, name, comments, warnings):
    if solid is None:
        return None
    try:
        ds = DirectShape.CreateElement(doc, ElementId(BuiltInCategory.OST_GenericModel))
        ds.ApplicationId = APP_ID
        ds.ApplicationDataId = data_id
        shape = List[GeometryObject]()
        shape.Add(solid)
        ds.SetShape(shape)
        try:
            ds.Name = name
        except:
            pass
        set_comments(ds, comments)
        return ds
    except Exception as ex:
        warnings.append("DirectShape create failed for {}: {}".format(data_id, ex))
        return None


# ------------------------------------------------------------
# DirectShape appearance: colored subcategories + materials  (VERBATIM machinery)
# ------------------------------------------------------------

STYLE_SPECS = [
    ("STUD",     "ORIGIN Stud",         (150, 155, 165)),
    ("KINGSTUD", "ORIGIN King Stud",    (120, 140, 180)),
    ("JACK",     "ORIGIN Jack Stud",    (120, 170, 140)),
    ("CRIPPLE",  "ORIGIN Cripple Stud", (170, 170, 120)),
    ("TRACK",    "ORIGIN Track",        (90, 95, 105)),
    ("HEADER",   "ORIGIN Header",       (200, 140, 80)),
    ("SILL",     "ORIGIN Sill",         (200, 140, 80)),
    ("GWB",      "ORIGIN Drywall Base", (235, 228, 214)),   # base layer, warm off-white
    ("GWB2",     "ORIGIN Drywall Face", (222, 212, 190)),   # 2nd (face) layer, slightly darker
]


def get_or_create_material(name, rgb):
    for m in FilteredElementCollector(doc).OfClass(Material):
        if m.Name == name:
            return m.Id
    mid = Material.Create(doc, name)
    try:
        m = doc.GetElement(mid)
        m.Color = Color(rgb[0], rgb[1], rgb[2])
        m.Transparency = 0
    except:
        pass
    return mid


def get_or_create_subcategory(parent_cat, name, material_id, rgb):
    try:
        for sc in parent_cat.SubCategories:
            if sc.Name == name:
                return sc
    except:
        pass
    sc = doc.Settings.Categories.NewSubcategory(parent_cat, name)
    try:
        sc.LineColor = Color(rgb[0], rgb[1], rgb[2])
    except:
        pass
    try:
        if material_id and material_id != ElementId.InvalidElementId:
            sc.Material = doc.GetElement(material_id)
    except:
        pass
    return sc


def setup_styles(warnings):
    """Create/find a colored Generic Model subcategory + material per kind. Returns
    {kind: (material_id, graphics_style_id)}. Best-effort; on failure elements are uncolored."""
    styles = {}
    try:
        gm = doc.Settings.Categories.get_Item(BuiltInCategory.OST_GenericModel)
    except Exception as ex:
        warnings.append("Could not access Generic Model category for coloring: {}".format(ex))
        return styles

    created = []
    for kind, name, rgb in STYLE_SPECS:
        try:
            mat_id = get_or_create_material(name, rgb)
            get_or_create_subcategory(gm, name, mat_id, rgb)
            created.append((kind, name, mat_id))
        except Exception as ex:
            warnings.append("Coloring for {} failed: {}".format(kind, ex))

    try:
        doc.Regenerate()
    except:
        pass

    subs_by_name = {}
    try:
        gm = doc.Settings.Categories.get_Item(BuiltInCategory.OST_GenericModel)
        for sc in gm.SubCategories:
            subs_by_name[sc.Name] = sc
    except:
        pass

    for kind, name, mat_id in created:
        gsid = ElementId.InvalidElementId
        sub = subs_by_name.get(name)
        if sub is not None:
            try:
                gs = sub.GetGraphicsStyle(GraphicsStyleType.Projection)
                if gs:
                    gsid = gs.Id
            except:
                pass
        styles[kind] = (mat_id, gsid)
    return styles


# ------------------------------------------------------------
# Cleanup  (VERBATIM; scoped to the walls being processed)
# ------------------------------------------------------------

def delete_previous(processed_ids, warnings):
    ids = List[ElementId]()
    wall_tokens = ["WALL=" + w + " " for w in processed_ids]

    try:
        for e in FilteredElementCollector(doc).OfClass(DirectShape):
            comment = None
            try:
                p = e.get_Parameter(BuiltInParameter.ALL_MODEL_INSTANCE_COMMENTS)
                comment = p.AsString() if p else None
            except:
                comment = None

            is_ours = False
            try:
                if e.ApplicationId == APP_ID:
                    is_ours = True
            except:
                pass
            if not is_ours and comment and APP_ID in comment:
                is_ours = True
            if not is_ours:
                continue

            if comment and any(tok in comment for tok in wall_tokens):
                ids.Add(e.Id)
    except Exception as ex:
        warnings.append("Cleanup (DirectShape) failed: {}".format(ex))

    try:
        col = FilteredElementCollector(doc).OfCategory(
            BuiltInCategory.OST_GenericModel).WhereElementIsNotElementType()
        for e in col:
            try:
                pg = e.LookupParameter("Generated_By")
                if not (pg and pg.AsString() == APP_ID):
                    continue
                pw = e.LookupParameter("Wall_ID")
                wid = pw.AsString() if pw else None
                if wid and wid in processed_ids:
                    ids.Add(e.Id)
            except:
                pass
    except Exception as ex:
        warnings.append("Cleanup (family) failed: {}".format(ex))

    count = ids.Count
    if count > 0:
        doc.Delete(ids)
    return count


# ------------------------------------------------------------
# Framing geometry helpers  (Phase 1, VERBATIM from v4)
# ------------------------------------------------------------

def stud_lines(wall_length, opening_rects):
    xs = []
    x = 0.0
    while x <= wall_length + 0.001:
        xs.append(x)
        x += STUD_SPACING_FT
    if not xs:
        xs.append(0.0)
    if abs(xs[-1] - wall_length) > 0.1:
        xs.append(wall_length)
    for (ox0, oy0, ox1, oy1) in opening_rects:
        xs.append(clamp(ox0, 0.0, wall_length))
        xs.append(clamp(ox1, 0.0, wall_length))
    return unique_sorted([clamp(v, 0.0, wall_length) for v in xs])


def stud_segments(sx, wall_height, opening_rects):
    blocks = []
    for (ox0, oy0, ox1, oy1) in opening_rects:
        if ox0 + 0.01 < sx < ox1 - 0.01:
            b0 = max(0.0, oy0)
            b1 = min(wall_height, oy1)
            if b1 > b0:
                blocks.append((b0, b1))
    if not blocks:
        return [(0.0, wall_height)]
    blocks.sort()
    segments = []
    cur = 0.0
    for (b0, b1) in blocks:
        if b0 > cur:
            segments.append((cur, b0))
        cur = max(cur, b1)
    if cur < wall_height:
        segments.append((cur, wall_height))
    return segments


def is_jamb_line(sx, opening_rects, tol=0.02):
    for (ox0, oy0, ox1, oy1) in opening_rects:
        if abs(sx - ox0) <= tol or abs(sx - ox1) <= tol:
            return True
    return False


def is_interior_line(sx, opening_rects):
    for (ox0, oy0, ox1, oy1) in opening_rects:
        if ox0 + 0.01 < sx < ox1 - 0.01:
            return True
    return False


def subtract_intervals(full_lo, full_hi, cuts):
    segments = [(full_lo, full_hi)]
    for (clo, chi) in cuts:
        new_segs = []
        for (lo, hi) in segments:
            if chi <= lo or clo >= hi:
                new_segs.append((lo, hi))
                continue
            if clo > lo:
                new_segs.append((lo, clo))
            if chi < hi:
                new_segs.append((chi, hi))
        segments = new_segs
    return segments


def ds_comment(wall_id, face_name, kind, eid):
    return "{} | WALL={} | {} | {} | {}".format(APP_ID, wall_id, face_name, kind, eid)


# {kind: (material_id, graphics_style_id)}; populated in the transaction.
styles = {}


def emit_member(origin, ax, ay, extrude_dir, depth, profile, kind, member_id, wall_id, warnings):
    if depth < MIN_SEG_FT:
        return 0
    mat_id, gs_id = styles.get(kind, (None, None))
    solid = make_profile_solid(origin, ax, ay, profile, extrude_dir, depth, mat_id, gs_id)
    ds = create_directshape(
        solid, member_id, "{} {}".format(kind, member_id),
        ds_comment(wall_id, "-", kind, member_id), warnings)
    return 1 if ds else 0


def emit_framing(wall_id, start, u, z, orientation, stud_inner_off, track_inner_off,
                 c_profile, u_profile, wall_length, wall_height, opening_rects, warnings):
    """stud_inner_off / track_inner_off are signed offsets from the wall Location Line along the
    exterior normal to the interior face of the stud / track. c_profile / u_profile already carry
    the correct through-wall depth for this wall."""
    counts = {"studs": 0, "cripples": 0, "kings": 0, "jacks": 0,
              "tracks": 0, "headers": 0, "sills": 0}

    down = XYZ(0, 0, -1)
    depth_off = orientation.Multiply(stud_inner_off)
    track_off = orientation.Multiply(track_inner_off)

    xs = stud_lines(wall_length, opening_rects)
    for si, sx in enumerate(xs):
        jamb = is_jamb_line(sx, opening_rects)
        interior = is_interior_line(sx, opening_rects)
        seg_i = 0
        for (sy0, sy1) in stud_segments(sx, wall_height, opening_rects):
            if (sy1 - sy0) < MIN_SEG_FT:
                continue
            seg_i += 1
            if jamb:
                kind, key = "KINGSTUD", "kings"
            elif interior:
                kind, key = "CRIPPLE", "cripples"
            else:
                kind, key = "STUD", "studs"
            member_id = "{}-{}-{:03d}-{}".format(wall_id, kind, si + 1, seg_i)
            origin = start.Add(u.Multiply(sx - FLANGE_FT / 2.0)).Add(depth_off).Add(z.Multiply(sy0))
            counts[key] += emit_member(origin, orientation, u, z, sy1 - sy0,
                                       c_profile, kind, member_id, wall_id, warnings)

    door_cuts = [(ox0, ox1) for (ox0, oy0, ox1, oy1) in opening_rects if oy0 <= 0.05]
    ti = 0
    for (x0, x1) in subtract_intervals(0.0, wall_length, door_cuts):
        if (x1 - x0) < MIN_SEG_FT:
            continue
        ti += 1
        member_id = "{}-BTRK-{}".format(wall_id, ti)
        origin = start.Add(u.Multiply(x0)).Add(track_off).Add(z.Multiply(0.0))
        counts["tracks"] += emit_member(origin, orientation, z, u, x1 - x0,
                                        u_profile, "TRACK", member_id, wall_id, warnings)

    ceil_cuts = [(ox0, ox1) for (ox0, oy0, ox1, oy1) in opening_rects if oy1 >= wall_height - 0.05]
    ti = 0
    for (x0, x1) in subtract_intervals(0.0, wall_length, ceil_cuts):
        if (x1 - x0) < MIN_SEG_FT:
            continue
        ti += 1
        member_id = "{}-TTRK-{}".format(wall_id, ti)
        origin = start.Add(u.Multiply(x0)).Add(track_off).Add(z.Multiply(wall_height))
        counts["tracks"] += emit_member(origin, orientation, down, u, x1 - x0,
                                        u_profile, "TRACK", member_id, wall_id, warnings)

    oi = 0
    for (ox0, oy0, ox1, oy1) in opening_rects:
        oi += 1
        span = ox1 - ox0
        is_window = oy0 > 0.05

        if span >= MIN_SEG_FT:
            member_id = "{}-HDR-{}".format(wall_id, oi)
            origin = start.Add(u.Multiply(ox0)).Add(depth_off).Add(z.Multiply(oy1))
            counts["headers"] += emit_member(origin, orientation, z, u, span,
                                             c_profile, "HEADER", member_id, wall_id, warnings)

        if is_window and span >= MIN_SEG_FT:
            member_id = "{}-SILL-{}".format(wall_id, oi)
            origin = start.Add(u.Multiply(ox0)).Add(depth_off).Add(z.Multiply(oy0 - FLANGE_FT))
            counts["sills"] += emit_member(origin, orientation, z, u, span,
                                           c_profile, "SILL", member_id, wall_id, warnings)

        jack_bottom = oy0 if is_window else 0.0
        jack_h = oy1 - jack_bottom
        if jack_h >= MIN_SEG_FT:
            jx_positions = [clamp(ox0 + FLANGE_FT, 0.0, wall_length),
                            clamp(ox1 - FLANGE_FT, 0.0, wall_length)]
            for jn, jx in enumerate(jx_positions):
                member_id = "{}-JACK-{}-{}".format(wall_id, oi, jn + 1)
                origin = start.Add(u.Multiply(jx - FLANGE_FT / 2.0)).Add(depth_off).Add(
                    z.Multiply(jack_bottom))
                counts["jacks"] += emit_member(origin, orientation, u, z, jack_h,
                                               c_profile, "JACK", member_id, wall_id, warnings)

    return counts


# ------------------------------------------------------------
# Drywall layout  (Phase 2, NEW)
# ------------------------------------------------------------

def normalize_shift(shift):
    try:
        s = float(shift)
    except:
        s = 0.0
    while s < 0.0:
        s += PANEL_LENGTH_FT
    while s >= PANEL_LENGTH_FT:
        s -= PANEL_LENGTH_FT
    return s


def generate_courses(wall_height, v_start):
    """Horizontal course bands covering [0, wall_height]. Boundaries at v_start + k*PANEL_HEIGHT
    (v_start staggers courses between stacked layers). Returns [(cy0, cy1, row), ...]."""
    rows = []
    y = v_start
    while y > 0.0:
        y -= PANEL_HEIGHT_FT
    row = 0
    cy = y
    while cy < wall_height - 1e-4:
        cy0 = max(0.0, cy)
        cy1 = min(wall_height, cy + PANEL_HEIGHT_FT)
        if (cy1 - cy0) >= MIN_PIECE_HEIGHT_FT:
            rows.append((cy0, cy1, row))
        cy += PANEL_HEIGHT_FT
        row += 1
    return rows


def row_joint_xs(row_shift, wall_length):
    """Interior vertical butt-joint x-positions for a course laid with the given left shift."""
    xs = []
    x = -row_shift + PANEL_LENGTH_FT
    while x < wall_length - 1e-4:
        if x > 1e-4:
            xs.append(x)
        x += PANEL_LENGTH_FT
    return xs


def joints_conflict(xs, opening_rects, clear):
    for xj in xs:
        for (ox0, oy0, ox1, oy1) in opening_rects:
            if abs(xj - ox0) < clear or abs(xj - ox1) < clear:
                return True
    return False


def adjust_row_shift(row_shift, wall_length, opening_rects):
    """Nudge a course's left shift so no butt joint lands within JOINT_CLEAR_FT of an opening
    jamb (the 'joints toward mid-opening, never at corners' rule). Heuristic; if no nudge clears
    every jamb it returns the original shift."""
    if not AVOID_JOINTS_AT_JAMBS or not opening_rects:
        return row_shift, False
    if not joints_conflict(row_joint_xs(row_shift, wall_length), opening_rects, JOINT_CLEAR_FT):
        return row_shift, False
    for d in (JOINT_CLEAR_FT * 1.5, -JOINT_CLEAR_FT * 1.5, JOINT_CLEAR_FT * 3.0,
              -JOINT_CLEAR_FT * 3.0, PANEL_LENGTH_FT * 0.25, PANEL_LENGTH_FT * 0.5):
        cand = normalize_shift(row_shift + d)
        if not joints_conflict(row_joint_xs(cand, wall_length), opening_rects, JOINT_CLEAR_FT):
            return cand, True
    return row_shift, False


def layer_stack(rated):
    """Return [(thickness_ft, type_x_bool), ...] from bottom (against studs) outward."""
    if rated:
        return [(DRYWALL_THICKNESS_RATED_FT, True)] * DRYWALL_LAYERS_RATED
    return [(DRYWALL_THICKNESS_STD_FT, False)] * DRYWALL_LAYERS_STD


def board_comment(wall_id, face_name, board_id, li, t_ft, type_x, is_cut, tapered, waste_sf):
    return ("{} | WALL={} | {} | DRYWALL | {} | L{} | t={}in | typeX={} | cut={} | "
            "taper={} | waste={}sf").format(
        APP_ID, wall_id, face_name, board_id, li, round(t_ft * 12.0, 3),
        int(bool(type_x)), int(bool(is_cut)), int(bool(tapered)), round(waste_sf, 2))


def emit_board(layer_origin, u, z, normal, shape, thickness, kind, board_id, comment, warnings):
    """Build one drywall board (rect / poly / hole) as a colored DirectShape. Returns 1/0."""
    mat_id, gs_id = styles.get(kind, (None, None))
    kind_tag, a, b = (shape[0], shape[1], shape[2] if len(shape) > 2 else None)

    if kind_tag == "rect":
        solid = make_rect_solid(layer_origin, u, z, normal, a, thickness, mat_id, gs_id)
    elif kind_tag == "poly":
        solid = make_planar_poly_solid(layer_origin, u, z, normal, a, thickness, mat_id, gs_id)
    elif kind_tag == "hole":
        solid = make_hole_solid(layer_origin, u, z, normal, a, b, thickness, mat_id, gs_id)
    elif kind_tag == "multicut":
        solid = make_multicut_solid(layer_origin, u, z, normal, a, b, thickness, mat_id, gs_id)
    else:
        return 0

    ds = create_directshape(solid, board_id, "Drywall " + board_id, comment, warnings)
    return 1 if ds else 0


def emit_drywall(wall_id, start, u, z, true_orientation, d_loc, width, wall_length, wall_height,
                 opening_rects, rated, install_ref, records, warnings):
    """Generate layered, staggered drywall on both faces. Openings are cut as single connected
    pieces. Returns a counts dict. install_ref is a 1-element list used as a mutable counter."""
    counts = {"boards": 0, "cut_boards": 0, "hole_boards": 0, "multi_boolean": 0,
              "nudged_rows": 0, "layers": 0}

    layers = layer_stack(rated)
    full_sheet_area = PANEL_LENGTH_FT * PANEL_HEIGHT_FT

    for face_config in FACE_LAYOUTS:
        if not face_config.get("enabled", True):
            continue
        face_name = face_config["face_name"]
        normal, face_offset = face_normal_and_offset(true_orientation, d_loc, width,
                                                      face_config["side"])
        origin_face = start.Add(normal.Multiply(face_offset))

        cum_before = 0.0     # thickness of layers already placed (closer to the finish face)
        for li, (t, type_x) in enumerate(layers):
            counts["layers"] += 1
            # Layer occupies [face - (cum_before + t), face - cum_before] along the outward
            # normal (i.e. stacked inward toward the studs). Extrude +normal by t from the inner
            # start so the outermost layer's face is flush with the wall finish face.
            layer_origin = origin_face.Add(normal.Multiply(-(cum_before + t)))
            kind = "GWB" if li == 0 else "GWB2"

            base_shift = face_config.get("base_edge_shift_ft", 0.0) + li * LAYER_H_STAGGER_FT
            odd_shift = face_config.get("odd_row_additional_shift_ft", 4.0)
            v_start = li * LAYER_V_STAGGER_FT

            for (cy0, cy1, row) in generate_courses(wall_height, v_start):
                row_shift = normalize_shift(base_shift + (odd_shift if row % 2 == 1 else 0.0))
                row_shift, nudged = adjust_row_shift(row_shift, wall_length, opening_rects)
                if nudged:
                    counts["nudged_rows"] += 1

                x = -row_shift
                col = 0
                while x < wall_length - 1e-4:
                    raw_x0 = max(0.0, x)
                    raw_x1 = min(wall_length, x + PANEL_LENGTH_FT)
                    # Apply the code gap by insetting the sheet on all sides.
                    g = CODE_GAP_FT / 2.0
                    sx0 = raw_x0 + g
                    sx1 = raw_x1 - g
                    sy0 = cy0 + g
                    sy1 = cy1 - g
                    x += PANEL_LENGTH_FT
                    col += 1
                    if (sx1 - sx0) < MIN_PIECE_WIDTH_FT or (sy1 - sy0) < MIN_PIECE_HEIGHT_FT:
                        continue

                    sheet = (sx0, sy0, sx1, sy1)
                    # Openings expanded by the drywall opening gap before cutting.
                    expanded = [(o[0] - DRYWALL_OPENING_GAP_FT, o[1] - DRYWALL_OPENING_GAP_FT,
                                 o[2] + DRYWALL_OPENING_GAP_FT, o[3] + DRYWALL_OPENING_GAP_FT)
                                for o in opening_rects]
                    shapes, multi = cut_sheet(sheet, expanded)
                    if multi:
                        counts["multi_boolean"] += 1

                    # Waste for this sheet = full sheet area minus the total area actually placed.
                    placed_area = 0.0
                    for sh in shapes:
                        if sh[0] == "rect":
                            placed_area += rect_area(sh[1])
                        elif sh[0] == "poly":
                            placed_area += poly_area(sh[1])
                        elif sh[0] == "hole":
                            placed_area += rect_area(sh[1]) - rect_area(sh[2])
                        elif sh[0] == "multicut":
                            pa = rect_area(sh[1])
                            for cr in sh[2]:
                                it = rect_intersection(sh[1], cr)
                                if it:
                                    pa -= rect_area(it)
                            placed_area += max(0.0, pa)
                    sheet_waste = max(0.0, full_sheet_area - placed_area)

                    piece_i = 0
                    for sh in shapes:
                        piece_i += 1
                        is_cut = not (sh[0] == "rect"
                                      and abs((sh[1][2] - sh[1][0]) - (PANEL_LENGTH_FT - CODE_GAP_FT)) < 0.02
                                      and abs((sh[1][3] - sh[1][1]) - (PANEL_HEIGHT_FT - CODE_GAP_FT)) < 0.02)
                        install_ref[0] += 1
                        board_id = "{}-{}-L{}-R{}-C{}-P{}".format(
                            face_name, wall_id, li, row + 1, col, piece_i)
                        waste = sheet_waste if piece_i == 1 else 0.0
                        comment = board_comment(wall_id, face_name, board_id, li, t, type_x,
                                                is_cut, TAPERED_LONG_EDGES, waste)
                        made = emit_board(layer_origin, u, z, normal, sh, t, kind,
                                          board_id, comment, warnings)
                        counts["boards"] += made
                        if made:
                            if sh[0] == "hole":
                                counts["hole_boards"] += 1
                            elif is_cut:
                                counts["cut_boards"] += 1
                            records.append({
                                "board_id": board_id, "wall_id": wall_id, "face": face_name,
                                "layer": li, "type_x": bool(type_x), "thickness_in": round(t * 12.0, 3),
                                "is_cut": bool(is_cut), "tapered": bool(TAPERED_LONG_EDGES),
                                "shape": sh[0], "install_order": install_ref[0],
                                "waste_sf": round(waste, 2),
                            })

            cum_before += t

    return counts


# ============================================================
# MAIN
# ============================================================

result = {
    "app_id": APP_ID,
    "output_mode": "directshape",
    "phase": "1_framing+2_drywall",
    "generate_framing": GENERATE_FRAMING,
    "generate_drywall": GENERATE_DRYWALL,
    "deleted_previous": 0,
    "walls_requested": 0,
    "walls_processed": 0,
    "walls_skipped": [],
    "rated_walls": 0,
    "framing_stud_depth_in": 0.0,      # derived stud web depth (last wall processed)
    "wall_diagnostics": [],            # per-wall thickness accounting (see notes if mismatch)
    # framing
    "studs_created": 0,
    "cripples_created": 0,
    "kings_created": 0,
    "jacks_created": 0,
    "tracks_created": 0,
    "headers_created": 0,
    "sills_created": 0,
    # drywall
    "boards_created": 0,
    "cut_boards": 0,
    "hole_boards": 0,
    "drywall_layers": 0,
    "multi_opening_boolean_sheets": 0,
    "jamb_nudged_courses": 0,
    "board_records": 0,
    "warnings": [],
    "notes": []
}
warnings = result["warnings"]

do_delete = as_bool(get_in(5), DELETE_PREVIOUS_ORIGIN_ASSEMBLY)
do_drywall = as_bool(get_in(6), GENERATE_DRYWALL)
force_rated_in = get_in(7)

walls = get_input_walls(warnings)
result["walls_requested"] = len(walls)

board_records = []

if len(walls) == 0:
    OUT = "No walls found. Select one or more straight walls in Revit, then run Dynamo again."
else:
    TransactionManager.Instance.EnsureInTransaction(doc)
    try:
        processed_ids = set("W" + str(eid_value(w.Id)) for w in walls)
        if do_delete:
            result["deleted_previous"] = delete_previous(processed_ids, warnings)

        if COLOR_BY_TYPE:
            styles = setup_styles(warnings)     # reassigns the module global read by emitters

        z = XYZ.BasisZ

        for wall in walls:
            wall_id = "W" + str(eid_value(wall.Id))
            try:
                curve_data = get_wall_curve_data(wall)
                if not curve_data:
                    result["walls_skipped"].append(wall_id + ": not a straight wall")
                    continue

                start, end, u, wall_length = curve_data
                orientation = safe_normalize(wall.Orientation)
                if orientation is None:
                    result["walls_skipped"].append(wall_id + ": cannot read Orientation")
                    continue

                wall_height = get_wall_height(wall)
                width = get_wall_width(wall)

                d_loc, core_center = wall_ref_geometry(wall, width, warnings)

                opening_rects = get_opening_rects(wall, start, u, wall_length, wall_height, warnings)

                if force_rated_in is not None:
                    rated = as_bool(force_rated_in, False)
                elif FORCE_FIRE_RATED is not None:
                    rated = bool(FORCE_FIRE_RATED)
                else:
                    rated = wall_is_fire_rated(wall, warnings)
                if rated:
                    result["rated_walls"] += 1

                # The whole assembly is CENTERED on the existing wall (symmetric, no offset to
                # either side): drywall sits flush inside each finish face, and the stud is
                # centered on the wall's center plane. Stud web depth = wall thickness - drywall on
                # both faces, so the stud butts the back of the drywall and framing + drywall
                # exactly fills the wall. Both framing and drywall reference this one center plane.
                half_w = width / 2.0
                wall_center_off = d_loc - half_w            # Location Line -> wall center, along +normal
                dw_per_face = sum(t for (t, _tx) in layer_stack(rated))
                if DERIVE_STUD_DEPTH_FROM_WALL:
                    stud_depth = width - 2.0 * dw_per_face
                    if stud_depth < MIN_STUD_DEPTH_FT:
                        warnings.append(
                            "Wall {}: derived stud depth {:.2f}in below minimum; clamped to "
                            "{:.2f}in (wall {:.2f}in, drywall {:.2f}in/side). Assembly will exceed "
                            "the wall - model the wall thicker or force non-rated.".format(
                                wall_id, stud_depth * 12.0, MIN_STUD_DEPTH_FT * 12.0,
                                width * 12.0, dw_per_face * 12.0))
                        stud_depth = MIN_STUD_DEPTH_FT
                else:
                    stud_depth = STUD_DEPTH_FT
                stud_inner_off = wall_center_off - stud_depth / 2.0   # stud centered on the wall
                track_inner_off = stud_inner_off - MAT_T_FT           # track wraps the stud
                c_profile, u_profile, track_depth = build_profiles(stud_depth)
                result["framing_stud_depth_in"] = round(stud_depth * 12.0, 3)

                # Per-wall thickness accounting so any mismatch is visible in the Watch output.
                ref_code = -1
                try:
                    _rp = wall.get_Parameter(BuiltInParameter.WALL_KEY_REF_PARAM)
                    if _rp:
                        ref_code = _rp.AsInteger()
                except:
                    pass
                assembly_total = 2.0 * dw_per_face + stud_depth
                result["wall_diagnostics"].append({
                    "wall_id": wall_id,
                    "wall_width_in": round(width * 12.0, 3),
                    # location_line_ref: 0=Centerline 1=CoreCenter 2=FinishExt 3=FinishInt 4=CoreExt 5=CoreInt
                    "location_line_ref": ref_code,
                    "wall_center_off_from_location_in": round(wall_center_off * 12.0, 3),
                    "rated": bool(rated),
                    "drywall_per_face_in": round(dw_per_face * 12.0, 3),
                    "stud_depth_in": round(stud_depth * 12.0, 3),
                    "assembly_total_in": round(assembly_total * 12.0, 3),
                    "assembly_equals_wall": abs(assembly_total - width) < 1e-4,
                })

                if GENERATE_FRAMING:
                    fc = emit_framing(wall_id, start, u, z, orientation, stud_inner_off,
                                      track_inner_off, c_profile, u_profile,
                                      wall_length, wall_height, opening_rects, warnings)
                    result["studs_created"] += fc["studs"]
                    result["cripples_created"] += fc["cripples"]
                    result["kings_created"] += fc["kings"]
                    result["jacks_created"] += fc["jacks"]
                    result["tracks_created"] += fc["tracks"]
                    result["headers_created"] += fc["headers"]
                    result["sills_created"] += fc["sills"]

                if do_drywall:
                    install_ref = [0]
                    dc = emit_drywall(wall_id, start, u, z, orientation, d_loc, width,
                                      wall_length, wall_height, opening_rects, rated,
                                      install_ref, board_records, warnings)
                    result["boards_created"] += dc["boards"]
                    result["cut_boards"] += dc["cut_boards"]
                    result["hole_boards"] += dc["hole_boards"]
                    result["drywall_layers"] += dc["layers"]
                    result["multi_opening_boolean_sheets"] += dc["multi_boolean"]
                    result["jamb_nudged_courses"] += dc["nudged_rows"]

                result["walls_processed"] += 1

            except Exception as wall_ex:
                result["walls_skipped"].append(wall_id + ": error - " + str(wall_ex))
                warnings.append("Wall {} failed mid-processing: {}".format(wall_id, wall_ex))
                continue

    except Exception as ex:
        result["notes"].append("FATAL: " + str(ex))
    finally:
        TransactionManager.Instance.TransactionTaskDone()

    result["board_records"] = len(board_records)
    if result["multi_opening_boolean_sheets"] > 0:
        result["notes"].append(
            "{} sheet(s) overlapped >1 opening and were cut with a boolean difference "
            "(single connected board, no joints at opening corners).".format(
                result["multi_opening_boolean_sheets"]))
    OUT = result
# ----------------------------------------
watch = Watch(python_script)
wall_types_3 = WallTypes("Interior - 4 3/4\" Partition (1-hr)")
